vi "Close Generic Object Refnum (Array VI).gvi"   [LabVIEW Platform Developer Preview 0.1.0]
inputs:
  "Gen Refnum Array": VIRefnum[], required
  "wait on unloaded? (FALSE)": bool
  "timeout in ms (-1)": i32 = -1
  "error in (no error)": error
outputs:
  "timed out?": bool
  "error out": error
diagram:
  s1 = no error  # shift register
  for {
    w1 = each element of $"Gen Refnum Array"
    Property Node[IsPlaceholderNodeForConversion=True](instance in=w1, error in=s1) -> ("Name"=w3, error out=w4, instance out=w5)
    Close Reference(reference=w5)
    append w3 to w2
    next s1 = w4
  }
  Property Node(instance in=$"error in (no error)") -> ("status"=w6)
  Logical And(not w6, $"wait on unloaded? (FALSE)") -> w7
  case (w7) {
    frame False, Default {
      w8 = FALSE
      w9 = s1
    }
    frame True {
      Tick Count() -> (timer value=w10)
      s2 = s1  # shift register
      while {
        Wait(time to wait=10) -> (timer value=w11)
        Subtract(x=w11, y=w10) -> w12
        Is Greater Or Equal(x=w12, y=$"timeout in ms (-1)") -> w13
        Is Less Than 0(x=$"timeout in ms (-1)") -> w14
        Logical And(w13, not w14) -> w8
        Property Node[IsPlaceholderNodeForConversion=True](error in=s2) -> ("App.AllVIs"=w15, error out=w16)
        for {
          w17 = each element of w2
          Search 1D Array(1D array=w15, element=w17) -> (index of element=w19)
          Is Less Than 0(x=w19) -> w20
          append w20 to w18
        }
        And Array Elements(Boolean array=w18) -> (logical AND=w21)
        Property Node(instance in=w16) -> ("status"=w22)
        Logical Or(w22, w21, w8) -> w23
        next s2 = w16
        stop if w23
      }
      w9 = s2
    }
  }
  Merge Errors($"error in (no error)", w9) -> (error out=w24)
  $"error out" <- w24
  $"timed out?" <- w8
