vi "Close Generic Object Refnum (Scalar VI).gvi"   [LabVIEW Platform Developer Preview 0.1.0]
inputs:
  "VI Refnum": VIRefnum, required
  "wait on unloaded? (FALSE)": bool
  "timeout in ms (-1)": i32 = -1
  "error in (no error)": error
outputs:
  "timed out?": bool
  "error out": error
uses:
  OpenG.Application Control::Close Generic Object Refnum (Array VI).gvi
diagram:
  Build Array($"VI Refnum") -> w1
  call "Close Generic Object Refnum (Array VI).gvi"(Gen Refnum Array=w1, wait on unloaded? (FALSE)=$"wait on unloaded? (FALSE)", timeout in ms (-1)=$"timeout in ms (-1)", error in (no error)=$"error in (no error)") -> (timed out?=w2, error out=w3)
  $"timed out?" <- w2
  $"error out" <- w3
