vi "Current VIs Namespace.gvi"   [LabVIEW Platform Developer Preview 0.1.0]
# Gets a the namespace of the VI this function.
outputs:
  "Namespace": string
uses:
  OpenG.Application Control::UnMangle VI Name (String).gvi
diagram:
  Call Chain() -> (callchain=w1)
  Array Index(array=w1) -> (out0[1]=w2)
  call "UnMangle VI Name (String).gvi"(Mangled Name=w2) -> (Namespace=w3)
  $Namespace <- w3
