vi "Current VIs Reference.gvi"   [LabVIEW Platform Developer Preview 0.1.0]
# Gets a reference to the VI calling this function.  This is useful for creating reusable VIs that needs a new reference to itself.
outputs:
  "Current VI's reference": VIRefnum
diagram:
  Open VI Reference() -> (vi reference=w1)
  $"Current VI's reference" <- w1
  Call Chain() -> (callchain=w2)
  Array Index(array=w2)
