vi "Find VI with Focus.gvi"   [LabVIEW Platform Developer Preview 0.1.0]
# Returns a reference to the frontmost VI panel.
# This VI is reentrant (as indicated by the crosshatched background) so that references in use by one caller aren't closed by another. This also allows different callers to exclude different panels from consideration and to get a proper indication of whether a changed has occurred since their own last last call.
# This is an enhancement of Jim Kring's Find Frontmost VI that returns a reference as well as a name, signals if this has changed since the last call, allows exclusion of VIs in the calling sequence of this VI or other VIs of the user's choice (useful for editing utilities that stay on top of all other windows), cleans up unused references, and runs, on average, 50 or more times faster.
# Generates no errors.
# Copyright © 2003 by Paul F. Sullivan.  All rights reserved.  You are only permitted the usage indicated in your license agreement.
inputs:
  "Exclude Names": string[]  # Additional utility VIs whose selection should not be considered a change of focus.
  "Exclude Levels": i32 = -1  # Allows a utility to follow the focus of the programmer by remembering the previously frontmost VI panel even when the programmer is manipulating the front panel of the utility. Useful values are: -1: Exclude all VIs in this VI's call chain. 0: Don't exclude anything. 1: Exclude only this VI. 2: Exclude this VI and it's immediate caller.
  "Exclude Callers": bool = TRUE  # Even callers of this VI that are not in the current call chain do not disturb the focus. Overridden if Exclude Levels is 0 (none).
  "error in": error
outputs:
  "Valid?": bool  # It may be that no acceptable VI has received focus since the original query or that the old reference to the VI with focus has been closed.
  "VI with Focus": VIRefnum
  "Changed?": bool  # True if the VI with focus has changed or its reference has been closed since the last call.
  "error out": error
  "VI Name": string
panel controls:
  "State Data": T1 = {"State"="Recent?"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}
panel indicators:
  "State Data 2": T1
types:
  "Find Focus State.gtype" = enum{"Initialize", "Recent?", "Accepted?", "Excluded?", "VI Panel?", "Valid?", "Done"}
  T1 = cluster{"State": "Find Focus State.gtype", "Recent VI": VIRefnum, "Recent Number": u32, "Recent VI Name": string, "VI with Focus": VIRefnum, "Focus Number": u32, "Focus VI Name": string, "Valid?": bool, "Changed?": bool}
uses:
  OpenG.Application Control::Is One Frontmost.gvi
diagram:
  Property Node[IsPlaceholderNodeForConversion=True]() -> ("Front Panel.IsFrontmost"=w1, "Callees"=w2, "Callers"=w3, "Name"=w4, instance out=w5)
  Is Not Equal To 0(x=$"Exclude Levels") -> w6
  case ($"error in") {
    frame No Error {
      s1 = uninitialised  # shift register
      while {
        Property Node(instance in=s1) -> ("State"=w7)
        case (w7) {
          frame "Initialize", Default {
            w8 = $"State Data"
          }
          frame "Recent?" {
            # Panel usually doesn't change, so try the most recent panel first.
            Property Node(instance in=s1) -> ("Recent VI"=w9)
            Property Node[IsPlaceholderNodeForConversion=True](instance in=w9) -> ("Front Panel.IsFrontmost"=w10)  # Reference properties
            Select(s=w10, t="Valid?", f="Accepted?") -> w11
            Property Node(instance in=s1, "State"=w11) -> (instance out=w8)
          }
          frame "Accepted?" {
            # Focus usually doesn't change, so try that next.
            Property Node(instance in=s1) -> ("VI with Focus"=w12)
            Property Node[IsPlaceholderNodeForConversion=True](instance in=w12) -> ("Front Panel.IsFrontmost"=w13)  # Reference properties
            Select(s=w6, t="Excluded?", f="VI Panel?") -> w14
            Select(s=w13, t="Done", f=w14) -> w15
            Property Node(instance in=s1, "State"=w15) -> (instance out=w8)
          }
          frame "Excluded?" {
            # Next most likely is one of the excluded panels.
            case (w1) {  # Is THIS VI frontmost?
              frame False, Default {
                Call Chain() -> (callchain=w19)
                Is Less Than 0(x=$"Exclude Levels") -> w20
                # What about other special VIs?
                case (w20) {  # Whole call chain?
                  frame False, Default {
                    Decrement(x=$"Exclude Levels") -> w22
                    Array Subset(array=w19, index0=1, length0=w22) -> w21
                  }
                  frame True {
                    w21 = w19
                  }
                }
                Delete From Array(inArray=w21, index0=0) -> (outArray=w23, deleted=w24)
                Build Array(w24) -> w25
                Select(s=$"Exclude Callers", t=w3, f=w25) -> w26
                Build Array[ConcatenateInputs=True](w2, w26, w23, $"Exclude Names") -> w27
                call "Is One Frontmost.gvi"(VI names=w27) -> (VI name=w18, yes=w16, VI Refnum=w17)
              }
              frame True {
                w16 = w1
                w17 = w5
                w18 = w4
              }
            }
            Property Node(instance in=s1) -> ("Recent VI"=w28, "VI with Focus"=w29)
            Is Equal(x=w28, y=w29) -> w30
            case (w16) {
              frame True {
                w31 = u32 0  # U32
                Type Cast(type=w31, x=w17) -> w32
                Property Node(instance in=s1, "State"="Valid?", "Recent VI Name"=w18, "Recent VI"=w17, "Recent Number"=w32) -> (instance out=w8)
                case (w30) {  # Has focus?
                  frame False, Default {
                    Close Reference(reference=w28)
                  }
                  frame True { }
                }
              }
              frame False {
                Property Node(instance in=s1, "State"="VI Panel?") -> (instance out=w8)
              }
            }
          }
          frame "VI Panel?" {
            Property Node(instance in=s1) -> ("VI with Focus"=w33, "Recent VI"=w34)
            Property Node[IsPlaceholderNodeForConversion=True]() -> ("App.AllVIs"=w35, "App.AllSysVIs"=w36)
            Build Array[ConcatenateInputs=True](w35, w36) -> w37
            call "Is One Frontmost.gvi"(VI names=w37) -> (VI name=w38, yes=w39, VI Refnum=w40)
            # Maybe no VI panel has focus.
            case (w39) {  # Found new one?
              frame True {
                w41 = u32 0  # U32
                Type Cast(type=w41, x=w40) -> w42
                Property Node(instance in=s1, "State"="Done", "Recent VI Name"=w38, "Focus VI Name"=w38, "Valid?"=w39, "Changed?"=w39, "VI with Focus"=w40, "Recent VI"=w40, "Recent Number"=w42, "Focus Number"=w42) -> (instance out=w8)
                Close Reference(reference=w33)
                Close Reference(reference=w34)
              }
              frame False {
                Property Node(instance in=s1, "State"="Valid?") -> (instance out=w8)
              }
            }
          }
          frame "Valid?" {
            # Is the old VI still in memory?
            Property Node(instance in=s1) -> ("Focus VI Name"=w43, "VI with Focus"=w44, "Valid?"=w45)
            Is Not A Number Or Path Or Refnum(number=w44) -> w46
            Not(x=w46) -> w47
            Is Not Equal(x=w47, y=w45) -> w48
            Select(s=w47, t=w43, f="") -> w49
            Property Node(instance in=s1, "State"="Done", "Focus VI Name"=w49, "Valid?"=w47, "Changed?"=w48) -> (instance out=w8)
          }
          frame "Done" {
            Property Node(instance in=s1) -> ("Focus VI Name"=w50, "VI with Focus"=w51, "Valid?"=w52, "Changed?"=w53)
            # Post the results and get ready for the next call.
            $"VI Name" <- w50
            Property Node(instance in=s1, "State"="Recent?") -> (instance out=w8)
            $"VI with Focus" <- w51
            $"Valid?" <- w52
            $"Changed?" <- w53
          }
        }
        $"State Data 2" <- s1
        Is Not Equal(x=w7, y="Done") -> w54
        next s1 = w8
        continue if w54
      }
    }
    frame Error { }
  }
  $"error out" <- $"error in"
