vi "Fit VI window to Content.gvi"   [LabVIEW Platform Developer Preview 0.1.0]
# This utility will fit (resize and center) a VI (defined by the "VI Ref" input) about the all of the Front Panel object.  It will add a border defined by border spacing in units of pixels.  If no VI Reference is passed in, it will operate on the calling VI.
inputs:
  "VI Ref (calling VI)": VIRefnum
  "border spacing (2 px)": i32 = 2
  "error in (no error)": error
outputs:
  "dup VI Ref": VIRefnum
  "error out": error
uses:
  OpenG.Application Control::Current VIs Parents Ref.gvi
  OpenG.Application Control::Close Generic Object Refnum (Array).gvi
diagram:
  $"dup VI Ref" <- $"VI Ref (calling VI)"
  case ($"error in (no error)") {
    frame No Error {
      Is Not A Number Or Path Or Refnum(number=$"VI Ref (calling VI)") -> w2
      # Get Parent's
      # Ref if null
      case (w2) {
        frame False, Default {
          w3 = $"VI Ref (calling VI)"
        }
        frame True {
          call "Current VIs Parents Ref.gvi"() -> (Calling VI's Reference=w3)
        }
      }
      # get panel ref
      Property Node[IsPlaceholderNodeForConversion=True](instance in=w3, error in=$"error in (no error)") -> ("Panel"=w4, error out=w5, instance out=w6)
      # get all FP obj refs
      Property Node[IsPlaceholderNodeForConversion=True](instance in=w4, error in=w5) -> ("AllObjs[]"=w7, error out=w8, instance out=w9)
      # close panel ref
      Close Reference(error in (no error)=w8, reference=w9) -> (error out=w10)
      # get # of obj's
      Array Size(array=w7) -> (size(s)=w11)
      # Destroy Parent's Ref
      # if null Ref in
      # < Opened a Parent Ref? >
      # < Opened a Parent Ref? >
      # < VI Ref >
      case (w11) {
        frame 0 {
          # do nothing if no objects
          w1 = w10
          w12 = w6
        }
        frame Default {
          s1 = w10  # shift register
          for {
            w13 = each element of w7
            # Get Decoration Areas
            Property Node[IsPlaceholderNodeForConversion=True](instance in=w13, error in=s1) -> ("Left"=w19, "Width"=w20, "Top"=w21, "Height"=w22, error out=w23, instance out=w24)
            To Word Integer(number=w19) -> w25
            To Word Integer(number=w20) -> w26
            Add(w25, w26) -> w27
            To Word Integer(number=w21) -> w28
            To Word Integer(number=w22) -> w29
            Add(w28, w29) -> w30
            append w24 to w14
            append w25 to w15
            append w27 to w16
            append w28 to w17
            append w30 to w18
            next s1 = w23
          }
          # close all  objs refs
          call "Close Generic Object Refnum (Array).gvi"(Gen Refnum Array=w14, error in (no error)=s1) -> (error out=w31)
          # get content extents
          Array Max And Min(array=w15) -> (min value=w32)
          To Word Integer(number=$"border spacing (2 px)") -> w33
          Subtract(x=w32, y=w33) -> w34
          Array Max And Min(array=w17) -> (min value=w35)
          Subtract(x=w35, y=w33) -> w36
          w37 = cluster{"Horizontal": i16, "Vertical": i16} {all zero or empty}
          # set panel origin to that of dec minus border spacing
          Property Node(instance in=w37, "Horizontal"=w34, "Vertical"=w36) -> (instance out=w38)
          Property Node[IsPlaceholderNodeForConversion=True](instance in=w6, "Front Panel.Origin"=w38, error in=w31) -> (error out=w39, instance out=w40)
          # set panel height and width
          Property Node[IsPlaceholderNodeForConversion=True](instance in=w40, error in=w39) -> ("Front Panel.PanelBounds"=w41, error out=w42, instance out=w43)
          # width = (2*border spacing) + dec width + 1
          # height = (2*border spacing) + dec height + 1
          Multiply(w33, 2) -> w44
          Array Max And Min(array=w18) -> (max value=w45)
          Subtract(x=w45, y=w35) -> w46
          Property Node(instance in=w41) -> ("Top"=w47)
          Add(w47, w46) -> w48
          Add(w48, w44) -> w49
          Array Max And Min(array=w16) -> (max value=w50)
          Subtract(x=w50, y=w32) -> w51
          Property Node(instance in=w41) -> ("Left"=w52)
          # Add 1 pixel fudge factor for asthetics
          Add(w52, w51) -> w53
          Add(w53, w44) -> w54
          Property Node(instance in=w41, "Bottom"=w49, "Right"=w54) -> (instance out=w55)
          Property Node[IsPlaceholderNodeForConversion=True](instance in=w43, "Front Panel.PanelBounds"=w55, error in=w42) -> (error out=w1, instance out=w12)
        }
      }
      case (w2) {
        frame False, Default { }
        frame True {
          Close Reference(reference=w12)
        }
      }
    }
    frame Error {
      w1 = $"error in (no error)"
    }
  }
  $"error out" <- w1
