vi "Fit VI window to Largest Dec.gvi"   [LabVIEW Platform Developer Preview 0.1.0]
# This utility will fit (resize and center) a VI (defined by the "VI Ref" input) about the largest decoration in that VI.  It will add a border defined by border spacing in units of pixels.  If there are no decorations found in the VI it is a no-op and will not produce an error.  Unfortunately, this VI can not find locked decorations (yet).
inputs:
  "VI Ref (calling VI)": VIRefnum
  "border spacing (2 px)": i32 = 2
  "error in (no error)": error
outputs:
  "dup VI Ref": VIRefnum
  "error out": error
uses:
  OpenG.Application Control::Current VIs Parents Ref.gvi
diagram:
  # Get Parent's
  # Ref if null
  Is Not A Number Or Path Or Refnum(number=$"VI Ref (calling VI)") -> w1
  case (w1) {
    frame False, Default {
      w2 = $"VI Ref (calling VI)"
    }
    frame True {
      call "Current VIs Parents Ref.gvi"() -> (Calling VI's Reference=w2)
    }
  }
  # get panel ref
  Property Node[IsPlaceholderNodeForConversion=True](instance in=w2, error in=$"error in (no error)") -> ("Panel"=w3, error out=w4, instance out=w5)
  Property Node[IsPlaceholderNodeForConversion=True](instance in=w3, error in=w4) -> ("Decos[]"=w6, error out=w7, instance out=w8)
  # close panel ref
  Close Reference(error in (no error)=w7, reference=w8) -> (error out=w9)
  # get all dec refs
  # get # of dec's
  Array Size(array=w6) -> (size(s)=w10)
  # Destroy Parent's Ref
  # if null Ref in
  # < VI Ref >
  case (w10) {
    frame 0 {
      # do nothing if no decorations
      w11 = w9
      w12 = w5
    }
    frame Default {
      s1 = w9  # shift register
      for {
        w13 = each element of w6
        # Get Decoration Areas
        Property Node[IsPlaceholderNodeForConversion=True](instance in=w13, error in=s1) -> ("Width"=w16, "Height"=w17, error out=w18, instance out=w19)
        Multiply(w16, w17) -> w20
        append w20 to w14
        append w19 to w15
        next s1 = w18
      }
      Array Max And Min(array=w14) -> (max index(es)=w21)
      # find dec with max area (largest dec)
      Array Index(array=w15) -> (out0[w21]=w22)
      # get coord's of largest decoration
      Property Node[IsPlaceholderNodeForConversion=True](instance in=w22, error in=s1) -> ("Left"=w23, "Top"=w24, "Width"=w25, "Height"=w26, error out=w27)
      # close all  decoration refs
      s2 = w27  # shift register
      for {
        w28 = each element of w15
        Close Reference(error in (no error)=s2, reference=w28) -> (error out=w29)
        next s2 = w29
      }
      To Word Integer(number=$"border spacing (2 px)") -> w30
      To Word Integer(number=w23) -> w31
      Subtract(x=w31, y=w30) -> w32
      To Word Integer(number=w24) -> w33
      Subtract(x=w33, y=w30) -> w34
      w35 = cluster{"Horizontal": i16, "Vertical": i16} {all zero or empty}
      # set panel origin to that of dec minus border spacing
      Property Node(instance in=w35, "Horizontal"=w32, "Vertical"=w34) -> (instance out=w36)
      Property Node[IsPlaceholderNodeForConversion=True](instance in=w5, "Front Panel.Origin"=w36, error in=s2) -> (error out=w37, instance out=w38)
      # set panel height and width
      Property Node[IsPlaceholderNodeForConversion=True](instance in=w38, error in=w37) -> ("Front Panel.PanelBounds"=w39, error out=w40, instance out=w41)
      # width = (2*border spacing) + dec width + 1
      # height = (2*border spacing) + dec height + 1
      Multiply(w30, 2) -> w42
      To Word Integer(number=w26) -> w43
      Property Node(instance in=w39) -> ("Top"=w44)
      Add(w44, w43) -> w45
      Add(w45, w42) -> w46
      To Word Integer(number=w25) -> w47
      Property Node(instance in=w39) -> ("Left"=w48)
      # Add 1 pixel fudge factor for asthetics
      Add(w48, w47) -> w49
      Add(w49, w42) -> w50
      Property Node(instance in=w39, "Bottom"=w46, "Right"=w50) -> (instance out=w51)
      Property Node[IsPlaceholderNodeForConversion=True](instance in=w41, "Front Panel.PanelBounds"=w51, error in=w40) -> (error out=w11, instance out=w12)
    }
  }
  case (w1) {
    frame False, Default { }
    frame True {
      Close Reference(reference=w12)
    }
  }
  $"dup VI Ref" <- w12
  $"error out" <- w11
