vi "Get ClassID Name.gvi"   [LabVIEW Platform Developer Preview 0.1.0]
# Gets the ClassID of a LabVIEW object by RefNum and outputs an enumeration using names such as "Digital Numeric", "Boolean", "String", "Path", etc.
inputs:
  "Gen Refnum": GenericRefnum, required
  "error in (no error)": error
outputs:
  "dup Gen Refnum": GenericRefnum
  "ClassID Name": "ClassID Names Enum.gtype"
  "ClassID Mapped?": bool
  "error out": error
types:
  "ClassID Names Enum.gtype" = enum{"0 <undefined>", "1 <undefined>", "2 <undefined>", "Generic", "Decoration", "Text", "Control", "ColorBox", "Boolean", "RefNum", "Variant", "Path", "ListBox", "Table", "Array", "Picture", "ActiveXContainer", "Numeric", "Digital", "NamedNumeric", "ColorRamp", "Slide", "GraphOrChart", "WaveformChart", "WaveformGraph", "IntensityChart", "IntensityGraph", "String", "IOName", "ComboBox", "Cluster", "Panel", "Knob", "NumWithScale", "Ring", "Enum", "GObject", "Plot", "Cursor", "NumericText", "Scale", "ColorScale", "GraphScale", "ColorGraphScale", "TypedRefNum", "OldKnobScale", "MCListbox", "MeasureData", "BVTag", "DAQName", "VISAName", "IVIName", "SlideScale", "TabControl", "Page", "TabArrayTabControl", "ConPane"}
  "ClassID Names Enum__ogtk.gtype" = enum{"0 <undefined>", "1 <undefined>", "2 <undefined>", "Generic", "Decoration", "Text", "Control", "ColorBox", "Boolean", "RefNum", "Variant", "Path", "ListBox", "Table", "Array", "Picture", "ActiveXContainer", "Numeric", "Digital", "NamedNumeric", "ColorRamp", "Slide", "GraphOrChart", "WaveformChart", "WaveformGraph", "IntensityChart", "IntensityGraph", "String", "IOName", "ComboBox", "Cluster", "Panel", "Knob", "NumWithScale", "Ring", "Enum", "GObject", "Plot", "Cursor", "NumericText", "Scale", "ColorScale", "GraphScale", "ColorGraphScale", "TypedRefNum", "OldKnobScale", "MCListbox", "MeasureData", "BVTag", "DAQName", "VISAName", "IVIName", "SlideScale", "TabControl", "Page", "TabArrayTabControl", "ConPane"}
diagram:
  Property Node[IsPlaceholderNodeForConversion=True](instance in=$"Gen Refnum", error in=$"error in (no error)") -> ("ClassID"=w1, error out=w2, instance out=w3)
  $"dup Gen Refnum" <- w3
  $"error out" <- w2
  Type Cast(type="ClassID Names Enum__ogtk.gtype" "0 <undefined>", x=w1) -> w4
  $"ClassID Name" <- w4
  Format Into String(w4) -> w5
  Is Decimal Digit(char=w5) -> w6
  Not(x=w6) -> w7
  $"ClassID Mapped?" <- w7
