vi "List Open Front Panels.gvi"   [LabVIEW Platform Developer Preview 0.1.0]
# Returns an array of the names of all VIs in memory whose front panels are open.
outputs:
  "Open Front Panels": string[]
diagram:
  Property Node[IsPlaceholderNodeForConversion=True]() -> ("App.AllVIs"=w1)
  s1 = string[] []  # shift register
  for {
    w2 = each element of w1
    Open VI Reference() -> (error out=w3, vi reference=w4)
    Property Node[IsPlaceholderNodeForConversion=True](instance in=w4, error in=w3) -> ("Front Panel.Open"=w5, error out=w6, instance out=w7)
    Close Reference(error in (no error)=w6, reference=w7)
    case (w5) {
      frame False, Default {
        w8 = s1
      }
      frame True {
        Build Array[ConcatenateInputs=True](s1, w2) -> w8
      }
    }
    next s1 = w8
  }
  $"Open Front Panels" <- s1
