vi "List VI Hierarchy.gvi"   [LabVIEW Platform Developer Preview 0.1.0]
# Returns a cluster of all of the Standard VIs, Control Type Definitions, Global VIs, and Polymorphic VIs in a VI's hierarchy.  You may optionally exclude any VIs whose paths are in vi.lib or any of its recursive subdirectories.
inputs:
  "VI reference": VIRefnum, required
  "exclude vi.lib VIs (FALSE)": bool
  "error in (no error)": error
outputs:
  "dup VI reference": VIRefnum
  "Hierarchy Lists": T1
  "error out": error
types:
  T1 = cluster{"Standard VIs": string[], "Control Type Definitions": string[], "Global VIs": string[], "Polymorphic VIs": string[]}
uses:
  OpenG.Application Control::Is VI-LIB.gvi
diagram:
  $"dup VI reference" <- $"VI reference"
  Property Node[IsPlaceholderNodeForConversion=True](error in=$"error in (no error)") -> ("App.AllVIs"=w1, error out=w2)
  Build Array[ConcatenateInputs=True](w1) -> w3
  # Look-up table of refnums to all VIs in memory.  This speeds up the process of getting the Callees
  s1 = w2  # shift register
  for {
    w4 = each element of w3
    Open VI Reference(error in (no error)=s1) -> (error out=w7, vi reference=w8)
    append w8 to w5
    append w4 to w6
    next s1 = w7
  }
  # get VI's subVIs and init SR array of VI's to get subVIs of
  Property Node[IsPlaceholderNodeForConversion=True](instance in=$"VI reference", error in=s1) -> ("Name"=w9, error out=w10)
  # init null cluster
  Unflatten From Byte Array(data bytes="", type=$"Hierarchy Lists") -> (value=w11)
  Build Array(w9) -> w12
  # Close Look-up table refnums
  s2 = w10  # shift register
  s3 = w11  # shift register
  s4 = w12  # shift register
  while {
    Array Size(array=s4) -> (size(s)=w13)
    Decrement(x=w13) -> w14
    # VI's in hierarchy
    # VI's to get subVIs of
    Delete From Array(inArray=s4, length (1)=1, index0=w14) -> (outArray=w15, deleted=w16)
    # pop last VI off stack
    Array Index(array=w16) -> (out0[_]=w17)
    Search 1D Array(1D array=w6, element=w17) -> (index of element=w18)
    # Look-up Refnum by name, open new on fail for System VIs
    case (w18) {
      frame -1 {
        Open VI Reference(error in (no error)=s2) -> (error out=w20, vi reference=w19)
      }
      frame Default {
        Array Index(array=w5) -> (out0[w18]=w19)
        w20 = s2
      }
    }
    # get VI's subVIs
    Property Node[IsPlaceholderNodeForConversion=True](instance in=w19, error in=w20) -> ("Callees"=w21, error out=w22, instance out=w23)
    # VI's to get subVIs of
    s5 = s3  # shift register
    for {
      w24 = each element of w21
      Open VI Reference() -> (error out=w25, vi reference=w26)
      # what type of VI?
      call "Is VI-LIB.gvi"(VI reference=w26, error in (no error)=w25) -> (dup VI reference=w27, is vi.lib?=w28, error out=w29)
      Property Node[IsPlaceholderNodeForConversion=True](instance in=w27, error in=w29) -> ("VIType"=w30, error out=w31, instance out=w32)
      Logical And(w28, $"exclude vi.lib VIs (FALSE)") -> w33
      case (w33) {  # Don't add to list because it's in vi.lib?
        frame False, Default {
          # Get that type array
          case (w30) {
            frame "Standard VI", Default {
              Property Node(instance in=s5) -> ("Standard VIs"=w35)
            }
            frame "Control VI" {
              Property Node(instance in=s5) -> ("Control Type Definitions"=w35)
            }
            frame "Global VI" {
              Property Node(instance in=s5) -> ("Global VIs"=w35)
            }
            frame "Polymorphic VI" {
              Property Node(instance in=s5) -> ("Polymorphic VIs"=w35)
            }
          }
          Search 1D Array(1D array=w35, element=w24) -> (index of element=w36)
          Is Equal(x=w36, y=-1) -> w37
          case (w37) {  # Not in list?
            frame False, Default {
              w38 = w35
            }
            frame True {
              Build Array[ConcatenateInputs=True](w35, w24) -> w38
            }
          }
          # put into that type array
          case (w30) {
            frame Default {
              w34 = s5
            }
            frame "Standard VI" {
              Property Node(instance in=s5, "Standard VIs"=w38) -> (instance out=w34)
            }
            frame "Control VI" {
              Property Node(instance in=s5, "Control Type Definitions"=w38) -> (instance out=w34)
            }
            frame "Global VI" {
              Property Node(instance in=s5, "Global VIs"=w38) -> (instance out=w34)
            }
            frame "Polymorphic VI" {
              Property Node(instance in=s5, "Polymorphic VIs"=w38) -> (instance out=w34)
            }
          }
        }
        frame True {
          w34 = s5
        }
      }
      Close Reference(error in (no error)=w31, reference=w32)
      next s5 = w34
    }
    # subVIs
    case (w18) {
      frame -1 {
        Close Reference(error in (no error)=w22, reference=w23) -> (error out=w39)
      }
      frame Default {
        w39 = w22
      }
    }
    # Quit if Error or no VIs left
    Property Node(instance in=w39) -> ("status"=w40)
    # subVIs
    # error cluster
    s6 = w15  # shift register
    for {
      w41 = each element of w21
      Search 1D Array(1D array=s6, element=w41) -> (index of element=w42)
      Is Equal(x=w42, y=-1) -> w43
      case (w43) {  # Not in List
        frame False, Default {
          w44 = s6
        }
        frame True {
          Build Array[ConcatenateInputs=True](s6, w41) -> w44
        }
      }
      next s6 = w44
    }
    # VI's to get subVIs of
    Array Size(array=s6) -> (size(s)=w45)
    Is Equal To 0(x=w45) -> w46
    Logical Or(w46, w40) -> w47
    next s2 = w39
    next s3 = s5
    next s4 = s6
    stop if w47
  }
  $"Hierarchy Lists" <- s3
  $"error out" <- s2
  for (after s2) {
    w48 = each element of w5
    Close Reference(reference=w48)
  }
