vi "Mangle VI Name (Path).gvi"   [LabVIEW Platform Developer Preview 0.1.0]
# Mangles a VI's name by applying a namespace string suffix.
# Name may be a path or a string.
# For example:
# Name => "Widget.vi"
# Namespace => "OpenG"
# Mangled Name => "Widget__OpenG.vi"
# Name => "Widget"
# Namespace => "OpenG"
# Mangled Name => "Widget__OpenG"
# Name => "Widget.vi"
# Namespace => "" (Note: blank string means do not mangle)
# Mangled Name => "Widget.vi"
inputs:
  "Name": path, required
  "Namespace (\"\": don't mangle)": string
  "error in (no error)": error
outputs:
  "Mangled Name": path
  "error out": error
uses:
  OpenG.Application Control::Mangle VI Name (String).gvi
diagram:
  Is Empty String Or Path(string/path=$Name) -> w1
  case (w1) {
    frame False, Default {
      Strip Path(path=$Name) -> (name=w4, stripped path=w5)
      call "Mangle VI Name (String).gvi"(Name=w4, Namespace ("": don't mangle)=$"Namespace (\"\": don't mangle)", error in (no error)=$"error in (no error)") -> (Mangled Name=w6, error out=w3)
      Build Path(base path=w5, name or relative path=w6) -> (appended path=w2)
    }
    frame True {
      w2 = $Name
      w3 = $"error in (no error)"
    }
  }
  $"Mangled Name" <- w2
  $"error out" <- w3
