vi "Open VI Clone Reference.gvi"   [LabVIEW Platform Developer Preview 0.1.0]
# This VI clones a specified VI, creates a reference to the clone by saving a copy of the VI as a VI Template and then opening a reference to the template.  It then deletes the template on disk, while leaving the clone in memory.  As is, this VI can only produce non-strict references to VIs.  The "type specifier VI Refnum" should be added if you wish to "Call by Reference".  It is suggested that you make a copy of this VI and add the type specifier for each strict reference you require.  A Polymorphic VI implimentation is not realistically capable of including all possible permutations of connector panel types, which is required for strict references and used by the "Call By Reference Node".
inputs:
  "application reference (local)": ApplicationRefnum
  "vi path": path, required
  "error in (no error)": error
  "password (\"\")": string
outputs:
  "clone vi reference": VIRefnum
  "error out": error
diagram:
  # not a ref if left unwired and therefore local
  Is Not A Number Or Path Or Refnum(number=$"application reference (local)") -> w1
  # Open a reference to the VI you wish to clone ()
  case (w1) {  # Local Ref?
    frame True {
      Open VI Reference(error in (no error)=$"error in (no error)") -> (error out=w2, vi reference=w3)
    }
    frame False {
      Open VI Reference(component reference=$"application reference (local)", error in (no error)=$"error in (no error)") -> (error out=w2, vi reference=w3)
    }
  }
  Path To String(path=$"vi path") -> (string=w4)
  # Change extension to "vit" (template)
  Match Pattern(regular expression=".vi", string=w4) -> (before substring=w5)
  Concatenate Strings(w5, ".vit") -> w6
  String To Path(string=w6) -> (path=w7)
  # Save a copy of the VI to the same directory but as a template by changing the extension to *.vit
  Invoke Node: Save.Instrument( Input 0=w3, error in (no error) Input 1=w2, Path to saved file Input 2=w7, Save a Copy Input 3=TRUE) -> ( Output 0=w8, error out Output 1=w9)  # Invoke Node: Save.Instrument (Placeholder)
  # Close the VI reference of the original VI
  Close Reference(error in (no error)=w9, reference=w8) -> (error out=w10)
  # Open a reference to the template VI (clone)
  Open VI Reference(error in (no error)=w10) -> (error out=w11, vi reference=w12)
  # Delete the template VI (clone) on disk
  $"clone vi reference" <- w12
  Delete File Or Folder(error in=w11, path (use dialog)=w7) -> (error out=w13)
  $"error out" <- w13
