vi "VI Tree - appcontrol.gvi"   [LabVIEW Platform Developer Preview 0.1.0]
panel controls:
  "Gen Refnum": GenericRefnum
  "Gen Refnum Array": VIRefnum[]
  "Gen Refnum Array 2": GenericRefnum[]
  "VI Refnum": VIRefnum
  "paths": T1
panel indicators:
  "ClassID Name": "ClassID Names Enum.gtype"
types:
  "ClassID Names Enum.gtype" = enum{"0 <undefined>", "1 <undefined>", "2 <undefined>", "Generic", "Decoration", "Text", "Control", "ColorBox", "Boolean", "RefNum", "Variant", "Path", "ListBox", "Table", "Array", "Picture", "ActiveXContainer", "Numeric", "Digital", "NamedNumeric", "ColorRamp", "Slide", "GraphOrChart", "WaveformChart", "WaveformGraph", "IntensityChart", "IntensityGraph", "String", "IOName", "ComboBox", "Cluster", "Panel", "Knob", "NumWithScale", "Ring", "Enum", "GObject", "Plot", "Cursor", "NumericText", "Scale", "ColorScale", "GraphScale", "ColorGraphScale", "TypedRefNum", "OldKnobScale", "MCListbox", "MeasureData", "BVTag", "DAQName", "VISAName", "IVIName", "SlideScale", "TabControl", "Page", "TabArrayTabControl", "ConPane"}
  T1 = cluster{"destination executable": path, "source llb": path, "source shell": path, "custom icon": path}
uses:
  OpenG.Application Control::Mangle VI Name (String).gvi
  OpenG.Application Control::Mangle VI Name (Path).gvi
  OpenG.Application Control::Current VIs Parents Ref.gvi
  OpenG.Application Control::List Open Front Panels.gvi
  OpenG.Application Control::Current VIs Reference.gvi
  OpenG.Application Control::Save VI ConPane Image.gvi
  OpenG.Application Control::List VI Hierarchy.gvi
  OpenG.Application Control::Get ClassID Name.gvi
  OpenG.Application Control::Metrics-Advanced.gvi
  OpenG.Application Control::Get Frontmost VI.gvi
  OpenG.Application Control::Open Untitled VI.gvi
  OpenG.Application Control::Untitled.gvi
  OpenG.Application Control::is OpenG.gvi
  OpenG.Application Control::UnMangle VI Name (String).gvi
  OpenG.Application Control::UnMangle VI Name (Path).gvi
  OpenG.Application Control::Open VI Clone Reference.gvi
  OpenG.Application Control::Is VI-LIB.gvi
  OpenG.Application Control::Get All Control Values {Variant}.gvi
  OpenG.Application Control::Dist Build App from LLB (proxy).gvi
  OpenG.Application Control::Get Control Value {Variant}.gvi
  OpenG.Application Control::Current VIs Namespace.gvi
  OpenG.Application Control::Set Control Value {Variant}.gvi
  OpenG.Application Control::Close Generic Object Refnum (Scalar).gvi
  OpenG.Application Control::Close Generic Object Refnum (Array VI).gvi
  OpenG.Application Control::Close Generic Object Refnum (Array).gvi
  OpenG.Application Control::Close Generic Object Refnum (Scalar VI).gvi
  OpenG.Application Control::Get Text Label Decs from VI.gvi
  OpenG.Application Control::Find VI with Focus.gvi
  OpenG.Application Control::Wait on VIs Unloaded from Memory.gvi
  OpenG.Application Control::Is One Frontmost.gvi
  OpenG.Application Control::Fit VI window to Content.gvi
  OpenG.Application Control::Fit VI window to Largest Dec.gvi
diagram:
  sequence {
    frame 0 {
      sequence {  # Mangle VI Name (Poly)
        frame 0 {
          call "Mangle VI Name (String).gvi"(Name="")
          call "Mangle VI Name (Path).gvi"(Name=path "", Namespace ("": don't mangle)="")
          call "Mangle VI Name (String).gvi"(Name="", Namespace ("": don't mangle)="")
        }
      }
      call "Current VIs Parents Ref.gvi"()  # Current VIs Parents Reference
      call "List Open Front Panels.gvi"()
      call "Current VIs Reference.gvi"()
      call "Save VI ConPane Image.gvi"(VI Path=path "", Image File Path=path "", Image Format="GIF")
      call "List VI Hierarchy.gvi"(VI reference=$"VI Refnum")
      call "Get ClassID Name.gvi"(Gen Refnum=$"Gen Refnum")
      call "Metrics-Advanced.gvi"(VI reference=$"VI Refnum")
      call "Get Frontmost VI.gvi"()
      call "Open Untitled VI.gvi"()
      call "Untitled.gvi"()
      call "is OpenG.gvi"(VI reference=$"VI Refnum")
      sequence {  # UnMangle VI Name (Poly)
        frame 0 {
          call "UnMangle VI Name (String).gvi"(Mangled Name="")
          call "UnMangle VI Name (String).gvi"(Mangled Name="")
          call "UnMangle VI Name (Path).gvi"(Mangled Name=path "")
        }
      }
      call "Open VI Clone Reference.gvi"(vi path=path "")
      call "Is VI-LIB.gvi"(VI reference=$"VI Refnum")
      call "Get All Control Values {Variant}.gvi"(VI Refnum=$"VI Refnum")
      call "Dist Build App from LLB (proxy).gvi"(paths=$paths)
      call "Get Control Value {Variant}.gvi"(VI Refnum=$"VI Refnum", Control Name="")
      call "Current VIs Namespace.gvi"()
      call "Set Control Value {Variant}.gvi"(VI Refnum=$"VI Refnum", Value=variant())
      w1 = $"Gen Refnum"
      w2 = $"Gen Refnum"
      w3 = $"Gen Refnum Array"
      w4 = $"Gen Refnum Array 2"
      w5 = $"VI Refnum"
      sequence {  # Close Generic Object Refnum (Poly)
        frame 0 {
          call "Close Generic Object Refnum (Scalar).gvi"(Gen Refnum=w1)
          call "Close Generic Object Refnum (Scalar).gvi"(Gen Refnum=w2)
          call "Close Generic Object Refnum (Array VI).gvi"(Gen Refnum Array=w3)
          call "Close Generic Object Refnum (Array).gvi"(Gen Refnum Array=w4)
          call "Close Generic Object Refnum (Scalar VI).gvi"(VI Refnum=w5)
        }
      }
      call "Get Text Label Decs from VI.gvi"(VI Refnum=$"VI Refnum")
      call "Find VI with Focus.gvi"()
      call "Wait on VIs Unloaded from Memory.gvi"(VIs to Wait on=string[] [])
      call "Is One Frontmost.gvi"(VI names=string[] [])
      call "Fit VI window to Content.gvi"()
      call "Fit VI window to Largest Dec.gvi"()  # Fit VI window to Largest Decoration
    }
  }
