vi "Reverse 2D Array (String).gvi"   [LabVIEW Platform Developer Preview 0.1.0]
# This polymorphic VI reverses the input 2D Array and outputs the result as Reversed Array.  Use the by rows or columns input to specify whether to sort by row or by column.
inputs:
  "Array": string[][], required
  "by rows or columns (rows)": enum{"rows", "columns"} = "rows"
outputs:
  "Reversed Array": string[][]
diagram:
  # # or rows or columns
  Array Size(array=$Array) -> (size(s)=w1)
  Array Index(array=w1) -> (out0[$"by rows or columns (rows)"]=w2)
  for (N = w2) (iteration -> i1) {  # Reverse 2d Array
    Decrement(x=w2) -> w4
    Subtract(x=w4, y=i1) -> w5
    case ($"by rows or columns (rows)") {
      frame "rows" {
        Array Index(array=$Array) -> (out0[w5, _]=w6)
      }
      frame "columns" {
        Array Index(array=$Array) -> (out0[_, w5]=w6)
      }
    }
    append w6 to w3
  }
  case ($"by rows or columns (rows)") {
    frame "rows" {
      w7 = w3
    }
    frame "columns" {
      Transpose 2D Array(2D array=w3) -> (transposed array=w7)
    }
  }
  $"Reversed Array" <- w7
