vi "VI Tree - array.gvi"   [LabVIEW Platform Developer Preview 0.1.0]
uses:
  OpenG.Array::Conditional Auto-Indexing Tunnel (DBL).gvi
  OpenG.Array::Filter 1D Array (DBL).gvi
  OpenG.Array::Remove Duplicates from 1D Array (DBL).gvi
  OpenG.Array::Reorder 2D Array2 (DBL).gvi
  OpenG.Array::Reorder 2D Array (DBL).gvi
  OpenG.Array::Reverse 2D Array (SGL).gvi
  OpenG.Array::Search 1D Array (DBL).gvi
  OpenG.Array::Slice 1D Array (DBL).gvi
  OpenG.Array::Sort 1D Array (DBL).gvi
  OpenG.Array::Sort 2D Array (DBL).gvi
  OpenG.Array::Index 1D Array Elements (DBL).gvi
  OpenG.Array::Empty 1D Array (DBL).gvi
  OpenG.Array::Delete Elements from 1D Array (DBL).gvi
diagram:
  call "Conditional Auto-Indexing Tunnel (DBL).gvi"(Elements to keep=bool[] [], Array in=f64[] [])
  call "Filter 1D Array (DBL).gvi"(array=f64[] [], items to filter=f64[] [])  # Filter 1D Array (DBL).vi
  call "Remove Duplicates from 1D Array (DBL).gvi"(Input Array=f64[] [])
  call "Reorder 2D Array2 (DBL).gvi"(array=f64[][] [], indices=i32[] [])  # Reorder 2D Array (DBL)
  call "Reorder 2D Array (DBL).gvi"(Array in=f64[][] [], Sorted Pointers in=i32[] [])  # Reorder 2D Array (DBL).vi
  call "Reverse 2D Array (SGL).gvi"(Array=f32[][] [])
  call "Search 1D Array (DBL).gvi"(Array=f64[] [], Element Data=0)  # Search 1D Array for All (DBL)
  call "Slice 1D Array (DBL).gvi"(array=f64[] [], slice="")
  call "Sort 1D Array (DBL).gvi"(Array in=f64[] [])
  call "Sort 2D Array (DBL).gvi"(Array in=f64[][] [], Order="ascending", Sort By in="row")
  call "Index 1D Array Elements (DBL).gvi"(array=f64[] [], indices=i32[] [])  # Index 1D Array Elements (DBL).vi
  call "Empty 1D Array (DBL).gvi"(Array=f64[] [])  # Empty 1D Array (DBL)?
  call "Delete Elements from 1D Array (DBL).gvi"(array=f64[] [], indices=i32[] [])  # Delete Elements from 1D Array (DBL).vi
