vi "Boolean Trigger.gvi"   [LabVIEW Platform Developer Preview 0.1.0]
# This VI is used to detect rising and falling edges of the Boolean Input.  "Rising Edge" is TRUE if Boolean Input is TRUE and was previously FALSE.  "Falling Edge" is TRUE if Boolean Input is FALSE and was previously TRUE.  This VI is intended to be used in loops to aid in user input polling.
inputs:
  "Boolean Input": bool
outputs:
  "Rising Edge": bool
  "Falling Edge": bool
diagram:
  s1 = uninitialised  # shift register
  while {
    w1 = s1
    next s1 = $"Boolean Input"
    continue if FALSE
  }
  Is First Call() -> w2
  Logical And(not w2, s1, not w1) -> w3
  $"Rising Edge" <- w3
  Logical And(not w2, not s1, w1) -> w4
  $"Falling Edge" <- w4
