vi "2D Variant Array Changed.gvi"   [LabVIEW Platform Developer Preview 0.1.0]
# Data Changed
# This is a polymorphic VI that will output a true if the data flowing into it has changed.  It is also a Reentrant VI. So each intance of it in your code is treated as a seperate VI.  The first time that the VI is run it will output a false.  It can take any data type as an input.  It has several native data types (for efficiency) and will coerce to variant if a non-native data type (error cluster, refnum, etc) is used.
inputs:
  "2D Variant Array": variant[][], required
outputs:
  "Changed": bool
diagram:
  s1 = uninitialised  # shift register
  while {
    w1 = s1
    next s1 = $"2D Variant Array"
    continue if FALSE
  }
  Is Not Equal[ComparisonMode=CompareAggregates](x=s1, y=w1) -> w2
  Is First Call() -> w3
  Logical And(w2, not w3) -> w4
  $Changed <- w4
