vi "Dictionary Create.gvi"   [LabVIEW Platform Developer Preview 0.1.0]
# Creates a new instance of empty dictionary data and returns a dictionary reference associated with the newly created dictionary.
inputs:
  "initial dictionary (empty)": cluster{"key": variant, "value": variant}[]  # initial dictionary (empty): It is the data to be written in the newly created dictionary. By default, it is creates an empty dictionary.
  "error in (no error)": error
outputs:
  "dictionary out": "Dictionary Object RefNum.gtype"  # dictionary is a reference to the newly created dictionary.
  "error out": error
panel controls:
  "Data in": "Dictionary Data.gtype"
types:
  "Dictionary Data.gtype" = cluster{"keys": variant[], "values": variant[]}
  "Dictionary Object RefNum.gtype" = i32
uses:
  OpenG.Dictionary::Dictionary New.gvi
diagram:
  Property Node(instance in=$"error in (no error)") -> ("status"=w1)
  case (w1) {
    frame False, Default {
      # Insert code that initializes object and
      # pass initial data to the new function.
      for {
        w4 = each element of $"initial dictionary (empty)"
        Property Node(instance in=w4) -> ("key"=w7, "value"=w8)
        append w7 to w5
        append w8 to w6
      }
      Property Node(instance in=$"Data in", "keys"=w5, "values"=w6) -> (instance out=w9)
      call "Dictionary New.gvi"(Data in=w9, error in (no error)=$"error in (no error)") -> (Object RefNum=w3, error out=w2)
    }
    frame True {
      w2 = $"error in (no error)"
      w3 = Not A Refnum
    }
  }
  $"dictionary out" <- w3
  $"error out" <- w2
