vi "Dictionary Data Store VI Name.gvi"   [LabVIEW Platform Developer Preview 0.1.0]
# Returns the name of the Data Store VI.
outputs:
  "Data Store VI Name": string
uses:
  OpenG.Dictionary::Dictionary Object Data Store.gvi
diagram:
  Property Node[IsPlaceholderNodeForConversion=True]() -> ("Callees"=w1)
  Array Index(array=w1) -> (out0[_]=w2)
  $"Data Store VI Name" <- w2
  call "Dictionary Object Data Store.gvi"()
