vi "Dictionary Delete.gvi"   [LabVIEW Platform Developer Preview 0.1.0]
inputs:
  "Object RefNum": "Dictionary Object RefNum.gtype"
  "error in (no error)": error
outputs:
  "error out": error
types:
  "Dictionary Object RefNum.gtype" = i32
uses:
  OpenG.Dictionary::Dictionary Close Object Reference.gvi
diagram:
  call "Dictionary Close Object Reference.gvi"(Object RefNum=$"Object RefNum") -> (error out=w1)
  Select(s=$"error in (no error)", t=$"error in (no error)", f=w1) -> w2
  $"error out" <- w2
