vi "Dictionary Get Data to Modify.gvi"   [LabVIEW Platform Developer Preview 0.1.0]
# Gets the GOOP data structure after acquiring mutex
inputs:
  "Object RefNum": "Dictionary Object RefNum.gtype"
  "ms timeout (-1)": i32 = -1  # ms timeout specifies how many milliseconds the function should wait for the semaphore to become available.
  "error in (no error)": error
outputs:
  "Dup Object RefNum": "Dictionary Object RefNum.gtype"
  "Data out": "Dictionary Data.gtype"
  "timed out": bool
  "error out": error
types:
  "Dictionary Object RefNum.gtype" = i32
  "Dictionary Data.gtype" = cluster{"keys": variant[], "values": variant[]}
uses:
  OpenG.Dictionary::Dictionary Get Instance Semaphore RefNum.gvi
  NI::G Core::Semaphore::Acquire Semaphore.gvi
  OpenG.Dictionary::Dictionary Data Core.gvi
  OpenG.Dictionary::Dictionary Default Data.gvi
diagram:
  case ($"error in (no error)") {
    frame No Error {
      call "Dictionary Get Instance Semaphore RefNum.gvi"(Object RefNum=$"Object RefNum", error out=$"error in (no error)") -> (dup Object RefNum=w5, semaphore=w6, error in (no error)=w7)
      call "Acquire Semaphore.gvi"(semaphore in=w6, ms timeout=$"ms timeout (-1)", error in=w7) -> (timed out=w2, error out=w8)
      call "Dictionary Data Core.gvi"(Object RefNum=w5, task (read)="read", error in (no error)=w8) -> (dup Object RefNum=w4, Data out=w3, error out=w1)
    }
    frame Error {
      call "Dictionary Default Data.gvi"() -> (Data out=w3)
      w1 = $"error in (no error)"
      w2 = FALSE
      w4 = $"Object RefNum"
    }
  }
  $"Dup Object RefNum" <- w4
  $"timed out" <- w2
  $"Data out" <- w3
  $"error out" <- w1
