vi "Dictionary Get Items.gvi"   [LabVIEW Platform Developer Preview 0.1.0]
# Returns all the items (key - value pairs) within the dictionary.
inputs:
  "dictionary": "Dictionary Object RefNum.gtype", required  # dictionary is a reference associated with a dictionary.
  "error in (no error)": error
outputs:
  "dictionary out": "Dictionary Object RefNum.gtype"  # dictionary out has the same value as dictionary.
  "items": cluster{"key": variant, "value": variant}[]  # This is a cluster of arrays containing all items (key - value pairs) present in the dictionary
  "error out": error
types:
  "Dictionary Object RefNum.gtype" = i32
  T1 = cluster{"Variant": variant, "Variant_2": variant}
uses:
  OpenG.Dictionary::Dictionary Get Data.gvi
diagram:
  call "Dictionary Get Data.gvi"(Object RefNum=$dictionary, error in (no error)=$"error in (no error)") -> (Dup Object RefNum=w1, Data out=w2, error out=w3)
  $"dictionary out" <- w1
  Property Node(instance in=w3) -> ("status"=w4)
  case (w4) {
    frame False, Default {
      Property Node(instance in=w2) -> ("keys"=w7, "values"=w8)
      # Put your own code here
      for {
        w9 = each element of w7
        w10 = each element of w8
        Property Node(instance in=T1 {all zero or empty}, "Variant"=w9, "Variant_2"=w10) -> (instance out=w11)
        append w11 to w6
      }
      w5 = w3
    }
    frame True {
      # Error
      w5 = w3
      w6 = T1[] []
    }
  }
  $items <- w6
  $"error out" <- w5
