vi "Dictionary Get Keys.gvi"   [LabVIEW Platform Developer Preview 0.1.0]
# Returns all the keys within in the dictionary.
inputs:
  "dictionary": "Dictionary Object RefNum.gtype", required  # dictionary is a reference associated with a dictionary.
  "error in (no error)": error
outputs:
  "dictionary out": "Dictionary Object RefNum.gtype"  # dictionary out has the same value as dictionary.
  "keys": variant[]  # This is an array of keys present in the dictionary
  "error out": error
types:
  "Dictionary Object RefNum.gtype" = i32
uses:
  OpenG.Dictionary::Dictionary Get Data.gvi
diagram:
  call "Dictionary Get Data.gvi"(Object RefNum=$dictionary, error in (no error)=$"error in (no error)") -> (Dup Object RefNum=w1, Data out=w2, error out=w3)
  $"dictionary out" <- w1
  Property Node(instance in=w3) -> ("status"=w4)
  case (w4) {
    frame False, Default {
      # Put your own code here
      Property Node(instance in=w2) -> ("keys"=w6)
      w5 = w3
    }
    frame True {
      # Error
      w5 = w3
      w6 = variant[] []
    }
  }
  $keys <- w6
  $"error out" <- w5
