vi "Dictionary Not a Dictionary.gvi"   [LabVIEW Platform Developer Preview 0.1.0]
# Returns TRUE if dictionary is not a valid dictionary refnum.
inputs:
  "dictionary": "Dictionary Object RefNum.gtype", required  # dictionary is a reference associated with a dictionary.
outputs:
  "not a dictionary?": bool  # not a dictionary returns TRUE if dictionary is not a valid dictionary reference.
types:
  "Dictionary Object RefNum.gtype" = i32
uses:
  OpenG.Dictionary::Dictionary Object Data Store VI Ref Type.gvi
diagram:
  Flatten To Byte Array(anything=$dictionary) -> (data bytes=w1)
  call "Dictionary Object Data Store VI Ref Type.gvi"() -> (VI Refnum (Object Data Store.vi Type)=w2)
  Unflatten From Byte Array(data bytes=w1, type=w2) -> (value=w3)
  Is Not A Number Or Path Or Refnum(number=w3) -> w4
  $"not a dictionary?" <- w4
