vi "Dictionary Open Object Reference.gvi"   [LabVIEW Platform Developer Preview 0.1.0]
inputs:
  "error in (no error)": error
outputs:
  "Object RefNum": "Dictionary Object RefNum.gtype"
  "error out": error
types:
  "Dictionary Object RefNum.gtype" = i32
uses:
  OpenG.Dictionary::Dictionary Data Store VI Name.gvi
  OpenG.Dictionary::Dictionary Object Data Store VI Ref Type.gvi
  OpenG.Dictionary::Dictionary Object Ref Type.gvi
  OpenG.Dictionary::Dictionary Data Core.gvi
diagram:
  case ($"error in (no error)") {
    frame No Error {
      call "Dictionary Data Store VI Name.gvi"()
      call "Dictionary Object Data Store VI Ref Type.gvi"() -> (VI Refnum (Object Data Store.vi Type)=w3)
      Open VI Reference(error in (no error)=$"error in (no error)", type specifier VI Refnum (for type only)=w3) -> (error out=w4, vi reference=w5)
      Flatten To Byte Array(anything=w5) -> (data bytes=w6)
      call "Dictionary Object Ref Type.gvi"() -> (Object RefNum Type=w7)
      Unflatten From Byte Array(data bytes=w6, type=w7) -> (value=w8)
      call "Dictionary Data Core.gvi"(Object RefNum=w8, task (read)="init", error in (no error)=w4) -> (dup Object RefNum=w1, error out=w2)
    }
    frame Error {
      w1 = Not A Refnum
      w2 = $"error in (no error)"
    }
  }
  $"Object RefNum" <- w1
  $"error out" <- w2
