vi "Dictionary Set Modified Data.gvi"   [LabVIEW Platform Developer Preview 0.1.0]
# Sets the GOOP data structure and releases mutex
inputs:
  "Object RefNum": "Dictionary Object RefNum.gtype"
  "Data in": "Dictionary Data.gtype"
  "error in (no error)": error
outputs:
  "dup Object RefNum": "Dictionary Object RefNum.gtype"
  "error out": error
types:
  "Dictionary Data.gtype" = cluster{"keys": variant[], "values": variant[]}
  "Dictionary Object RefNum.gtype" = i32
uses:
  OpenG.Dictionary::Dictionary Data Core.gvi
  OpenG.Dictionary::Dictionary Get Instance Semaphore RefNum.gvi
diagram:
  case ($"error in (no error)") {
    frame No Error {
      # /*Write data*/
      call "Dictionary Data Core.gvi"(Object RefNum=$"Object RefNum", Data in=$"Data in", task (read)="write", error in (no error)=$"error in (no error)") -> (dup Object RefNum=w2, error out=w1)
    }
    frame Error {
      w1 = $"error in (no error)"
      w2 = $"Object RefNum"
    }
  }
  # /*Merge error with priority for existing error*/
  call "Dictionary Get Instance Semaphore RefNum.gvi"(Object RefNum=w2) -> (dup Object RefNum=w3, semaphore=w4, error in (no error)=w5)
  $"dup Object RefNum" <- w3
  # /*Get semaphore refnum and release mutex*/
  Release Semaphore_71(semaphore Input 0=w4, error in (no error) Input 1=w5) -> (error out Output 3=w6)  # Release Semaphore_71 (Placeholder)
  Select(s=w1, t=w1, f=w6) -> w7
  $"error out" <- w7
