vi "Dictionary Update (by reference).gvi"   [LabVIEW Platform Developer Preview 0.1.0]
# Looks for all the keys and writes all the respective values from dictionary refnum into the dictionary linked to specified dictionary reference.
inputs:
  "dictionary": "Dictionary Object RefNum.gtype", required  # dictionary is a reference associated with a dictionary.
  "dictionary with updates": "Dictionary Object RefNum.gtype", required  # Reference to the dictionary with updates.
  "error in (no error)": error
outputs:
  "dictionary out": "Dictionary Object RefNum.gtype"  # dictionary out has the same value as dictionary.
  "created new?": bool[]  # This boolean array returns TRUE for each key created in the dictionary
  "error out": error
types:
  "Dictionary Object RefNum.gtype" = i32
uses:
  OpenG.Dictionary::Dictionary Get Items.gvi
  OpenG.Dictionary::Dictionary Update (by value).gvi
diagram:
  call "Dictionary Get Items.gvi"(dictionary=$"dictionary with updates", error in (no error)=$"error in (no error)") -> (items=w1, error out=w2)
  call "Dictionary Update (by value).gvi"(dictionary=$dictionary, dictionary with updates=w1, error in (no error)=w2) -> (dictionary out=w3, created new?=w4, error out=w5)
  $"dictionary out" <- w3
  $"created new?" <- w4
  $"error out" <- w5
