vi "Dictionary Update (by scalar value).gvi"   [LabVIEW Platform Developer Preview 0.1.0]
# Updates a single value in the dictionary, referenced by the key.
# unlock dictionary will unlock a previously locked dictionary.  Locking a dictionary is useful when the values of keys store compound data, which might be modified in multiple locations.
inputs:
  "dictionary": "Dictionary Object RefNum.gtype", required  # dictionary is a reference associated with a dictionary.
  "key-value": "Dictionary Key Value Pair Cluster.gtype", required  # key is searched in the dictionary value is written to the associated location in the dictionary
  "error in (no error)": error
  "unlock dictionary? (FALSE)": bool  # This boolean input will unlock a previously locked dictionary. Locking a dictionary is useful when the values of keys store compound data, which might be modified in multiple locations.
outputs:
  "dictionary out": "Dictionary Object RefNum.gtype"  # dictionary out has the same value as dictionary.
  "created new?": bool  # This boolean returns TRUE if the supplied key was created in the dictionary
  "error out": error
types:
  "Dictionary Object RefNum.gtype" = i32
  "Dictionary Key Value Pair Cluster.gtype" = cluster{"key": variant, "value": variant}
uses:
  OpenG.Dictionary::Dictionary Update (by value).gvi
diagram:
  Build Array($"key-value") -> w1
  call "Dictionary Update (by value).gvi"(dictionary=$dictionary, dictionary with updates=w1, error in (no error)=$"error in (no error)", unlock dictionary? (FALSE)=$"unlock dictionary? (FALSE)") -> (dictionary out=w2, created new?=w3, error out=w4)
  $"dictionary out" <- w2
  Array Index(array=w3) -> (out0[_]=w5)
  $"created new?" <- w5
  $"error out" <- w4
