vi "Dictionary Update (by value).gvi"   [LabVIEW Platform Developer Preview 0.1.0]
# Looks for all the keys and writes the respective values to the dictionary linked to specified dictionary reference.
# unlock dictionary will unlock a previously locked dictionary.  Locking a dictionary is useful when the values of keys store compound data, which might be modified in multiple locations.
inputs:
  "dictionary": "Dictionary Object RefNum.gtype", required  # dictionary is a reference associated with a dictionary.
  "dictionary with updates": "Dictionary Key Value Pair Cluster.gtype"[], required  # Cluster of items to be written to the dictionary
  "error in (no error)": error
  "unlock dictionary? (FALSE)": bool  # This boolean input will unlock a previously locked dictionary. Locking a dictionary is useful when the values of keys store compound data, which might be modified in multiple locations.
outputs:
  "dictionary out": "Dictionary Object RefNum.gtype"  # dictionary out has the same value as dictionary.
  "created new?": bool[]  # This boolean array returns TRUE for each key created in the dictionary
  "error out": error
types:
  "Dictionary Object RefNum.gtype" = i32
  "Dictionary Key Value Pair Cluster.gtype" = cluster{"key": variant, "value": variant}
uses:
  OpenG.Dictionary::Dictionary Get Data to Modify.gvi
  OpenG.Dictionary::Dictionary Get Data.gvi
  OpenG.Dictionary::Dictionary Set Modified Data.gvi
diagram:
  case ($"unlock dictionary? (FALSE)") {
    frame False, Default {
      call "Dictionary Get Data to Modify.gvi"(Object RefNum=$dictionary, error in (no error)=$"error in (no error)") -> (Dup Object RefNum=w4, Data out=w1, timed out=w3, error out=w2)
    }
    frame True {
      call "Dictionary Get Data.gvi"(Object RefNum=$dictionary, error in (no error)=$"error in (no error)") -> (Dup Object RefNum=w4, Data out=w1, error out=w2)
      w3 = default
    }
  }
  case (w3) {
    frame False, Default {
      Property Node(instance in=w1) -> ("values"=w8, "keys"=w9)
      s1 = w8  # shift register
      s2 = w9  # shift register
      for {
        w10 = each element of $"dictionary with updates"
        Property Node(instance in=w10) -> ("key"=w12, "value"=w13)
        Search 1D Array(1D array=s2, element=w12) -> (index of element=w14)
        Is Greater Or Equal To 0(x=w14) -> w15
        case (w15) {  # has key?
          frame False, Default {
            Build Array[ConcatenateInputs=True](s1, w13) -> w17
            Build Array[ConcatenateInputs=True](s2, w12) -> w16
          }
          frame True {
            Replace Array Subset(inArray=s1, index=w14, new=w13) -> w17
            Replace Array Subset(inArray=s2, index=w14, new=w12) -> w16
          }
        }
        append w15 to w11
        next s1 = w17
        next s2 = w16
      }
      Not(x=w11) -> w7
      Property Node(instance in=w1, "values"=s1, "keys"=s2) -> (instance out=w18)
      call "Dictionary Set Modified Data.gvi"(Object RefNum=w4, Data in=w18) -> (dup Object RefNum=w6, error out=w19)
      Select(s=w19, t=w19, f=w2) -> w5
    }
    frame True {
      # Error or timed out
      w5 = w2
      w6 = w4
      w7 = default
    }
  }
  $"dictionary out" <- w6
  $"created new?" <- w7
  $"error out" <- w5
