vi "Build Error Cluster.gvi"   [LabVIEW Platform Developer Preview 0.1.0]
# Creates an error cluster, building the source string from the calling VIs call chain in a standard LabVIEW fashon.  Builds source string as:
# "Calling VI in Calling VI's Caller->Calling VI's Caller's Caller->etc...->etc..."
# Optional 'String to Prepend to source ("")' string input is used to add extra descriptive info to the source string.  This string, if present, will be enclosed in parenthesis and prepended to the source string.
inputs:
  "code": i32, required
  "String to Prepend to source (\"\")": string
outputs:
  "error out": error
diagram:
  Call Chain() -> (callchain=w1)
  Delete From Array(inArray=w1, length (1)=1, index0=0) -> w2
  Delete From Array(inArray=w2, length (1)=1, index0=0) -> (outArray=w3, deleted=w4)
  case ($"String to Prepend to source (\"\")") {
    frame "" {
      w5 = $"String to Prepend to source (\"\")"
    }
    frame Default {
      Format Into String(formatString="(%s) ", $"String to Prepend to source (\"\")") -> w5
    }
  }
  Array Size(array=w2) -> (size(s)=w6)
  # Builds source string as "Calling VI in Calling VI's Caller->Calling VI's Caller's Caller->etc...->etc..."
  case (w6) {
    frame 1 {
      w7 = ""
    }
    frame Default {
      w7 = " in "
    }
  }
  Array To Spreadsheet String(array=w3, delimiter="->", format string="%s") -> (spreadsheet string=w8)
  Concatenate Strings(w5, w4, w7, w8) -> w9
  w10 = TRUE  # status
  Property Node(instance in=no error, "status"=w10, "code"=$code, "source"=w9) -> (instance out=w11)
  $"error out" <- w11
