vi "Filter Error Codes (Array).gvi"   [LabVIEW Platform Developer Preview 0.1.0]
# Filters Error In if matches Error Code to Filter. An Upstream Error can be optionally merged with the resulting filtered error.
inputs:
  "Error Codes to Filter": i32[], required
  "Error In": error, required
  "Upstream Error (optional)": error
outputs:
  "Filtered Error Details": "Filtered Error Details - Cluster.gtype"  # The error out cluster passes error or warning information out of a VI to be used by other VIs. The pop-up option Explain Error (or Explain Warning) gives more information about the error displayed.
  "Error Filtered?": bool
  "Error Out": error
types:
  "Filtered Error Details - Cluster.gtype" = cluster{"code": i32, "source": string}
uses:
  OpenG.Error::Clear All Errors.gvi
diagram:
  w1 = "Filtered Error Details - Cluster.gtype" {all zero or empty}  # filtered error details
  # Default values of output
  w2 = FALSE  # error filtered?
  case ($"Error In") {  # Error?
    frame No Error {
      # No Error: Do nothing
      w3 = $"Error In"
      w4 = w1
      w5 = w2
    }
    frame Error {
      # >found?>
      Property Node(instance in=$"Error In") -> ("code"=w6, "source"=w7)
      # Error: Check for Filter
      # Is Error Code in list to filter
      Search 1D Array(1D array=$"Error Codes to Filter", element=w6) -> (index of element=w8)
      Is Greater Or Equal To 0(x=w8) -> w9
      case (w9) {  # Clear Error?
        frame False, Default {
          # Error Not Found: Do nothing (use default outputs)
          w4 = w1
          w5 = w2
          w3 = $"Error In"
        }
        frame True {
          # Error Found: Clear it
          call "Clear All Errors.gvi"(Error In=$"Error In") -> (Error Out=w3)
          # Set "filtered error details"
          w10 = TRUE  # error filtered = TRUE
          # Clear Error Cluster
          Property Node(instance in=w1, "code"=w6, "source"=w7) -> (instance out=w4)
          w5 = w10
        }
      }
    }
  }
  $"Error Filtered?" <- w5
  Merge Errors($"Upstream Error (optional)", w3) -> (error out=w11)
  $"Error Out" <- w11
  $"Filtered Error Details" <- w4
