vi "Filter Error Codes (Scalar).gvi"   [LabVIEW Platform Developer Preview 0.1.0]
# Filters Error In if matches Error Code to Filter. An Upstream Error can be optionally merged with the resulting filtered error.
inputs:
  "Error Code to Filter": i32, required
  "Error In": error, required
  "Upstream Error (optional)": error
outputs:
  "Filtered Error Details": "Filtered Error Details - Cluster.gtype"  # The error out cluster passes error or warning information out of a VI to be used by other VIs. The pop-up option Explain Error (or Explain Warning) gives more information about the error displayed.
  "Error Filtered?": bool
  "Error Out": error
types:
  "Filtered Error Details - Cluster.gtype" = cluster{"code": i32, "source": string}
uses:
  OpenG.Error::Filter Error Codes (Array).gvi
diagram:
  Build Array($"Error Code to Filter") -> w1
  call "Filter Error Codes (Array).gvi"(Error Codes to Filter=w1, Error In=$"Error In", Upstream Error (optional)=$"Upstream Error (optional)") -> (Filtered Error Details=w2, Error Filtered?=w3, Error Out=w4)
  $"Filtered Error Details" <- w2
  $"Error Filtered?" <- w3
  $"Error Out" <- w4
