vi "Append Path to Root if Relative - Scalar.gvi"   [LabVIEW Platform Developer Preview 0.1.0]
# Ouputs "Absolute or Relative Path". If "Absolute or Relative Path" is relative it is appended to "Root Path". If "Absolute or Relative Path" is absolute it is passed straight through.
inputs:
  "Root Path": path, required
  "Absolute or Relative Path": path, required
outputs:
  "Absolute or Appended Path": path
types:
  T1 = enum{"Absolute path", "Relative path", "Not-a-path"}
diagram:
  # /*coerce I16 to U16 so typecast will work*/
  w1 = T1 "Absolute path"  # Path Type
  Path Type(path=$"Absolute or Relative Path") -> (type=w2)
  To Unsigned Word Integer(number=w2) -> w3
  Type Cast(type=w1, x=w3) -> w4
  case (w4) {
    frame "Absolute path" {
      # /*Pass absolute paths through*/
      w5 = $"Absolute or Relative Path"
    }
    frame "Not-a-path" {
      # /*Not-a-path is an error*/
      w5 = $"Absolute or Relative Path"
    }
    frame "Relative path" {
      # /*Relative path Targets are relative to Build Root so append*/
      Build Path(base path=$"Root Path", name or relative path=$"Absolute or Relative Path") -> (appended path=w5)
    }
  }
  $"Absolute or Appended Path" <- w5
