vi "Current VI's Path.gvi"   [LabVIEW Platform Developer Preview 0.1.0]
# Returns the current VI's path + relative path.
inputs:
  "Relative path (.)": path = path "."
outputs:
  "Current VI's Path (+ Relative)": path
diagram:
  Call Chain() -> (callchain=w1)
  Array Index(array=w1)
  Open VI Reference() -> (error out=w2, vi reference=w3)
  Property Node[IsPlaceholderNodeForConversion=True](instance in=w3, error in=w2) -> ("Path"=w4, error out=w5, instance out=w6)
  Close Reference(error in (no error)=w5, reference=w6)
  Build Path(base path=w4, name or relative path=$"Relative path (.)") -> (appended path=w7)
  $"Current VI's Path (+ Relative)" <- w7
