vi "Default Directory.gvi"   [LabVIEW Platform Developer Preview 0.1.0]
# Returns the default directory + relative path.
inputs:
  "Relative path (.)": path = path "."
outputs:
  "Default Directory (+ Relative)": path
diagram:
  DefaultDirectory() -> (path Output 0=w1)  # DefaultDirectory (Placeholder)
  Build Path(base path=w1, name or relative path=$"Relative path (.)") -> (appended path=w2)
  $"Default Directory (+ Relative)" <- w2
