vi "VI Tree - file.gvi"   [LabVIEW Platform Developer Preview 0.1.0]
panel controls:
  "Case Constant (See Context Help)": bool
    # LabVIEW created this control from a constant that was wired to a Case structure. In LabVIEW 7.1 and earlier, subVIs could be kept in memory by wiring a constant to a Case structure and placing the subVI in a case that would not be executed. For example, you could wire a True constant to the Case structure and place a subVI in the False case of the Case structure, and LabVIEW would load the subVI along with the calling VI. This no longer works in LabVIEW 8.0 because the Case structure is optimized to remove code that will not be executed. Changing the constant to a control ensures that this VI behaves as it did in LabVIEW 7.1 and earlier. If the intent is not to keep subVIs in memory, you can change this control back to a constant by right-clicking the control and selecting Change to Constant from the shortcut menu. The proper way to keep a subVI in memory without calling it is to use a Static VI Reference.
uses:
  OpenG.File::File Exists - Scalar.gvi
  OpenG.File::Copy with Options.gvi
  OpenG.File::Build Path - Traditional.gvi
  OpenG.File::Application Directory.gvi
  OpenG.File::List Top Level VIs.gvi
  OpenG.File::Force File Move.gvi
  OpenG.File::Create Dir if Non-Existant.gvi
  OpenG.File::Current VIs Parent Directory.gvi
  OpenG.File::User Library.gvi
  OpenG.File::Delete Recursive.gvi
  OpenG.File::Current VI's Path.gvi
  OpenG.File::Instrument Library.gvi
  OpenG.File::List Directory Recursive.gvi
  OpenG.File::Default Directory.gvi
  OpenG.File::List Directory.gvi
  OpenG.File::File Info.gvi
  OpenG.File::OpenG Library.gvi
  OpenG.File::Temporary Filename.gvi
  OpenG.File::Set VI Top Level.gvi
  OpenG.File::Temporary Directory.gvi
  OpenG.File::Merge Directories.gvi
  OpenG.File::VI Library.gvi
  OpenG.File::Convert VI Libraries to Dirs (proxy).gvi
  OpenG.File::Strip Path Extension - Path.gvi
  OpenG.File::Valid Path - Traditional.gvi
  OpenG.File::Convert Dirs to VI Libraries (proxy).gvi
  OpenG.File::Strip Path - Traditional.gvi
  OpenG.File::Convert File Extension (Path).gvi
  OpenG.File::Compare Two Paths - Scalar.gvi
  OpenG.File::Append Path to Root if Relative - Scalar.gvi
  OpenG.File::Compare File Binary.gvi
diagram:
  case ($"Case Constant (See Context Help)") {
    frame False, Default { }
    frame True {
      call "File Exists - Scalar.gvi"(file path=path "")
      call "Copy with Options.gvi"(source path=path "", target path=path "")
      call "Build Path - Traditional.gvi"(base path=path "", name or relative path="")
      call "Application Directory.gvi"()
      call "List Top Level VIs.gvi"(LLB Path=path "")  # List Top Level VIs.vi
      call "Force File Move.gvi"(target=path "", source=path "")
      call "Create Dir if Non-Existant.gvi"(Directory Path=path "")
      call "Current VIs Parent Directory.gvi"()
      call "User Library.gvi"()
      call "Delete Recursive.gvi"(Path=path "")
      call "Current VI's Path.gvi"()
      call "Instrument Library.gvi"()
      call "List Directory Recursive.gvi"(Path=path "")
      call "Default Directory.gvi"()
      call "List Directory.gvi"(directory path=path "")
      call "File Info.gvi"(file=path "")
      call "OpenG Library.gvi"()
      call "Temporary Filename.gvi"()
      call "Set VI Top Level.gvi"(VI Path=path "")  # Set VI Top Level.vi
      call "Temporary Directory.gvi"()
      call "Merge Directories.gvi"(source directory path=path "", target directory path=path "")
      call "VI Library.gvi"()
      call "Convert VI Libraries to Dirs (proxy).gvi"()  # Convert VI Libraries to Dirs (proxy).vi
      call "Strip Path Extension - Path.gvi"(path=path "")
      call "Valid Path - Traditional.gvi"(path=path "")
      call "Convert Dirs to VI Libraries (proxy).gvi"()  # Convert Dirs to VI Libraries (proxy).vi
      call "Strip Path - Traditional.gvi"(path=path "")
      call "Convert File Extension (Path).gvi"(file name=path "")
      call "Compare Two Paths - Scalar.gvi"(path1=path "", path2=path "")
      call "Append Path to Root if Relative - Scalar.gvi"(Root Path=path "", Absolute or Relative Path=path "")
      call "Compare File Binary.gvi"(original file=path "", copy file=path "")
    }
  }
