vi "VI Tree - Large File.gvi"   [LabVIEW Platform Developer Preview 0.1.0]
uses:
  OpenG.Large File::LF Open File.gvi
  OpenG.Large File::LF Read File (STR).gvi
  OpenG.Large File::LF Write File (STR).gvi
  OpenG.Large File::LF End Of File.gvi
  OpenG.Large File::LF Seek File.gvi
  OpenG.Large File::LF Read File (I16).gvi
  OpenG.Large File::LF Write File (I16).gvi
  OpenG.Large File::LFU Error Handler.gvi
  OpenG.Large File::LF Read File (I32).gvi
  OpenG.Large File::LF Write File (I32).gvi
  OpenG.Large File::LF Read File (SGL).gvi
  OpenG.Large File::LF Write File (SGL).gvi
  OpenG.Large File::LF Read File (DBL).gvi
  OpenG.Large File::LF Write File (DBL).gvi
  OpenG.Large File::LF Read File (U32).gvi
  OpenG.Large File::LF Write File (U32).gvi
  OpenG.Large File::LFU Retrieve File Handle.gvi
  OpenG.Large File::LFU Get File Size.gvi
  OpenG.Large File::LFU Set End Of File.gvi
  OpenG.Large File::LFU Set File Pointer.gvi
diagram:
  call "LF Open File.gvi"()
  call "LF Read File (STR).gvi"()
  call "LF Write File (STR).gvi"()
  call "LF End Of File.gvi"()
  call "LF Seek File.gvi"()
  call "LF Read File (STR).gvi"()
  call "LF Write File (STR).gvi"()
  call "LF Read File (I16).gvi"()
  call "LF Write File (I16).gvi"()
  call "LFU Error Handler.gvi"()
  call "LF Read File (I32).gvi"()
  call "LF Write File (I32).gvi"()
  call "LF Read File (SGL).gvi"()
  call "LF Write File (SGL).gvi"()
  call "LF Read File (DBL).gvi"()
  call "LF Write File (DBL).gvi"()
  call "LF Read File (U32).gvi"()
  call "LF Write File (U32).gvi"()
  call "LFU Retrieve File Handle.gvi"()
  call "LFU Get File Size.gvi"()
  call "LFU Set End Of File.gvi"()
  call "LFU Set File Pointer.gvi"()
