vi "Conditional Auto-Indexing Tunnel (GObj-REF).gvi"   [LabVIEW Platform Developer Preview 0.1.0]
# This polymorphic VI filters Array In by keeping only those elements where corresponding elements in Elements to keep are TRUE.
inputs:
  "Elements to keep": bool[], required
  "Array in": GenericRefnum[], required
outputs:
  "Filtered Array out": GenericRefnum[]
diagram:
  Boolean To Integer(Boolean=$"Elements to keep") -> (0, 1=w1)
  To Unsigned Long Integer(number=w1) -> w2
  # Get number of elements to keep. This is the sum of the true elements.
  Add Array Elements(numeric array=w2) -> (sum=w3)
  s1 = -1  # shift register
  for (N = w3) {
    Increment(x=s1) -> w5
    # Find the next element to keep
    Search 1D Array(1D array=$"Elements to keep", element=TRUE, start index (0)=w5) -> (index of element=w6)
    # index out that element
    Array Index(array=$"Array in") -> (out0[w6]=w7)
    append w7 to w4
    next s1 = w6
  }
  $"Filtered Array out" <- w4
