vi "Delete Elements from 1D Array (LVObject).gvi"   [LabVIEW Platform Developer Preview 0.1.0]
# This polymorphic VI deletes elements from a 1D or 2D array at the corresponding indices, returning array w/ subset deleted and deleted elements.  For 2D arrays, wire the delete (rows or columns) input to specify whether to delete rows or columns.
inputs:
  "array": gObject[], required
  "indices": i32[], required
outputs:
  "array w/ subset deleted": gObject[]
  "deleted elements": gObject[]
uses:
  openg::library::array::Sort 1D Array (I32).gvi
  openg::library::array::Reorder 1D Array2 (LVObject).gvi
diagram:
  # Sort Indices, descending, to delete array elements from the back of the array to the front.
  call "Sort 1D Array (I32).gvi"(Array in=$indices, Order="descending") -> (Sorted Array out=w1, Sorted Pointers=w2)
  s1 = $array  # shift register
  for {  # For Each element to delete
    w3 = each element of w1
    # delete element
    Delete From Array(inArray=s1, index0=w3) -> (outArray=w5, deleted=w6)
    append w6 to w4
    next s1 = w5
  }
  $"array w/ subset deleted" <- s1
  # sorted pointers
  # Reorder the deleted elements by getting the sorted pointers of the sorted pointers -- this is order of the deleted elements.
  call "Sort 1D Array (I32).gvi"(Array in=w2, Order="ascending") -> (Sorted Pointers=w7)
  call "Reorder 1D Array2 (LVObject).gvi"(array=w4, indices=w7) -> (reordered array=w8)
  $"deleted elements" <- w8
