vi "Delete Elements from 2D Array (CSG).gvi"   [LabVIEW Platform Developer Preview 0.1.0]
# This polymorphic VI deletes elements from a 1D or 2D array at the corresponding indices, returning array w/ subset deleted and deleted elements.  For 2D arrays, wire the delete (rows or columns) input to specify whether to delete rows or columns.
inputs:
  "array": c64[][], required
  "indices": i32[], required
  "delete (rows or columns)": enum{"rows", "columns"} = "rows", required
outputs:
  "array w/ subset deleted": c64[][]
  "deleted elements": c64[][]
uses:
  openg::library::array::Sort 1D Array (I32).gvi
  openg::library::array::Reorder 2D Array2 (CSG).gvi
diagram:
  # Sort Indices, descending, to delete array elements from the back of the array to the front.
  call "Sort 1D Array (I32).gvi"(Array in=$indices, Order="descending") -> (Sorted Array out=w1, Sorted Pointers=w2)
  case ($"delete (rows or columns)") {
    frame "rows" {
      s1 = $array  # shift register
      for {  # For Each row to delete
        w6 = each element of w1
        # delete row
        Delete From Array(inArray=s1, index0=w6) -> (outArray=w7, deleted=w8)
        append w8 to w4
        next s1 = w7
      }
      w3 = s1
      w5 = "rows"
    }
    frame "columns" {
      s2 = $array  # shift register
      for {  # For each column to delete
        w9 = each element of w1
        # delete column
        Delete From Array(inArray=s2, index1=w9) -> (outArray=w11, deleted=w12)
        append w12 to w10
        next s2 = w11
      }
      # Convert to columns
      Transpose 2D Array(2D array=w10) -> (transposed array=w4)
      w3 = s2
      w5 = "columns"
    }
  }
  $"array w/ subset deleted" <- w3
  Array Size(array=$array) -> (size(s)=w13)
  Array Index(array=w13)
  # sorted pointers
  # Reorder the deleted elements by getting the sorted pointers of the sorted pointers -- this is order of the deleted elements.
  call "Sort 1D Array (I32).gvi"(Array in=w2, Order="ascending") -> (Sorted Pointers=w14)
  call "Reorder 2D Array2 (CSG).gvi"(array=w4, indices=w14, reorder (rows)=w5) -> (reordered array=w15)
  $"deleted elements" <- w15
