vi "Empty 1D Array (LVObject).gvi"   [LabVIEW Platform Developer Preview 0.1.0]
# Returns TRUE if Array is empty (any dimension has length equal zero). Otherwise, this function returns FALSE.
inputs:
  "Array": gObject[], required
outputs:
  "Empty Array?": bool
diagram:
  Array Size(array=$Array) -> (size(s)=w1)
  Is Equal To 0(x=w1) -> w2
  $"Empty Array?" <- w2
