vi "Empty Array (Variant).gvi"   [LabVIEW Platform Developer Preview 0.1.0]
# Returns TRUE if Array is empty (any dimension has length equal zero). Otherwise, this function returns FALSE.
inputs:
  "Array": variant, required
outputs:
  "Empty Array?": bool
uses:
  openg::library::variant data::Array Size(s).gvi
diagram:
  call "Array Size(s).gvi"(Array=$Array) -> (Size(s)=w1)
  Is Equal To 0(x=w1) -> w2
  Or Array Elements(Boolean array=w2) -> (logical OR=w3)
  $"Empty Array?" <- w3
