vi "Filter 1D Array (LVObject).gvi"   [LabVIEW Platform Developer Preview 0.1.0]
# This polymorphic VI filters out all instances of items to filter from the input array and outputs the result as filtered array along with an array of filtered item indices containing the indices of the items that were filtered.  You can wire either a 1D array or a scalar value to items to filter.
inputs:
  "array": gObject[], required
  "items to filter": gObject[], required
outputs:
  "filtered array": gObject[]
  "filtered item indices": i32[]
uses:
  openg::library::array::Remove Duplicates from 1D Array (LVObject).gvi
  openg::library::array::Search 1D Array (LVObject).gvi
  openg::library::array::Delete Elements from 1D Array (LVObject).gvi
diagram:
  call "Remove Duplicates from 1D Array (LVObject).gvi"(Input Array=$"items to filter") -> (Output Array=w1)
  s1 = i32[] []  # shift register
  for {
    w2 = each element of w1
    call "Search 1D Array (LVObject).gvi"(Array=$array, Element Data=w2) -> (Indices of Elements=w3)
    Build Array[ConcatenateInputs=True](s1, w3) -> w4
    next s1 = w4
  }
  call "Delete Elements from 1D Array (LVObject).gvi"(array=$array, indices=s1) -> (array w/ subset deleted=w5)
  $"filtered array" <- w5
  $"filtered item indices" <- s1
