vi "Filter 1D Array with Scalar (CSG).gvi"   [LabVIEW Platform Developer Preview 0.1.0]
# This polymorphic VI filters out all instances of items to filter from the input array and outputs the result as filtered array along with an array of filtered item indices containing the indices of the items that were filtered.  You can wire either a 1D array or a scalar value to items to filter.
inputs:
  "array": c64[], required
  "items to filter": c64, required
outputs:
  "filtered array": c64[]
  "filtered item indices": i32[]
uses:
  openg::library::array::Search 1D Array (CSG).gvi
  openg::library::array::Delete Elements from 1D Array (CSG).gvi
diagram:
  call "Search 1D Array (CSG).gvi"(Array=$array, Element Data=$"items to filter") -> (Indices of Elements=w1)
  call "Delete Elements from 1D Array (CSG).gvi"(array=$array, indices=w1) -> (array w/ subset deleted=w2)
  $"filtered array" <- w2
  $"filtered item indices" <- w1
