vi "Remove Duplicates from 1D Array (Boolean).gvi"   [LabVIEW Platform Developer Preview 0.1.0]
# This polymorphic VI removes all duplicate elements in Input Array and outputs the result as Output Array.  It also outputs the indices of removed elements.
inputs:
  "Input Array": bool[], required
outputs:
  "Output Array": bool[]
  "indices of removed elements": i32[]
diagram:
  # Build empty array of same type as input array
  Array Index(array=$"Input Array") -> (out0[_]=w1)
  Initialize Array(element=w1, size=0) -> w2
  s1 = w2  # shift register
  s2 = i32[] []  # shift register
  for (iteration -> i1) {
    w3 = each element of $"Input Array"
    Search 1D Array(1D array=s1, element=w3) -> (index of element=w4)
    case (w4) {
      frame Default {
        Build Array[ConcatenateInputs=True](s2, i1) -> w6
        w5 = s1
      }
      frame -1 {
        Build Array[ConcatenateInputs=True](s1, w3) -> w5
        w6 = s2
      }
    }
    next s1 = w5
    next s2 = w6
  }
  $"indices of removed elements" <- s2
  $"Output Array" <- s1
