vi "Remove Duplicates from 1D Array (LVObject).gvi"   [LabVIEW Platform Developer Preview 0.1.0]
# This polymorphic VI removes all duplicate elements in Input Array and outputs the result as Output Array.  It also outputs the indices of removed elements.
inputs:
  "Input Array": gObject[], required
outputs:
  "Output Array": gObject[]
  "indices of removed elements": i32[]
diagram:
  s1 = gObject[] []  # shift register
  s2 = i32[] []  # shift register
  for (iteration -> i1) {
    w1 = each element of $"Input Array"
    Search 1D Array(1D array=s1, element=w1) -> (index of element=w2)
    case (w2) {
      frame Default {
        Build Array[ConcatenateInputs=True](s2, i1) -> w4
        w3 = s1
      }
      frame -1 {
        Build Array[ConcatenateInputs=True](s1, w1) -> w3
        w4 = s2
      }
    }
    next s1 = w3
    next s2 = w4
  }
  $"indices of removed elements" <- s2
  $"Output Array" <- s1
