vi "Reorder 2D Array (Variant).gvi"   [LabVIEW Platform Developer Preview 0.1.0]
# This polymorphic VI reorders by row or by column, a 2D array of any size based on the sorted pointers you specify.
# THIS VI IS DEPRICATED.  Please use "Reorder Array2" (or newer version), available as "Reorder Array" from the Functions palette.
inputs:
  "Array in": variant[][], required
  "Sorted Pointers in": i32[], required
  "Sort By in": enum{"row", "column"} = "row"
outputs:
  "Sorted Array out": variant[][]
  "Sorted Pointers out": i32[]
  "Sort By out": enum{"row", "column"}
diagram:
  $"Sorted Pointers out" <- $"Sorted Pointers in"
  # Transpose the Array if reordering by columns.
  case ($"Sort By in") {
    frame "column" {
      Transpose 2D Array(2D array=$"Array in") -> (transposed array=w1)
    }
    frame "row" {
      # Row
      w1 = $"Array in"
    }
  }
  # Reorder 2D Array by Pointer
  for {
    w2 = each element of $"Sorted Pointers in"
    Array Index(array=w1) -> (out0[_, w2]=w4)
    append w4 to w3
  }
  # This automatically transposes the array if we were reordering by column and we have to transpose it if we were reordering by row.
  case ($"Sort By in") {
    frame "column" {
      w5 = w3
    }
    frame "row" {
      # Row
      Transpose 2D Array(2D array=w3) -> (transposed array=w5)
    }
  }
  $"Sorted Array out" <- w5
  $"Sort By out" <- $"Sort By in"
