vi "Reorder 2D Array2 (LVObject).gvi"   [LabVIEW Platform Developer Preview 0.1.0]
# This polymorphic VI reorders a 1D or 2D array of any size based on the indices you specify.  For 2D arrays, it reorders by row or by column.
inputs:
  "array": gObject[][], required
  "indices": i32[], required
  "reorder (rows)": enum{"rows", "columns"} = "rows"
outputs:
  "reordered array": gObject[][]
diagram:
  # Transpose the input array if reordering rows
  case ($"reorder (rows)") {
    frame "columns" {
      # Row
      w1 = $array
    }
    frame "rows" {
      Transpose 2D Array(2D array=$array) -> (transposed array=w1)
    }
  }
  # Reorder 2D array by pointer
  for {
    w2 = each element of $indices
    Array Index(array=w1) -> (out0[_, w2]=w4)
    append w4 to w3
  }
  # Transpose the output array if we were reordering columns
  case ($"reorder (rows)") {
    frame "columns" {
      Transpose 2D Array(2D array=w3) -> (transposed array=w5)
    }
    frame "rows" {
      w5 = w3
    }
  }
  $"reordered array" <- w5
