vi "Search 1D Array (LVObject).gvi"   [LabVIEW Platform Developer Preview 0.1.0]
# Searches for all element data matches in array
inputs:
  "Array": gObject[], required
  "Element Data": gObject, required
  "Start Index (0)": i32
outputs:
  "Indices of Elements": i32[]
diagram:
  w1 = i32[] []  # Initial Elements
  s1 = $"Start Index (0)"  # shift register
  s2 = w1  # shift register
  while {
    Search 1D Array(1D array=$Array, element=$"Element Data", start index (0)=s1) -> (index of element=w2)
    case (w2) {
      frame -1 {
        w3 = s2
      }
      frame Default {
        Build Array[ConcatenateInputs=True](s2, w2) -> w3
      }
    }
    Increment(x=w2) -> w4
    Is Greater Or Equal To 0(x=w2) -> w5
    next s1 = w4
    next s2 = w3
    continue if w5
  }
  $"Indices of Elements" <- s2
