vi "Slice 1D Array (FILE-REF).gvi"   [LabVIEW Platform Developer Preview 0.1.0]
# Returns a subset from array. subset has the following syntax:
# array[subset] = subarray
# subset is a range and is of the form "i:j" where i and j are integers
# if i is ommitted it is assumed to be zero.  If j is ommitted it is assumed to be length(array)
# if i or j are negative numbers they are assumed to be refferenced from the end of the string.
# examples:
# if array = [7,6,5,4,3,2,1]
# string[2:] = [5,4,3,2,1]
# string[:3] = [7,6,5]
# string[-1] = [1]
# string[4] = [3]
# string[-4:-2] = [4,3]
inputs:
  "array": ByteStreamFileRefnum[], required
  "slice": string, required
outputs:
  "subarray (array[i:j])": ByteStreamFileRefnum[]
uses:
  openg::library::string::Trim Whitespace (String).gvi
diagram:
  Match Pattern(regular expression=":", string=$slice) -> (after substring=w1, before substring=w2, offset past match=w3)
  call "Trim Whitespace (String).gvi"(String in=w2) -> (String out=w4)
  call "Trim Whitespace (String).gvi"(String in=w1) -> (String out=w5)
  case (w3) {
    frame Default {
      Is Empty String Or Path(string/path=w4) -> w8
      Scan From String(formatString="%d", inputString=w4) -> (out0=w9)
      Is Less Than 0(x=w9) -> w10
      Array Size(array=$array) -> (size(s)=w11)
      Add(w11, w9) -> w12
      Select(s=w10, t=w12, f=w9) -> w13
      Select(s=w8, t=0, f=w13) -> w7
      Is Empty String Or Path(string/path=w5) -> w14
      Scan From String(formatString="%d", inputString=w5) -> (out0=w15)
      Is Less Than 0(x=w15) -> w16
      Add(w11, w15) -> w17
      Select(s=w16, t=w17, f=w15) -> w18
      Select(s=w14, t=w11, f=w18) -> w6
    }
    frame -1 {
      Scan From String(formatString="%d", inputString=w4) -> (out0=w19)
      Is Less Than 0(x=w19) -> w20
      Array Size(array=$array) -> (size(s)=w21)
      Add(w21, w19) -> w22
      Select(s=w20, t=w22, f=w19) -> w7
      Increment(x=w7) -> w6
    }
  }
  Subtract(x=w6, y=w7) -> w23
  Array Subset(array=$array, index0=w7, length0=w23) -> w24
  $"subarray (array[i:j])" <- w24
