vi "Sort 1D Array (CDB).gvi"   [LabVIEW Platform Developer Preview 0.1.0]
# This polymorphic VI sorts a 1D array of numerics or strings, regardless of the array size. You can specify whether to sort in ascending or descending order.
inputs:
  "Array in": c128[], required
  "Order": enum{"ascending", "descending"} = "ascending"
  "Method (magnitude)": enum{"real", "imaginary", "magnitude"} = "magnitude"
outputs:
  "Sorted Array out": c128[]
  "Sorted Pointers": i32[]
uses:
  openg::library::array::Reorder 1D Array (CDB).gvi
diagram:
  # Bundle Sort List with Pointer
  for (iteration -> i1) {
    w1 = each element of $"Array in"
    case ($"Method (magnitude)") {
      frame "magnitude" {
        Absolute Value(x=w1) -> w3
      }
      frame "real" {
        Complex To Real Imaginary(x + iy=w1) -> (x=w3)
      }
      frame "imaginary" {
        Complex To Real Imaginary(x + iy=w1) -> (y=w3)
      }
    }
    w4 = cluster{"Element 1": f64, "Element 2": i32} {all zero or empty}
    Property Node(instance in=w4, "Element 1"=w3, "Element 2"=i1) -> (instance out=w5)
    append w5 to w2
  }
  Sort 1D Array(array=w2) -> (sorted array=w6)
  # Sort Cluster
  case ($Order) {
    frame "ascending", Default {
      w7 = w6
    }
    frame "descending" {
      # descending
      Reverse 1D Array(array=w6) -> (reversed array=w7)
    }
  }
  # Sort 1D Array by Pointer
  for {
    w8 = each element of w7
    Property Node(instance in=w8) -> ("Element 2"=w10)
    append w10 to w9
  }
  call "Reorder 1D Array (CDB).gvi"(Array in=$"Array in", Sorted Pointers in=w9) -> (Sorted Array out=w11)
  $"Sorted Array out" <- w11
  $"Sorted Pointers" <- w9
