vi "Sort 1D Array (String).gvi"   [LabVIEW Platform Developer Preview 0.1.0]
# This polymorphic VI sorts a 1D array of numerics or strings, regardless of the array size. You can specify whether to sort in ascending or descending order.
inputs:
  "Array in": string[], required
  "Order": enum{"ascending", "descending"} = "ascending"
outputs:
  "Sorted Array out": string[]
  "Sorted Pointers": i32[]
diagram:
  # Bundle Sort List with Pointer
  for (iteration -> i1) {
    w1 = each element of $"Array in"
    w3 = cluster{"String": string, "Element 2": i32} {all zero or empty}
    Property Node(instance in=w3, "String"=w1, "Element 2"=i1) -> (instance out=w4)
    append w4 to w2
  }
  Sort 1D Array(array=w2) -> (sorted array=w5)
  # Sort Cluster
  case ($Order) {
    frame "ascending", Default {
      w6 = w5
    }
    frame "descending" {
      # descending
      Reverse 1D Array(array=w5) -> (reversed array=w6)
    }
  }
  # Sort 1D Array by Pointer
  for {
    w7 = each element of w6
    Property Node(instance in=w7) -> ("String"=w10, "Element 2"=w11)
    append w10 to w8
    append w11 to w9
  }
  $"Sorted Array out" <- w8
  $"Sorted Pointers" <- w9
