vi "Sort 1D Array (U8).gvi"   [LabVIEW Platform Developer Preview 0.1.0]
# This polymorphic VI sorts a 1D array of numerics or strings, regardless of the array size. You can specify whether to sort in ascending or descending order.
inputs:
  "Array in": u8[], required
  "Order": enum{"ascending", "descending"} = "ascending"
outputs:
  "Sorted Array out": u8[]
  "Sorted Pointers": i32[]
diagram:
  # Bundle Sort List with Pointer
  for (iteration -> i1) {
    w1 = each element of $"Array in"
    Property Node(instance in=cluster{"Numeric": u8, "Element 2": i32} {all zero or empty}, "Numeric"=w1, "Element 2"=i1) -> (instance out=w3)
    append w3 to w2
  }
  Sort 1D Array(array=w2) -> (sorted array=w4)
  # Sort Cluster
  case ($Order) {
    frame "ascending", Default {
      w5 = w4
    }
    frame "descending" {
      # descending
      Reverse 1D Array(array=w4) -> (reversed array=w5)
    }
  }
  # Sort 1D Array by Pointer
  for {
    w6 = each element of w5
    Property Node(instance in=w6) -> ("Numeric"=w9, "Element 2"=w10)
    append w9 to w7
    append w10 to w8
  }
  $"Sorted Array out" <- w7
  $"Sorted Pointers" <- w8
