vi "Sort 2D Array (Path).gvi"   [LabVIEW Platform Developer Preview 0.1.0]
# This polymorphic VI sorts a 2D array of numerics or strings, regardless of the array size. You can specify whether to sort by column or row, which column or row to sort by, and whether to sort in ascending or descending order. You also can specify a secondary row or column to sort by.
inputs:
  "Array in": path[][], required
  "Order": enum{"ascending", "descending"} = "ascending"
  "Sort By in": enum{"row", "column"} = "row"
  "Column/Row to Sort By": u32
outputs:
  "Sorted Array out": path[][]
  "Sorted Pointers": i32[]
  "Index Out of Range?": bool
  "Sort By out": enum{"row", "column"}
diagram:
  Array Size(array=$"Array in") -> (size(s)=w1)
  Decrement(x=w1) -> w2
  # Transpose the Array if sorting by columns and check whether either sorting index is out of range.
  case ($"Sort By in") {
    frame "column" {
      Transpose 2D Array(2D array=$"Array in") -> (transposed array=w3)
      Array Index(array=w2) -> (out0[1]=w5)
      Is Greater(x=$"Column/Row to Sort By", y=w5) -> w4
    }
    frame "row" {
      Array Index(array=w2) -> (out0[0]=w6)
      # Row
      Is Greater(x=$"Column/Row to Sort By", y=w6) -> w4
      w3 = $"Array in"
    }
  }
  Array Index(array=w3) -> (out0[$"Column/Row to Sort By", _]=w7)
  # Bundle Sort List with Pointer
  for (iteration -> i1) {
    w8 = each element of w7
    Property Node(instance in=cluster{"Path": path, "Element 2": i32} {all zero or empty}, "Path"=w8, "Element 2"=i1) -> (instance out=w10)
    append w10 to w9
  }
  Sort 1D Array(array=w9) -> (sorted array=w11)
  # Sort Cluster
  case ($Order) {
    frame "ascending", Default {
      w12 = w11
    }
    frame "descending" {
      # descending
      Reverse 1D Array(array=w11) -> (reversed array=w12)
    }
  }
  # Sort 2D Array by Pointer
  for {
    w13 = each element of w12
    Property Node(instance in=w13) -> ("Element 2"=w16)
    Array Index(array=w3) -> (out0[_, w16]=w17)
    append w17 to w14
    append w16 to w15
  }
  $"Sorted Pointers" <- w15
  # This automatically transposes the array if we were sorting by column and we have to transpose it if we were sorting by row.
  case ($"Sort By in") {
    frame "column" {
      w18 = w14
    }
    frame "row" {
      # Row
      Transpose 2D Array(2D array=w14) -> (transposed array=w18)
    }
  }
  $"Sorted Array out" <- w18
  $"Sort By out" <- $"Sort By in"
  $"Index Out of Range?" <- w4
