vi "Sort 2D Array (String).gvi"   [LabVIEW Platform Developer Preview 0.1.0]
# This polymorphic VI sorts a 2D array of numerics or strings, regardless of the array size. You can specify whether to sort by column or row, which column or row to sort by, and whether to sort in ascending or descending order. You also can specify a secondary row or column to sort by.
inputs:
  "Array in": string[][], required
  "Order": enum{"ascending", "descending"} = "ascending"
  "Sort By in": enum{"row", "column"} = "row"
  "Column/Row to Sort By": u32
outputs:
  "Sorted Array out": string[][]
  "Sorted Pointers": i32[]
  "Index Out of Range?": bool
  "Sort By out": enum{"row", "column"}
diagram:
  Array Size(array=$"Array in") -> (size(s)=w1)
  Decrement(x=w1) -> w2
  # Transpose the Array if sorting by columns and check whether either sorting index is out of range.
  case ($"Sort By in") {
    frame "column" {
      Transpose 2D Array(2D array=$"Array in") -> (transposed array=w3)
      Array Index(array=w2) -> (out0[1]=w5)
      Is Greater(x=$"Column/Row to Sort By", y=w5) -> w4
    }
    frame "row" {
      Array Index(array=w2) -> (out0[0]=w6)
      # Row
      Is Greater(x=$"Column/Row to Sort By", y=w6) -> w4
      w3 = $"Array in"
    }
  }
  Array Index(array=w3) -> (out0[$"Column/Row to Sort By", _]=w7)
  # Bundle Sort List with Pointer
  for (iteration -> i1) {
    w8 = each element of w7
    w10 = cluster{"String": string, "Element 2": i32} {all zero or empty}
    Property Node(instance in=w10, "String"=w8, "Element 2"=i1) -> (instance out=w11)
    append w11 to w9
  }
  Sort 1D Array(array=w9) -> (sorted array=w12)
  # Sort Cluster
  case ($Order) {
    frame "ascending", Default {
      w13 = w12
    }
    frame "descending" {
      # descending
      Reverse 1D Array(array=w12) -> (reversed array=w13)
    }
  }
  # Sort 2D Array by Pointer
  for {
    w14 = each element of w13
    Property Node(instance in=w14) -> ("Element 2"=w17)
    Array Index(array=w3) -> (out0[_, w17]=w18)
    append w18 to w15
    append w17 to w16
  }
  $"Sorted Pointers" <- w16
  # This automatically transposes the array if we were sorting by column and we have to transpose it if we were sorting by row.
  case ($"Sort By in") {
    frame "column" {
      w19 = w15
    }
    frame "row" {
      # Row
      Transpose 2D Array(2D array=w15) -> (transposed array=w19)
    }
  }
  $"Sorted Array out" <- w19
  $"Sort By out" <- $"Sort By in"
  $"Index Out of Range?" <- w4
