vi "VI Tree - xxx- Files.gvi"   [LabVIEW Platform Developer Preview 0.1.0]
uses:
  openg::library::array::Filter 1D Array with Scalar (xxx).gvi
  openg::library::array::Conditional Auto-Indexing Tunnel (xxx).gvi
  openg::library::array::Filter 1D Array (xxx).gvi
  openg::library::array::Reorder 1D Array2 (xxx).gvi
  openg::library::array::Remove Duplicates from 1D Array (xxx).gvi
  openg::library::array::Reorder 1D Array (xxx).gvi
  openg::library::array::Reorder 2D Array2 (xxx).gvi
  openg::library::array::Reverse 2D Array (xxx).gvi
  openg::library::array::Reorder 2D Array (xxx).gvi
  openg::library::array::Slice 1D Array (xxx).gvi
  openg::library::array::Index 1D Array Elements (xxx).gvi
  openg::library::array::Search 1D Array (xxx).gvi
  openg::library::array::Sort 2D Array (xxx).gvi
  openg::library::array::Index 2D Array Elements (xxx).gvi
  openg::library::array::Sort 1D Array (xxx).gvi
  openg::library::array::Empty 1D Array (xxx).gvi
  openg::library::array::Delete Elements from 1D Array (xxx).gvi
  openg::library::array::Empty 2D Array (xxx).gvi
  openg::library::array::Delete Elements from 2D Array (xxx).gvi
diagram:
  call "Filter 1D Array with Scalar (xxx).gvi"(array=f64[] [], items to filter=0)
  call "Conditional Auto-Indexing Tunnel (xxx).gvi"(Elements to keep=bool[] [], Array in=f64[] [])
  call "Filter 1D Array (xxx).gvi"(array=f64[] [], items to filter=f64[] [])
  call "Reorder 1D Array2 (xxx).gvi"(array=f64[] [], indices=i32[] [])
  call "Remove Duplicates from 1D Array (xxx).gvi"(Input Array=f64[] [])
  call "Reorder 1D Array (xxx).gvi"(Array in=f64[] [], Sorted Pointers in=i32[] [])
  call "Reorder 2D Array2 (xxx).gvi"(array=f64[][] [], indices=i32[] [])  # Reorder 2D Array (xxx)
  call "Reverse 2D Array (xxx).gvi"(Array=f64[][] [])  # Reverse 2D Array (Variant)
  call "Reorder 2D Array (xxx).gvi"(Array in=f64[][] [], Sorted Pointers in=i32[] [])
  call "Slice 1D Array (xxx).gvi"(array=f64[] [], slice="")
  call "Index 1D Array Elements (xxx).gvi"(array=f64[] [], indices=i32[] [])
  call "Search 1D Array (xxx).gvi"(Array=f64[] [], Element Data=0)  # Search 1D Array for All (xxx)
  call "Sort 2D Array (xxx).gvi"(Array in=f64[][] [], Order="ascending", Sort By in="row")
  call "Index 2D Array Elements (xxx).gvi"(array=f64[][] [], indices 0=i32[] [], indices 1=i32[] [])
  call "Sort 1D Array (xxx).gvi"(Array in=f64[] [])
  call "Empty 1D Array (xxx).gvi"(Array=f64[] [])  # Empty 1D Array (DBL)?
  call "Delete Elements from 1D Array (xxx).gvi"(array=f64[] [], indices=i32[] [])
  call "Empty 2D Array (xxx).gvi"(Array=f64[][] [])  # Empty 2D Array (DBL)?
  call "Delete Elements from 2D Array (xxx).gvi"(array=f64[][] [], indices=i32[] [], delete (rows or columns)="rows")  # Delete Elements from 2D Array (xxx).vi
