vi "Filter Error Codes (Array).gvi"   [LabVIEW Platform Developer Preview 0.1.0]
# Filters Error In if matches Error Code to Filter. An Upstream Error can be optionally merged with the resulting filtered error.
inputs:
  "Error Codes to Filter": i32[], required
  "Error In": error, required
  "Upstream Error (optional)": error
outputs:
  "Filtered Error Details": "Filtered Error Details - Cluster.gtype"
  "Error Filtered?": bool
  "Error Out": error
types:
  "Filtered Error Details - Cluster.gtype" = cluster{"code": i32, "source": string}
uses:
  openg::library::error::Clear All Errors.gvi
diagram:
  # Default values of output
  w1 = FALSE  # error filtered?
  case ($"Error In") {  # Error?
    frame No Error {
      # No Error: Do nothing
      w2 = $"Error In"
      w3 = "Filtered Error Details - Cluster.gtype" {all zero or empty}
      w4 = w1
    }
    frame Error {
      # >found?>
      Property Node(instance in=$"Error In") -> ("code"=w5, "source"=w6)
      # Error: Check for Filter
      # Is Error Code in list to filter
      Search 1D Array(1D array=$"Error Codes to Filter", element=w5) -> (index of element=w7)
      Is Greater Or Equal To 0(x=w7) -> w8
      case (w8) {  # Clear Error?
        frame False, Default {
          # Error Not Found: Do nothing (use default outputs)
          w3 = "Filtered Error Details - Cluster.gtype" {all zero or empty}
          w4 = w1
          w2 = $"Error In"
        }
        frame True {
          # Error Found: Clear it
          call "Clear All Errors.gvi"(Error In=$"Error In") -> (Error Out=w2)
          # Set "filtered error details"
          w9 = TRUE  # error filtered = TRUE
          # Clear Error Cluster
          Property Node(instance in="Filtered Error Details - Cluster.gtype" {all zero or empty}, "code"=w5, "source"=w6) -> (instance out=w3)
          w4 = w9
        }
      }
    }
  }
  $"Error Filtered?" <- w4
  Merge Errors($"Upstream Error (optional)", w2) -> (error out=w10)
  $"Error Out" <- w10
  $"Filtered Error Details" <- w3
