vi "Filter Error Codes (Scalar).gvi"   [LabVIEW Platform Developer Preview 0.1.0]
# Filters Error In if matches Error Code to Filter. An Upstream Error can be optionally merged with the resulting filtered error.
inputs:
  "Error Code to Filter": i32, required
  "Error In": error, required
  "Upstream Error (optional)": error
outputs:
  "Filtered Error Details": "Filtered Error Details - Cluster.gtype"
  "Error Filtered?": bool
  "Error Out": error
types:
  "Filtered Error Details - Cluster.gtype" = cluster{"code": i32, "source": string}
uses:
  openg::library::error::Filter Error Codes (Array).gvi
diagram:
  Build Array($"Error Code to Filter") -> w1
  call "Filter Error Codes (Array).gvi"(Upstream Error (optional)=$"Upstream Error (optional)", Error Codes to Filter=w1, Error In=$"Error In") -> (Filtered Error Details=w2, Error Filtered?=w3, Error Out=w4)
  $"Filtered Error Details" <- w2
  $"Error Filtered?" <- w3
  $"Error Out" <- w4
