vi "VI Tree - error.gvi"   [LabVIEW Platform Developer Preview 0.1.0]
uses:
  openg::library::error::Build Error Cluster.gvi
  openg::library::error::Case (Error IO).gvi
  openg::library::error::Error Codes Ring Constant.gvi
  openg::library::error::Error Constant.gvi
  openg::library::error::Clear All Errors.gvi
  openg::library::error::Filter Error Codes (Array).gvi
diagram:
  call "Build Error Cluster.gvi"(code=0)
  call "Case (Error IO).gvi"()
  call "Error Codes Ring Constant.gvi"()
  call "Error Constant.gvi"()
  call "Clear All Errors.gvi"(Error In=no error)
  call "Filter Error Codes (Array).gvi"(Error Codes to Filter=i32[] [], Error In=no error)
