vi "Compare File Binary.gvi"   [LabVIEW Platform Developer Preview 0.1.0]
# Compare File Binary.vi - Compares two files to be of the same size and containing the same binary data.
inputs:
  "original file": path, required
  "copy file": path, required
  "block size (100000)": i32 = 100000
  "error in (no error)": error
outputs:
  "not equal": bool
  "error out": error
uses:
  openg::library::error::Build Error Cluster.gvi
diagram:
  File Or Directory Info(error in=$"error in (no error)", path=$"original file") -> (directory=w1, error out=w2, path out=w3, size=w4)
  File Or Directory Info(error in=w2, path=$"copy file") -> (directory=w5, error out=w6, path out=w7, size=w8)
  To Long Integer(number=w4) -> w9
  To Long Integer(number=w8) -> w10
  case (w6) {
    frame No Error {
      Is Not Equal(x=w10, y=w9) -> w13
      Is Not Equal(x=w1, y=w5) -> w14
      Logical Or(w14, w13) -> w15
      case (w15) {
        frame False, Default {
          To Unsigned Quad Integer(number="read-only") -> w16
          Open Or Create Or Replace File(access (0:read/write)=w16, error in=w6, file path (use dialog)=w7) -> (error out=w17, refnum out=w18)
          Open Or Create Or Replace File(access (0:read/write)=w16, error in=w17, file path (use dialog)=w3) -> (error out=w19, refnum out=w20)
          s1 = w20  # shift register
          s2 = w18  # shift register
          s3 = w19  # shift register
          s4 = w9  # shift register
          s5 = 0  # shift register
          while {
            Set File Position(error in=s3, offset (in bytes) (0)=s5, refnum=s2) -> (error out=w21, refnum out=w22)
            Max And Min(x=$"block size (100000)", y=s4) -> (min(x,y)=w23: i32)
            Read From Binary File(count=w23, error in=w21, file (use dialog)=w22) -> (data=w24, error out=w25, refnum out=w26)
            Get File Position(error in=w25, refnum=w26) -> (error out=w27, offset (in bytes) (0)=w28, refnum out=w29)
            To Long Integer(number=w28) -> w30
            Subtract(x=s4, y=w23) -> w31
            Is Less Or Equal To 0(x=w31) -> w32
            Set File Position(error in=w27, offset (in bytes) (0)=s5, refnum=s1) -> (error out=w33, refnum out=w34)
            Read From Binary File(count=w23, error in=w33, file (use dialog)=w34) -> (data=w35, error out=w36, refnum out=w37)
            Property Node(instance in=w36) -> ("status"=w38)
            Is Not Equal[ComparisonMode=CompareAggregates](x=w35, y=w24) -> w39
            Logical Or[output inverted](w39, w38, w32) -> w40
            next s1 = w37
            next s2 = w29
            next s3 = w36
            next s4 = w31
            next s5 = w30
            continue if w40
          }
          Property Node(instance in=s3) -> ("status"=w41)
          case (w41) {
            frame False, Default {
              case (w39) {
                frame False, Default {
                  w11 = s3
                  w12 = w39
                }
                frame True {
                  call "Build Error Cluster.gvi"(code="File not found"(7), String to Prepend to source ("")="File not Equal") -> (error out=w11)
                  w12 = w39
                }
              }
            }
            frame True {
              w11 = s3
              w12 = TRUE
            }
          }
          Close File(refnum=s2)
          Close File(refnum=s1)
        }
        frame True {
          Select(s=w13, t="Different File Size", f="Directory Type") -> w42
          call "Build Error Cluster.gvi"(code="File not found"(7), String to Prepend to source ("")=w42) -> (error out=w11)
          w12 = w15
        }
      }
    }
    frame Error {
      w11 = w6
      w12 = FALSE
    }
  }
  $"not equal" <- w12
  $"error out" <- w11
