vi "Compare Two Paths - Array.gvi"   [LabVIEW Platform Developer Preview 0.1.0]
# Compare Two Paths.vi - Compares two paths and if the paths are the same type (both absolute or both relative), the relative path between them is returned.
inputs:
  "path1": path[], required
  "path2": path[], required
outputs:
  "common path": path[]
  "relative path from 1 to 2": path[]
  "any different types?": bool
uses:
  openg::library::file::Compare Two Paths - Scalar.gvi
diagram:
  for {
    w1 = each element of $path1
    w2 = each element of $path2
    call "Compare Two Paths - Scalar.gvi"(path1=w1, path2=w2) -> (common path=w6, relative path from 1 to 2=w7, different types?=w8)
    append w8 to w3
    append w7 to w4
    append w6 to w5
  }
  $"common path" <- w5
  $"relative path from 1 to 2" <- w4
  Or Array Elements(Boolean array=w3) -> (logical OR=w9)
  $"any different types?" <- w9
