vi "Compare Two Paths - Path1 Array.gvi"   [LabVIEW Platform Developer Preview 0.1.0]
# Compare Two Paths.vi - Compares two paths and if the paths are the same type (both absolute or both relative), the relative path between them is returned.
inputs:
  "path1": path[], required
  "path2": path, required
outputs:
  "common path": path[]
  "relative path from 1 to 2": path[]
  "any different types?": bool
uses:
  openg::library::file::Compare Two Paths - Scalar.gvi
diagram:
  for {
    w1 = each element of $path1
    call "Compare Two Paths - Scalar.gvi"(path1=w1, path2=$path2) -> (common path=w5, relative path from 1 to 2=w6, different types?=w7)
    append w7 to w2
    append w6 to w3
    append w5 to w4
  }
  $"common path" <- w4
  $"relative path from 1 to 2" <- w3
  Or Array Elements(Boolean array=w2) -> (logical OR=w8)
  $"any different types?" <- w8
