vi "Compare Two Paths - Scalar.gvi"   [LabVIEW Platform Developer Preview 0.1.0]
# Compare Two Paths.vi - Compares two paths and if the paths are the same type (both absolute or both relative), the relative path between them is returned.
inputs:
  "path1": path, required
  "path2": path, required
outputs:
  "common path": path
  "relative path from 1 to 2": path
  "different types?": bool
diagram:
  # NOT XOR checks if inputs are either both absolute or both relative
  Path To Array Of Strings(path=$path1) -> (array of strings=w1, relative=w2)
  Path To Array Of Strings(path=$path2) -> (array of strings=w3, relative=w4)
  Path To Array Of Strings(path=path "..") -> (array of strings=w5)
  Array Index(array=w5) -> (out0[0]=w6)
  Logical Exclusive Or[output inverted](w2, w4) -> w7
  case (w7) {
    frame False, Default {
      # Inputs are different types - do not run the compare
      w8 = path ""
      w9 = path ""
    }
    frame True {
      Array Size(array=w1) -> (size(s)=w10)
      Array Size(array=w3) -> (size(s)=w11)
      Max And Min[ComparisonMode=CompareAggregates](x=w10, y=w11) -> (min(x,y)=w12: i32)
      # >is relative comparison?>
      # 1.
      # 1. If relative comparison then Common Path will be relative
      s1 = w12  # shift register
      for (iteration -> i1) {
        w13 = each element of w1
        w14 = each element of w3
        Is Equal(x=s1, y=w12) -> w15
        To Lower Case(string=w13) -> w16
        To Lower Case(string=w14) -> w17
        Is Not Equal(x=w16, y=w17) -> w18
        Logical And(w18, w15) -> w19
        Select(s=w19, t=i1, f=s1) -> w20
        next s1 = w20
      }
      Array Subset(array=w1, index0=0, length0=s1) -> w21
      Array Of Strings To Path(array of strings=w21, relative=w2) -> (path=w8)
      Array Size(array=w21) -> (size(s)=w22)
      Array Subset(array=w3, index0=w22) -> w23
      Subtract(x=w10, y=w22) -> w24
      Initialize Array(element=w6, size=w24) -> w25
      Build Array[ConcatenateInputs=True](w25, w23) -> w26
      Array Of Strings To Path(array of strings=w26, relative=TRUE) -> (path=w9)
    }
  }
  $"common path" <- w8
  $"relative path from 1 to 2" <- w9
  Not(x=w7) -> w27
  $"different types?" <- w27
