vi "Convert File Extension (Path).gvi"   [LabVIEW Platform Developer Preview 0.1.0]
# Converts the file extension of a file. "new ending" will accept an extension prefixed with or without a period, or a blank ("") string.
# For example:
# file name => c:\temp\data.txt
# new ending => "csv" or ".csv"
# new filename => c:\temp\data.csv
# prev ending => ".txt"
# file name => c:\temp\data.txt
# new ending => ""
# new filename => c:\temp\data
# prev ending => ".txt"
inputs:
  "file name": path, required
  "new ending (none)": string
outputs:
  "new filename": path
  "prev ending": string
uses:
  openg::library::file::Convert File Extension (String).gvi
diagram:
  Strip Path(path=$"file name") -> (name=w1, stripped path=w2)
  call "Convert File Extension (String).gvi"(file name=w1, new ending (none)=$"new ending (none)") -> (new filename=w3, prev ending=w4)
  Build Path(base path=w2, name or relative path=w3) -> (appended path=w5)
  $"new filename" <- w5
  $"prev ending" <- w4
