vi "Convert File Extension (String).gvi"   [LabVIEW Platform Developer Preview 0.1.0]
# Converts the file extension of a file. "new ending" will accept an extension prefixed with or without a period, or a blank ("") string.
# For example:
# file name => c:\temp\data.txt
# new ending => "csv" or ".csv"
# new filename => c:\temp\data.csv
# prev ending => ".txt"
# file name => c:\temp\data.txt
# new ending => ""
# new filename => c:\temp\data
# prev ending => ".txt"
inputs:
  "file name": string, required
  "new ending (none)": string
outputs:
  "new filename": string
  "prev ending": string
diagram:
  Match Pattern(regular expression="\\.[~\\.]*$", string=$"file name") -> (before substring=w1, match substring=w2)
  $"prev ending" <- w2
  case ($"new ending (none)") {
    frame Default {
      Match Pattern(regular expression="^\\.", string=$"new ending (none)") -> (offset past match=w4)
      Is Less Than 0(x=w4) -> w5
      Select(s=w5, t=".%s", f="%s") -> w6
      Format Into String(formatString=w6, initString=w1, $"new ending (none)") -> w3
    }
    frame "" {
      w3 = w1
    }
  }
  $"new filename" <- w3
