vi "Convert VI Libraries to Dirs (proxy).gvi"   [LabVIEW Platform Developer Preview 0.1.0]
# Converts an array of VI Libraries (.llb) into Directories.
# Note: This VI dynamically calls the LabVIEW subVI "Convert VI Libraries to Dirs.vi" located at \project\llbedit.llb (as it is not in the VI search paths).
inputs:
  "VI libraries": path[]
  "dir name scheme (0:remove .llb)": enum{"remove .llb", "same name", "prompt"} = "remove .llb"
  "multiplatform names": bool
  "error in (no error)": error
  "automatically rename": bool
  "backup vi libraries": bool
outputs:
  "renamed VIs new path": path[]
  "renamed VIs original name": string[]
  "destination paths": path[]
  "error out": error
panel controls:
  "type specifier": StrictVIRefnum<"function ">
uses:
  openg.library.file::Application Directory.gvi
diagram:
  call "Application Directory.gvi"(Relative path (.)=path "project\\llbedit.llb\\Convert VI Libraries to Dirs.vi")
  # Call the VI dynamically because it is not
  # usually in the VI search paths (./project)
  Open VI Reference(error in (no error)=$"error in (no error)", type specifier VI Refnum (for type only)=$"type specifier") -> (error out=w1, vi reference=w2)
  CallByReference(type specifier Input 0=w2, Error IO Input 1=w1, backup vi libraries Input 2=$"backup vi libraries", automatically rename Input 3=$"automatically rename", multiplatform names Input 4=$"multiplatform names", dir name scheme (0:remove .llb) Input 5=$"dir name scheme (0:remove .llb)", VI libraries Input 6=$"VI libraries") -> (type specifier Output 0=w3, Error IO Output 1=w4, destination paths Output 2=w5, renamed VIs original name Output 3=w6, renamed VIs new path Output 4=w7)  # CallByReference (Placeholder)
  Close Reference(error in (no error)=w4, reference=w3) -> (error out=w8)
  $"error out" <- w8
  $"renamed VIs new path" <- w7
  $"renamed VIs original name" <- w6
  $"destination paths" <- w5
