vi "Copy with Options.gvi"   [LabVIEW Platform Developer Preview 0.1.0]
# Adds useful options to the "Copy" primitive.  It allows to replace existing files with the options "If Newer", "Never", and "Always".
inputs:
  "source path": path, required
  "target path": path, required
  "Replace Mode (Never)": enum{"Never", "Always", "If Newer"} = "Never"
  "error in (no error)": error
outputs:
  "new path": path  # new path specifies the new location of the file or directory if the copy is successful. If not, this function sets new path to Not A Path.
  "error out": error
uses:
  openg::library::error::Build Error Cluster.gvi
diagram:
  case ($"error in (no error)") {
    frame No Error {
      File Or Directory Info(error in=$"error in (no error)", path=$"source path") -> (directory=w3, error out=w4, path out=w5)
      case (w3) {
        frame False, Default {
          File Or Directory Info(path=$"target path") -> (directory=w6, error out=w7, last mod=w8, path out=w9)
          Time Stamp To Double Precision Float(number=w8) -> (double precision float=w10)
          # /*Check if file exists*/
          To Unsigned Long Integer(number=w10) -> w11
          # is Dir?
          case (w6) {
            frame False, Default {
              w12 = w9
              w13 = w7
              w14 = w11
            }
            frame True {
              Strip Path(path=w5) -> (name=w15)
              Build Path(base path=w9, name or relative path=w15) -> (appended path=w16)
              File Or Directory Info(error in=w7, path=w16) -> (error out=w13, last mod=w17, path out=w12)
              Time Stamp To Double Precision Float(number=w17) -> (double precision float=w18)
              To Unsigned Long Integer(number=w18) -> w14
            }
          }
          case (w13) {
            frame No Error {
              # /*File Exists*/
              case ($"Replace Mode (Never)") {
                frame "Never" {
                  w1 = w4
                  w2 = path constant
                }
                frame "Always" {
                  Delete File Or Folder(error in=w4, path (use dialog)=w12) -> (deleted path=w19, error out=w20)
                  Copy File Or Folder(error in=w20, source path=w5, target path (use dialog)=w19) -> (error out=w1, new path=w2)
                }
                frame "If Newer" {
                  File Or Directory Info(path=w5) -> (last mod=w21)
                  Time Stamp To Double Precision Float(number=w21) -> (double precision float=w22)
                  To Unsigned Long Integer(number=w22) -> w23
                  Is Greater(x=w23, y=w14) -> w24
                  # /*is newer?*/
                  case (w24) {
                    frame False, Default {
                      w1 = w4
                      w2 = path constant
                    }
                    frame True {
                      Delete File Or Folder(error in=w4, path (use dialog)=w12) -> (deleted path=w25, error out=w26)
                      Copy File Or Folder(error in=w26, source path=w5, target path (use dialog)=w25) -> (error out=w1, new path=w2)
                    }
                  }
                }
              }
            }
            frame Error {
              # /*Error means that file does not exist*/
              Copy File Or Folder(error in=w4, source path=w5, target path (use dialog)=w12) -> (error out=w1, new path=w2)
            }
          }
        }
        frame True {
          call "Build Error Cluster.gvi"(code="Argument error"(1), String to Prepend to source ("")="Source path cannot be a directory") -> (error out=w1)
          w2 = path constant
        }
      }
    }
    frame Error {
      w1 = $"error in (no error)"
      w2 = path constant
    }
  }
  $"new path" <- w2
  $"error out" <- w1
