vi "Create Dir if Non-Existant.gvi"   [LabVIEW Platform Developer Preview 0.1.0]
# Will create all directories above and including the directory defined by the "Directory Path" input, if they do not already exist.
inputs:
  "Directory Path": path, required
  "permissions (0755)": i16 = 493
  "error in (no error)": error
outputs:
  "dup Directory Path": path
  "Created Directories": path[]
  "error out": error
uses:
  openg::library::file::Strip Path - Traditional.gvi
  openg::library::file::Build Path - Traditional.gvi
diagram:
  $"dup Directory Path" <- $"Directory Path"
  s1 = $"Directory Path"  # shift register
  s2 = string[] []  # shift register
  while {
    File Or Directory Info(path=s1) -> (directory=w2, path out=w3)
    Set Permissions(path=w3, permissions=$"permissions (0755)")
    call "Strip Path - Traditional.gvi"(path=w3) -> (stripped path=w4, name=w5)
    Build Array[ConcatenateInputs=True](w5, s2) -> w6
    Is Empty String Or Path(string/path=w3) -> w7
    Is Not A Number Or Path Or Refnum(number=w3) -> w8
    Logical Or(w7, w8, w2) -> w9
    w1 = s2
    next s1 = w4
    next s2 = w6
    stop if w9
  }
  s3 = w3  # shift register
  s4 = $"error in (no error)"  # shift register
  for {
    w10 = each element of w1
    call "Build Path - Traditional.gvi"(base path=s3, name or relative path=w10) -> (appended path=w12)
    Create Folder(error in=s4, path (use dialog)=w12) -> (created path=w13, error out=w14)
    Set Permissions(error in=w14, path=w13, permissions=$"permissions (0755)") -> (error out=w15, path out=w16)
    append w16 to w11
    next s3 = w16
    next s4 = w15
  }
  $"Created Directories" <- w11
  $"error out" <- s4
