vi "Current VIs Parent Directory.gvi"   [LabVIEW Platform Developer Preview 0.1.0]
# Gets the path to the parent directory of the calling VI.  This may be used for building a path to a config file that exists in that directory or a directory relative to it.  This function will move up the file structure until it reaches and Operating System Directory.  It will not return the path to a built EXE or to an LLB.
inputs:
  "Relative path (.)": path = path "."
outputs:
  "Parent Directory (+ Relative)": path
uses:
  OpenG.Application Control::Current VIs Parents Ref.gvi
  openg::library::file::Strip Path - Traditional.gvi
diagram:
  call "Current VIs Parents Ref.gvi"() -> (Calling VI's Reference=w1)
  Property Node[IsPlaceholderNodeForConversion=True](instance in=w1) -> ("Path"=w2, instance out=w3)
  Close Reference(reference=w3)
  s1 = w2  # shift register
  while {
    call "Strip Path - Traditional.gvi"(path=s1) -> (stripped path=w4)
    File Or Directory Info(path=w4) -> (directory=w5)
    # is Dir?
    Is Not A Number Or Path Or Refnum(number=s1) -> w6
    Is Empty String Or Path(string/path=s1) -> w7
    Logical Or(w5, w6, w7) -> w8
    next s1 = w4
    stop if w8
  }
  Build Path(base path=s1, name or relative path=$"Relative path (.)") -> (appended path=w9)
  $"Parent Directory (+ Relative)" <- w9
