vi "Delete Recursive.gvi"   [LabVIEW Platform Developer Preview 0.1.0]
# Deletes the file or directory specified by path.  If path specifies a directory that is not empty and "Recursive" is FALSE or if you do not have write permission for both the file or directory specified by path and its parent directory and "Ignore Read-Only" is FALSE, this function does not remove the directory and returns an error.
inputs:
  "Path": path, required
  "Recursive? (FALSE)": bool
  "Ignore Read-Only? (FALSE)": bool
  "error in (no error)": error
outputs:
  "dup Path": path
  "error out": error
uses:
  openg::library::file::Valid Path - Traditional.gvi
  openg::library::error::Build Error Cluster.gvi
  openg::library::file::Build Path - File Names Array.gvi
diagram:
  $"dup Path" <- $Path
  case ($"error in (no error)") {
    frame No Error {
      call "Valid Path - Traditional.gvi"(path=$Path) -> (valid=w2)
      case (w2) {
        frame False, Default {
          Format Into String(formatString="Input path \"%s\" is not valid.", $Path) -> w3
          call "Build Error Cluster.gvi"(code="Argument error"(1), String to Prepend to source ("")=w3) -> (error out=w4)
          Merge Errors($"error in (no error)", w4) -> (error out=w1)
        }
        frame True {
          File Or Directory Info(error in=$"error in (no error)", path=$Path) -> (directory=w5, error out=w6)
          Logical And(w5, $"Recursive? (FALSE)") -> w7
          case (w7) {
            frame False, Default {
              # Non-Recursive or File (not a dir)
              case (w6) {
                frame No Error {
                  case ($"Ignore Read-Only? (FALSE)") {
                    frame False, Default {
                      w8 = w6
                      w9 = $Path
                    }
                    frame True {
                      Get Permissions(error in=w6, path=$Path) -> (error out=w10, path out=w11, permissions=w12)
                      # make writable
                      Logical Or(w12, 146) -> w13
                      Set Permissions(error in=w10, path=w11, permissions=w13) -> (error out=w8, path out=w9)
                    }
                  }
                  Delete File Or Folder(error in=w8, path (use dialog)=w9) -> (error out=w1)
                }
                frame Error {
                  w1 = w6
                }
              }
            }
            frame True {
              case (w6) {
                frame No Error {
                  Build Array($Path) -> w14
                  s1 = w14  # shift register
                  s2 = w6  # shift register
                  while {
                    Delete From Array(inArray=s1) -> (outArray=w15, deleted=w16)
                    # pop last path off stack
                    List Folder(error in=s2, path=w16) -> (error out=w17, file names=w18, folder names=w19, path out=w20)
                    Array Size(array=w19) -> (size(s)=w21)
                    # get directories contents
                    call "Build Path - File Names Array.gvi"(base path=w20, name or relative path=w18) -> (appended path=w22)
                    s3 = w17  # shift register
                    for {  # Delete all files in dir
                      w23 = each element of w22
                      case ($"Ignore Read-Only? (FALSE)") {
                        frame False, Default {
                          w24 = s3
                          w25 = w23
                        }
                        frame True {
                          Get Permissions(error in=s3, path=w23) -> (error out=w26, path out=w27, permissions=w28)
                          # make writable
                          Logical Or(w28, 146) -> w29
                          Set Permissions(error in=w26, path=w27, permissions=w29) -> (error out=w24, path out=w25)
                        }
                      }
                      Delete File Or Folder(error in=w24, path (use dialog)=w25) -> (error out=w30)
                      next s3 = w30
                    }
                    # Quit if Error or no files or no directories
                    # has sub directories
                    case (w21) {
                      frame 0 {
                        case ($"Ignore Read-Only? (FALSE)") {
                          frame False, Default {
                            w33 = s3
                            w34 = w20
                          }
                          frame True {
                            Get Permissions(error in=s3, path=w20) -> (error out=w35, path out=w36, permissions=w37)
                            # make writable
                            Logical Or(w37, 146) -> w38
                            Set Permissions(error in=w35, path=w36, permissions=w38) -> (error out=w33, path out=w34)
                          }
                        }
                        # No, Delete Dir
                        Delete File Or Folder(error in=w33, path (use dialog)=w34) -> (error out=w31)
                        w32 = w15
                      }
                      frame Default {
                        call "Build Path - File Names Array.gvi"(base path=w20, name or relative path=w19) -> (appended path=w39)
                        # Yes, add to stack
                        Build Array[ConcatenateInputs=True](w15, w20, w39) -> w32
                        w31 = s3
                      }
                    }
                    Property Node(instance in=w31) -> ("status"=w40)
                    Array Size(array=w32) -> (size(s)=w41)
                    Is Equal To 0(x=w41) -> w42
                    Logical Or(w42, w40) -> w43
                    next s1 = w32
                    next s2 = w31
                    stop if w43
                  }
                  w1 = s2
                }
                frame Error {
                  w1 = w6
                }
              }
            }
          }
        }
      }
    }
    frame Error {
      w1 = $"error in (no error)"
    }
  }
  $"error out" <- w1
