vi "File Exists - Scalar.gvi"   [LabVIEW Platform Developer Preview 0.1.0]
# Checks to see whether a path exists on disk and whether it is a directory.
inputs:
  "file path": path, required
outputs:
  "is directory": bool
  "exists": bool
diagram:
  File Or Directory Info(path=$"file path") -> (directory=w1, error out=w2)
  $"is directory" <- w1
  Property Node(instance in=w2) -> ("status"=w3)
  Not(x=w3) -> w4
  $exists <- w4
