vi "File Info.gvi"   [LabVIEW Platform Developer Preview 0.1.0]
# This function either returns extended file information or changes that information for a file. For setting a particular value to something else you should first retrieve the entire information, change the value in question and write it back to disk. Be careful with this as setting wrong values for this could make the files inaccessible or even destroy it.
# Some of the information can be also read and modified by LabVIEW icons, others not. Following information is available in the cluster:
# type: this is the Macintosh file type. This is actually also valid for the standard LabVIEW files on non-Macintosh platforms as LabVIEW stores its files in a similar fashion as what is used for Macintosh files. This value is the same as the "type" parameter from the Type & Creator function.
# type: this is the Macintosh file creator. This is actually also valid for the standard LabVIEW files on non-Macintosh platforms as LabVIEW stores its files in a similar fashion as what is used for Macintosh files. In this case the creator is always "LBVW". This value is the same as the "creator" parameter from the Type & Creator function.
# permissions: This is the file access permission and is the same as is read or set with the Access Rights function.
# data size: This is the same value as returned by the "File/Directory Info" function as well as it can be accessed by the EOF function.
# res size: This is the size of the Macintosh resource fork. On non Macintosh systems this value is always 0.
# creation date: The creation date of the file as far as the OS file system supports that. Changing this value is under normal circumstances probably not a good idea. For instance making this date to be later than the modification date could cause certain issues on some systems.
# modification date: This value is the same as returned by the "File/Directory Info" LabVIEW node.
# bFolder: If non-zero indicates that the path points to a directory. This value is the same as returned by the "File/Directory Info" function.
# bInvisible: If non-zero indicates if the file has the OS dependant hidden flag set.
# location: System specific desktop geographical location (on Mac only)
inputs:
  "file": path, required
  "file info 2": "File Info Record.gtype"
  "error in (no error)": error
  "update (F)": bool
outputs:
  "file out": path
  "file info": "File Info Record.gtype"
  "error out": error
types:
  "File Info Record.gtype" = cluster{"type": string, "creator": string, "permissions": i32, "data size": i32, "res size": i32, "creation date": u32, "modification date": u32, "bFolder": bool, "bInvisible": bool, "location": cluster{"vertical": i16, "horizontal": i16}, "owner": string, "group": string}
  T1 = cluster{"permissions": i32, "data size": i32, "res size": i32, "creation date": u32, "modification date": u32, "bFolder": i32, "bInvisible": i32, "location": cluster{"vertical": i16, "horizontal": i16}}
uses:
  openg::library::file::LabVIEW.sli::FGetInfo
  openg::library::file::LabVIEW.sli::FSetInfo
diagram:
  Property Node(instance in=$"error in (no error)") -> ("status"=w1)
  case (w1) {
    frame False, Default {
      # Detect if we are on a
      # little endian machine
      Type Cast(type=string "", x=0x4C45) -> w5
      Is Equal(x=w5, y="LE") -> w6
      case ($"update (F)") {
        frame False, Default {
          Initialize Array(element=0, size=552) -> w7
          call "FGetInfo"(path in=$file, infop in=w7) -> (return=w8, infop out=w9)
          case (w8) {
            frame Default {
              Property Node(instance in=$"error in (no error)", "status"=TRUE, "code"=w8) -> (instance out=w2)
              w3 = $"file info 2"
            }
            frame 0 {
              Array Index(array=w9) -> (out0[40]=w10)
              Increment(x=40) -> w11
              Array Subset(array=w9, index0=w11, length0=w10) -> w12
              Byte Array To String(encoding="Extended ASCII", unsigned byte array=w12) -> (string=w13)
              Array Index(array=w9) -> (out0[296]=w14)
              Increment(x=296) -> w15
              Array Subset(array=w9, index0=w15, length0=w14) -> w16
              Byte Array To String(encoding="Extended ASCII", unsigned byte array=w16) -> (string=w17)
              Array Subset(array=w9, index0=4, length0=4) -> w18
              Byte Array To String(encoding="Extended ASCII", unsigned byte array=w18) -> (string=w19)
              Array Subset(array=w9, length0=4) -> w20
              Byte Array To String(encoding="Extended ASCII", unsigned byte array=w20) -> (string=w21)
              Array Subset(array=w9, index0=8) -> w22
              Type Cast(type=T1 {all zero or empty}, x=w22) -> w23
              case (w6) {
                frame False, Default {
                  w24 = w23
                }
                frame True {
                  Swap Bytes(data=w23) -> (byte swapped=w25)
                  Swap Words(data=w25) -> (word swapped=w24)
                }
              }
              Property Node(instance in=w24) -> ("permissions"=w26, "data size"=w27, "res size"=w28, "creation date"=w29, "modification date"=w30, "bFolder"=w31, "bInvisible"=w32, "location"=w33)
              Is Not Equal To 0(x=w31) -> w34
              Is Not Equal To 0(x=w32) -> w35
              Property Node(instance in=$"file info 2", "type"=w21, "creator"=w19, "permissions"=w26, "data size"=w27, "res size"=w28, "creation date"=w29, "modification date"=w30, "bFolder"=w34, "bInvisible"=w35, "location"=w33, "owner"=w13, "group"=w17) -> (instance out=w3)
              w2 = $"error in (no error)"
            }
          }
          w4 = $file
        }
        frame True {
          Property Node(instance in=$"file info 2") -> ("type"=w36, "creator"=w37, "permissions"=w38, "data size"=w39, "res size"=w40, "creation date"=w41, "modification date"=w42, "bFolder"=w43, "bInvisible"=w44, "location"=w45, "owner"=w46, "group"=w47)
          String To Byte Array(encoding="Extended ASCII", string=w47) -> (unsigned byte array=w48)
          String To Byte Array(encoding="Extended ASCII", string=w46) -> (unsigned byte array=w49)
          String To Byte Array(encoding="Extended ASCII", string=w36) -> (unsigned byte array=w50)
          Reshape Array(inArray=w50, size=4) -> w51
          String To Byte Array(encoding="Extended ASCII", string=w37) -> (unsigned byte array=w52)
          Reshape Array(inArray=w52, size=4) -> w53
          String Length(string=w46) -> (length=w54)
          Subtract(x=255, y=w54) -> w55
          Initialize Array(element=0, size=w55) -> w56
          String Length(string=w47) -> (length=w57)
          Subtract(x=255, y=w57) -> w58
          Initialize Array(element=0, size=w58) -> w59
          Boolean To Integer(Boolean=w43) -> (0, 1=w60)
          Boolean To Integer(Boolean=w44) -> (0, 1=w61)
          Property Node(instance in=T1 {all zero or empty}, "permissions"=w38, "data size"=w39, "res size"=w40, "creation date"=w41, "modification date"=w42, "bFolder"=w60, "bInvisible"=w61, "location"=w45) -> (instance out=w62)
          case (w6) {
            frame False, Default {
              w63 = w62
            }
            frame True {
              Swap Bytes(data=w62) -> (byte swapped=w64)
              Swap Words(data=w64) -> (word swapped=w63)
            }
          }
          Type Cast(type=w53, x=w63) -> w65
          To Unsigned Byte Integer(number=w54) -> w66
          To Unsigned Byte Integer(number=w57) -> w67
          Build Array[ConcatenateInputs=True](w51, w53, w65, w66, w49, w56, w67, w48, w59) -> w68
          call "FSetInfo"(path in=$file, infop in=w68) -> (return=w69, path out=w4)
          case (w69) {
            frame 0 {
              w2 = $"error in (no error)"
            }
            frame Default {
              Property Node(instance in=$"error in (no error)", "status"=TRUE, "code"=w69) -> (instance out=w2)
            }
          }
          w3 = $"file info 2"
        }
      }
    }
    frame True {
      w2 = $"error in (no error)"
      w3 = $"file info 2"
      w4 = $file
    }
  }
  $"error out" <- w2
  $"file out" <- w4
  $"file info" <- w3
