vi "Force File Move.gvi"   [LabVIEW Platform Developer Preview 0.1.0]
# Moves a file, forcing it even if the target does already exist and/or is write protected.
inputs:
  "target": path, required  # The target filename to which the source file should be moved. This file will be overwritten even if it is write protected!
  "source": path, required
  "maintain original rights (T)": bool = TRUE  # Transfers the rights from an already existing target file to the newly created file.
  "error in (no error)": error
outputs:
  "target out": path  # The path to the newly created file or the original if the move failed.
  "error out": error
diagram:
  Get Permissions(error in=$"error in (no error)", path=$target) -> (error out=w1, path out=w2, permissions=w3)
  Logical Or(128, w3) -> w4
  Set Permissions(error in=w1, path=w2, permissions=w4) -> (error out=w5, path out=w6)
  Delete File Or Folder(error in=w5, path (use dialog)=w6) -> (deleted path=w7, error out=w8)
  Move File Or Folder(error in=$"error in (no error)", source path=$source, target path (use dialog)=w7) -> (error out=w9, new path=w10)
  Property Node(instance in=w8) -> ("status"=w11)
  Logical And(not w11, $"maintain original rights (T)") -> w12
  case (w12) {
    frame False, Default {
      w13 = w9
      w14 = w10
    }
    frame True {
      Set Permissions(error in=w9, path=w10, permissions=w3) -> (error out=w13, path out=w14)
    }
  }
  $"target out" <- w14
  $"error out" <- w13
