vi "Instrument Library.gvi"   [LabVIEW Platform Developer Preview 0.1.0]
# Returns the Instrument Library path + relative path.
inputs:
  "Relative path (.)": path = path "."
outputs:
  "Instrument Library (+ Relative)": path
diagram:
  VILibrary() -> (path Output 0=w1)  # VILibrary (Placeholder)
  Build Path(base path=w1, name or relative path=path "..\\instr.lib") -> (appended path=w2)
  Build Path(base path=w2, name or relative path=$"Relative path (.)") -> (appended path=w3)
  $"Instrument Library (+ Relative)" <- w3
