vi "List Directory Recursive.gvi"   [LabVIEW Platform Developer Preview 0.1.0]
# Returns an array of strings listing the names of all files in directory path and its subfolders, filtering the file names array based upon the specified pattern.  If "Treat llb files as directories" is TRUE, llb files will not show up in the "file paths" output, but thier contents will.  If "List only Top-level files in llbs?" is TRUE, only top-level llb contents will show up in the "file paths" output.
inputs:
  "Path": path, required
  "pattern": string
  "error in (no error)": error
outputs:
  "dup Path": path
  "file paths": path[]
  "dir paths": path[]
  "error out": error
uses:
  NI::G Core::File IO (General)::Get File Extension.gvi
  openg::library::file::List Directory.gvi
  openg::library::file::Build Path - File Names Array.gvi
  openg::library::error::Build Error Cluster.gvi
  NI::G Core::Error::Legacy::General Error Handler.gvi
  openg::library::array::Remove Duplicates from 1D Array (Path).gvi
  openg::library::array::Filter 1D Array (Path).gvi
diagram:
  Build Array($Path) -> w1
  Is Empty String Or Path(string/path=$Path) -> w2
  case (w2) {
    frame False, Default {
      case ($"error in (no error)") {
        frame No Error {
          s1 = w1  # shift register
          s2 = $"error in (no error)"  # shift register
          s3 = path[] []  # shift register
          s4 = path[] []  # shift register
          while {
            Wait(time to wait=0)
            Delete From Array(inArray=s1) -> (outArray=w6, deleted=w7)
            File Or Directory Info(path=w7) -> (directory=w8, error out=w9)
            call "Get File Extension.gvi"(file=w7) -> (lowercase file extension=w10)
            Is Equal(x=w10, y="llb") -> w11
            Logical And(not w8, w11) -> w12
            # pop last path off stack
            case (w12) {  # Has LLB extension?
              frame False, Default {
                # Get dirs
                call "List Directory.gvi"(directory path=w7, pattern=$pattern, error in (no error)=s2) -> (dup directory path=w16, file names=w17, error out=w18)
                call "Build Path - File Names Array.gvi"(base path=w16, name or relative path=w17) -> (appended path=w14)
                # all directories
                call "List Directory.gvi"(directory path=w16, error in (no error)=w18) -> (dup directory path=w19, directory names=w20)
                # all files
                # Get Files
                # by pattern
                call "Build Path - File Names Array.gvi"(base path=w19, name or relative path=w20) -> (appended path=w15)
                w13 = s2
              }
              frame True {
                case (w9) {
                  frame No Error {
                    # Raise Error
                    call "Build Error Cluster.gvi"(code=1, String to Prepend to source ("")="llb file not to be treated as dir") -> (error out=w13)
                  }
                  frame Error {
                    w13 = w9
                  }
                }
                w14 = path[] []
                w15 = path[] []
              }
            }
            Build Array[ConcatenateInputs=True](s3, w14) -> w21
            Build Array(w7) -> w22
            Build Array[ConcatenateInputs=True](s4, w22) -> w23
            call "General Error Handler.gvi"(type of dialog="no dialog"(0), exception action="cancel error on match"(1), error in=w13, exception code=8) -> (error out=w24)
            Property Node(instance in=w24) -> ("status"=w25)
            Build Array[ConcatenateInputs=True](w6, w15) -> w26
            Array Size(array=w26) -> (size(s)=w27)
            # Quit if Error or no directories
            Is Equal To 0(x=w27) -> w28
            # filter read permission errors
            Logical Or(w28, w25) -> w29
            next s1 = w26
            next s2 = w24
            next s3 = w21
            next s4 = w23
            stop if w29
          }
          w3 = s2
          w4 = s3
          w5 = s4
        }
        frame Error {
          w3 = $"error in (no error)"
          w4 = path[] []
          w5 = path[] []
        }
      }
    }
    frame True {
      w3 = $"error in (no error)"
      w4 = path[] []
      w5 = path[] []
    }
  }
  call "Remove Duplicates from 1D Array (Path).gvi"(Input Array=w4) -> (Output Array=w30)
  $"file paths" <- w30
  Build Array($Path) -> w31
  call "Filter 1D Array (Path).gvi"(array=w5, items to filter=w31) -> (filtered array=w32)
  call "Remove Duplicates from 1D Array (Path).gvi"(Input Array=w32) -> (Output Array=w33)
  $"dir paths" <- w33
  $"dup Path" <- $Path
  $"error out" <- w3
