vi "List Directory.gvi"   [LabVIEW Platform Developer Preview 0.1.0]
# Augments the primitive List Directory function by allowing multiple semicolon delimited patterns.
inputs:
  "directory path": path, required
  "pattern": string
  "error in (no error)": error
outputs:
  "dup directory path": path
  "file names": string[]
  "directory names": string[]
  "error out": error
uses:
  openg::library::string::Trim Whitespace (String).gvi
  openg::library::array::Remove Duplicates from 1D Array (String).gvi
diagram:
  $"dup directory path" <- $"directory path"
  s1 = $pattern  # shift register
  while {
    Match Pattern(regular expression=";", string=s1) -> (after substring=w2, before substring=w3, offset past match=w4)
    call "Trim Whitespace (String).gvi"(String in=w3, Remove (leading and trailing)="both") -> (String out=w5)
    Is Greater Or Equal To 0(x=w4) -> w6
    append w5 to w1
    next s1 = w2
    continue if w6
  }
  s2 = $"error in (no error)"  # shift register
  s3 = string[] []  # shift register
  s4 = string[] []  # shift register
  for {
    w7 = each element of w1
    List Folder(error in=s2, path=$"directory path", pattern=w7) -> (error out=w8, file names=w9, folder names=w10)
    Build Array[ConcatenateInputs=True](s3, w9) -> w11
    Build Array[ConcatenateInputs=True](s4, w10) -> w12
    next s2 = w8
    next s3 = w11
    next s4 = w12
  }
  call "Remove Duplicates from 1D Array (String).gvi"(Input Array=s3) -> (Output Array=w13)
  $"file names" <- w13
  call "Remove Duplicates from 1D Array (String).gvi"(Input Array=s4) -> (Output Array=w14)
  $"directory names" <- w14
  $"error out" <- s2
