vi "List Top Level VIs.gvi"   [LabVIEW Platform Developer Preview 0.1.0]
# Lists the Top-Level VIs in an LLB or EXE.
inputs:
  "LLB Path": path, required
  "error in (no error)": error
outputs:
  "dup LLB Path": path
  "Top-Level VIs": string[]
  "error out": error
uses:
  NI::G Core::Error::Legacy::General Error Handler.gvi
  openg::library::array::Conditional Auto-Indexing Tunnel (String).gvi
diagram:
  case ($"error in (no error)") {
    frame No Error {
      List Folder(error in=$"error in (no error)", path=$"LLB Path") -> (error out=w3, file names=w4, path out=w5)
      s1 = w3  # shift register
      for {
        w6 = each element of w4
        Build Path(base path=w5, name or relative path=w6) -> (appended path=w9)
        Librarian Get Info(path Input 0=w9, error in (no error) Input 1=s1) -> (file information Output 3=w10, error out Output 4=w11)  # Librarian Get Info (Placeholder)
        Property Node(instance in=w10) -> ("top level"=w12)
        Property Node(instance in=w11) -> ("code"=w13)
        Is Equal(x=w13, y=15) -> w14
        Logical Or(w12, w14) -> w15
        # /*Filter Error 15 - Which occurs in an EXE with top-level VI*/
        call "General Error Handler.gvi"(type of dialog="no dialog"(0), exception action="cancel error on match"(1), error in=w11, exception code=15) -> (error out=w16)
        append w15 to w7
        append w6 to w8
        next s1 = w16
      }
      call "Conditional Auto-Indexing Tunnel (String).gvi"(Elements to keep=w7, Array in=w8) -> (Filtered Array out=w1)
      w2 = s1
    }
    frame Error {
      w1 = string[] []
      w2 = $"error in (no error)"
    }
  }
  $"Top-Level VIs" <- w1
  $"error out" <- w2
  $"dup LLB Path" <- $"LLB Path"
