vi "Merge Directories.gvi"   [LabVIEW Platform Developer Preview 0.1.0]
# Copies the contents of source directory into the destination directory. If source directory has subdirectories they will be copied into the destination directory recursively. Optionally, existing files may be overwritten, by setting the "Overwrite Existing Files?" input to TRUE. If you attempt to overwrite an existing file without setting to TRUE an error will be returned. If FALSE, existing files will not be overwritten and no error wil be returned, Optionally, read-only files may be overwritten, by setting the "Ignore Read-Only?" input to TRUE. If you attempt to overwrite a read-only files without setting to TRUE an error will be returned. Optionally, by setting the "Delete Source?" input to TRUE the source directory will be deleted upon merge completion if no errors occured.
inputs:
  "source directory path": path, required
  "target directory path": path, required
  "Overwrite Existing Files? (FALSE)": bool
  "error in (no error)": error
  "Delete Source? (FALSE)": bool
  "Ignore Read-Only? (FALSE)": bool
outputs:
  "dup target directory path": path
  "error out": error
uses:
  openg::library::file::Build Path - File Names Array.gvi
  openg::library::file::Compare Two Paths - Scalar.gvi
  openg::library::file::Build Path - Traditional - path.gvi
  openg::library::error::Build Error Cluster.gvi
  openg::library::file::Delete Recursive.gvi
  openg::library::file::Strip Path - Traditional.gvi
  openg::library::file::Create Dir if Non-Existant.gvi
diagram:
  $"dup target directory path" <- $"target directory path"
  Build Array($"source directory path") -> w1
  # delete source dir?
  # delete source dir?
  s1 = w1  # shift register
  s2 = $"error in (no error)"  # shift register
  while {
    # Overwrite Existing Files?
    # dir being copied
    # target directory
    # Ignore Read-Only?
    Array Size(array=s1) -> (size(s)=w2)
    # get directories contents
    # pop last path off stack
    # source dir
    Decrement(x=w2) -> w3
    Delete From Array(inArray=s1, length (1)=1, index0=w3) -> (outArray=w4, deleted=w5)
    Array Index(array=w5) -> (out0[_]=w6)
    # folder stack (remaining to be copied)
    List Folder(error in=s2, path=w6) -> (error out=w7, file names=w8, folder names=w9, path out=w10)
    Array Size(array=w9) -> (size(s)=w11)
    case (w11) {
      frame 0 {
        w12 = w4
      }
      frame Default {
        # Yes, add to stack
        call "Build Path - File Names Array.gvi"(base path=w10, name or relative path=w9) -> (appended path=w13)
        Build Array[ConcatenateInputs=True](w4, w13) -> w12
      }
    }
    Array Size(array=w12) -> (size(s)=w14)
    Is Equal To 0(x=w14) -> w15
    # has sub directories
    # subDirs of the dir being copied
    call "Build Path - File Names Array.gvi"(base path=w10, name or relative path=w8) -> (appended path=w16)
    # error
    s3 = w7  # shift register
    for {  # Copy All Files dir
      w17 = each element of w16
      # Overwrite Existing Files?
      # target directory
      # Build path in destination dir
      # Ignore Read-Only?
      call "Compare Two Paths - Scalar.gvi"(path1=$"source directory path", path2=w17) -> (relative path from 1 to 2=w18)
      # Get path relative to source dir
      # file source
      # error
      # file destinatioin
      call "Build Path - Traditional - path.gvi"(base path=$"target directory path", name or relative path=w18) -> (appended path=w19)
      File Or Directory Info(path=w19) -> (error out=w20)
      case (w20) {  # No Error means that file already exists
        frame No Error {
          case ($"Overwrite Existing Files? (FALSE)") {  # Overwrite Existing?
            frame False, Default {
              call "Build Error Cluster.gvi"(code=8, String to Prepend to source ("")="file exists in destination dir") -> (error out=w21)
            }
            frame True {
              # 1) Delete File
              # 2) Split Path to get target Dir
              # 3) Copy Source File to Target Dir
              call "Delete Recursive.gvi"(Path=w19, Recursive? (FALSE)=FALSE, Ignore Read-Only? (FALSE)=$"Ignore Read-Only? (FALSE)", error in (no error)=s3) -> (dup Path=w22, error out=w23)
              call "Strip Path - Traditional.gvi"(path=w22) -> (stripped path=w24)
              Copy File Or Folder(error in=w23, source path=w17, target path (use dialog)=w24) -> (error out=w21)
            }
          }
        }
        frame Error {
          # 1) Split Path to get target Dir
          # 2) Make sure target Dir Exists
          # 3) Copy Source File to Target Dir
          call "Strip Path - Traditional.gvi"(path=w19) -> (stripped path=w25)
          call "Create Dir if Non-Existant.gvi"(Directory Path=w25, error in (no error)=s3) -> (dup Directory Path=w26, error out=w27)
          Copy File Or Folder(error in=w27, source path=w17, target path (use dialog)=w26) -> (error out=w21)
        }
      }
      next s3 = w21
    }
    # folder stack
    Property Node(instance in=s3) -> ("status"=w28)
    # Quit if Error or no files or no directories
    Logical Or(w15, w28) -> w29
    next s1 = w12
    next s2 = s3
    stop if w29
  }
  # Delete Source Directory, if resquested by calling VI and no errors
  case ($"Delete Source? (FALSE)") {  # delete source dir?
    frame False, Default {
      w30 = s2
    }
    frame True {
      Property Node(instance in=s2) -> ("status"=w31)
      Path To Array Of Strings(path=$"target directory path") -> (array of strings=w32)
      Path To Array Of Strings(path=$"source directory path") -> (array of strings=w33)
      # Don't Delete Source Directory, if above target Dir
      Is Equal(x=w32, y=w33) -> w34
      And Array Elements(Boolean array=w34) -> (logical AND=w35)
      Logical Or(w35, w31) -> w36
      case (w36) {
        frame False, Default {
          call "Delete Recursive.gvi"(Path=$"source directory path", Recursive? (FALSE)=TRUE, Ignore Read-Only? (FALSE)=TRUE, error in (no error)=s2) -> (error out=w30)
        }
        frame True {
          w30 = s2
        }
      }
    }
  }
  $"error out" <- w30
