vi "OpenG Library.gvi"   [LabVIEW Platform Developer Preview 0.1.0]
# Returns the OpenG Library path + relative path.
inputs:
  "Relative path (.)": path = path "."
outputs:
  "OpenG Library (+ Relative)": path
diagram:
  Property Node[IsPlaceholderNodeForConversion=True]() -> ("App.Dir"=w1)
  Build Path(base path=w1, name or relative path=path "user.lib\\_OpenG.lib") -> (appended path=w2)
  Build Path(base path=w2, name or relative path=$"Relative path (.)") -> (appended path=w3)
  $"OpenG Library (+ Relative)" <- w3
