vi "Set VI Top Level.gvi"   [LabVIEW Platform Developer Preview 0.1.0]
# Sets the top level flag of a VI within an LLB to top level.
inputs:
  "VI Path": path, required
  "Top Level (T)": bool = TRUE
  "error in (no error)": error
outputs:
  "VI Path dup": path
  "error out": error
diagram:
  Librarian Get Info(path Input 0=$"VI Path", error in (no error) Input 1=$"error in (no error)") -> (dup path Output 2=w1, file information Output 3=w2, error out Output 4=w3)  # Librarian Get Info (Placeholder)
  Property Node(instance in=w2, "top level"=$"Top Level (T)") -> (instance out=w4)
  Librarian Set Info(path Input 0=w1, file information Input 1=w4, error in (no error) Input 2=w3) -> (dup path Output 3=w5, error out Output 4=w6)  # Librarian Set Info (Placeholder)
  $"VI Path dup" <- w5
  $"error out" <- w6
