vi "Strip Path Extension - 1D Array of Paths.gvi"   [LabVIEW Platform Developer Preview 0.1.0]
inputs:
  "paths": path[], required
outputs:
  "roots": string[]
  "extensions": string[]
uses:
  openg::library::file::Strip Path Extension - String.gvi
diagram:
  Path To String(path=$paths) -> (string=w1)
  for {
    w2 = each element of w1
    call "Strip Path Extension - String.gvi"(path=w2) -> (root=w5, extension=w6)
    append w5 to w3
    append w6 to w4
  }
  $roots <- w3
  $extensions <- w4
