vi "Strip Path Extension - Path.gvi"   [LabVIEW Platform Developer Preview 0.1.0]
inputs:
  "path": path, required
outputs:
  "root": string
  "extension": string
uses:
  openg::library::file::Strip Path Extension - String.gvi
diagram:
  Path To String(path=$path) -> (string=w1)
  call "Strip Path Extension - String.gvi"(path=w1) -> (root=w2, extension=w3)
  $root <- w2
  $extension <- w3
