vi "Strip Path Extension - String.gvi"   [LabVIEW Platform Developer Preview 0.1.0]
inputs:
  "path": string, required
outputs:
  "root": string
  "extension": string
diagram:
  Reverse String(string=$path) -> (reversed=w1)
  # Reverse strings because we're
  # searching from the back
  Match Pattern(regular expression="\\.", string=w1) -> (after substring=w2, before substring=w3, offset past match=w4)
  Is Not Equal(x=w4, y=-1) -> w5
  # Get Position
  # of Period
  case (w5) {  # Has Period?
    frame False, Default {
      w6 = default
      w7 = w1
    }
    frame True {
      Match Pattern(regular expression="\\", string=w1) -> (offset past match=w8)
      # Get Position of
      # Path Separator?
      Is Not Equal(x=-1, y=w8) -> w9
      Is Less(x=w8, y=w4) -> w10
      Logical And(w9, w10) -> w11
      case (w11) {  # Path Separator before Period?
        frame False, Default {
          w7 = w2
          w6 = w3
        }
        frame True {
          w7 = w1
          w6 = default
        }
      }
    }
  }
  Reverse String(string=w6) -> (reversed=w12)
  $extension <- w12
  Reverse String(string=w7) -> (reversed=w13)
  # Un-reverse strings
  $root <- w13
