vi "Temporary Directory.gvi"   [LabVIEW Platform Developer Preview 0.1.0]
# Returns the temp directory + relative path.
inputs:
  "Relative path (.)": path = path "."
outputs:
  "Temporary Directory (+ Relative)": path
uses:
  openg::library::file::Valid Path - Traditional.gvi
  NI::G Core::File IO (General)::Get System Directory.gvi
diagram:
  call "Valid Path - Traditional.gvi"(path=$"Relative path (.)") -> (valid=w1)
  call "Get System Directory.gvi"(type="User Temporary") -> (system directory=w2)
  case (w1) {
    frame False, Default {
      w3 = w2
    }
    frame True {
      Build Path(base path=w2, name or relative path=$"Relative path (.)") -> (appended path=w3)
    }
  }
  $"Temporary Directory (+ Relative)" <- w3
