vi "Temporary Filename.gvi"   [LabVIEW Platform Developer Preview 0.1.0]
# Generates an unused temporary file path.
inputs:
  "sub directory": path = path "."  # An optional subdirectory to create in the temporary directory.
  "pattern (lvtemp%d.tmp)": string  # Optional filename pattern to use to generate the temporary filename. This pattern should contain exactly one "%d" to work properly.
  "error in (no error)": error
outputs:
  "file in tmp dir": path  # A randomly named file in the temporary directory.
  "error out": error
uses:
  openg::library::file::Temporary Directory.gvi
  openg::library::file::Create Dir if Non-Existant.gvi
diagram:
  call "Temporary Directory.gvi"(Relative path (.)=$"sub directory") -> (Temporary Directory (+ Relative)=w1)
  call "Create Dir if Non-Existant.gvi"(Directory Path=w1, error in (no error)=$"error in (no error)") -> (dup Directory Path=w2, error out=w3)
  List Folder(error in=w3, path=w2) -> (error out=w4, file names=w5, path out=w6)
  case ($"pattern (lvtemp%d.tmp)") {
    frame Default {
      w7 = $"pattern (lvtemp%d.tmp)"
    }
    frame "" {
      w7 = "lvtemp%d.tmp"
    }
  }
  # Keep making up names
  # till you find one that
  # isn't used.
  case (w4) {
    frame No Error {
      while {
        Random Number() -> (number (0 to 1)=w9)
        Multiply(w9, 999) -> w10
        Format Into String(formatString=w7, w10) -> w8
        Is Equal(x=w5, y=w8) -> w11
        Or Array Elements(Boolean array=w11) -> (logical OR=w12)
        continue if w12
      }
    }
    frame Error {
      w8 = default
    }
  }
  Build Path(base path=w6, name or relative path=w8) -> (appended path=w13)
  $"file in tmp dir" <- w13
  $"error out" <- w4
