vi "Valid Path - Traditional.gvi"   [LabVIEW Platform Developer Preview 0.1.0]
# Valid Path.vi - Checks to see if a path is valid, meaning not "Empty path" and not "Not a Path".
inputs:
  "path": path, required
outputs:
  "valid": bool
diagram:
  Is Empty String Or Path(string/path=$path) -> w1
  Is Not A Number Or Path Or Refnum(number=$path) -> w2
  Logical Or[output inverted](w1, w2) -> w3
  $valid <- w3
