vi "LF End Of File.gvi"   [LabVIEW Platform Developer Preview 0.1.0]
# Changes the size of a file as double float to work for files larger than 2GB.
inputs:
  "refnum": ByteStreamFileRefnum
  "pos mode (end)": enum{"start", "end", "current"} = "end"
  "offset in (0)": f64
  "error in (no error)": error
outputs:
  "refnum out": ByteStreamFileRefnum
  "offset out": f64
  "error out": error
uses:
  openg::library::large file::LFU Retrieve File Handle.gvi
  openg::library::large file::LFU Set File Pointer.gvi
  openg::library::large file::LFU Get File Size.gvi
  openg::library::large file::LFU Set End Of File.gvi
diagram:
  $"refnum out" <- $refnum
  call "LFU Retrieve File Handle.gvi"(file refnum=$refnum, error in (no error)=$"error in (no error)") -> (handle out=w1, error out=w2)
  call "LFU Set File Pointer.gvi"(handle=w1, error in (no error)=w2) -> (handle out=w3, offset out=w4, error out=w5)
  case ($"pos mode (end)") {
    frame "start" {
      w6 = w5
      w7 = 0
      w8 = w3
    }
    frame "end" {
      call "LFU Get File Size.gvi"(handle=w3, error in (no error)=w5) -> (handle out=w8, file size=w7, error out=w6)
    }
    frame "current" {
      w6 = w5
      w7 = w4
      w8 = w3
    }
  }
  Is Not Equal(x="end", y=$"pos mode (end)") -> w9
  Is Greater Than 0(x=$"offset in (0)") -> w10
  Logical Or(w9, w10) -> w11
  case (w11) {
    frame False, Default {
      w12 = w6
      w13 = w7
    }
    frame True {
      Add(w7, $"offset in (0)") -> w14
      call "LFU Set File Pointer.gvi"(handle=w8, pos mode (current)="start", offset in (0)=w14, error in (no error)=w6) -> (handle out=w15, offset out=w13, error out=w16)
      call "LFU Set End Of File.gvi"(handle=w15, error in (no error)=w16) -> (handle out=w17, error out=w18)
      Is Greater(x=w13, y=w4) -> w19
      case (w19) {
        frame False, Default {
          w12 = w18
        }
        frame True {
          call "LFU Set File Pointer.gvi"(handle=w17, pos mode (current)="start", offset in (0)=w4, error in (no error)=w18) -> (error out=w12)
        }
      }
    }
  }
  $"offset out" <- w13
  $"error out" <- w12
