vi "LF Open File.gvi"   [LabVIEW Platform Developer Preview 0.1.0]
# Opens a file for reading and or writing to. This function is very similar to the LabVIEW File Open fucntion but it does not resolve shortcuts to their target file location.
inputs:
  "file path": path
  "open mode (0)": T1 = "read/write"
  "deny mode (2)": T2 = "deny none"
  "error in (no error)": error
outputs:
  "refnum out": ByteStreamFileRefnum
  "error out": error
types:
  T1 = enum{"read/write", "read-only", "write-only", "write-only (truncate)"}
  T2 = enum{"deny read/write", "deny write-only", "deny none"}
uses:
  openg::library::large file::kernel32.sli::CreateFileA
  openg::library::large file::LFU Create File Handle.gvi
  openg::library::large file::LFU Error Handler.gvi
diagram:
  Property Node(instance in=$"error in (no error)") -> ("status"=w1)
  case (w1) {
    frame False, Default {
      case ($"open mode (0)") {
        frame "read/write" {
          w4 = 0xC0000000
          w5 = 3
        }
        frame "read-only" {
          w4 = 0x80000000
          w5 = 0x3
        }
        frame "write-only" {
          w4 = 0x40000000
          w5 = 3
        }
        frame "write-only (truncate)" {
          w4 = 0x40000000
          w5 = 5
        }
      }
      case ($"deny mode (2)") {
        frame "deny read/write" {
          w6 = 0x0
        }
        frame "deny write-only" {
          w6 = 0x1
        }
        frame "deny none" {
          w6 = 0x3
        }
      }
      Path To String(path=$"file path") -> (string=w7)
      call "CreateFileA"(fileName in=w7, desiredAccess in=w4, shareMode in=w6, securityDesc in=0, creationDisposition in=w5, flagsAttributes in=0x80, TemplateFile in=0) -> (return=w8)
      Is Equal(x=w8, y=0xFFFFFFFF) -> w9
      case (w9) {
        frame False, Default {
          call "LFU Create File Handle.gvi"(file path=$"file path", handle=w8) -> (file refnum=w3, error out=w2)
        }
        frame True {
          call "LFU Error Handler.gvi"() -> (error out=w2)
          w3 = Not A Refnum
        }
      }
    }
    frame True {
      w2 = $"error in (no error)"
      w3 = Not A Refnum
    }
  }
  $"refnum out" <- w3
  $"error out" <- w2
