vi "LF Read File (SGL).gvi"   [LabVIEW Platform Developer Preview 0.1.0]
# Reads an array of single precision numbers using a double precision number as offset to work for files larger than 2GB.
inputs:
  "refnum": ByteStreamFileRefnum
  "pos mode (current)": enum{"start", "end", "current"} = "current"
  "offset in (0)": f64
  "error in (no error)": error
  "elements to read": i32
  "type": f32[]
outputs:
  "refnum out": ByteStreamFileRefnum
  "data": f32[]
  "offset out": f64
  "error out": error
uses:
  openg::library::large file::LFU Retrieve File Handle.gvi
  openg::library::large file::LFU Set File Pointer.gvi
  openg::library::large file::LFU Get File Size.gvi
  openg::library::large file::kernel32.sli::ReadFile_4
  openg::library::large file::LFU Error Handler.gvi
  openg::library::error::Build Error Cluster.gvi
diagram:
  $"refnum out" <- $refnum
  call "LFU Retrieve File Handle.gvi"(file refnum=$refnum, error in (no error)=$"error in (no error)") -> (handle out=w1, error out=w2)
  call "LFU Set File Pointer.gvi"(handle=w1, pos mode (current)=$"pos mode (current)", offset in (0)=$"offset in (0)", error in (no error)=w2) -> (handle out=w3, offset out=w4, error out=w5)
  call "LFU Get File Size.gvi"(handle=w3, error in (no error)=w5) -> (handle out=w6, file size=w7, error out=w8)
  To Unsigned Long Integer(number=$"elements to read") -> w9
  Logical Shift(x=w9, y=2) -> w10
  To Double Precision Float(number=w10) -> w11
  Subtract(x=w7, y=w4) -> w12
  Is Less(x=w12, y=w11) -> w13
  Select(s=w13, t=w12, f=w11) -> w14
  To Unsigned Long Integer(number=w14) -> w15
  case (w8) {
    frame No Error {
      Reshape Array(inArray=$type, size=$"elements to read") -> w20
      call "ReadFile_4"(handle in=w6, buffer in=w20, bytesToRead in=w15, bytesRead in=0, overlapped in=0) -> (return=w21, handle out=w16, buffer out=w18, bytesRead out=w22)
      Logical Shift(x=w22, y=-2) -> w23
      To Long Integer(number=w23) -> w19
      call "LFU Error Handler.gvi"(retval=w21) -> (error out=w17)
    }
    frame Error {
      w16 = w6
      w17 = w8
      w18 = $type
      w19 = 0
    }
  }
  Reshape Array(inArray=w18, size=w19) -> w24
  $data <- w24
  call "LFU Set File Pointer.gvi"(handle=w16, error in (no error)=w17) -> (offset out=w25, error out=w26)
  $"offset out" <- w25
  Property Node(instance in=w26) -> ("status"=w27)
  Logical And(not w27, w13) -> w28
  case (w28) {
    frame False, Default {
      w29 = w26
    }
    frame True {
      call "Build Error Cluster.gvi"(code="End of file"(4)) -> (error out=w29)
    }
  }
  $"error out" <- w29
