vi "LF Read File (STR).gvi"   [LabVIEW Platform Developer Preview 0.1.0]
# Reads a string using a double precision number as offset to work for files larger than 2GB.
inputs:
  "refnum": ByteStreamFileRefnum
  "pos mode (current)": enum{"start", "end", "current"} = "current"
  "offset in (0)": f64
  "error in (no error)": error
  "line mode (F)": bool
  "convert eol (F)": bool
  "bytes to read": i32
  "type": string
outputs:
  "refnum out": ByteStreamFileRefnum
  "String": string
  "offset out": f64
  "error out": error
uses:
  openg::library::large file::LFU Retrieve File Handle.gvi
  openg::library::large file::LFU Set File Pointer.gvi
  openg::library::large file::LFU Get File Size.gvi
  openg::library::large file::kernel32.sli::ReadFile_5
  openg::library::large file::LFU Error Handler.gvi
  openg::library::large file::LFU Convert End Of Line.gvi
  openg::library::error::Build Error Cluster.gvi
diagram:
  $"refnum out" <- $refnum
  call "LFU Retrieve File Handle.gvi"(file refnum=$refnum, error in (no error)=$"error in (no error)") -> (handle out=w1, error out=w2)
  call "LFU Set File Pointer.gvi"(handle=w1, pos mode (current)=$"pos mode (current)", offset in (0)=$"offset in (0)", error in (no error)=w2) -> (handle out=w3, offset out=w4, error out=w5)
  call "LFU Get File Size.gvi"(handle=w3, error in (no error)=w5) -> (handle out=w6, file size=w7, error out=w8)
  To Double Precision Float(number=$"bytes to read") -> w9
  Subtract(x=w7, y=w4) -> w10
  Is Less(x=w10, y=w9) -> w11
  Select(s=w11, t=w10, f=w9) -> w12
  To Unsigned Long Integer(number=w12) -> w13
  String To Byte Array(encoding="Extended ASCII", string=$type) -> (unsigned byte array=w14)
  case (w8) {
    frame No Error {
      Reshape Array(inArray=w14, size=$"bytes to read") -> w19
      call "ReadFile_5"(handle in=w6, buffer in=w19, bytesToRead in=w13, bytesRead in=0, overlapped in=0) -> (return=w20, handle out=w15, buffer out=w17, bytesRead out=w21)
      To Long Integer(number=w21) -> w18
      call "LFU Error Handler.gvi"(retval=w20) -> (error out=w16)
    }
    frame Error {
      w15 = w6
      w16 = w8
      w17 = w14
      w18 = 0
    }
  }
  Reshape Array(inArray=w17, size=w18) -> w22
  Byte Array To String(encoding="Extended ASCII", unsigned byte array=w22) -> (string=w23)
  case ($"convert eol (F)") {
    frame False, Default {
      w24 = w23
    }
    frame True {
      call "LFU Convert End Of Line.gvi"(input=w23, convert to LV=TRUE) -> (output=w24)
    }
  }
  $String <- w24
  call "LFU Set File Pointer.gvi"(handle=w15, error in (no error)=w16) -> (offset out=w25, error out=w26)
  $"offset out" <- w25
  Property Node(instance in=w26) -> ("status"=w27)
  Logical And(not w27, w11) -> w28
  case (w28) {
    frame False, Default {
      w29 = w26
    }
    frame True {
      call "Build Error Cluster.gvi"(code="End of file"(4)) -> (error out=w29)
    }
  }
  $"error out" <- w29
