vi "LF Read File (U32).gvi"   [LabVIEW Platform Developer Preview 0.1.0]
# Reads an array of 32 bit integers using a double precision number as offset to work for files larger than 2GB.
inputs:
  "refnum": ByteStreamFileRefnum
  "pos mode (current)": enum{"start", "end", "current"} = "current"
    # pos mode, together with pos offset, specifies where the read operation should begin reading.
    # 0&emsp pos mode indicates that the read operation should begin at the beginning of the file plus pos offset.
    # 1&emsp pos mode indicates that the read operation should begin at the end of the file plus pos offset.
    # 2&emsp pos mode indicates that the read operation should begin at the current location of the file mark plus pos offset.
    # If the computed location does not exist in the file, for example, pos mode = 0 and pos offset = -10, the file mark does not move, no data is read, and the function returns an error.
    # &emspIf you wire pos offset, pos mode defaults to 0, and the offset is relative to the beginning of the file. If you do not wire pos offset it defaults to 0, pos mode defaults to 2, and the read operation starts at the current file mark. Leave these inputs unwired if you want to read the data following the most recently read data.
  "offset in (0)": f64
  "error in (no error)": error
  "count": i32  # count is the number of instances of byte stream type to read. You can lock or unlock a range that extends beyond the end of the file to ensure that no other users append to a file while you append to it. This function returns an error if count is less than zero. &emsp
  "byte stream type": u32[]  # This serves only as a selection input to cause the polymorphic VI to select the proper underlaying function to handle the data.
outputs:
  "refnum out": ByteStreamFileRefnum
  "data": u32[]
  "offset out": f64
  "error out": error
uses:
  openg::library::large file::LFU Retrieve File Handle.gvi
  openg::library::large file::LFU Set File Pointer.gvi
  openg::library::large file::LFU Get File Size.gvi
  openg::library::large file::kernel32.sli::ReadFile_6
  openg::library::large file::LFU Error Handler.gvi
  openg::library::error::Build Error Cluster.gvi
diagram:
  $"refnum out" <- $refnum
  call "LFU Retrieve File Handle.gvi"(file refnum=$refnum, error in (no error)=$"error in (no error)") -> (handle out=w1, error out=w2)
  call "LFU Set File Pointer.gvi"(handle=w1, pos mode (current)=$"pos mode (current)", offset in (0)=$"offset in (0)", error in (no error)=w2) -> (handle out=w3, offset out=w4, error out=w5)
  call "LFU Get File Size.gvi"(handle=w3, error in (no error)=w5) -> (handle out=w6, file size=w7, error out=w8)
  Subtract(x=w7, y=w4) -> w9
  To Unsigned Long Integer(number=$count) -> w10
  Logical Shift(x=w10, y=2) -> w11
  To Double Precision Float(number=w11) -> w12
  Is Less(x=w9, y=w12) -> w13
  Select(s=w13, t=w9, f=w12) -> w14
  To Unsigned Long Integer(number=w14) -> w15
  case (w8) {
    frame No Error {
      Reshape Array(inArray=$"byte stream type", size=$count) -> w20
      call "ReadFile_6"(handle in=w6, buffer in=w20, bytesToRead in=w15, bytesRead in=0, overlapped in=0) -> (return=w21, handle out=w16, buffer out=w18, bytesRead out=w22)
      Logical Shift(x=w22, y=-2) -> w23
      To Long Integer(number=w23) -> w19
      call "LFU Error Handler.gvi"(retval=w21) -> (error out=w17)
    }
    frame Error {
      w16 = w6
      w17 = w8
      w18 = $"byte stream type"
      w19 = 0
    }
  }
  Reshape Array(inArray=w18, size=w19) -> w24
  $data <- w24
  call "LFU Set File Pointer.gvi"(handle=w16, error in (no error)=w17) -> (offset out=w25, error out=w26)
  $"offset out" <- w25
  Property Node(instance in=w26) -> ("status"=w27)
  Logical And(not w27, w13) -> w28
  case (w28) {
    frame False, Default {
      w29 = w26
    }
    frame True {
      call "Build Error Cluster.gvi"(code="End of file"(4)) -> (error out=w29)
    }
  }
  $"error out" <- w29
