vi "LF Seek File.gvi"   [LabVIEW Platform Developer Preview 0.1.0]
# Reads and eventually modifies the current read/write file pointer using a double float as offset to work for files larger than 2GB.
inputs:
  "refnum": ByteStreamFileRefnum
  "pos mode (current)": enum{"start", "end", "current"} = "current"
  "offset in (0)": f64
  "error in (no error)": error
outputs:
  "refnum out": ByteStreamFileRefnum
  "offset out": f64
  "error out": error
uses:
  openg::library::large file::LFU Retrieve File Handle.gvi
  openg::library::large file::LFU Set File Pointer.gvi
diagram:
  $"refnum out" <- $refnum
  call "LFU Retrieve File Handle.gvi"(file refnum=$refnum, error in (no error)=$"error in (no error)") -> (handle out=w1, error out=w2)
  call "LFU Set File Pointer.gvi"(handle=w1, pos mode (current)=$"pos mode (current)", offset in (0)=$"offset in (0)", error in (no error)=w2) -> (offset out=w3, error out=w4)
  $"offset out" <- w3
  $"error out" <- w4
