vi "LF Write File (SGL).gvi"   [LabVIEW Platform Developer Preview 0.1.0]
# Writes an array ofsingle precision numbers using a double precision number as offset to work for files larger than 2GB.
inputs:
  "refnum": ByteStreamFileRefnum
  "pos mode (current)": enum{"start", "end", "current"} = "current"
  "offset in (0)": f64
  "error in (no error)": error
  "data": f32[]
outputs:
  "refnum out": ByteStreamFileRefnum
  "offset out": f64
  "error out": error
uses:
  openg::library::large file::LFU Retrieve File Handle.gvi
  openg::library::large file::LFU Set File Pointer.gvi
  openg::library::large file::kernel32.sli::WriteFile_4
  openg::library::large file::LFU Error Handler.gvi
diagram:
  $"refnum out" <- $refnum
  call "LFU Retrieve File Handle.gvi"(file refnum=$refnum, error in (no error)=$"error in (no error)") -> (handle out=w1, error out=w2)
  call "LFU Set File Pointer.gvi"(handle=w1, pos mode (current)=$"pos mode (current)", offset in (0)=$"offset in (0)", error in (no error)=w2) -> (handle out=w3, error out=w4)
  case (w4) {
    frame No Error {
      Array Size(array=$data) -> (size(s)=w7)
      To Unsigned Long Integer(number=w7) -> w8
      Logical Shift(x=w8, y=2) -> w9
      call "WriteFile_4"(handle in=w3, buffer in=$data, bytesToRead in=w9, bytesRead in=w9, overlapped in=0) -> (return=w10, handle out=w5)
      call "LFU Error Handler.gvi"(retval=w10) -> (error out=w6)
    }
    frame Error {
      w5 = w3
      w6 = w4
    }
  }
  call "LFU Set File Pointer.gvi"(handle=w5, error in (no error)=w6) -> (offset out=w11, error out=w12)
  $"offset out" <- w11
  $"error out" <- w12
