vi "LF Write File (STR).gvi"   [LabVIEW Platform Developer Preview 0.1.0]
# Writes an string using a double precision number as offset to work for files larger than 2GB.
inputs:
  "refnum": ByteStreamFileRefnum
  "pos mode (current)": enum{"start", "end", "current"} = "current"
  "offset in (0)": f64
  "error in (no error)": error
  "convert eol (F)": bool
  "data": string
outputs:
  "refnum out": ByteStreamFileRefnum
  "offset out": f64
  "error out": error
uses:
  openg::library::large file::LFU Convert End Of Line.gvi
  openg::library::large file::LFU Retrieve File Handle.gvi
  openg::library::large file::LFU Set File Pointer.gvi
  openg::library::large file::kernel32.sli::WriteFile_5
  openg::library::large file::LFU Error Handler.gvi
diagram:
  $"refnum out" <- $refnum
  case ($"convert eol (F)") {
    frame False, Default {
      w1 = $data
    }
    frame True {
      call "LFU Convert End Of Line.gvi"(input=$data, convert to LV=FALSE) -> (output=w1)
    }
  }
  call "LFU Retrieve File Handle.gvi"(file refnum=$refnum, error in (no error)=$"error in (no error)") -> (handle out=w2, error out=w3)
  call "LFU Set File Pointer.gvi"(handle=w2, pos mode (current)=$"pos mode (current)", offset in (0)=$"offset in (0)", error in (no error)=w3) -> (handle out=w4, error out=w5)
  case (w5) {
    frame No Error {
      String To Byte Array(encoding="Extended ASCII", string=w1) -> (unsigned byte array=w8)
      Array Size(array=w8) -> (size(s)=w9)
      To Unsigned Long Integer(number=w9) -> w10
      call "WriteFile_5"(handle in=w4, buffer in=w8, bytesToRead in=w10, bytesRead in=w10, overlapped in=0) -> (return=w11, handle out=w6)
      call "LFU Error Handler.gvi"(retval=w11) -> (error out=w7)
    }
    frame Error {
      w6 = w4
      w7 = w5
    }
  }
  call "LFU Set File Pointer.gvi"(handle=w6, error in (no error)=w7) -> (offset out=w12, error out=w13)
  $"offset out" <- w12
  $"error out" <- w13
