vi "LFU Convert End Of Line.gvi"   [LabVIEW Platform Developer Preview 0.1.0]
# Low level utility function to convert EOLs.
inputs:
  "input": string
  "convert to LV": bool
outputs:
  "output": string
diagram:
  String To Byte Array(encoding="Extended ASCII", string=$input) -> (unsigned byte array=w1)
  String To Byte Array(encoding="Extended ASCII", string="\r\n") -> (unsigned byte array=w2)
  case ($"convert to LV") {
    frame False, Default {
      Array Size(array=w1) -> (size(s)=w4)
      # convert lf to according lf, cr, and cr/lf
      s1 = u8[] []  # shift register
      s2 = 0  # shift register
      while {
        s3 = 0  # shift register
        s4 = w1  # shift register
        s5 = s2  # shift register
        while {
          Array Index(array=s4) -> (out0[s5]=w5)
          Increment(x=s5) -> w6
          case (w5) {
            frame Default {
              Increment(x=s3) -> w9
              Is Less(x=w6, y=w4) -> w10
              w7 = s4
              w8 = w6
              w11 = w10
            }
            frame 10 {
              Array Index(array=s4) -> (out0[w6]=w12)
              case (w12) {
                frame Default {
                  w8 = w6
                }
                frame 13 {
                  Increment(x=w6) -> w8
                }
              }
              w7 = s4
              w9 = s3
              w10 = FALSE
              w11 = TRUE
            }
            frame 13 {
              Array Index(array=s4) -> (out0[w6]=w13)
              case (w13) {
                frame Default {
                  w8 = w6
                }
                frame 10 {
                  Increment(x=w6) -> w8
                }
              }
              w7 = s4
              w9 = s3
              w10 = FALSE
              w11 = TRUE
            }
          }
          next s3 = w9
          next s4 = w7
          next s5 = w8
          continue if w10
        }
        Array Subset(array=s4, index0=s2, length0=s3) -> w14
        case (w11) {
          frame False {
            Build Array[ConcatenateInputs=True](s1, w14) -> w15
          }
          frame True {
            Build Array[ConcatenateInputs=True](s1, w14, w2) -> w15
          }
        }
        next s1 = w15
        next s2 = s5
        continue if w11
      }
      w3 = s1
    }
    frame True {
      # convert lf, cr, and cr/lf to lf
      w3 = w1
    }
  }
  Byte Array To String(encoding="Extended ASCII", unsigned byte array=w3) -> (string=w16)
  $output <- w16
