vi "LFU Create File Handle.gvi"   [LabVIEW Platform Developer Preview 0.1.0]
# Low level utility function tocreate a LabVIEW file handle from a platform API specific file handle.
inputs:
  "file path": path
  "handle": u32
  "error in (no error)": error
outputs:
  "file refnum": ByteStreamFileRefnum
  "error out": error
uses:
  openg::library::file::LabVIEW.sli::FNewRefNum
diagram:
  case ($"error in (no error)") {
    frame No Error {
      call "FNewRefNum"(path in=$"file path", refNum in=$handle, fd in=0) -> (return=w3, fd out=w4)
      Type Cast(type=GenericRefnum Not A Refnum, x=w4) -> w2
      Is Not Equal To 0(x=w3) -> w5
      Property Node(instance in=$"error in (no error)", "status"=w5, "code"=w3, "source"="LFU Create File Handle") -> (instance out=w1)
    }
    frame Error {
      w1 = $"error in (no error)"
      w2 = GenericRefnum Not A Refnum
    }
  }
  $"file refnum" <- w2
  $"error out" <- w1
