vi "LFU Error Handler.gvi"   [LabVIEW Platform Developer Preview 0.1.0]
# Low level utility function to check for Windows API errors and create an according LabVIEW error cluster.
inputs:
  "retval": u32
  "prepend string": string
outputs:
  "error out": error
panel controls:
  "error in (no error)": error
uses:
  openg::library::large file::kernel32.sli::GetLastError
  openg::library::error::Build Error Cluster.gvi
diagram:
  Is Equal To 0(x=$retval) -> w1
  case (w1) {
    frame False, Default {
      w2 = 0
    }
    frame True {
      # GetLastError()
      call "GetLastError"() -> (return=w2)
    }
  }
  case (w2) {
    frame Default {
      Format Into String(formatString="WinError: %d; ", initString=$"prepend string", w2) -> w4
      call "Build Error Cluster.gvi"(code="Generic file I/O error"(6), String to Prepend to source ("")=w4) -> (error out=w3)
    }
    frame 0 {
      w3 = $"error in (no error)"
    }
  }
  $"error out" <- w3
