vi "LFU Get File Size.gvi"   [LabVIEW Platform Developer Preview 0.1.0]
# Low level utility function to retrieve the size of a file as double precision number to work for files larger than 2GB.
inputs:
  "handle": u32
  "error in (no error)": error
outputs:
  "handle out": u32
  "file size": f64
  "error out": error
uses:
  openg::library::large file::kernel32.sli::GetFileSize
  openg::library::large file::kernel32.sli::GetLastError
diagram:
  case ($"error in (no error)") {
    frame No Error {
      call "GetFileSize"(handle in=$handle, sizeHigh in=0) -> (return=w4, handle out=w1, sizeHigh out=w5)
      Is Equal(x=w4, y=0xFFFFFFFF) -> w6
      # DWORD GetFileSize(
      #   HANDLE hFile,  // handle of file to get size of
      #   LPDWORD lpFileSizeHigh
      #                  // pointer to high-order word for file size
      # );
      case (w6) {
        frame False, Default {
          w7 = 0
        }
        frame True {
          # GetLastError()
          call "GetLastError"() -> (return=w7)
        }
      }
      case (w7) {
        frame Default {
          Property Node(instance in=$"error in (no error)", "status"=TRUE, "code"="Generic file I/O error"(6), "source"="LF Get File Size") -> (instance out=w2)
          w3 = 0
        }
        frame 0 {
          Multiply(w5, 4294967296) -> w8
          Add(w4, w8) -> w3
          w2 = $"error in (no error)"
        }
      }
    }
    frame Error {
      w1 = $handle
      w2 = $"error in (no error)"
      w3 = 0
    }
  }
  $"handle out" <- w1
  $"file size" <- w3
  $"error out" <- w2
