vi "LFU Retrieve File Handle.gvi"   [LabVIEW Platform Developer Preview 0.1.0]
# Low level utility function to retrieve the platform API specific file handle from a LabVIEW file handle.
inputs:
  "file refnum": ByteStreamFileRefnum
  "error in (no error)": error
outputs:
  "handle out": u32
  "error out": error
uses:
  openg::library::file::LabVIEW.sli::FRefNumToFD
diagram:
  case ($"error in (no error)") {
    frame No Error {
      Type Cast(type=u32 0, x=$"file refnum") -> w3
      call "FRefNumToFD"(refNum in=w3) -> (return=w4, fd out=w1)
      Is Not Equal To 0(x=w4) -> w5
      Property Node(instance in=$"error in (no error)", "status"=w5, "code"=w4, "source"="LF Retrieve File Handle") -> (instance out=w2)
    }
    frame Error {
      w1 = 0
      w2 = $"error in (no error)"
    }
  }
  $"handle out" <- w1
  $"error out" <- w2
