vi "LFU Set End Of File.gvi"   [LabVIEW Platform Developer Preview 0.1.0]
# Low level utility function to change the size of a file using a double precision number to work for files larger than 2GB.
inputs:
  "handle": u32
  "error in (no error)": error
outputs:
  "handle out": u32
  "error out": error
uses:
  openg::library::large file::kernel32.sli::SetEndOfFile
  openg::library::large file::kernel32.sli::GetLastError
diagram:
  case ($"error in (no error)") {
    frame No Error {
      # BOOL ReadFile(
      #   HANDLE hFile,                // handle of file to read
      #   LPVOID lpBuffer,             // pointer to buffer that receives data
      #   DWORD nNumberOfBytesToRead,  // number of bytes to read
      #   LPDWORD lpNumberOfBytesRead, // pointer to number of bytes read
      #   LPOVERLAPPED lpOverlapped    // pointer to structure for data
      # );
      call "SetEndOfFile"(handle in=$handle) -> (return=w3, handle out=w1)
      Is Equal To 0(x=w3) -> w4
      case (w4) {
        frame False, Default {
          w5 = 0
        }
        frame True {
          # GetLastError()
          call "GetLastError"() -> (return=w5)
        }
      }
      case (w5) {
        frame Default {
          Property Node(instance in=$"error in (no error)", "status"=TRUE, "code"="Generic file I/O error"(6), "source"="LF Set End Of File") -> (instance out=w2)
        }
        frame 0 {
          w2 = $"error in (no error)"
        }
      }
    }
    frame Error {
      w1 = $handle
      w2 = $"error in (no error)"
    }
  }
  $"handle out" <- w1
  $"error out" <- w2
