vi "LFU Set File Pointer.gvi"   [LabVIEW Platform Developer Preview 0.1.0]
# Low level utility function to change the current read/write pointer in a file using a double precision number to work for files larger than 2GB.
inputs:
  "handle": u32
  "pos mode (current)": enum{"start", "end", "current"} = "current"
  "offset in (0)": f64
  "error in (no error)": error
outputs:
  "handle out": u32
  "offset out": f64
  "error out": error
uses:
  openg::library::large file::kernel32.sli::SetFilePointer
  openg::library::large file::kernel32.sli::GetLastError
diagram:
  case ($"error in (no error)") {
    frame No Error {
      Array Index(array=["BEGIN", "END", "CURRENT"]) -> (out0[$"pos mode (current)"]=w4)
      Quotient And Remainder(x=$"offset in (0)", y=4294967296) -> (floor(x/y)=w5, x-y*floor(x/y)=w6)
      To Unsigned Long Integer(number=w6) -> w7
      # DWORD SetFilePointer(
      #   HANDLE hFile,          // handle of file
      #   LONG lDistanceToMove,  // number of bytes to move file pointer
      #   PLONG lpDistanceToMoveHigh,
      #                          // pointer to high-order DWORD of
      #                          // distance to move
      #   DWORD dwMoveMethod     // how to move
      # );
      To Long Integer(number=w5) -> w8
      call "SetFilePointer"(handle in=$handle, dist in=w7, lpDistHigh in=w8, method in=w4) -> (return=w9, handle out=w1, lpDistHigh out=w10)
      Is Equal(x=w9, y=0xFFFFFFFF) -> w11
      case (w11) {
        frame False, Default {
          w12 = 0
        }
        frame True {
          # GetLastError()
          call "GetLastError"() -> (return=w12)
        }
      }
      case (w12) {
        frame Default {
          Property Node(instance in=$"error in (no error)", "status"=TRUE, "code"="Generic file I/O error"(6), "source"="LF Set File Pointer") -> (instance out=w3)
          w2 = 0
        }
        frame 0 {
          Multiply(w10, 4294967296) -> w13
          Add(w9, w13) -> w2
          w3 = $"error in (no error)"
        }
      }
    }
    frame Error {
      w1 = $handle
      w2 = $"offset in (0)"
      w3 = $"error in (no error)"
    }
  }
  $"error out" <- w3
  $"offset out" <- w2
  $"handle out" <- w1
