vi "VI Tree - Large File.gvi"   [LabVIEW Platform Developer Preview 0.1.0]
uses:
  openg::library::large file::LF Open File.gvi
  openg::library::large file::LF Read File (STR).gvi
  openg::library::large file::LF Write File (STR).gvi
  openg::library::large file::LF End Of File.gvi
  openg::library::large file::LF Seek File.gvi
  openg::library::large file::LF Read File (I16).gvi
  openg::library::large file::LF Write File (I16).gvi
  openg::library::large file::LFU Error Handler.gvi
  openg::library::large file::LF Read File (I32).gvi
  openg::library::large file::LF Write File (I32).gvi
  openg::library::large file::LF Read File (SGL).gvi
  openg::library::large file::LF Write File (SGL).gvi
  openg::library::large file::LF Read File (DBL).gvi
  openg::library::large file::LF Write File (DBL).gvi
  openg::library::large file::LF Read File (U32).gvi
  openg::library::large file::LF Write File (U32).gvi
  openg::library::large file::LFU Retrieve File Handle.gvi
  openg::library::large file::LFU Get File Size.gvi
  openg::library::large file::LFU Set End Of File.gvi
  openg::library::large file::LFU Set File Pointer.gvi
diagram:
  call "LF Open File.gvi"()
  call "LF Read File (STR).gvi"()
  call "LF Write File (STR).gvi"()
  call "LF End Of File.gvi"()
  call "LF Seek File.gvi"()
  call "LF Read File (STR).gvi"()
  call "LF Write File (STR).gvi"()
  call "LF Read File (I16).gvi"()
  call "LF Write File (I16).gvi"()
  call "LFU Error Handler.gvi"()
  call "LF Read File (I32).gvi"()
  call "LF Write File (I32).gvi"()
  call "LF Read File (SGL).gvi"()
  call "LF Write File (SGL).gvi"()
  call "LF Read File (DBL).gvi"()
  call "LF Write File (DBL).gvi"()
  call "LF Read File (U32).gvi"()
  call "LF Write File (U32).gvi"()
  call "LFU Retrieve File Handle.gvi"()
  call "LFU Get File Size.gvi"()
  call "LFU Set End Of File.gvi"()
  call "LFU Set File Pointer.gvi"()
