vi "MD5 FGHI functions.gvi"   [LabVIEW Platform Developer Preview 0.1.0]
inputs:
  "Chaining Variables": u32[]
  "Operator function": enum{"F", "G", "H", "I"} = "F"
  "Mj": u32
  "s": i32
  "ti": u32
outputs:
  "Resulting Chaining Variables": u32[]
uses:
  openg::library::md5::MD5 F function.gvi
  openg::library::md5::MD5 G function.gvi
  openg::library::md5::MD5 H function.gvi
  openg::library::md5::MD5 I function.gvi
diagram:
  Array Index(array=$"Chaining Variables") -> (out0[1]=w1)
  Array Index(array=$"Chaining Variables") -> (out0[0]=w2)
  Array Index(array=$"Chaining Variables") -> (out0[2]=w3)
  Array Index(array=$"Chaining Variables") -> (out0[3]=w4)
  case ($"Operator function") {
    frame "F", Default {
      call "MD5 F function.gvi"(X=w1, Y=w3, Z=w4) -> (F(X,Y,Z)=w5)
    }
    frame "G" {
      call "MD5 G function.gvi"(X=w1, Y=w3, Z=w4) -> (G(X,Y,Z)=w5)
    }
    frame "H" {
      call "MD5 H function.gvi"(X=w1, Y=w3, Z=w4) -> (H(X,Y,Z)=w5)
    }
    frame "I" {
      call "MD5 I function.gvi"(X=w1, Y=w3, Z=w4) -> (I(X,Y,Z)=w5)
    }
  }
  Add(w2, w5, $Mj, $ti) -> w6
  Rotate(x=w6, y=$s) -> w7
  Add(w1, w7) -> w8
  Replace Array Subset(inArray=$"Chaining Variables", index=0, new=w8) -> w9
  $"Resulting Chaining Variables" <- w9
