vi "MD5 Hash.gvi"   [LabVIEW Platform Developer Preview 0.1.0]
# MD5 Hash? returns TRUE if Input String represents an MD5 Hash otherwise, it returns FALSE.
# For a valid Hash the Input String should be 32 characters and consist of the following characters: 0-9, a-f or A-F.
# E.g. "6a204bd89f3c8348afd5c77c717a097a" or "6A204BD89F3C8348AFD5C77C717A097A"
# If Strict Case = TRUE, Input String should only consist of the following characters: 0-9 or a-f.
# E.g. "6a204bd89f3c8348afd5c77c717a097a"
inputs:
  "Input String": string, required
  "Strict Case? (False)": bool
outputs:
  "MD5 Hash?": bool
diagram:
  Select(s=$"Strict Case? (False)", t="^[0-9a-f]+$", f="^[0-9a-fA-F]+$") -> w1
  Match Pattern(regular expression=w1, string=$"Input String") -> (match substring=w2)
  String Length(string=w2) -> (length=w3)
  Is Equal(x=w3, y=32) -> w4
  $"MD5 Hash?" <- w4
