vi "MD5 I function.gvi"   [LabVIEW Platform Developer Preview 0.1.0]
inputs:
  "X": u32
  "Y": u32
  "Z": u32
outputs:
  "I(X,Y,Z)": u32
diagram:
  Not(x=$Z) -> w1
  Logical Or(w1, $X) -> w2
  Logical Exclusive Or(w2, $Y) -> w3
  $"I(X,Y,Z)" <- w3
