vi "MD5 Message Digest (Binary String).gvi"   [LabVIEW Platform Developer Preview 0.1.0]
# Implements the MD5 algorithm to produce a 128-Bit Hash condensed representation of a message or a data file.
# Polymorphic VI can output MD5 Hash as Binary String or Hexadeximal String.
inputs:
  "Message": string, required
outputs:
  "MD5 Message Digest": string
uses:
  openg::library::md5::MD5 ti.gvi
  openg::library::md5::MD5 Padding.gvi
  openg::library::md5::MD5 FGHI functions.gvi
diagram:
  for (N = 64) (iteration -> i1) {
    Increment(x=i1) -> w2
    call "MD5 ti.gvi"(i=w2) -> (ti=w3)
    append w3 to w1
  }
  call "MD5 Padding.gvi"(String=$Message) -> (MD5 Padded String=w4)
  Type Cast(type=u32[] [], x=w4) -> w5
  Swap Bytes(data=w5) -> (byte swapped=w6)
  Swap Words(data=w6) -> (word swapped=w7)
  Array Size(array=w7) -> (size(s)=w8)
  Quotient And Remainder(x=w8, y=16) -> (floor(x/y)=w9)
  Reshape Array(inArray=w7, size=w9, size=16) -> w10
  w11 = 0x67452301  # A
  w12 = 0x10325476  # D
  Build Array(w11, 0xEFCDAB89, 0x98BADCFE, w12) -> w13
  s1 = w13  # shift register
  for {
    w14 = each element of w10
    s2 = s1  # shift register
    for (iteration -> i2) {
      w15 = each element of w1
      case (i2) {
        frame 0..15, Default {
          Quotient And Remainder(x=i2, y=16) -> (x-y*floor(x/y)=w19)
          w20 = [0, 1, 2, 3, 4, 5, 6, 7, 8, 9, 10, 11, 12, 13, 14, 15]  # Round 1
          Array Index(array=w20) -> (out0[w19]=w18)
          Quotient And Remainder(x=i2, y=4) -> (x-y*floor(x/y)=w21)
          case (w21) {
            frame 0, Default {
              w17 = 7
            }
            frame 1 {
              w17 = 12
            }
            frame 2 {
              w17 = 17
            }
            frame 3 {
              w17 = 22
            }
          }
          w16 = "F"
        }
        frame 16..31 {
          w22 = [1, 6, 11, 0, 5, 10, 15, 4, 9, 14, 3, 8, 13, 2, 7, 12]  # Round 2
          Quotient And Remainder(x=i2, y=16) -> (x-y*floor(x/y)=w23)
          Array Index(array=w22) -> (out0[w23]=w18)
          Quotient And Remainder(x=i2, y=4) -> (x-y*floor(x/y)=w24)
          case (w24) {
            frame 0, Default {
              w17 = 5
            }
            frame 1 {
              w17 = 9
            }
            frame 2 {
              w17 = 14
            }
            frame 3 {
              w17 = 20
            }
          }
          w16 = "G"
        }
        frame 32..47 {
          w25 = [5, 8, 11, 14, 1, 4, 7, 10, 13, 0, 3, 6, 9, 12, 15, 2]  # Round 3
          Quotient And Remainder(x=i2, y=16) -> (x-y*floor(x/y)=w26)
          Array Index(array=w25) -> (out0[w26]=w18)
          Quotient And Remainder(x=i2, y=4) -> (x-y*floor(x/y)=w27)
          case (w27) {
            frame 0, Default {
              w17 = 4
            }
            frame 1 {
              w17 = 11
            }
            frame 2 {
              w17 = 16
            }
            frame 3 {
              w17 = 23
            }
          }
          w16 = "H"
        }
        frame 48..63 {
          w28 = [0, 7, 14, 5, 12, 3, 10, 1, 8, 15, 6, 13, 4, 11, 2, 9]  # Round 4
          Quotient And Remainder(x=i2, y=16) -> (x-y*floor(x/y)=w29)
          Array Index(array=w28) -> (out0[w29]=w18)
          Quotient And Remainder(x=i2, y=4) -> (x-y*floor(x/y)=w30)
          case (w30) {
            frame 0, Default {
              w17 = 6
            }
            frame 1 {
              w17 = 10
            }
            frame 2 {
              w17 = 15
            }
            frame 3 {
              w17 = 21
            }
          }
          w16 = "I"
        }
      }
      Array Index(array=w14) -> (out0[w18]=w31)
      call "MD5 FGHI functions.gvi"(Chaining Variables=s2, Operator function=w16, Mj=w31, s=w17, ti=w15) -> (Resulting Chaining Variables=w32)
      Rotate 1D Array(array=w32, n=1) -> (array (last n elements first)=w33)
      next s2 = w33
    }
    Add(s1, s2) -> w34
    next s1 = w34
  }
  Swap Bytes(data=s1) -> (byte swapped=w35)
  Swap Words(data=w35) -> (word swapped=w36)
  Type Cast(type=string "", x=w36) -> w37
  $"MD5 Message Digest" <- w37
