vi "MD5 Message Digest (Hexadecimal String).gvi"   [LabVIEW Platform Developer Preview 0.1.0]
# Implements the MD5 algorithm to produce a 128-Bit Hash condensed representation of a message or a data file.
# Polymorphic VI can output MD5 Hash as Binary String or Hexadeximal String.
inputs:
  "Message": string, required
outputs:
  "MD5 Message Digest": string
uses:
  openg::library::md5::MD5 Message Digest (Binary String).gvi
diagram:
  call "MD5 Message Digest (Binary String).gvi"(Message=$Message) -> (MD5 Message Digest=w1)
  String To Byte Array(encoding="Extended ASCII", string=w1) -> (unsigned byte array=w2)
  # Converts Binary MD5 string to Hexadecimal MD5 string, output should always be lower case (LabVIEW default is uppercase).
  #
  # Reference:
  # RFC - Using Digest Authentication as a SASL Mechanism (http://www.ietf.org/rfc/rfc2831.txt)
  Number To Hexadecimal String(number=w2, width (-)=2) -> (hex integer string=w3)
  Concatenate Strings(w3) -> w4
  To Lower Case(string=w4) -> w5
  $"MD5 Message Digest" <- w5
