vi "MD5 Padding.gvi"   [LabVIEW Platform Developer Preview 0.1.0]
inputs:
  "String": string
outputs:
  "MD5 Padded String": string
uses:
  openg::library::md5::MD5 Unrecoverable character padding.gvi
diagram:
  Concatenate Strings("00000000", $String, "€") -> w1
  # MD5 requires the last 64 bits
  # to be the length of the string
  call "MD5 Unrecoverable character padding.gvi"(Message=w1, Block Size (16)=64) -> (Padded message=w2)
  Search Or Split String(offset=8, search string/char="", string=w2) -> (match + rest of string=w3)
  String Length(string=$String) -> (length=w4)
  To Unsigned Long Integer(number=w4) -> w5
  Number To Boolean Array(number=w5) -> (Boolean array=w6)
  Number To Boolean Array(number=0x0) -> (Boolean array=w7)
  Build Array[ConcatenateInputs=True](w6, w7) -> w8
  Rotate 1D Array(array=w8, n=3) -> (array (last n elements first)=w9)
  Split 1D Array(array=w9, index=32) -> (first subarray=w10, second subarray=w11)
  Boolean Array To Number(Boolean array=w10) -> (number=w12)
  Boolean Array To Number(Boolean array=w11) -> (number=w13)
  Build Array(w12, w13) -> w14
  Swap Bytes(data=w14) -> (byte swapped=w15)
  Swap Words(data=w15) -> (word swapped=w16)
  Type Cast(type=$String, x=w16) -> w17
  Concatenate Strings(w3, w17) -> w18
  $"MD5 Padded String" <- w18
