vi "MD5 Unrecoverable character padding.gvi"   [LabVIEW Platform Developer Preview 0.1.0]
# Insert a number of Padding Character until the length of the string is a multiple of Block Size.
inputs:
  "Message": string  # Original message
  "Block Size (16)": i32 = 16  # Message will be padded until its size (number of characters) is a multiple of this value.
outputs:
  "Padded message": string  # Message padded with Padding Character to make its size a multiple of Block Size. The last 4 characters are Message original size (in hex format).
diagram:
  String Length(string=$Message) -> (length=w1)
  Quotient And Remainder(x=w1, y=$"Block Size (16)") -> (x-y*floor(x/y)=w2)
  case (w2) {
    frame 0 {
      w3 = default
    }
    frame 1, Default {
      Subtract(x=$"Block Size (16)", y=w2) -> w4
      Initialize Array(element="", size=w4) -> w5
      Concatenate Strings(w5) -> w3
    }
  }
  Concatenate Strings($Message, w3) -> w6
  $"Padded message" <- w6
