vi "Random Number - Within Range.gvi"   [LabVIEW Platform Developer Preview 0.1.0]
# Generates a Random Number between High and Low inputs. If the inputs are unwired, High defaults to 1 and Low defaults to 0.
# This VI is Private users should call the Public function Random Number Within Range  (polymorphic VI) instead.
inputs:
  "Max (1.00)": f64 = 1
  "Min (0.00)": f64
outputs:
  "Random Number": f64
diagram:
  Random Number() -> (number (0 to 1)=w1)
  Subtract(x=$"Max (1.00)", y=$"Min (0.00)") -> w2
  Multiply(w1, w2) -> w3
  Add(w3, $"Min (0.00)") -> w4
  $"Random Number" <- w4
