vi "Random Number - Within Range__ogtk.gvi"   [LabVIEW Platform Developer Preview 0.1.0]
# Generates a Random Number between High and Low inputs. If the inputs are unwired, High defaults to 1 and Low defaults to 0.
# This VI is Private users should call the Public function Random Number Within Range  (polymorphic VI) instead.
inputs:
  "High (1.00)": f64 = 1
  "Low (0.00)": f64
outputs:
  "Random Number": f64
diagram:
  Subtract(x=$"High (1.00)", y=$"Low (0.00)") -> w1
  Random Number() -> (number (0 to 1)=w2)
  Multiply(w2, w1) -> w3
  Add(w3, $"Low (0.00)") -> w4
  $"Random Number" <- w4
