vi "Random Number Within Range - I32.gvi"   [LabVIEW Platform Developer Preview 0.1.0]
# Generates a Random Number between High and Low inputs. Prechecks data to ensure that High is greater than Low.
inputs:
  "High": i32 = 1, required
  "Low": i32, required
outputs:
  "Random Number": i32
uses:
  openg::library::numeric::Random Number - Within Range.gvi
diagram:
  # This VI is a wrapper around the Random Number VI that prechecks High and Low and makes all inputs 'Required'.
  #
  # For even distribution between Low and High for an integer, High is incremented by one then the Random Number is rounded down.
  Max And Min(x=$High, y=$Low) -> (min(x,y)=w1: i32, max(x,y)=w2: i32)
  To Double Precision Float(number=w1) -> w3
  To Double Precision Float(number=w2) -> w4
  Increment(x=w4) -> w5
  call "Random Number - Within Range.gvi"(Max (1.00)=w5, Min (0.00)=w3) -> (Random Number=w6)
  Round Toward Negative Infinity(x=w6) -> w7
  To Long Integer(number=w7) -> w8
  $"Random Number" <- w8
