vi "1D Array to String.gvi"   [LabVIEW Platform Developer Preview 0.1.0]
# Converts 1D Array of strings to a delimited string
inputs:
  "Array of Strings": string[], required
  "delimiter (Tab)": string
outputs:
  "delimited string": string
diagram:
  Array To Spreadsheet String(array=$"Array of Strings", delimiter=$"delimiter (Tab)", format string="%s") -> (spreadsheet string=w1)
  # Match last EOL:
  # anchor at rear
  Concatenate Strings("\r\n", "$") -> w2
  Match Pattern(regular expression=w2, string=w1) -> (before substring=w3)
  $"delimited string" <- w3
