vi "Convert EOLs (String).gvi"   [LabVIEW Platform Developer Preview 0.1.0]
# Converts all EOLs in the string to the type specified.  A CRLF pair (\r\n) is considered to be one EOL.  Therefore all CRLF pairs may be converted to just a CR or just a LF.  Likewise single CRs or LFs may be converted to CRLF pairs.  LabVIEW's Write File VIs have this option built into them, but Serial, TCP-IP, and others do not.  There is no way to "escape" a CR, LF, or CRLF as not an EOL so be careful when using this utility.
inputs:
  "String in": string, required
  "Convert to:": enum{"CR", "LF", "CRLF"} = "CR"
outputs:
  "String out": string
diagram:
  Search And Replace String(input string=$"String in", replace all (F)=TRUE, replace string ("")="\n", search string="\r\n") -> (result string=w1)
  Search And Replace String(input string=w1, replace all (F)=TRUE, replace string ("")="\n", search string="\r") -> (result string=w2)
  Array Index(array=["\r", "\n", "\r\n"]) -> (out0[$"Convert to:"]=w3)
  Search And Replace String(input string=w2, replace all (F)=TRUE, replace string ("")=w3, search string="\n") -> (result string=w4)
  $"String out" <- w4
