vi "Format Variant Into String.gvi"   [LabVIEW Platform Developer Preview 0.1.0]
# Overcomes a limitation of "Format Into String" by allowing variant data types to be used. This VI supports variant data for all LabVIEW data types supported by "Format Into String".
# Notes:
# Format string input may optionally be passed as a variant attribute named "Format String".
# ISO 8601 is used as the default formating for Timestamp unless otherwise specified. Timestamp data must use the Format String: %T (or variations of %T), otherwise it will return an error.
inputs:
  "Input String": string
  "error in (no error)": error
  "Variant": variant, required
  "Format String": string
outputs:
  "Output String": string
  "error out": error
uses:
  openg::library::variant data::Get TDEnum from Data.gvi
  openg::library::error::Build Error Cluster.gvi
  openg::library::variant data::Get Refnum Type Enum from Data.gvi
  openg::library::variant data::Strip Units.gvi
  openg::library::variant data::Get Strings from Enum.gvi
  openg::library::variant data::Get Waveform Type Enum from Data.gvi
  openg::library::string::Resolve Timestamp Format.gvi
diagram:
  case ($"error in (no error)") {
    frame No Error {
      Get Variant Attribute(default value=$"Format String", name="Format String", variant=$Variant) -> (value=w3)
      call "Get TDEnum from Data.gvi"(Data=$Variant) -> (Type Descriptor Enumeration=w4)
      case (w4) {
        frame "<Null>", Default {
          Format Into String(formatString="Unexpected Datatype <%s>", w4) -> w6
          call "Build Error Cluster.gvi"(code="Argument error"(1), String to Prepend to source ("")=w6) -> (error out=w2)
          w5 = ""
        }
        frame "I8".."I64" {
          w7 = i64 0  # I64 Type
          Variant To Data(error in (no error)=$"error in (no error)", type=w7, variant=$Variant) -> (data=w8, error out=w9)
          Format Into String(formatString=w3, errIn=w9, w8) -> (outString=w5, errOut=w2)
        }
        frame "Refnum" {
          call "Get Refnum Type Enum from Data.gvi"(Data=$Variant) -> (Refnum Subtype Enum=w10)
          # The Default case is the code original VI; and VISA, IVI, Hardware generated an Error before, so the Refnum case is backwards compatible.
          case (w10) {
            frame Default {
              Variant To Data(error in (no error)=$"error in (no error)", type=GenericRefnum Not A Refnum, variant=$Variant) -> (data=w11, error out=w12)
              w13 = u32 0  # U32
              Type Cast(type=w13, x=w11) -> w14
              Format Into String(formatString=w3, errIn=w12, w14) -> (outString=w5, errOut=w2)
            }
            frame "VISA Resource".."IVI Logical Name", "Hardware Plugin Tag Refnum" {
              Variant To Data(error in (no error)=$"error in (no error)", type=string "", variant=$Variant) -> (data=w15, error out=w16)
              Format Into String(formatString=w3, errIn=w16, w15) -> (outString=w5, errOut=w2)
            }
          }
        }
        frame "U8".."U64" {
          w17 = u64 0  # U64 Type
          Variant To Data(error in (no error)=$"error in (no error)", type=w17, variant=$Variant) -> (data=w18, error out=w19)
          Format Into String(formatString=w3, errIn=w19, w18) -> (outString=w5, errOut=w2)
        }
        frame "SGL PQ".."EXT PQ" {
          call "Strip Units.gvi"(Number or 1D array with units=$Variant, error in (no error)=$"error in (no error)") -> (Pure Number(s) (base units)=w20, error out=w21)
          w22 = f64 0  # EXT Type
          Variant To Data(error in (no error)=w21, type=w22, variant=w20) -> (data=w23, error out=w24)
          Format Into String(formatString=w3, errIn=w24, w23) -> (outString=w5, errOut=w2)
        }
        frame "SGL".."EXT" {
          w25 = f64 0  # EXT Type
          Variant To Data(error in (no error)=$"error in (no error)", type=w25, variant=$Variant) -> (data=w26, error out=w27)
          Format Into String(formatString=w3, errIn=w27, w26) -> (outString=w5, errOut=w2)
        }
        frame "CSG".."CXT" {
          w28 = c128 0+0i  # CXT Type
          Variant To Data(error in (no error)=$"error in (no error)", type=w28, variant=$Variant) -> (data=w29, error out=w30)
          Format Into String(formatString=w3, errIn=w30, w29) -> (outString=w5, errOut=w2)
        }
        frame "CSG PQ".."CXT PQ" {
          call "Strip Units.gvi"(Number or 1D array with units=$Variant, error in (no error)=$"error in (no error)") -> (Pure Number(s) (base units)=w31, error out=w32)
          w33 = c128 0+0i  # CXT Type
          Variant To Data(error in (no error)=w32, type=w33, variant=w31) -> (data=w34, error out=w35)
          Format Into String(formatString=w3, errIn=w35, w34) -> (outString=w5, errOut=w2)
        }
        frame "Boolean" {
          Variant To Data(error in (no error)=$"error in (no error)", type=bool FALSE, variant=$Variant) -> (data=w36, error out=w37)
          Format Into String(formatString=w3, errIn=w37, w36) -> (outString=w5, errOut=w2)
        }
        frame "String", "DAQ" {
          Variant To Data(error in (no error)=$"error in (no error)", type=string "", variant=$Variant) -> (data=w38, error out=w39)
          Format Into String(formatString=w3, errIn=w39, w38) -> (outString=w5, errOut=w2)
        }
        frame "Path" {
          Variant To Data(error in (no error)=$"error in (no error)", type=path path "", variant=$Variant) -> (data=w40, error out=w41)
          Format Into String(formatString=w3, errIn=w41, w40) -> (outString=w5, errOut=w2)
        }
        frame "Enum U8".."Enum U32" {
          call "Get Strings from Enum.gvi"(Enum=$Variant, error in (no error)=$"error in (no error)") -> (String Value=w5, error out=w2)
        }
        frame "Waveform" {
          call "Get Waveform Type Enum from Data.gvi"(Data=$Variant) -> (Waveform Subtype Enum=w42)
          case (w42) {
            frame Default {
              Format Into String(formatString="Unexpected Waveform Datatype <%s>", w42) -> w43
              call "Build Error Cluster.gvi"(code="Argument error"(1), String to Prepend to source ("")=w43) -> (error out=w2)
              w5 = ""
            }
            frame "Timestamp" {
              Variant To Data(error in (no error)=$"error in (no error)", type=timestamp 1904-01-01T00:00:00Z, variant=$Variant) -> (data=w44, error out=w45)
              call "Resolve Timestamp Format.gvi"(Timestamp Format In=w3) -> (Timestamp Format Out=w46)
              Format Into String(formatString=w46, errIn=w45, w44) -> (outString=w5, errOut=w2)
            }
          }
        }
      }
      Concatenate Strings($"Input String", w5) -> w1
    }
    frame Error {
      w1 = ""
      w2 = $"error in (no error)"
    }
  }
  $"Output String" <- w1
  $"error out" <- w2
