vi "Multi-line String to Array.gvi"   [LabVIEW Platform Developer Preview 0.1.0]
# Converts a multiline input string to a 1D array of lines (without EOLs). If the input string ends in an EOL, then the last line will be removed (since it is empty) -- this behavior is useful for instrument communication where the last line ends with a EOL character that we do not wish to treat as a seperate line (since it contains no data).
inputs:
  "string": string, required
outputs:
  "lines": string[]
uses:
  openg::library::string::Convert EOLs (String).gvi
  openg::library::string::String to 1D Array.gvi
diagram:
  # Convert all EOLs to CRLF and then split string at CRLF.  Outputs array of lines (without EOLs).
  call "Convert EOLs (String).gvi"(String in=$string, Convert to:="CRLF") -> (String out=w1)
  # all lines
  call "String to 1D Array.gvi"(string=w1, delimiter (Tab)="\r\n") -> (Array of Strings=w2)
  # delete last line (element) from array
  # all but last line
  # last line
  # all lines
  Delete From Array(inArray=w2) -> (outArray=w3, deleted=w4)
  # Is last element empty?
  # discard last line?
  Is Empty String Or Path(string/path=w4) -> w5
  Select(s=w5, t=w3, f=w2) -> w6
  $lines <- w6
