vi "Place Number to Proper Engl Text.gvi"   [LabVIEW Platform Developer Preview 0.1.0]
# Converts a place number to proper English text (examples:  1 becomes first, 15 becoms fifteenth).  Rounds off to whole numbers and can handle up to 10^63 (vigintillion) places.
inputs:
  "Numeric": f64, required
outputs:
  "String": string
panel indicators:
  "hasHundredsPlace": bool
  "hasTensPlace": bool
  "isTeen": bool
  "hasOnesPlace": bool
diagram:
  Format Into String(formatString="%0.0f", $Numeric) -> w1
  Reverse String(string=w1) -> (reversed=w2)
  String Length(string=w1) -> (length=w3)
  Divide(x=w3, y=3) -> w4
  Round Toward Positive Infinity(x=w4) -> w5
  s1 = w2  # shift register
  for (N = w5) {
    Search Or Split String(offset=3, string=s1) -> (match + rest of string=w7, substring before match=w8)
    append w8 to w6
    next s1 = w7
  }
  Reverse String(string=w6) -> (reversed=w9)
  Reverse 1D Array(array=w9) -> (reversed array=w10)
  s2 = ""  # shift register
  for (N -> w11) (iteration -> i1) {
    w12 = each element of w10
    Subtract(x=w11, y=i1) -> w13
    Decrement(x=w13) -> w14
    Reverse String(string=w12) -> (reversed=w15)
    sequence {
      frame 0 {
        $isTeen <- FALSE
        $hasOnesPlace <- FALSE
        $hasTensPlace <- FALSE
        $hasHundredsPlace <- FALSE
      }
      frame 1 {
        String Length(string=w15) -> (length=w16)
        Is Equal(x=w16, y=3) -> w17
        case (w17) {
          frame False, Default { }
          frame True {
            String Subset(length (rest)=1, offset (0)=2, string=w15) -> w18
            Is Not Equal(x=w18, y="0") -> w19
            $hasHundredsPlace <- w19
          }
        }
        Is Greater Or Equal(x=w16, y=1) -> w20
        case (w20) {
          frame False, Default { }
          frame True {
            String Subset(length (rest)=1, offset (0)=0, string=w15) -> w21
            Is Not Equal(x=w21, y="0") -> w22
            $hasOnesPlace <- w22
          }
        }
        Is Greater Or Equal(x=w16, y=2) -> w23
        case (w23) {
          frame False, Default { }
          frame True {
            String Subset(length (rest)=1, offset (0)=1, string=w15) -> w24
            Is Not Equal(x=w24, y="0") -> w25
            $hasTensPlace <- w25
            Is Equal(x=w24, y="1") -> w26
            String Subset(length (rest)=1, offset (0)=0, string=w15) -> w27
            Is Not Equal(x=w27, y="0") -> w28
            Logical And(w26, w28) -> w29
            $isTeen <- w29
          }
        }
      }
      frame 2 {
        Is Equal To 0(x=w14) -> w30
        w31 = "\none\ntwo\nthree\nfour\nfive\nsix\nseven\neight\nnine"  # onesPlaceDict
        w32 = "\nfirst\nsecond\nthird\nfourth\nfifth\nsixth\nseventh\neighth\nninth"  # onesPlaceDict
        Select(s=w30, t=w32, f=w31) -> w33
        w34 = "\neleventh\ntwelfth\nthirteenth\nfourteenth\nfifteenth\nsixteenth\nseventeenth\neighteenth\nnineteenth"  # teensDict
        w35 = "\neleven\ntwelve\nthirteen\nfourteen\nfifteen\nsixteen\nseventeen\neighteen\nnineteen"  # teensDict
        Select(s=w30, t=w34, f=w35) -> w36
        case ($hasHundredsPlace) {
          frame False, Default {
            w37 = ""
          }
          frame True {
            String Subset(length (rest)=1, offset (0)=2, string=w15) -> w38
            Scan From String(inputString=w38, default=1) -> (out0=w39)
            Pick Line(line index=w39, multi-line string=w31) -> (output string=w40)
            Concatenate Strings("", w40, " hundred") -> w37
          }
        }
        w41 = "\ntenth\ntwentieth\nthirtieth\nfortieth\nfiftieth\nsixtieth\nseventieth\neightieth\nninetieth"  # tensPlaceDict
        w42 = "\nten\ntwenty\nthirty\nforty\nfifty\nsixty\nseventy\neighty\nninety"  # tensPlaceDict
        Logical And(not $hasOnesPlace, $hasTensPlace) -> w43
        Logical And(w43, w30) -> w44
        Select(s=w44, t=w41, f=w42) -> w45
        Logical And($hasTensPlace, not $isTeen) -> w46
        case (w46) {
          frame False, Default {
            w47 = w37
            w48 = w46
          }
          frame True {
            Is Empty String Or Path(string/path=w37) -> w49
            Concatenate Strings(w37, " ") -> w50
            Select(s=w49, t=w37, f=w50) -> w51
            String Subset(length (rest)=1, offset (0)=1, string=w15) -> w52
            Scan From String(inputString=w52, default=1) -> (out0=w53)
            Pick Line(line index=w53, multi-line string=w45) -> (output string=w54)
            Concatenate Strings(w51, w54) -> w47
            w48 = w46
          }
        }
        case ($isTeen) {
          frame False, Default {
            case ($hasOnesPlace) {
              frame False, Default {
                Logical And(not w48, w30) -> w57
                case (w57) {
                  frame False, Default {
                    w55 = w47
                    w56 = default
                  }
                  frame True {
                    Concatenate Strings(w47, "th") -> w55
                    w56 = "th"
                  }
                }
              }
              frame True {
                case ($hasTensPlace) {
                  frame False, Default {
                    Is Empty String Or Path(string/path=w47) -> w59
                    Concatenate Strings(w47, " ") -> w60
                    Select(s=w59, t=w47, f=w60) -> w58
                  }
                  frame True {
                    Concatenate Strings(w47, " ") -> w58
                  }
                }
                String Subset(length (rest)=1, offset (0)=0, string=w15) -> w61
                Scan From String(inputString=w61, default=1) -> (out0=w62)
                Pick Line(line index=w62, multi-line string=w33) -> (output string=w63)
                Concatenate Strings(w58, w63) -> w55
                w56 = default
              }
            }
          }
          frame True {
            Is Empty String Or Path(string/path=w47) -> w64
            Concatenate Strings(w47, " ") -> w65
            Select(s=w64, t=w47, f=w65) -> w66
            String Subset(length (rest)=1, offset (0)=0, string=w15) -> w67
            Scan From String(inputString=w67, default=1) -> (out0=w68)
            Pick Line(line index=w68, multi-line string=w36) -> (output string=w69)
            Concatenate Strings(w66, w69) -> w55
            w56 = default
          }
        }
      }
    }
    w70 = """
thousand
million
billion
trillion
quadrillion
quintillion
sextillion
septillion
octillion
nonillion
decillion
undecillion
duodecillion
tredecillion
quattuordecillion
quindecillion
sexdecillion
septendecillion
octodecillion
novemdecillion
vigintillion"""  # largeNamesDict
    Is Empty String Or Path(string/path=w55) -> w71
    case (w71) {
      frame False, Default {
        Concatenate Strings(s2, " ") -> w73
        Is Empty String Or Path(string/path=s2) -> w74
        Is Equal(x=w55, y=w56) -> w75
        Logical Or(w74, w75) -> w76
        Select(s=w76, t=s2, f=w73) -> w77
        Concatenate Strings(w77, w55) -> w78
        Pick Line(line index=w14, multi-line string=w70) -> (output string=w79)
        Is Empty String Or Path(string/path=w79) -> w80
        Concatenate Strings(w78, " ", w79) -> w81
        Select(s=w80, t=w78, f=w81) -> w72
      }
      frame True {
        w72 = s2
      }
    }
    next s2 = w72
  }
  Is Equal(x="th", y=s2) -> w82
  Select(s=w82, t="zeroth", f=s2) -> w83
  $String <- w83
