vi "Resolve Timestamp Format.gvi"   [LabVIEW Platform Developer Preview 0.1.0]
# Resolves a Timestamp Format string. ISO 8601 is used as the default formating for Timestamp unless otherwise specified.
# ISO 8601 is used with the following options:
#     Extended format
#     UTC
#     Decimal point (.) for decimal fractions (lowest order of time element is seconds)
#     3 Decimal places
# E.g: [YYYY]-[MM]-[DD]T[hh]:[mm]:[ss]Z
# This VI is Private.
inputs:
  "Timestamp Format In": string, required
outputs:
  "Timestamp Format Out": string
uses:
  openg::library::string::Trim Whitespace (String).gvi
diagram:
  # ISO 8601 is used as default formating for Timestamp unless otherwise specified
  # Use with options:
  #     Extended format
  #     UTC
  #     Decimal point (.) for decimal fractions (lowest order of time element is seconds)
  #     3 Decimal places
  # E.g: [YYYY]-[MM]-[DD]T[hh]:[mm]:[ss]Z
  #
  # See: http://en.wikipedia.org/wiki/ISO_8601
  call "Trim Whitespace (String).gvi"(String in=$"Timestamp Format In") -> (String out=w1)
  Is Empty String Or Path(string/path=w1) -> w2
  Select(s=w2, t="%^<%Y-%m-%dT%H:%M:%S%3uZ>T", f=w1) -> w3
  $"Timestamp Format Out" <- w3
