vi "Scan Variant from String.gvi"   [LabVIEW Platform Developer Preview 0.1.0]
# Overcomes a limitation of "Scan From String" by allowing variant data types to be used/returned. This VI supports variant data for all LabVIEW data types supported by "Scan From String".
# Notes:
# Format string input may optionally be passed as a variant attribute named "Format String".
# ISO 8601 is used as the default formating for Timestamp unless otherwise specified. Timestamp data must use the Format String: %T (or variations of %T), otherwise it will return an error.
inputs:
  "Input String": string, required
  "Initial Scan Location": u32
  "error in (no error)": error
  "Default Value": variant, required
  "Format String (optional)": string
outputs:
  "Remaining String": string
  "Offset Past Scan": u32
  "error out": error
  "Output": variant
uses:
  openg::library::variant data::Get Data Name.gvi
  openg::library::variant data::Get TDEnum from Data.gvi
  openg::library::error::Build Error Cluster.gvi
  openg::library::variant data::Get Refnum Type Enum from Data.gvi
  openg::library::variant data::Set Enum String Value.gvi
  openg::library::variant data::Get Waveform Type Enum from Data.gvi
  openg::library::string::Resolve Timestamp Format.gvi
  openg::library::variant data::Set Data Name.gvi
diagram:
  case ($"error in (no error)") {
    frame No Error {
      call "Get Data Name.gvi"(Data=$"Default Value", error in (no error)=$"error in (no error)") -> (Data Name=w5, error out=w6)
      call "Get TDEnum from Data.gvi"(Data=$"Default Value") -> (Type Descriptor Enumeration=w7)
      Get Variant Attribute(default value=$"Format String (optional)", name="Format String", variant=$"Default Value") -> (value=w8)
      case (w7) {
        frame "<Null>", Default {
          # Unexpected datatype
          Format Into String(formatString="Unexpected Datatype <%s>", w7) -> w11
          call "Build Error Cluster.gvi"(code="Argument error"(1), String to Prepend to source ("")=w11) -> (error out=w9)
          w1 = ""
          w3 = 0
          w10 = variant()
        }
        frame "I8".."I64" {
          w12 = i64 0  # I64 Type
          Variant To Data(error in (no error)=w6, type=w12, variant=$"Default Value") -> (data=w13, error out=w14)
          Scan From String(formatString=w8, inputString=$"Input String", startLoc=$"Initial Scan Location", errIn=w14, default=w13) -> (outString=w1, offsetPastScan=w3, errOut=w9, out0=w15)
          To Variant(anything=w15) -> w10
        }
        frame "Refnum" {
          call "Get Refnum Type Enum from Data.gvi"(Data=$"Default Value") -> (Refnum Subtype Enum=w16)
          # The Default case is the code original VI; and VISA, IVI, Hardware generated an Error before, so the Refnum case is backwards compatible.
          case (w16) {
            frame Default {
              Variant To Flattened Byte Array(variant=$"Default Value") -> (data string=w17, type string=w18)
              Variant To Data(error in (no error)=w6, type=GenericRefnum Not A Refnum, variant=$"Default Value") -> (error out=w19)
              # "%d" is the only format supported for these refnums
              w20 = 0  # U32 Type
              To Unsigned Long Integer(number=w20) -> w21
              Type Cast(type=w21, x=w17) -> w22
              Scan From String(formatString="%d", inputString=$"Input String", startLoc=$"Initial Scan Location", errIn=w19, default=w22) -> (outString=w1, offsetPastScan=w3, errOut=w9, out0=w23)
              Type Cast(type=string "", x=w23) -> w24
              Type Cast(type=u8[] [], x=w24) -> w25
              Flattened Byte Array To Variant(data string=w25, type string=w18) -> (variant out=w10)
            }
            frame "VISA Resource".."IVI Logical Name", "Hardware Plugin Tag Refnum" {
              w26 = string ""  # String Type
              Variant To Data(error in (no error)=w6, type=w26, variant=$"Default Value") -> (data=w27, error out=w28)
              Scan From String(formatString=w8, inputString=$"Input String", startLoc=$"Initial Scan Location", errIn=w28, default=w27) -> (outString=w1, offsetPastScan=w3, errOut=w9, out0=w29)
              To Variant(anything=w29) -> w10
            }
          }
        }
        frame "U8".."U64" {
          w30 = u64 0  # U64 Type
          Variant To Data(error in (no error)=w6, type=w30, variant=$"Default Value") -> (data=w31, error out=w32)
          Scan From String(formatString=w8, inputString=$"Input String", startLoc=$"Initial Scan Location", errIn=w32, default=w31) -> (outString=w1, offsetPastScan=w3, errOut=w9, out0=w33)
          To Variant(anything=w33) -> w10
        }
        frame "SGL".."EXT" {
          w34 = f64 0  # EXT Type
          Variant To Data(error in (no error)=w6, type=w34, variant=$"Default Value") -> (data=w35, error out=w36)
          Scan From String(formatString=w8, inputString=$"Input String", startLoc=$"Initial Scan Location", errIn=w36, default=w35) -> (outString=w1, offsetPastScan=w3, errOut=w9, out0=w37)
          To Variant(anything=w37) -> w10
        }
        frame "CSG".."CXT" {
          w38 = c128 0+0i  # CXT Type
          Variant To Data(error in (no error)=w6, type=w38, variant=$"Default Value") -> (data=w39, error out=w40)
          Scan From String(formatString=w8, inputString=$"Input String", startLoc=$"Initial Scan Location", errIn=w40, default=w39) -> (outString=w1, offsetPastScan=w3, errOut=w9, out0=w41)
          To Variant(anything=w41) -> w10
        }
        frame "Boolean" {
          w42 = bool FALSE  # Boolean Type
          Variant To Data(error in (no error)=w6, type=w42, variant=$"Default Value") -> (data=w43, error out=w44)
          Scan From String(formatString=w8, inputString=$"Input String", startLoc=$"Initial Scan Location", errIn=w44, default=w43) -> (outString=w1, offsetPastScan=w3, errOut=w9, out0=w45)
          To Variant(anything=w45) -> w10
        }
        frame "String", "DAQ" {
          w46 = string ""  # String Type
          Variant To Data(error in (no error)=w6, type=w46, variant=$"Default Value") -> (data=w47, error out=w48)
          Scan From String(formatString=w8, inputString=$"Input String", startLoc=$"Initial Scan Location", errIn=w48, default=w47) -> (outString=w1, offsetPastScan=w3, errOut=w9, out0=w49)
          To Variant(anything=w49) -> w10
        }
        frame "Path" {
          w50 = path path ""  # Path Type
          Variant To Data(error in (no error)=w6, type=w50, variant=$"Default Value") -> (data=w51, error out=w52)
          Scan From String(formatString=w8, inputString=$"Input String", startLoc=$"Initial Scan Location", errIn=w52, default=w51) -> (outString=w1, offsetPastScan=w3, errOut=w9, out0=w53)
          To Variant(anything=w53) -> w10
        }
        frame "Enum U8".."Enum U32" {
          case (w8) {
            frame Default {
              call "Build Error Cluster.gvi"(code="Scan failed"(85), String to Prepend to source ("")="\"%s\" is the only supported scan format for enums") -> (error out=w9)
              w1 = $"Input String"
              w3 = $"Initial Scan Location"
              w10 = $"Default Value"
            }
            frame "", "%s" {
              Scan From String(formatString="%s", inputString=$"Input String", startLoc=$"Initial Scan Location", errIn=w6) -> (outString=w1, offsetPastScan=w3, errOut=w54, out0=w55)
              # "%s" is the only format
              # supported for enums
              call "Set Enum String Value.gvi"(Default Enum Value=$"Default Value", String Value=w55, error in (no error)=w54) -> (Enum=w10, error out=w9)
            }
          }
        }
        frame "Waveform" {
          call "Get Waveform Type Enum from Data.gvi"(Data=$"Default Value") -> (Waveform Subtype Enum=w56)
          case (w56) {
            frame "<Not a Waveform Type>", Default {
              Format Into String(formatString="Unexpected Waveform Datatype <%s>", w56) -> w57
              call "Build Error Cluster.gvi"(code="Argument error"(1), String to Prepend to source ("")=w57) -> (error out=w9)
              w1 = ""
              w3 = 0
              w10 = variant()
            }
            frame "Timestamp" {
              call "Resolve Timestamp Format.gvi"(Timestamp Format In=w8) -> (Timestamp Format Out=w58)
              Scan From String(formatString=w58, inputString=$"Input String", startLoc=$"Initial Scan Location", default=1904-01-01T00:00:00Z) -> (outString=w1, offsetPastScan=w3, errOut=w9, out0=w59)
              To Variant(anything=w59) -> w10
            }
          }
        }
      }
      call "Set Data Name.gvi"(Data=w10, Data Name=w5, error in (no error)=w9) -> (Renamed Data=w4, error out=w2)
    }
    frame Error {
      w1 = ""
      w2 = $"error in (no error)"
      w3 = 0
      w4 = variant()
    }
  }
  $"Remaining String" <- w1
  $"Offset Past Scan" <- w3
  $Output <- w4
  $"error out" <- w2
