vi "Search or Split String.gvi"   [LabVIEW Platform Developer Preview 0.1.0]
# Performs the standard Search/Split String function, but, in Search mode, splits string after search string/char and returns the offset after the match.
inputs:
  "string": string, required
  "search string/char (-)": string
  "offset (0)": i32
outputs:
  "substring before match": string
  "substring after match": string
  "offset after match": i32
diagram:
  Search Or Split String(offset=$"offset (0)", search string/char=$"search string/char (-)", string=$string) -> (match + rest of string=w1, offset of match=w2, substring before match=w3)
  Is Not Equal(x=w2, y=-1) -> w4
  # match found?
  case (w4) {  # Trim Match from Rest of String?
    frame False {
      w5 = w2
      w6 = w3
      w7 = w1
    }
    frame True {
      String Length(string=$"search string/char (-)") -> (length=w8)
      Search Or Split String(offset=w8, string=w1) -> (match + rest of string=w7)
      Add(w8, w2) -> w5
      w6 = w3
    }
  }
  $"substring before match" <- w6
  $"substring after match" <- w7
  $"offset after match" <- w5
