vi "Slice String 1.gvi"   [LabVIEW Platform Developer Preview 0.1.0]
# Returns a substring, specified by subset, from string.
# Slice String.vi was originally written to emulate the slice notation of Python. (See below for extended capabilities.) In Python, a slice is a subset of elements in a list and a string is a list of characters. If you want to access one character in the string (or one element in any list), you'd use the list name and the index value:
# substring = string[i]
# To get multple contiguous characters, use the slice i:j notation in place of the single index:
# substring = string[i:j]
# Characters (elements) are assigned to the output starting at the first index value, and continuing up to, but not including, the last value.
# In this notation, i and j are integers.
# The first character in string has index zero.
# If i is ommitted it is assumed to be zero and substringcontains the leftmost characters of string.
# If j is ommitted it is assumed to be length(string) and substringcontains the rightmost characters of string.
# If i or j are negative numbers they are assumed to be referenced from the end of the string.
# In the LabVIEW implementation, the range of the slice is expressed in the string variable subset as "i:j".
# Slice String.vi has now been extended to allow the (optional) inclusion of the last value as well (for those who are used to the closed interval syntax) by wiring a TRUE constant to the fourth terminal. (Only two of the examples below, in boldface, are affected.)
# Examples:
# If string = "MyString"
# for include string[j] = FALSE (default)      /      for include string[j] = TRUE
# string[2:] = "String"                                               string[2:] = "String"
# string[:3] = "MyS"                                                 string[:3] = "MySt"
# string[-1] = "g"                                                      string[-1] = "g"
# string[4] = "r"                                                        string[4] = "r"
# string[-4:-2] = "ri"                                                  string[-4:-2] = "rin"
inputs:
  "String": string, required
  "Subset (i:j)": string, required
  "Include String[j] (false)": bool
outputs:
  "Substring (String[i:j])": string
uses:
  openg::library::string::Trim Whitespace (String).gvi
diagram:
  Match Pattern(regular expression=":", string=$"Subset (i:j)") -> (after substring=w1, before substring=w2, offset past match=w3)
  call "Trim Whitespace (String).gvi"(String in=w2) -> (String out=w4)
  Is Empty String Or Path(string/path=w4) -> w5
  # >specifes a range?>
  Scan From String(formatString="%d", inputString=w4) -> (out0=w6)
  # >entry missing?>
  String Length(string=$String) -> (length=w7)
  Add(w7, w6) -> w8
  Is Less Than 0(x=w6) -> w9
  Select(s=w9, t=w8, f=w6) -> w10
  Select(s=w5, t=0, f=w10) -> w11
  # Analyse slice spec
  Is Greater Or Equal To 0(x=w3) -> w12
  # No, just a single charactrer
  call "Trim Whitespace (String).gvi"(String in=w1) -> (String out=w13)
  # >entry missing?>
  Is Empty String Or Path(string/path=w13) -> w14
  Scan From String(formatString="%d", inputString=w13) -> (out0=w15)
  # Negative numbers reference end of string
  Add(w7, w15) -> w16
  Is Less Than 0(x=w15) -> w17
  Select(s=w17, t=w16, f=w15) -> w18
  Increment(x=w18) -> w19
  Select(s=$"Include String[j] (false)", t=w19, f=w18) -> w20
  # Missing numbers are ends of string
  Select(s=w14, t=w7, f=w20) -> w21
  Subtract(x=w21, y=w11) -> w22
  # Yes, the number of characters
  Select(s=w12, t=w22, f=1) -> w23
  String Subset(length (rest)=w23, offset (0)=w11, string=$String) -> w24
  $"Substring (String[i:j])" <- w24
