vi "String to 1D Array.gvi"   [LabVIEW Platform Developer Preview 0.1.0]
# Converts delimited string to a 1D array.
inputs:
  "string": string, required
  "delimiter (Tab)": string = "\t"
  "ignore duplicate delimiters? (F=No)": bool
outputs:
  "Array of Strings": string[]
diagram:
  case ($"ignore duplicate delimiters? (F=No)") {
    frame False, Default {
      Spreadsheet String To Array(array type=string[] [], delimiter=$"delimiter (Tab)", format string="%s", spreadsheet string=$string) -> (array=w1)
    }
    frame True {
      Build Array($"delimiter (Tab)") -> w2
      s1 = 0  # shift register
      while (iteration -> i1) {
        Scan String For Tokens(delimiters=w2, input string=$string, offset=s1) -> (offset past token=w4, token string=w5)
        Is Less Than 0(x=w4) -> w6
        append w5 to w3
        next s1 = w4
        stop if w6
      }
      Is Not Equal To 0(x=i1) -> w7
      Select(s=w7, t=w3, f=string[] []) -> w1
    }
  }
  $"Array of Strings" <- w1
