vi "String to Character Array.gvi"   [LabVIEW Platform Developer Preview 0.1.0]
# Converts Input String into a Character Array where each character is an individual element in the array.
# E.g. Input String = "ABC"; Character Array = [A,B,C]
inputs:
  "Input String": string, required
outputs:
  "Character Array": string[]
diagram:
  String Length(string=$"Input String") -> (length=w1)
  for (N = w1) (iteration -> i1) {
    String Subset(length (rest)=1, offset (0)=i1, string=$"Input String") -> w3
    append w3 to w2
  }
  $"Character Array" <- w2
