vi "To Camel Case (String).gvi"   [LabVIEW Platform Developer Preview 0.1.0]
# Converts alphabetic characters in string to "camel" case (i.e., first alphabetic character to uppercase, all others to lowercase for each "word," removing spaces between words).
inputs:
  "string": string, required
  "no change if no spaces? (F=No)": bool
outputs:
  "CamelCase string": string
uses:
  openg::library::string::Trim Whitespace (String).gvi
  openg::library::string::To Proper Case (String Array).gvi
diagram:
  call "Trim Whitespace (String).gvi"(String in=$string) -> (String out=w1)
  Spreadsheet String To Array(array type=string[] [], delimiter=" ", format string="%s", spreadsheet string=w1) -> (array=w2)
  Array Size(array=w2) -> (size(s)=w3)
  Is Less Or Equal(x=w3, y=1) -> w4
  Logical And($"no change if no spaces? (F=No)", w4) -> w5
  case (w5) {
    frame True {
      w6 = w2
    }
    frame False {
      call "To Proper Case (String Array).gvi"(strings=w2) -> (proper case strings=w6)
    }
  }
  Concatenate Strings(w6) -> w7
  $"CamelCase string" <- w7
