vi "To Proper Case (String).gvi"   [LabVIEW Platform Developer Preview 0.1.0]
# Converts alphabetic characters in string to proper case (i.e., first alphabetic character to uppercase, all others to lowercase).
inputs:
  "string": string, required
outputs:
  "proper case string": string
diagram:
  Search Or Split String(offset=1, string=$string) -> (match + rest of string=w1, substring before match=w2)
  To Upper Case(string=w2) -> w3
  To Lower Case(string=w1) -> w4
  Concatenate Strings(w3, w4) -> w5
  $"proper case string" <- w5
