vi "VI Tree - string.gvi"   [LabVIEW Platform Developer Preview 0.1.0]
uses:
  openg::library::string::Format Variant Into String.gvi
  openg::library::string::Convert EOLs (String).gvi
  openg::library::string::Scan Variant from String.gvi
  openg::library::string::Multi-line String to Array.gvi
  openg::library::string::Variant Array to Spreadsheet.gvi
  openg::library::string::Place Number to Proper Engl Text.gvi
  openg::library::string::Number to Proper Engl Text.gvi
  openg::library::string::To Camel Case (String).gvi
  openg::library::string::Slice String.gvi
  openg::library::string::To Proper Case (String).gvi
  openg::library::string::Slice String 1.gvi
  openg::library::string::String to 1D Array.gvi
  openg::library::string::Search or Split String.gvi
  openg::library::string::1D Array to String.gvi
  openg::library::string::String to Character Array.gvi
  openg::library::string::Trim Whitespace (String).gvi
  openg::library::string::Comment.gvi
diagram:
  sequence {  # VI Tree - String
    frame 0 {
      call "Format Variant Into String.gvi"(Variant=variant())
      call "Convert EOLs (String).gvi"(String in="")
      call "Scan Variant from String.gvi"(Input String="", Default Value=variant())
      call "Multi-line String to Array.gvi"(string="")
      call "Variant Array to Spreadsheet.gvi"(2D Variant Array=variant[][] [])  # Variant Array to Spreadsheet String
      call "Place Number to Proper Engl Text.gvi"(Numeric=0)  # Place Number to Proper English Text
      call "Number to Proper Engl Text.gvi"(Numeric=0)  # Number to Proper English Text
      call "To Camel Case (String).gvi"(string="")
      call "Slice String.gvi"(string="", slice="")
      call "To Proper Case (String).gvi"(string="")
      call "Slice String 1.gvi"(String="", Subset (i:j)="")
      call "String to 1D Array.gvi"(string="")
      call "Search or Split String.gvi"(string="")
      call "1D Array to String.gvi"(Array of Strings=string[] [])
      call "String to Character Array.gvi"(Input String="")
      call "Trim Whitespace (String).gvi"(String in="")
      call "Comment.gvi"()
    }
  }
