vi "Variant Array to Spreadsheet.gvi"   [LabVIEW Platform Developer Preview 0.1.0]
# Overcomes a limitation of "Array to Spreadsheet String" by allowing variant data types to be used. This VI supports variant data for all LabVIEW data types supported by "Format Into String".  The "format string" for each Varriant element of the input array must be passed within each variant element as a variant attribute named "Format String".
inputs:
  "error in (no error)": error
  "2D Variant Array": variant[][], required
  "delimiter (Tab)": string = "\t"
outputs:
  "error out": error
  "spreadsheet string": string
uses:
  openg::library::string::Format Variant Into String.gvi
diagram:
  s1 = ""  # shift register
  s2 = $"error in (no error)"  # shift register
  for {
    w1 = each element of $"2D Variant Array"
    Array Size(array=w1) -> (size(s)=w2)
    s3 = s1  # shift register
    s4 = s2  # shift register
    for (iteration -> i1) {
      w3 = each element of w1
      call "Format Variant Into String.gvi"(Input String=s3, error in (no error)=s4, Variant=w3) -> (Output String=w4, error out=w5)
      Increment(x=i1) -> w6
      Is Equal(x=w2, y=w6) -> w7
      Select(s=w7, t="\r\n", f=$"delimiter (Tab)") -> w8
      Concatenate Strings(w4, w8) -> w9
      next s3 = w9
      next s4 = w5
    }
    next s1 = s3
    next s2 = s4
  }
  $"spreadsheet string" <- s1
  $"error out" <- s2
