vi "Wait (ms).gvi"   [LabVIEW Platform Developer Preview 0.1.0]
# Wait (ms) primitive with added error handling.  This VI will not wait if an error is passed into it unless the Wait on Error input is set to TRUE.
inputs:
  "milliseconds to wait": u32, required
  "Wait on Error (FALSE)": bool
  "Abort wait on occurence": Occurrence
  "error in (no error)": error
outputs:
  "millisecond timer value": u32
  "error out": error
diagram:
  # Wait if No Error or Wait on Error
  $"error out" <- $"error in (no error)"
  Is Not A Number Or Path Or Refnum(number=$"Abort wait on occurence") -> w1
  Property Node(instance in=$"error in (no error)") -> ("status"=w2)
  Logical Or(not w2, $"Wait on Error (FALSE)") -> w3
  Select(s=w3, t=$"milliseconds to wait", f=0) -> w4
  case (w1) {
    frame False, Default {
      Wait On Occurrence(occurrence=$"Abort wait on occurence", timeout in milliseconds=w4) -> (timed out=w6)
      sequence (after w6) {
        frame 0 {
          Tick Count() -> (timer value=w5)
        }
      }
    }
    frame True {
      Wait(time to wait=w4) -> (timer value=w5)
    }
  }
  $"millisecond timer value" <- w5
