vi "Array Dim(s) from TD.gvi"   [LabVIEW Platform Developer Preview 0.1.0]
# Returns the number dimensions described by array type descriptor input.
inputs:
  "Array Type Descriptor": "Type Descriptor.gtype", required
  "error in (no error)": error
outputs:
  "N dims": u32
  "error out": error
types:
  "Type Descriptor.gtype" = i16[]
uses:
  openg::library::variant data::Get Header from TD.gvi
  openg::library::error::Build Error Cluster.gvi
diagram:
  case ($"error in (no error)") {
    frame No Error {
      call "Get Header from TD.gvi"(Type Descriptor=$"Array Type Descriptor") -> (Type Descriptor Header=w3)
      Property Node(instance in=w3) -> ("# elements"=w4, "type"=w5)
      case (w5) {
        frame Default {
          Format Into String(formatString="Unexpected Datatype <%s>", w5) -> w6
          call "Build Error Cluster.gvi"(code="Argument error"(1), String to Prepend to source ("")=w6) -> (error out=w2)
          w1 = 0
        }
        frame "Array" {
          To Unsigned Long Integer(number=w4) -> w1
          w2 = no error
        }
      }
    }
    frame Error {
      w1 = 0
      w2 = $"error in (no error)"
    }
  }
  $"N dims" <- w1
  $"error out" <- w2
