vi "Array Size(s).gvi"   [LabVIEW Platform Developer Preview 0.1.0]
# Returns the number of elements in each dimension and number of dimensions of variant array input.
inputs:
  "Array": variant, required
  "error in (no error)": error
outputs:
  "Size(s)": u32[]
  "N dims": u32
  "error out": error
uses:
  openg::library::variant data::Variant to Header Info.gvi
  openg::library::error::Build Error Cluster.gvi
diagram:
  case ($"error in (no error)") {
    frame No Error {
      call "Variant to Header Info.gvi"(Variant=$Array) -> (Type Descriptor Header=w4, Type Descriptor=w5, data string=w6)
      Property Node(instance in=w4) -> ("# elements"=w7, "type"=w8)
      case (w8) {
        frame Default {
          # Unexpected Datatype
          Format Into String(formatString="Unexpected Datatype <%s>", w8) -> w9
          call "Build Error Cluster.gvi"(code="Argument error"(1), String to Prepend to source ("")=w9) -> (error out=w1)
          w2 = 0
          w3 = u32[] []
        }
        frame "Array" {
          To Unsigned Long Integer(number=w7) -> w2
          Type Cast(type=string "", x=w2) -> w10
          Multiply(w2, 4) -> w11
          String Subset(length (rest)=w11, string=w6) -> w12
          Concatenate Strings(w10, w12) -> w13
          Type Cast(type=u8[] [], x=w13) -> w14
          Unflatten From Byte Array(data bytes=w14, type=u32[] []) -> (value=w3)
          w1 = no error
        }
      }
    }
    frame Error {
      w1 = $"error in (no error)"
      w2 = 0
      w3 = u32[] []
    }
  }
  $"N dims" <- w2
  $"error out" <- w1
  $"Size(s)" <- w3
