vi "Array of VData to VArray.gvi"   [LabVIEW Platform Developer Preview 0.1.0]
# Converts a 1D Array of variants (of identical element datatypes) to an array of data wrapped in a Variant.
inputs:
  "1D Array of VData": variant[], required
  "Element Type (when empty)": variant
  "error in (no error)": error
  "Array Name": string
outputs:
  "VArray": variant
  "error out": error
uses:
  openg::library::variant data::Get TDEnum from Data.gvi
  openg::library::error::Build Error Cluster.gvi
  openg::library::variant data::Set Data Name.gvi
diagram:
  case ($"error in (no error)") {
    frame No Error {
      Array Size(array=$"1D Array of VData") -> (size(s)=w3)
      case (w3) {
        frame 0 {
          call "Get TDEnum from Data.gvi"(Data=$"Element Type (when empty)") -> (Type Descriptor Enumeration=w7)
          # Array of VData is empty (no elements)
          case (w7) {
            frame "<Null>" {
              # Null type: raise error
              call "Build Error Cluster.gvi"(code="Argument error"(1), String to Prepend to source ("")="No element type for empty array") -> (error out=w5)
              w4 = variant()
              w6 = ""
            }
            frame Default {
              w8 = 0  # Length of Empty Array
              To Long Integer(number=w8) -> w9
              # Type is not Null: pass it through
              Type Cast(type=string "", x=w9) -> w6
              w5 = no error
              w4 = $"Element Type (when empty)"
            }
          }
        }
        frame Default {
          # Array of VData is non-empty (has elements)
          # Get an element for its type
          Array Index(array=$"1D Array of VData") -> (out0[_]=w4)
          for (N -> w10) {  # For Each Element
            w11 = each element of $"1D Array of VData"
            # Get Data
            Variant To Flattened Byte Array(variant=w11) -> (data string=w13)
            append w13 to w12
          }
          Type Cast(type=string "", x=w12) -> w14
          # array length
          Type Cast(type=string "", x=w10) -> w15
          Concatenate Strings(w15, w14) -> w6
          # array data
          w5 = no error
        }
      }
      # element TD
      Type Cast(type=u8[] [], x=w6) -> w16
      # Get Element TD
      Variant To Flattened Byte Array(variant=w4) -> (type string=w17)
      # FFFFFFFF (-1) indicates variable sized. actual length is is stored with data
      w18 = -1  # # Elements
      w19 = 1  # # dims
      w20 = "Array"  # Type Descriptor Enumeration
      # Calculate TD Length for TD Header
      w21 = 2  # bytes per I16
      w22 = 5  # array TD header I16s to add
      # Convert to length to U16 before math.
      # element TD
      Array Size(array=w17) -> (size(s)=w23)
      To Unsigned Word Integer(number=w23) -> w24
      Add(w24, w22) -> w25
      Multiply(w25, w21) -> w26
      # array name
      # Convert to I16, since that's the TD data type used by NI
      # Prepend array TD header onto element TD.
      # new TD length
      # TD length
      To Word Integer(number=w26) -> w27
      Build Array[ConcatenateInputs=True](w27, w20, w19, w18, w18, w17) -> w28
      # Convert Flattened Data to Variant
      Flattened Byte Array To Variant(data string=w16, error in=w5, type string=w28) -> (error out=w29, variant out=w30)
      case ($"Array Name") {
        frame Default {
          # Name argument specified: set name.
          # Set Data Name
          call "Set Data Name.gvi"(Data=w30, Data Name=$"Array Name", error in (no error)=w29) -> (Renamed Data=w1, error out=w2)
        }
        frame "" {
          # Name argument is empty: don't set name.
          w1 = w30
          w2 = w29
        }
      }
    }
    frame Error {
      w1 = variant()
      w2 = $"error in (no error)"
    }
  }
  $VArray <- w1
  $"error out" <- w2
