vi "Array of VData to VCluster.gvi"   [LabVIEW Platform Developer Preview 0.1.0]
# Returns the elements of an array as elements of a variant cluster.
inputs:
  "Array": variant[], required
  "Cluster Name": string
  "error in (no error)": error
outputs:
  "VCluster": variant
  "error out": error
uses:
  openg::library::variant data::Variant to Header Info.gvi
  openg::library::variant data::Set Data Name.gvi
diagram:
  case ($"error in (no error)") {
    frame No Error {
      s1 = i16[] []  # shift register
      for (N -> w3) {  # For Each Element: Concatenate TD
        w4 = each element of $Array
        call "Variant to Header Info.gvi"(Variant=w4) -> (Type Descriptor=w6, data string=w7)
        Build Array[ConcatenateInputs=True](s1, w6) -> w8
        append w7 to w5
        next s1 = w8
      }
      Concatenate Strings(w5) -> w9
      # # elements
      # elements TDs (concatenated)
      # Convert Flattened Data to Variant
      Type Cast(type=u8[] [], x=w9) -> w10
      w11 = 2  # bytes per I16
      w12 = 3  # cluster TD header I16s to add
      # Convert to length to U16 before math.
      Array Size(array=s1) -> (size(s)=w13)
      To Unsigned Word Integer(number=w13) -> w14
      Add(w14, w12) -> w15
      Multiply(w15, w11) -> w16
      # Convert to I16, since that's the TD data type used by NI
      To Word Integer(number=w16) -> w17
      w18 = "Cluster"  # Type Descriptor Enumeration
      To Word Integer(number=w18) -> w19
      To Word Integer(number=w3) -> w20
      # Prepend cluster TD header onto elements TDs.
      Build Array[ConcatenateInputs=True](w17, w19, w20, s1) -> w21
      Flattened Byte Array To Variant(data string=w10, type string=w21) -> (error out=w22, variant out=w23)
      case ($"Cluster Name") {
        frame Default {
          # Name argument specified: set name.
          # Set Data Name
          call "Set Data Name.gvi"(Data=w23, Data Name=$"Cluster Name", error in (no error)=w22) -> (Renamed Data=w2, error out=w1)
        }
        frame "" {
          # Name argument is empty: don't set name.
          w2 = w23
          w1 = w22
        }
      }
    }
    frame Error {
      w1 = $"error in (no error)"
      w2 = variant()
    }
  }
  $VCluster <- w2
  $"error out" <- w1
