vi "Array to Array of VData.gvi"   [LabVIEW Platform Developer Preview 0.1.0]
# Converts an Array into a 1D Array of variants.
inputs:
  "MultiD Array": variant, required
  "error in (no error)": error
outputs:
  "1D Array of Variants": variant[]
  "error out": error
uses:
  openg::library::variant data::Reshape Array to 1D VArray.gvi
diagram:
  call "Reshape Array to 1D VArray.gvi"(MultiD Array=$"MultiD Array", error in (no error)=$"error in (no error)") -> (1D VArray=w1, error out=w2)
  Variant To Data(error in (no error)=w2, variant=w1) -> (data=w3, error out=w4)
  $"1D Array of Variants" <- w3
  $"error out" <- w4
