vi "Array to VCluster.gvi"   [LabVIEW Platform Developer Preview 0.1.0]
# Returns the elements of an array as elements of a variant cluster.
inputs:
  "Array": variant, required
  "error in (no error)": error
outputs:
  "VCluster": variant
  "error out": error
uses:
  openg::library::variant data::Get Data Name.gvi
  openg::library::variant data::Array to Array of VData.gvi
  openg::library::variant data::Array of VData to VCluster.gvi
diagram:
  call "Get Data Name.gvi"(Data=$Array, error in (no error)=$"error in (no error)") -> (Data dup=w1, Data Name=w2, error out=w3)
  call "Array to Array of VData.gvi"(MultiD Array=w1, error in (no error)=w3) -> (1D Array of Variants=w4, error out=w5)
  call "Array of VData to VCluster.gvi"(Array=w4, Cluster Name=w2, error in (no error)=w5) -> (VCluster=w6, error out=w7)
  $VCluster <- w6
  $"error out" <- w7
