vi "Cluster to Array of VData.gvi"   [LabVIEW Platform Developer Preview 0.1.0]
# Returns the elements of a cluster as an array of variant data.
inputs:
  "Cluster": variant, required
  "error in (no error)": error
outputs:
  "Array of VData": variant[]
  "error out": error
uses:
  openg::library::variant data::Variant to Header Info.gvi
  openg::library::error::Build Error Cluster.gvi
  openg::library::variant data::Split Cluster TD.gvi
  openg::library::variant data::Parse String with TDs.gvi
diagram:
  case ($"error in (no error)") {
    frame No Error {
      call "Variant to Header Info.gvi"(Variant=$Cluster) -> (Type Descriptor Header=w3, Type Descriptor=w4, data string=w5)
      Property Node(instance in=w3) -> ("type"=w6)
      case (w6) {
        frame Default {
          Format Into String(formatString="Unexpected Datatype <%s>", w6) -> w7
          call "Build Error Cluster.gvi"(code="Argument error"(1), String to Prepend to source ("")=w7) -> (error out=w1)
          w2 = variant[] []
        }
        frame "Cluster" {
          call "Split Cluster TD.gvi"(Type Descriptor=w4) -> (Type Descriptors=w8, error out=w9)
          call "Parse String with TDs.gvi"(Type Descriptors=w8, Data string=w5, error in (no error)=w9) -> (Array of VData=w2, error out=w1)
        }
      }
    }
    frame Error {
      w1 = $"error in (no error)"
      w2 = variant[] []
    }
  }
  $"Array of VData" <- w2
  $"error out" <- w1
