vi "Cluster to VArray.gvi"   [LabVIEW Platform Developer Preview 0.1.0]
# Convert a cluster of identical element datatypes into an array.
inputs:
  "Cluster": variant, required
  "error in (no error)": error
outputs:
  "VArray": variant
  "error out": error
uses:
  openg::library::variant data::Variant to Header Info.gvi
  openg::library::error::Build Error Cluster.gvi
  openg::library::variant data::Split Cluster TD.gvi
  NI::G Core::Error::Legacy::Clear Errors.gvi
diagram:
  case ($"error in (no error)") {
    frame No Error {
      call "Variant to Header Info.gvi"(Variant=$Cluster) -> (Type Descriptor Header=w3, Type Descriptor=w4, data string=w5)
      Property Node(instance in=w3) -> ("type"=w6, "# elements"=w7)
      case (w6) {
        frame Default {
          # Unexpected Datatype
          Format Into String(formatString="Unexpected Datatype <%s>", w6) -> w8
          call "Build Error Cluster.gvi"(code="Argument error"(1), String to Prepend to source ("")=w8) -> (error out=w1)
          w2 = variant()
        }
        frame "Cluster" {
          To Unsigned Long Integer(number=w7) -> w9
          Flatten To Byte Array(anything=w9) -> (data bytes=w10)
          Type Cast(type=string "", x=w10) -> w11
          Concatenate Strings(w11, w5) -> w12
          Type Cast(type=u8[] [], x=w12) -> w13
          call "Split Cluster TD.gvi"(Type Descriptor=w4) -> (Type Descriptors=w14)
          # 1st element TD
          Array Index(array=w14) -> (out0[0]=w15)
          Property Node(instance in=w15) -> ("Type Descriptor"=w16)
          w17 = "Array"  # Type Descriptor Enumeration
          Array Size(array=w16) -> (size(s)=w18)
          C Code Node("x"=w18) -> ("x"=w19, Error Out=w20)
          ~~~
          // Code in a Expression Node was converted to code in a C Node.
          // Review the converted code to ensure it has the same behavior
          // as the original code.


          // ORIGINAL CODE:

          // 2*x+10


          // CONVERTED CODE:

          x = 2*x+10;
          ~~~
          # Build the TD of an Array
          To Word Integer(number=w19) -> w21
          w22 = 1  # 1D array
          Build Array[ConcatenateInputs=True](w21, w17, w22, -1, -1, w16) -> w23
          Flattened Byte Array To Variant(data string=w13, type string=w23) -> (error out=w1, variant out=w2)
          call "Clear Errors.gvi"(error in=w20)
        }
      }
    }
    frame Error {
      w1 = $"error in (no error)"
      w2 = variant()
    }
  }
  $VArray <- w2
  $"error out" <- w1
