vi "Compute 1D Index.gvi"   [LabVIEW Platform Developer Preview 0.1.0]
# Returns the 1D index incorresponding to the element of a MultiD array at given indices.
inputs:
  "Indices": u32[], required
  "Size(s)": u32[], required
outputs:
  "1D Index": i32
diagram:
  Reverse 1D Array(array=$"Size(s)") -> (reversed array=w1)
  s1 = 1  # shift register
  for {
    w2 = each element of w1
    Multiply(s1, w2) -> w4
    append s1 to w3
    next s1 = w4
  }
  Reverse 1D Array(array=w3) -> (reversed array=w5)
  Multiply(w5, $Indices) -> w6
  Add Array Elements(numeric array=w6) -> (sum=w7)
  $"1D Index" <- w7
