vi "Get Array Element Default Data.gvi"   [LabVIEW Platform Developer Preview 0.1.0]
# Returns the default data of the array element.
inputs:
  "Array": variant, required
  "error in (no error)": error
outputs:
  "Array Element Default Data": variant
  "error out": error
uses:
  openg::library::variant data::Get Array Element TD.gvi
  openg::library::variant data::Get Default Data from TD.gvi
diagram:
  call "Get Array Element TD.gvi"(Array=$Array, error in (no error)=$"error in (no error)") -> (Type Descriptor=w1, error out=w2)
  call "Get Default Data from TD.gvi"(Type Descriptor=w1, error in (no error)=w2) -> (Default VData=w3, error out=w4)
  $"Array Element Default Data" <- w3
  $"error out" <- w4
