vi "Get Array Element TD.gvi"   [LabVIEW Platform Developer Preview 0.1.0]
# Returns the type descriptor of the array element.
inputs:
  "Array": variant, required
  "error in (no error)": error
outputs:
  "Type Descriptor": "Type Descriptor.gtype"
  "error out": error
types:
  "Type Descriptor.gtype" = i16[]
uses:
  openg::library::variant data::Get Element TD from Array TD.gvi
diagram:
  Variant To Flattened Byte Array(variant=$Array) -> (type string=w1)
  call "Get Element TD from Array TD.gvi"(Array Type Descriptor=w1, error in (no error)=$"error in (no error)") -> (Element Type Descriptor=w2, error out=w3)
  $"Type Descriptor" <- w2
  $"error out" <- w3
