vi "Get Array Element TDEnum.gvi"   [LabVIEW Platform Developer Preview 0.1.0]
# Returns the type descriptor enumeration of the array element.
inputs:
  "Array": variant, required
  "error in (no error)": error
outputs:
  "Element Type": "Type Descriptor Enumeration.gtype"
  "error out": error
types:
  "Type Descriptor Enumeration.gtype" = enum{"<Null>", "I8", "I16", "I32", "I64", "U8", "U16", "U32", "U64", "SGL", "DBL", "EXT", "CSG", "CDB", "CXT", "0x0F", "0x10", "0x11", "0x12", "0x13", "0x14", "Enum U8", "Enum U16", "Enum U32", "Enum U64", "SGL PQ", "DBL PQ", "EXT PQ", "CSG PQ", "CDB PQ", "CXT PQ", "0x1F", "0x20", "Boolean", "0x22", "0x23", "0x24", "0x25", "0x26", "0x27", "0x28", "0x29", "0x2A", "0x2B", "0x2C", "0x2D", "0x2E", "0x2F", "String", "0x31", "Path", "Pict", "0x34", "0x35", "0x36", "DAQ", "0x38", "0x39", "0x3A", "0x3B"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}
uses:
  openg::library::variant data::Variant to Header Info.gvi
  openg::library::error::Build Error Cluster.gvi
  NI::G Core::Error::Legacy::Clear Errors.gvi
  openg::library::variant data::Get Header from TD.gvi
diagram:
  case ($"error in (no error)") {
    frame No Error {
      call "Variant to Header Info.gvi"(Variant=$Array) -> (Type Descriptor Header=w3, Type Descriptor=w4, data string=w5)
      Property Node(instance in=w3) -> ("type"=w6, "# elements"=w7)
      case (w6) {
        frame Default {
          w8 = "<Null>"  # Type Descriptor Enumeration
          Format Into String(formatString="Unexpected Datatype <%s>", w6) -> w9
          call "Build Error Cluster.gvi"(code="Argument error"(1), String to Prepend to source ("")=w9) -> (error out=w1)
          w2 = w8
        }
        frame "Array" {
          C Code Node("x"=w7) -> ("x"=w10, Error Out=w11)
          ~~~
          // Code in a Expression Node was converted to code in a C Node.
          // Review the converted code to ensure it has the same behavior
          // as the original code.


          // ORIGINAL CODE:

          // 2*x+3


          // CONVERTED CODE:

          x = 2*x+3;
          ~~~
          call "Clear Errors.gvi"(error in=w11)
          Array Subset(array=w4, index0=w10) -> w12
          call "Get Header from TD.gvi"(Type Descriptor=w12) -> (Type Descriptor Header=w13)
          Property Node(instance in=w13) -> ("type"=w2)
          w1 = no error
        }
      }
    }
    frame Error {
      w14 = "<Null>"  # Type Descriptor Enumeration
      w1 = $"error in (no error)"
      w2 = w14
    }
  }
  $"Element Type" <- w2
  $"error out" <- w1
