vi "Get Cluster Element Names.gvi"   [LabVIEW Platform Developer Preview 0.1.0]
# Returns the data names of the cluster elements.
inputs:
  "Cluster": variant, required
  "error in (no error)": error
outputs:
  "Element Names": string[]
  "error out": error
uses:
  openg::library::variant data::Get Cluster Elements TDs.gvi
  openg::library::variant data::Get Data Name from TD.gvi
diagram:
  call "Get Cluster Elements TDs.gvi"(Cluster=$Cluster, error in (no error)=$"error in (no error)") -> (type strings=w1, error out=w2)
  s1 = w2  # shift register
  for {
    w3 = each element of w1
    Property Node(instance in=w3) -> ("type string"=w5)
    call "Get Data Name from TD.gvi"(Type Descriptor=w5, error in (no error)=s1) -> (name=w6, error=w7)
    append w6 to w4
    next s1 = w7
  }
  $"Element Names" <- w4
  $"error out" <- s1
