vi "Get Cluster Element by Name.gvi"   [LabVIEW Platform Developer Preview 0.1.0]
# Returns the element in the cluster by its name.
inputs:
  "Cluster": variant, required
  "Element Name": string, required
  "error in (no error)": error
outputs:
  "VElement": variant
  "found?": bool
  "error out": error
uses:
  openg::library::variant data::Cluster to Array of VData.gvi
  openg::library::variant data::Get Cluster Element Names.gvi
diagram:
  call "Cluster to Array of VData.gvi"(Cluster=$Cluster, error in (no error)=$"error in (no error)") -> (Array of VData=w1, error out=w2)
  call "Get Cluster Element Names.gvi"(Cluster=$Cluster, error in (no error)=w2) -> (Element Names=w3, error out=w4)
  Search 1D Array(1D array=w3, element=$"Element Name") -> (index of element=w5)
  Array Index(array=w1) -> (out0[w5]=w6)
  $VElement <- w6
  Is Greater Or Equal To 0(x=w5) -> w7
  $"found?" <- w7
  $"error out" <- w4
