vi "Get Cluster Elements TDs.gvi"   [LabVIEW Platform Developer Preview 0.1.0]
# Returns the elements of a cluster as an array of variant data.
inputs:
  "Cluster": variant, required
  "error in (no error)": error
outputs:
  "type strings": cluster{"type string": i16[]}[]
  "error out": error
types:
  "Type Descriptor.gtype" = i16[]
  T1 = cluster{"Type Descriptor": "Type Descriptor.gtype"}
uses:
  openg::library::variant data::Split Cluster TD.gvi
diagram:
  case ($"error in (no error)") {
    frame No Error {
      Variant To Flattened Byte Array(variant=$Cluster) -> (type string=w3)
      call "Split Cluster TD.gvi"(Type Descriptor=w3) -> (Type Descriptors=w1, error out=w2)
    }
    frame Error {
      w1 = cluster{"Element 1": i16[]}[] []
      w2 = $"error in (no error)"
    }
  }
  Coerce To Type(type=T1[] [], x=w1) -> w4
  $"type strings" <- w4
  $"error out" <- w2
