vi "Get Data Name from TD.gvi"   [LabVIEW Platform Developer Preview 0.1.0]
# Returns the name of the data described by the type string input.
inputs:
  "Type Descriptor": "Type Descriptor.gtype", required
  "error in (no error)": error
outputs:
  "name": string
  "error": error
types:
  "Type Descriptor.gtype" = i16[]
uses:
  openg::library::variant data::Get Header from TD.gvi
  openg::library::variant data::Get PString.gvi
  NI::G Core::Error::Legacy::Clear Errors.gvi
  openg::library::variant data::Get Last PString.gvi
  openg::library::error::Build Error Cluster.gvi
diagram:
  case ($"error in (no error)") {
    frame No Error {
      call "Get Header from TD.gvi"(Type Descriptor=$"Type Descriptor") -> (Type Descriptor Header=w3)
      Property Node(instance in=w3) -> ("private"=w4, "type"=w5, "# elements"=w6)
      Type Cast(type=string "", x=$"Type Descriptor") -> w7
      w8 = 64  # named bit mask
      Logical And(w8, w4) -> w9
      Is Not Equal To 0(x=w9) -> w10
      case (w10) {
        frame False, Default {
          # Data is not named
          w2 = no error
          w1 = ""
        }
        frame True {
          # Data is named
          case (w5) {
            frame "I8".."CXT", "Boolean", "Variant" {
              call "Get PString.gvi"(String=w7, offset (0)=4) -> (PString=w1)
              w2 = no error
            }
            frame "Enum U8".."Enum U64" {
              s1 = 6  # shift register
              for (N = w6) {
                call "Get PString.gvi"(String=w7, offset (0)=s1) -> (offset past PString=w11)
                next s1 = w11
              }
              Quotient And Remainder(x=s1, y=2) -> (x-y*floor(x/y)=w12)
              Add(s1, w12) -> w13
              call "Get PString.gvi"(String=w7, offset (0)=w13) -> (PString=w1)
              w2 = no error
            }
            frame "SGL PQ".."CXT PQ" {
              C Code Node("x"=w6) -> ("x"=w14, Error Out=w15)
              ~~~
              // Code in a Expression Node was converted to code in a C Node.
              // Review the converted code to ensure it has the same behavior
              // as the original code.


              // ORIGINAL CODE:

              // x*4+6


              // CONVERTED CODE:

              x = x*4+6;
              ~~~
              call "Clear Errors.gvi"(error in=w15)
              call "Get PString.gvi"(String=w7, offset (0)=w14) -> (PString=w1)
              w2 = no error
            }
            frame "String", "Path".."Pict" {
              call "Get PString.gvi"(String=w7, offset (0)=8) -> (PString=w1)
              w2 = no error
            }
            frame "Array" {
              C Code Node("x"=w6) -> ("x"=w16, Error Out=w17)
              ~~~
              // Code in a Expression Node was converted to code in a C Node.
              // Review the converted code to ensure it has the same behavior
              // as the original code.


              // ORIGINAL CODE:

              // 2*x+3


              // CONVERTED CODE:

              x = 2*x+3;
              ~~~
              call "Clear Errors.gvi"(error in=w17)
              Array Index(array=$"Type Descriptor") -> (out0[w16]=w18)
              Multiply(w16, 2) -> w19
              Add(w19, w18) -> w20
              call "Get PString.gvi"(String=w7, offset (0)=w20) -> (PString=w1)
              w2 = no error
            }
            frame "Cluster" {
              s2 = 3  # shift register
              for (N = w6) {
                Array Index(array=$"Type Descriptor") -> (out0[s2]=w21)
                Quotient And Remainder(x=w21, y=2) -> (floor(x/y)=w22)
                To Long Integer(number=w22) -> w23
                Add(w23, s2) -> w24
                next s2 = w24
              }
              Multiply(s2, 2) -> w25
              call "Get PString.gvi"(String=w7, offset (0)=w25) -> (PString=w1)
              w2 = no error
            }
            frame "Waveform" {
              # Waveform type descriptor is not documented
              # Attempt to identify a PString at the end of the
              # type descriptor.
              call "Get Last PString.gvi"(String=w7) -> (Last PString=w1)
              w2 = no error
            }
            frame "DAQ", "Refnum" {
              call "Get Last PString.gvi"(String=w7) -> (Last PString=w1)
              # Refnums type descriptors are not documented
              # Attempt to identify a PString at the end of the
              # type descriptor.
              w2 = no error
            }
            frame Default {
              Format Into String(formatString="Unexpected Datatype <%s>", w5) -> w26
              # Unexpected Datatype
              call "Build Error Cluster.gvi"(code="Argument error"(1), String to Prepend to source ("")=w26) -> (error out=w2)
              w1 = ""
            }
          }
        }
      }
    }
    frame Error {
      w1 = ""
      w2 = $"error in (no error)"
    }
  }
  $name <- w1
  $error <- w2
