vi "Get Data Name.gvi"   [LabVIEW Platform Developer Preview 0.1.0]
# Returns the name of the data wired on input.
inputs:
  "Data": variant, required
  "error in (no error)": error
outputs:
  "Data dup": variant
  "Data Name": string
  "error out": error
uses:
  openg::library::variant data::Get Data Name from TD.gvi
diagram:
  $"Data dup" <- $Data
  case ($"error in (no error)") {
    frame No Error {
      Variant To Flattened Byte Array(variant=$Data) -> (type string=w3)
      call "Get Data Name from TD.gvi"(Type Descriptor=w3, error in (no error)=$"error in (no error)") -> (name=w2, error=w1)
    }
    frame Error {
      w1 = $"error in (no error)"
      w2 = ""
    }
  }
  $"Data Name" <- w2
  $"error out" <- w1
