vi "Get Data TD from Datalog Ref.gvi"   [LabVIEW Platform Developer Preview 0.1.0]
# Resolves the Type Descriptor for a Datalog Refnum.
inputs:
  "Datalog Refnum": variant, required
  "error in (no error)": error
outputs:
  "Type Descriptor": "Type Descriptor.gtype"
  "error out": error
types:
  "Type Descriptor.gtype" = i16[]
  "Refnum Code.gtype" = enum{"Not a Refnum", "Datalog File", "Byte Stream File", "0x03", "Occurence", "TCP", "0x06", "ActiveX", "Generic VI Server Class", "Menu", "0x0A", "IMAQ Session", "0x0C", "0x0D", "VISA", "IVI", "UDP"}
uses:
  openg::library::variant data::Variant to Header Info.gvi
  openg::library::error::Build Error Cluster.gvi
  openg::library::variant data::Get Header from TD.gvi
diagram:
  case ($"error in (no error)") {
    frame No Error {
      call "Variant to Header Info.gvi"(Variant=$"Datalog Refnum") -> (Type Descriptor Header=w3, Type Descriptor=w4, data string=w5)
      Property Node(instance in=w3) -> ("type"=w6, "# elements"=w7)
      case (w6) {
        frame Default {
          Format Into String(formatString="Unexpected Datatype <%s>", w6) -> w8
          call "Build Error Cluster.gvi"(code="Argument error"(1), String to Prepend to source ("")=w8) -> (error out=w1)
          w2 = i16[] []
        }
        frame "Refnum" {
          Type Cast(type="Refnum Code.gtype" "Datalog File", x=w7) -> w9
          case (w9) {
            frame "Datalog File" {
              Array Subset(array=w4, index0=3) -> w10
              call "Get Header from TD.gvi"(Type Descriptor=w10) -> (Type Descriptor Header=w11)
              Property Node(instance in=w11) -> ("length"=w12)
              Quotient And Remainder(x=w12, y=2) -> (floor(x/y)=w13)
              Array Subset(array=w10, length0=w13) -> w2
              w1 = no error
            }
            frame Default {
              Format Into String(formatString="Unexpected Refnum Type <%s>", w9) -> w14
              call "Build Error Cluster.gvi"(code="Argument error"(1), String to Prepend to source ("")=w14) -> (error out=w1)
              w2 = i16[] []
            }
          }
        }
      }
    }
    frame Error {
      w1 = $"error in (no error)"
      w2 = i16[] []
    }
  }
  $"error out" <- w1
  $"Type Descriptor" <- w2
