vi "Get Default Data from TD.gvi"   [LabVIEW Platform Developer Preview 0.1.0]
# Returns default data of the type defined by the TD.  This VI calls itself recursively.
# This VI is Reentrant
inputs:
  "Type Descriptor": "Type Descriptor.gtype", required
  "error in (no error)": error
outputs:
  "Default VData": variant
  "error out": error
types:
  "Type Descriptor.gtype" = i16[]
uses:
  openg::library::variant data::Get Header from TD.gvi
  openg::library::error::Build Error Cluster.gvi
  openg::library::variant data::Split Cluster TD.gvi
  openg::library::variant data::Get Data Name from TD.gvi
  openg::library::variant data::Get Default Data from TD.gvi
  openg::library::variant data::Array of VData to VCluster.gvi
  openg::library::variant data::Get Waveform Type Enum from TD.gvi
diagram:
  case ($"error in (no error)") {
    frame No Error {
      call "Get Header from TD.gvi"(Type Descriptor=$"Type Descriptor") -> (Type Descriptor Header=w3)
      Property Node(instance in=w3) -> ("type"=w4, "# elements"=w5)
      case (w4) {
        frame "<Null>", Default {
          # Unexpected Datatype
          Format Into String(formatString="Unexpected Datatype <%s>", w4) -> w6
          call "Build Error Cluster.gvi"(code="Argument error"(1), String to Prepend to source ("")=w6) -> (error out=w1)
          w2 = variant()
        }
        frame "I8", "U8", "Enum U8" {
          # 1 Byte
          w7 = 0  # I8 Type
          Type Cast(type=string "", x=w7) -> w8
          Type Cast(type=u8[] [], x=w8) -> w9
          Flattened Byte Array To Variant(data string=w9, type string=$"Type Descriptor") -> (error out=w1, variant out=w2)
        }
        frame "I16", "U16", "Enum U16" {
          # 2 Bytes
          w10 = 0  # I16 Type
          Type Cast(type=string "", x=w10) -> w11
          Type Cast(type=u8[] [], x=w11) -> w12
          Flattened Byte Array To Variant(data string=w12, type string=$"Type Descriptor") -> (error out=w1, variant out=w2)
        }
        frame "I32", "U32", "SGL", "Enum U32", "SGL PQ", "DAQ", "Refnum" {
          # 4 Bytes
          w13 = 0  # I32 Type
          Type Cast(type=string "", x=w13) -> w14
          Type Cast(type=u8[] [], x=w14) -> w15
          Flattened Byte Array To Variant(data string=w15, type string=$"Type Descriptor") -> (error out=w1, variant out=w2)
        }
        frame "I64", "U64", "DBL", "CSG", "Enum U64", "DBL PQ", "CSG PQ" {
          # 8 Bytes
          w16 = 0  # DBL Type
          Flatten To Byte Array(anything=w16) -> (data bytes=w17)
          Flattened Byte Array To Variant(data string=w17, type string=$"Type Descriptor") -> (error out=w1, variant out=w2)
        }
        frame "EXT", "CDB", "EXT PQ", "CDB PQ" {
          # 16 Bytes
          w18 = 0  # EXT Type
          Type Cast(type=string "", x=w18) -> w19
          Type Cast(type=u8[] [], x=w19) -> w20
          Flattened Byte Array To Variant(data string=w20, type string=$"Type Descriptor") -> (error out=w1, variant out=w2)
        }
        frame "CXT", "CXT PQ" {
          # 32 Bytes
          w21 = 0+0i  # CXT Type
          Type Cast(type=string "", x=w21) -> w22
          Type Cast(type=u8[] [], x=w22) -> w23
          Flattened Byte Array To Variant(data string=w23, type string=$"Type Descriptor") -> (error out=w1, variant out=w2)
        }
        frame "Boolean" {
          Type Cast(type=string "", x=FALSE) -> w24
          Type Cast(type=u8[] [], x=w24) -> w25
          Flattened Byte Array To Variant(data string=w25, type string=$"Type Descriptor") -> (error out=w1, variant out=w2)
        }
        frame "String" {
          Flatten To Byte Array(anything="") -> (data bytes=w26)
          Flattened Byte Array To Variant(data string=w26, type string=$"Type Descriptor") -> (error out=w1, variant out=w2)
        }
        frame "Path" {
          Flatten To Byte Array(anything=path "") -> (data bytes=w27)
          Flattened Byte Array To Variant(data string=w27, type string=$"Type Descriptor") -> (error out=w1, variant out=w2)
        }
        frame "Cluster" {
          call "Split Cluster TD.gvi"(Type Descriptor=$"Type Descriptor") -> (Type Descriptors=w28, error out=w29)
          # Recursively call VI for Cluster elements
          call "Get Data Name from TD.gvi"(Type Descriptor=$"Type Descriptor", error in (no error)=w29) -> (name=w30, error=w31)
          # >cluster name>
          s1 = w31  # shift register
          for {
            w32 = each element of w28
            Property Node(instance in=w32) -> ("Type Descriptor"=w34)
            call "Get Default Data from TD.gvi"(Type Descriptor=w34, error in (no error)=s1) -> (Default VData=w35, error out=w36)
            append w35 to w33
            next s1 = w36
          }
          call "Array of VData to VCluster.gvi"(Array=w33, Cluster Name=w30, error in (no error)=s1) -> (VCluster=w2, error out=w1)
        }
        frame "Array" {
          # Set size(s) to 0
          w37 = 0  # I32
          Initialize Array(element=w37, size=w5) -> w38
          Type Cast(type=string "", x=w38) -> w39
          Type Cast(type=u8[] [], x=w39) -> w40
          Flattened Byte Array To Variant(data string=w40, type string=$"Type Descriptor") -> (error out=w1, variant out=w2)
        }
        frame "Waveform" {
          call "Get Waveform Type Enum from TD.gvi"(Type Descriptor=$"Type Descriptor") -> (Waveform Subtype Enum=w41)
          # Only the Waveform subtype of Timestamp is supported
          case (w41) {
            frame Default {
              Format Into String(formatString="Unexpected Waveform Datatype <%s>", w41) -> w42
              call "Build Error Cluster.gvi"(code="Argument error"(1), String to Prepend to source ("")=w42) -> (error out=w1)
              w2 = variant()
            }
            frame "Timestamp" {
              Type Cast(type=string "", x=1904-01-01T00:00:00Z) -> w43
              Type Cast(type=u8[] [], x=w43) -> w44
              Flattened Byte Array To Variant(data string=w44, type string=$"Type Descriptor") -> (error out=w1, variant out=w2)
            }
          }
        }
      }
    }
    frame Error {
      w1 = $"error in (no error)"
      w2 = variant()
    }
  }
  $"Default VData" <- w2
  $"error out" <- w1
