vi "Get Default Data from Variant.gvi"   [LabVIEW Platform Developer Preview 0.1.0]
# Default VData returns default data of the type defined by Variant.
inputs:
  "Variant": variant
  "error in (no error)": error
outputs:
  "Default VData": variant
  "error out": error
uses:
  openg::library::variant data::Get Default Data from TD.gvi
diagram:
  Variant To Flattened Byte Array(variant=$Variant) -> (type string=w1)
  call "Get Default Data from TD.gvi"(Type Descriptor=w1, error in (no error)=$"error in (no error)") -> (Default VData=w2, error out=w3)
  $"Default VData" <- w2
  $"error out" <- w3
