vi "Get Element TD from Array TD.gvi"   [LabVIEW Platform Developer Preview 0.1.0]
# Returns the type descriptor of the array element.
inputs:
  "Array Type Descriptor": "Type Descriptor.gtype", required
  "error in (no error)": error
outputs:
  "Element Type Descriptor": "Type Descriptor.gtype"
  "error out": error
types:
  "Type Descriptor.gtype" = i16[]
uses:
  openg::library::variant data::Get Header from TD.gvi
  openg::library::error::Build Error Cluster.gvi
  NI::G Core::Error::Legacy::Clear Errors.gvi
diagram:
  case ($"error in (no error)") {
    frame No Error {
      call "Get Header from TD.gvi"(Type Descriptor=$"Array Type Descriptor") -> (Type Descriptor Header=w3)
      Property Node(instance in=w3) -> ("type"=w4, "# elements"=w5)
      case (w4) {
        frame Default {
          Format Into String(formatString="Unexpected Datatype <%s>", w4) -> w6
          call "Build Error Cluster.gvi"(code="Argument error"(1), String to Prepend to source ("")=w6) -> (error out=w1)
          w2 = i16[] []
        }
        frame "Array" {
          C Code Node("x"=w5) -> ("x"=w7, Error Out=w8)
          ~~~
          // Code in a Expression Node was converted to code in a C Node.
          // Review the converted code to ensure it has the same behavior
          // as the original code.


          // ORIGINAL CODE:

          // 2*x+3


          // CONVERTED CODE:

          x = 2*x+3;
          ~~~
          call "Clear Errors.gvi"(error in=w8)
          Array Subset(array=$"Array Type Descriptor", index0=w7) -> w9
          call "Get Header from TD.gvi"(Type Descriptor=w9) -> (Type Descriptor Header=w10)
          Property Node(instance in=w10) -> ("length"=w11)
          Quotient And Remainder(x=w11, y=2) -> (floor(x/y)=w12)
          Array Subset(array=w9, length0=w12) -> w2
          w1 = no error
        }
      }
    }
    frame Error {
      w1 = $"error in (no error)"
      w2 = i16[] []
    }
  }
  $"error out" <- w1
  $"Element Type Descriptor" <- w2
