vi "Get GOOP Object Type.gvi"   [LabVIEW Platform Developer Preview 0.1.0]
# Resolves a GOOP Refnum's Object Type (which is the string value of the Enum in GOOP Datalog File Refnum).
inputs:
  "GOOP Refnum": variant, required
  "error in (no error)": error
outputs:
  "Object Type": string
  "error out": error
uses:
  openg::library::variant data::Get Data TD from Datalog Ref.gvi
  openg::library::variant data::Get Strings from Enum.gvi
diagram:
  call "Get Data TD from Datalog Ref.gvi"(Datalog Refnum=$"GOOP Refnum", error in (no error)=$"error in (no error)") -> (Type Descriptor=w1, error out=w2)
  Type Cast(type=u8[] [], x="") -> w3
  Flattened Byte Array To Variant(data string=w3, error in=w2, type string=w1) -> (error out=w4, variant out=w5)
  call "Get Strings from Enum.gvi"(Enum=w5, error in (no error)=w4) -> (String Value=w6, error out=w7)
  $"Object Type" <- w6
  $"error out" <- w7
