vi "Get Physical Units from TD.gvi"   [LabVIEW Platform Developer Preview 0.1.0]
# Returns the physical units of the TD (number or array).
inputs:
  "Float or Array Type Descriptor": "Type Descriptor.gtype", required
  "error in (no error)": error
outputs:
  "Physical Units": "Physical Units.gtype"[]
  "error out": error
panel controls:
  "Physical Units (type)": "Physical Units.gtype"
types:
  "Type Descriptor.gtype" = i16[]
  T1 = enum{"radian", "steradian", "second", "meter", "kilogram", "ampere", "kelvin", "mole", "candela"}
  "Physical Units.gtype" = cluster{"Base Units": T1, "Exponent": i16}
uses:
  openg::library::variant data::Get TDEnum from TD.gvi
  openg::library::variant data::Get Element TD from Array TD.gvi
  openg::library::variant data::Get Header from TD.gvi
  openg::library::error::Build Error Cluster.gvi
  NI::G Core::Error::Legacy::Clear Errors.gvi
diagram:
  w1 = cluster{"Base Units": T1, "Exponent": i16}[] []  # No Units
  case ($"error in (no error)") {
    frame No Error {
      call "Get TDEnum from TD.gvi"(Type Descriptor=$"Float or Array Type Descriptor") -> (Type Descriptor Enumeration=w4)
      case (w4) {
        frame Default {
          w5 = $"Float or Array Type Descriptor"
        }
        frame "Array" {
          call "Get Element TD from Array TD.gvi"(Array Type Descriptor=$"Float or Array Type Descriptor") -> (Element Type Descriptor=w5)
        }
      }
      call "Get Header from TD.gvi"(Type Descriptor=w5) -> (Type Descriptor Header=w6)
      Property Node(instance in=w6) -> ("type"=w7, "# elements"=w8)
      case (w7) {
        frame Default {
          Format Into String(formatString="Unexpected Datatype <%s>", w7) -> w9
          call "Build Error Cluster.gvi"(code="Argument error"(1), String to Prepend to source ("")=w9) -> (error out=w2)
          w3 = w1
        }
        frame "SGL PQ".."CXT PQ" {
          w10 = $"Physical Units (type)"
          s1 = 3  # shift register
          for (N = w8) {
            C Code Node("x"=s1) -> ("x"=w11, Error Out=w12)
            ~~~
            // Code in a Expression Node was converted to code in a C Node.
            // Review the converted code to ensure it has the same behavior
            // as the original code.


            // ORIGINAL CODE:

            // x+2


            // CONVERTED CODE:

            x = x+2;
            ~~~
            call "Clear Errors.gvi"(error in=w12)
            Array Index(array=w5) -> (out0[s1]=w13, out1[_]=w14)
            Property Node(instance in=w10, "Base Units"=w13, "Exponent"=w14) -> (instance out=w15)
            append w15 to w3
            next s1 = w11
          }
          w2 = no error
        }
        frame "SGL".."EXT" {
          w2 = no error
          w3 = w1
        }
      }
    }
    frame Error {
      w2 = $"error in (no error)"
      w3 = w1
    }
  }
  $"error out" <- w2
  $"Physical Units" <- w3
