vi "Get Physical Units.gvi"   [LabVIEW Platform Developer Preview 0.1.0]
# Returns the physical units of the variant input (number or array).
inputs:
  "Float or Array of Floats": variant, required
  "error in (no error)": error
outputs:
  "Physical Units": "Physical Units.gtype"[]
  "error out": error
types:
  T1 = enum{"radian", "steradian", "second", "meter", "kilogram", "ampere", "kelvin", "mole", "candela"}
  "Physical Units.gtype" = cluster{"Base Units": T1, "Exponent": i16}
uses:
  openg::library::variant data::Get Physical Units from TD.gvi
diagram:
  Variant To Flattened Byte Array(variant=$"Float or Array of Floats") -> (type string=w1)
  call "Get Physical Units from TD.gvi"(Float or Array Type Descriptor=w1, error in (no error)=$"error in (no error)") -> (Physical Units=w2, error out=w3)
  $"Physical Units" <- w2
  $"error out" <- w3
