vi "Get Refnum Type Enum from Data.gvi"   [LabVIEW Platform Developer Preview 0.1.0]
# Gets the Refnum Type Enumeration of the input.
inputs:
  "Data": variant, required
outputs:
  "Refnum Subtype Enum": "Refnum Subtype Enum.gtype"
types:
  "Refnum Subtype Enum.gtype" = enum{"Generic", "Datalog File Refnum", "Byte Stream File Refnum", "Device Refnum", "Occurence Refnum", "TCP Connection Refnum", "VISA Refnum (Obsolete)", "Automation Renum", "VI Server Refnum", "Menu Refnum", "IVI Refnum (Obsolete)", "IMAQ Session", "0x0C", "Datasocket Refnum", "VISA Resource", "IVI Logical Name", "UDP Connection Refnum", "Notifier Refnum", "Queue Refnum", "IrDA Refnum", "Hardware Plugin Refnum", "Hardware Plugin Tag Refnum", "DAQmx Refnum", "Event Registration Refnum", ".NET Refnum", "User Event Refnum", "0x1A", "Event Callback", "0x1C", "0x1D", "Only Used Internal to LabVIEW", "Bluetooth", "Data Value References", "RT FIFO", "TDM Streaming"}
uses:
  openg::library::variant data::Get Refnum Type Enum from TD.gvi
diagram:
  Variant To Flattened Byte Array(variant=$Data) -> (type string=w1)
  call "Get Refnum Type Enum from TD.gvi"(Type Descriptor=w1) -> (Refnum Subtype Enum=w2)
  $"Refnum Subtype Enum" <- w2
