vi "Get Strings from Enum TD.gvi"   [LabVIEW Platform Developer Preview 0.1.0]
# Returns Enum Strings array, String Value and Enum Name from an Enum Type Descriptor.
inputs:
  "Type Descriptor": i16[], required
  "error in (no error)": error
outputs:
  "enum strings": string[]
  "enum name": string
  "error out": error
uses:
  openg::library::variant data::Get Header from TD.gvi
  openg::library::error::Build Error Cluster.gvi
  openg::library::variant data::Get PString.gvi
diagram:
  # default output values
  case ($"error in (no error)") {
    frame No Error {
      call "Get Header from TD.gvi"(Type Descriptor=$"Type Descriptor") -> (Type Descriptor Header=w4)
      Property Node(instance in=w4) -> ("# elements"=w5, "type"=w6)
      case (w6) {
        frame "<Null>", Default {
          Format Into String(formatString="Unexpected Datatype <%s>", w6) -> w7
          call "Build Error Cluster.gvi"(code="Argument error"(1), String to Prepend to source ("")=w7) -> (error out=w1)
          w2 = string[] []
          w3 = ""
        }
        frame "Enum U8".."Enum U64" {
          Type Cast(type=string "", x=$"Type Descriptor") -> w8
          # name is
          # word aligned
          s1 = 6  # shift register
          for (N = w5) {
            call "Get PString.gvi"(String=w8, offset (0)=s1) -> (PString=w9, offset past PString=w10)
            append w9 to w2
            next s1 = w10
          }
          Quotient And Remainder(x=s1, y=2) -> (x-y*floor(x/y)=w11)
          Add(s1, w11) -> w12
          call "Get PString.gvi"(String=w8, offset (0)=w12) -> (PString=w3)
          w1 = $"error in (no error)"
        }
      }
    }
    frame Error {
      w1 = $"error in (no error)"
      w2 = string[] []
      w3 = ""
    }
  }
  $"error out" <- w1
  $"enum strings" <- w2
  $"enum name" <- w3
