vi "Get Strings from Enum.gvi"   [LabVIEW Platform Developer Preview 0.1.0]
# Returns Enum Strings array, String Value and Enum Name from an Enum.
inputs:
  "Enum": variant, required
  "error in (no error)": error
outputs:
  "Enum Name": string
  "Enum Strings": string[]
  "String Value": string
  "error out": error
uses:
  openg::library::variant data::Variant to Header Info.gvi
  openg::library::error::Build Error Cluster.gvi
  openg::library::variant data::Get Strings from Enum TD.gvi
diagram:
  # default output values
  case ($"error in (no error)") {
    frame No Error {
      call "Variant to Header Info.gvi"(Variant=$Enum) -> (Type Descriptor Header=w5, Type Descriptor=w6, data string=w7)
      Property Node(instance in=w5) -> ("type"=w8)
      case (w8) {
        frame Default {
          # Unexpected Datatype
          Format Into String(formatString="Unexpected Datatype <%s>", w8) -> w9
          call "Build Error Cluster.gvi"(code="Argument error"(1), String to Prepend to source ("")=w9) -> (error out=w1)
          w2 = string[] []
          w3 = ""
          w4 = ""
        }
        frame "Enum U8".."Enum U64" {
          String Length(string=w7) -> (length=w10)
          case (w10) {
            frame 0, Default {
              w11 = 0
            }
            frame 1 {
              Type Cast(type=u8[] [], x=w7) -> w12
              w13 = u8 0  # U8
              Unflatten From Byte Array(data bytes=w12, type=w13) -> (value=w11)
            }
            frame 2 {
              Type Cast(type=u8[] [], x=w7) -> w14
              w15 = u16 0  # U16
              Unflatten From Byte Array(data bytes=w14, type=w15) -> (value=w11)
            }
            frame 4 {
              Type Cast(type=u8[] [], x=w7) -> w16
              w17 = u32 0  # U32
              Unflatten From Byte Array(data bytes=w16, type=w17) -> (value=w11)
            }
            frame 8 {
              # Enum 64
              # Coerce Data to U32
              String Subset(offset (0)=4, string=w7) -> w18
              Type Cast(type=u8[] [], x=w18) -> w19
              w20 = u32 0  # U32
              Unflatten From Byte Array(data bytes=w19, type=w20) -> (value=w11)
            }
          }
          call "Get Strings from Enum TD.gvi"(Type Descriptor=w6, error in (no error)=$"error in (no error)") -> (enum strings=w2, enum name=w3, error out=w1)
          Array Index(array=w2) -> (out0[w11]=w4)
        }
      }
    }
    frame Error {
      w1 = $"error in (no error)"
      w2 = string[] []
      w3 = ""
      w4 = ""
    }
  }
  $"Enum Strings" <- w2
  $"Enum Name" <- w3
  $"error out" <- w1
  $"String Value" <- w4
