vi "Get TDEnum from Data.gvi"   [LabVIEW Platform Developer Preview 0.1.0]
# Gets the type enumeration enum of the input.
inputs:
  "Data": variant, required
outputs:
  "Type Descriptor Enumeration": "Type Descriptor Enumeration.gtype"
types:
  "Type Descriptor Enumeration.gtype" = enum{"<Null>", "I8", "I16", "I32", "I64", "U8", "U16", "U32", "U64", "SGL", "DBL", "EXT", "CSG", "CDB", "CXT", "0x0F", "0x10", "0x11", "0x12", "0x13", "0x14", "Enum U8", "Enum U16", "Enum U32", "Enum U64", "SGL PQ", "DBL PQ", "EXT PQ", "CSG PQ", "CDB PQ", "CXT PQ", "0x1F", "0x20", "Boolean", "0x22", "0x23", "0x24", "0x25", "0x26", "0x27", "0x28", "0x29", "0x2A", "0x2B", "0x2C", "0x2D", "0x2E", "0x2F", "String", "0x31", "Path", "Pict", "0x34", "0x35", "0x36", "DAQ", "0x38", "0x39", "0x3A", "0x3B"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}
uses:
  openg::library::variant data::Get Header from TD.gvi
diagram:
  Variant To Flattened Byte Array(variant=$Data) -> (type string=w1)
  call "Get Header from TD.gvi"(Type Descriptor=w1) -> (Type Descriptor Header=w2)
  Property Node(instance in=w2) -> ("type"=w3)
  $"Type Descriptor Enumeration" <- w3
