vi "Get Waveform Type Enum from Data.gvi"   [LabVIEW Platform Developer Preview 0.1.0]
# Gets the Waveform Type Enumeration of the input.
inputs:
  "Data": variant, required
outputs:
  "Waveform Subtype Enum": "Waveform Subtype Enum.gtype"
types:
  "Waveform Subtype Enum.gtype" = enum{"<Not a Waveform Type>", "0x01", "Analog 16-bit signed", "Analog Double-Precision", "0x04", "Analog Single Precision", "Timestamp", "Digital Data", "Digital Waveform", "Dynamic Data", "Analog Extended-Precision", "Analog 8-bit unsigned", "Analog 16-bit unsigned", "Analog 32-bit unsigned", "Analog 8-bit signed", "Analog 32-bit signed", "Analog Complex Single-Precision", "Analog Complex Double-Precision", "Analog Complex Extended Precision", "Analog 64-bit signed", "Analog 64-bit unsigned"}
uses:
  openg::library::variant data::Get Waveform Type Enum from TD.gvi
diagram:
  Variant To Flattened Byte Array(variant=$Data) -> (type string=w1)
  call "Get Waveform Type Enum from TD.gvi"(Type Descriptor=w1) -> (Waveform Subtype Enum=w2)
  $"Waveform Subtype Enum" <- w2
