vi "Index Array.gvi"   [LabVIEW Platform Developer Preview 0.1.0]
# Returns the element of a MultiD array at given indices. Inefficient for large arrays.
inputs:
  "MultiD Array": variant, required
  "Index (1D)": u32
  "Indices (>=1D)": u32[]
  "error in (no error)": error
outputs:
  "Array Element": variant
  "error out": error
uses:
  openg::library::variant data::Array Size(s).gvi
  openg::library::variant data::Reshape Array to 1D VArray.gvi
  openg::library::variant data::Compute 1D Index.gvi
diagram:
  call "Array Size(s).gvi"(Array=$"MultiD Array", error in (no error)=$"error in (no error)") -> (Size(s)=w1, error out=w2)
  call "Reshape Array to 1D VArray.gvi"(MultiD Array=$"MultiD Array", error in (no error)=w2) -> (1D VArray=w3, error out=w4)
  case (w4) {
    frame No Error {
      Array Size(array=$"Indices (>=1D)") -> (size(s)=w7)
      case (w7) {
        frame 0 {
          Build Array($"Index (1D)") -> w8
        }
        frame Default {
          w8 = $"Indices (>=1D)"
        }
      }
      call "Compute 1D Index.gvi"(Indices=w8, Size(s)=w1) -> (1D Index=w9)
      w10 = variant[] []  # Variant Array
      Variant To Data(type=w10, variant=w3) -> (data=w11, error out=w5)
      Array Index(array=w11) -> (out0[w9]=w6)
    }
    frame Error {
      w5 = w4
      w6 = variant()
    }
  }
  $"Array Element" <- w6
  $"error out" <- w5
