vi "LVOOP Is Default Value.gvi"   [LabVIEW Platform Developer Preview 0.1.0]
# Is Default Value? returns TRUE only if Object is the default instance of its Class.
inputs:
  "Object": gObject, required
outputs:
  "Is Default Value?": bool
uses:
  openg::library::variant data::LVOOP Get Default Object.gvi
diagram:
  call "LVOOP Get Default Object.gvi"(Object=$Object) -> (Object Default Instance=w1)
  Is Equal(x=$Object, y=w1) -> w2
  $"Is Default Value?" <- w2
