vi "LVOOP Is Same Or Descendant Class.gvi"   [LabVIEW Platform Developer Preview 0.1.0]
# Is Same Class or Descendant? returns TRUE if the Possible Descendant Object is of the same Class as, or is a descendant Class of, the Object.
inputs:
  "Object": gObject, required
  "Possible Descendant Object": gObject, required
outputs:
  "Is Same Class or Descendant?": bool
diagram:
  Preserve Run Time Class(object in=$"Possible Descendant Object", target object=$Object) -> (error out=w1)
  Property Node(instance in=w1) -> ("status"=w2)
  Not(x=w2) -> w3
  $"Is Same Class or Descendant?" <- w3
