vi "LVOOP Return Class Name.gvi"   [LabVIEW Platform Developer Preview 0.1.0]
# Returns the Class Base Name, Qualified Name and Qualified Name Array of Object.
# For example if Object is of type Library.lvlib:Class 1.lvclass then:
# Class Base Name = Class 1
# Qualified Name = Library.lvlib:Class 1.lvclass
# Qualified Name Array = [Library.lvlib, Class 1.lvclass]
# Notes:
# This VI benefits from being generic (e.g. good for probes/scripting) however, is most likely inefficient to the cost of flattening the entire object data to a string (as is any VI that does this). Although this VI is optimised to only use the default object data.
# The following alternative method is recommended for high performance applications:
# Add a dynamic dispatch method to the root Class (e.g. called "Get Class Name.vi") and override that VI at every level of the hierarchy to return a string constant of the desired name. This avoids the memory allocation and performance hit of the flattening to the string. An example of a use case is creating a by-name-lookup object hierarchy.
inputs:
  "Object": gObject, required
outputs:
  "Class Base Name": string
  "Qualified Name": string
  "Qualified Name Array": string[]
uses:
  openg::library::variant data::LVOOP Get Default Object.gvi
diagram:
  call "LVOOP Get Default Object.gvi"(Object=$Object) -> (Object Default Instance=w1)
  Flatten To Byte Array(anything=w1) -> (data bytes=w2)
  Type Cast(type=string "", x=w2) -> w3
  w4 = u8 0  # U8
  # Returns the Object's default instanse to lessen hit of flattening to string
  String Subset(length (rest)=1, offset (0)=4, string=w3) -> w5
  Type Cast(type=w4, x=w5) -> w6
  # >name string>
  String Subset(length (rest)=w6, offset (0)=5, string=w3) -> w7
  s1 = w7  # shift register
  while {  # find position for each name
    w9 = u8 0  # U8
    String Subset(length (rest)=1, offset (0)=0, string=s1) -> w10
    Type Cast(type=w9, x=w10) -> w11
    Increment(x=w11) -> w12
    String Subset(offset (0)=w12, string=s1) -> w13
    Increment(x=0) -> w14
    String Subset(length (rest)=w11, offset (0)=w14, string=s1) -> w15
    Is Less Or Equal To 0(x=w11) -> w16
    append w15 to w8
    next s1 = w13
    stop if w16
  }
  Array Size(array=w8) -> (size(s)=w17)
  Decrement(x=w17) -> w18
  Array Subset(array=w8, length0=w18) -> w19
  Delete From Array(inArray=w19) -> (deleted=w20)
  Match Pattern(regular expression=".lvclass", string=w20) -> (before substring=w21)
  $"Class Base Name" <- w21
  # This VI is located in <vi.lib>\Utility\LVClass but is not exposed in the palettes
  disable {
    frame Enabled {
      w22 = default
    }
    frame Disabled {
      Qualified Name Array To Single String(Fully Qualified Array Input 0=w19) -> (Fully Qualified String Output 1=w22)  # Qualified Name Array To Single String (Placeholder)
    }
  }
  $"Qualified Name" <- w22
  $"Qualified Name Array" <- w19
