vi "No of Elements in Cluster.gvi"   [LabVIEW Platform Developer Preview 0.1.0]
# Returns the number of elements in a  cluster.
inputs:
  "Cluster": variant, required
  "error in (no error)": error
outputs:
  "Number of Elements": u16
  "error out": error
uses:
  openg::library::variant data::Variant to Header Info.gvi
  openg::library::error::Build Error Cluster.gvi
diagram:
  case ($"error in (no error)") {
    frame No Error {
      call "Variant to Header Info.gvi"(Variant=$Cluster) -> (Type Descriptor Header=w3)
      Property Node(instance in=w3) -> ("type"=w4, "# elements"=w5)
      case (w4) {
        frame Default {
          # Unexpected Datatype
          Format Into String(formatString="Unexpected Datatype <%s>", w4) -> w6
          call "Build Error Cluster.gvi"(code="Argument error"(1), String to Prepend to source ("")=w6) -> (error out=w1)
          w2 = 0
        }
        frame "Cluster" {
          w1 = no error
          w2 = w5
        }
      }
    }
    frame Error {
      w1 = $"error in (no error)"
      w2 = 0
    }
  }
  $"Number of Elements" <- w2
  $"error out" <- w1
