vi "Parse String with TDs.gvi"   [LabVIEW Platform Developer Preview 0.1.0]
# Parses a flattened string with type descriptors to output an array of variant data.
inputs:
  "Type Descriptors": T1[], required
  "Data string": string, required
  "offset (0)": i32
  "error in (no error)": error
outputs:
  "Array of VData": variant[]
  "offset past parsing": i32
  "error out": error
types:
  "Type Descriptor.gtype" = i16[]
  T1 = cluster{"Type Descriptor": "Type Descriptor.gtype"}
diagram:
  s1 = $"offset (0)"  # shift register
  s2 = $"error in (no error)"  # shift register
  for {
    w1 = each element of $"Type Descriptors"
    Property Node(instance in=w1) -> ("Type Descriptor"=w3)
    String Subset(offset (0)=s1, string=$"Data string") -> w4
    Type Cast(type=u8[] [], x=w4) -> w5
    Flattened Byte Array To Variant(data string=w5, error in=s2, type string=w3) -> (error out=w6, variant out=w7)
    Variant To Flattened Byte Array(variant=w7) -> (data string=w8)
    Type Cast(type=string "", x=w8) -> w9
    String Length(string=w9) -> (length=w10)
    Add(w10, s1) -> w11
    append w7 to w2
    next s1 = w11
    next s2 = w6
  }
  $"Array of VData" <- w2
  $"offset past parsing" <- s1
  $"error out" <- s2
