vi "Remove Typedefs from Variant.gvi"   [LabVIEW Platform Developer Preview 0.1.0]
# Removes typedef information via a variant to variant "conversion".
inputs:
  "Variant with typedefs": variant, required
  "error in": error
outputs:
  "Variant without typedef": variant
  "error out": error
diagram:
  # Flattinging removes typedefs
  Variant To Flattened Byte Array(variant=$"Variant with typedefs") -> (data string=w1, type string=w2)
  # Convert flattened data back to variant
  Flattened Byte Array To Variant(data string=w1, error in=$"error in", type string=w2) -> (error out=w3, variant out=w4)
  $"Variant without typedef" <- w4
  $"error out" <- w3
