vi "Replace Array Element.gvi"   [LabVIEW Platform Developer Preview 0.1.0]
# Replaces the elements in a MultiD array at given indices.
inputs:
  "MultiD Array": variant, required
  "Index (1D)": u32
  "Indices (>=1D)": u32[]
  "error in (no error)": error
  "New Element": variant, required
outputs:
  "VMultiD Array": variant
  "error out": error
uses:
  openg::library::variant data::Array Size(s).gvi
  openg::library::variant data::Reshape Array to 1D VArray.gvi
  openg::library::variant data::Compute 1D Index.gvi
diagram:
  call "Array Size(s).gvi"(Array=$"MultiD Array", error in (no error)=$"error in (no error)") -> (Size(s)=w1, error out=w2)
  call "Reshape Array to 1D VArray.gvi"(MultiD Array=$"MultiD Array", error in (no error)=w2) -> (1D VArray=w3, error out=w4)
  case (w4) {
    frame No Error {
      w7 = variant[] []  # Array of VData
      Variant To Data(type=w7, variant=w3) -> (data=w8, error out=w9)
      Array Index(array=w8) -> (out0[_]=w10)
      Variant To Flattened Byte Array(variant=w10) -> (type string=w11)
      Variant To Flattened Byte Array(variant=$"New Element") -> (data string=w12)
      Flattened Byte Array To Variant(data string=w12, error in=w9, type string=w11) -> (error out=w13, variant out=w14)
      Variant To Flattened Byte Array(variant=$"MultiD Array") -> (type string=w15)
      Type Cast(type=string "", x=w1) -> w16
      Array Size(array=$"Indices (>=1D)") -> (size(s)=w17)
      case (w17) {
        frame 0 {
          Build Array($"Index (1D)") -> w18
        }
        frame Default {
          w18 = $"Indices (>=1D)"
        }
      }
      call "Compute 1D Index.gvi"(Indices=w18, Size(s)=w1) -> (1D Index=w19)
      Replace Array Subset(inArray=w8, index=w19, new=w14) -> w20
      for {
        w21 = each element of w20
        Variant To Flattened Byte Array(variant=w21) -> (data string=w23)
        append w23 to w22
      }
      Type Cast(type=string "", x=w22) -> w24
      Concatenate Strings(w16, w24) -> w25
      Type Cast(type=u8[] [], x=w25) -> w26
      Flattened Byte Array To Variant(data string=w26, error in=w13, type string=w15) -> (error out=w5, variant out=w6)
    }
    frame Error {
      w5 = w4
      w6 = variant()
    }
  }
  $"VMultiD Array" <- w6
  $"error out" <- w5
