vi "Reshape 1D Array.gvi"   [LabVIEW Platform Developer Preview 0.1.0]
# Reshapes all elements from a 1D array in a variant MultiD array.
inputs:
  "1D Array": variant, required
  "Size(s)": u32[], required
  "error in (no error)": error
outputs:
  "Reshaped VArray": variant
  "error out": error
uses:
  openg::library::variant data::Variant to Header Info.gvi
  openg::library::error::Build Error Cluster.gvi
  openg::library::variant data::Get Array Element TD.gvi
  NI::G Core::Error::Legacy::Clear Errors.gvi
  openg::library::variant data::Get Data Name.gvi
  openg::library::variant data::Set Data Name.gvi
diagram:
  case ($"error in (no error)") {
    frame No Error {
      call "Variant to Header Info.gvi"(Variant=$"1D Array") -> (Type Descriptor Header=w3, data string=w4)
      Property Node(instance in=w3) -> ("# elements"=w5, "type"=w6)
      case (w6) {
        frame Default {
          Format Into String(formatString="Unexpected Datatype <%s>", w6) -> w7
          # Unexpected Datatype
          call "Build Error Cluster.gvi"(code="Argument error"(1), String to Prepend to source ("")=w7) -> (error out=w1)
          w2 = variant()
        }
        frame "Array" {
          case (w5) {
            frame Default {
              call "Build Error Cluster.gvi"(code="Argument error"(1), String to Prepend to source ("")="Expected 1D Array ") -> (error out=w1)
              w2 = variant()
            }
            frame 1 {
              Array Size(array=$"Size(s)") -> (size(s)=w8)
              C Code Node("x"=w8) -> ("x"=w9, Error Out=w10)
              ~~~
              // Code in a Expression Node was converted to code in a C Node.
              // Review the converted code to ensure it has the same behavior
              // as the original code.


              // ORIGINAL CODE:

              // x*2


              // CONVERTED CODE:

              x = x*2;
              ~~~
              call "Get Array Element TD.gvi"(Array=$"1D Array") -> (Type Descriptor=w11, error out=w12)
              Array Size(array=w11) -> (size(s)=w13)
              Add(3, w13, w9) -> w14
              C Code Node("x"=w14) -> ("x"=w15, Error Out=w16)
              ~~~
              // Code in a Expression Node was converted to code in a C Node.
              // Review the converted code to ensure it has the same behavior
              // as the original code.


              // ORIGINAL CODE:

              // x*2


              // CONVERTED CODE:

              x = x*2;
              ~~~
              call "Clear Errors.gvi"(error in=w16)
              call "Get Data Name.gvi"(Data=$"1D Array", error in (no error)=w12) -> (Data Name=w17, error out=w18)
              # array data
              Type Cast(type=string "", x=$"Size(s)") -> w19
              # >> Array Name >>
              String Subset(offset (0)=4, string=w4) -> w20
              Concatenate Strings(w19, w20) -> w21
              Type Cast(type=u8[] [], x=w21) -> w22
              Initialize Array(element=-1, size=w9) -> w23
              w24 = "Array"  # Type Descriptor Enumeration
              Build Array[ConcatenateInputs=True](w15, w24, w8, w23, w11) -> w25
              Flattened Byte Array To Variant(data string=w22, error in=w18, type string=w25) -> (error out=w26, variant out=w27)
              call "Set Data Name.gvi"(Data=w27, Data Name=w17, error in (no error)=w26) -> (Renamed Data=w2, error out=w1)
              call "Clear Errors.gvi"(error in=w10)
            }
          }
        }
      }
    }
    frame Error {
      w1 = $"error in (no error)"
      w2 = variant()
    }
  }
  $"Reshaped VArray" <- w2
  $"error out" <- w1
