vi "Reshape Array to 1D VArray.gvi"   [LabVIEW Platform Developer Preview 0.1.0]
# Reshapes all elements from a MultiD array in a variant 1D array. Returns the input array size(s).
inputs:
  "MultiD Array": variant, required
  "error in (no error)": error
outputs:
  "1D VArray": variant
  "Size(s)": u32[]
  "error out": error
uses:
  openg::library::variant data::Variant to Header Info.gvi
  openg::library::error::Build Error Cluster.gvi
  openg::library::variant data::Array Size(s).gvi
  NI::G Core::Error::Legacy::Clear Errors.gvi
  openg::library::variant data::Get Data Name.gvi
  openg::library::variant data::Set Data Name.gvi
diagram:
  case ($"error in (no error)") {
    frame No Error {
      call "Variant to Header Info.gvi"(Variant=$"MultiD Array") -> (Type Descriptor Header=w4, Type Descriptor=w5, data string=w6)
      Property Node(instance in=w4) -> ("type"=w7)
      case (w7) {
        frame Default {
          # Unexpected Datatype
          Format Into String(formatString="Unexpected Datatype <%s>", w7) -> w8
          call "Build Error Cluster.gvi"(code="Argument error"(1), String to Prepend to source ("")=w8) -> (error out=w1)
          w2 = variant()
          w3 = u32[] []
        }
        frame "Array" {
          call "Array Size(s).gvi"(Array=$"MultiD Array") -> (Size(s)=w3, N dims=w9, error out=w10)
          C Code Node("x"=w9) -> ("x"=w11, Error Out=w12)
          ~~~
          // Code in a Expression Node was converted to code in a C Node.
          // Review the converted code to ensure it has the same behavior
          // as the original code.


          // ORIGINAL CODE:

          // 2*x+3


          // CONVERTED CODE:

          x = 2*x+3;
          ~~~
          Array Index(array=w5) -> (out0[w11]=w13)
          # Convert length to U16 before math.
          To Unsigned Word Integer(number=w13) -> w14
          C Code Node("x"=w14) -> ("x"=w15, Error Out=w16)
          ~~~
          // Code in a Expression Node was converted to code in a C Node.
          // Review the converted code to ensure it has the same behavior
          // as the original code.


          // ORIGINAL CODE:

          // x+10


          // CONVERTED CODE:

          x = x+10;
          ~~~
          # Convert to I16, since that's the TD data type used by NI
          call "Clear Errors.gvi"(error in=w16)
          call "Clear Errors.gvi"(error in=w12)
          call "Get Data Name.gvi"(Data=$"MultiD Array", error in (no error)=w10) -> (Data Name=w17, error out=w18)
          C Code Node("x"=w9) -> ("x"=w19, Error Out=w20)
          ~~~
          // Code in a Expression Node was converted to code in a C Node.
          // Review the converted code to ensure it has the same behavior
          // as the original code.


          // ORIGINAL CODE:

          // 4*x


          // CONVERTED CODE:

          x = 4*x;
          ~~~
          String Subset(offset (0)=w19, string=w6) -> w21
          Multiply Array Elements(numeric array=w3) -> (product=w22)
          # # of elements
          Type Cast(type=string "", x=w22) -> w23
          # Element TD
          Concatenate Strings(w23, w21) -> w24
          Type Cast(type=u8[] [], x=w24) -> w25
          To Word Integer(number=w15) -> w26
          w27 = "Array"  # Type Descriptor Enumeration
          # array data
          Quotient And Remainder(x=w14, y=2) -> (floor(x/y)=w28)
          Array Subset(array=w5, index0=w11, length0=w28) -> w29
          w30 = 1  # Dim 1D
          Build Array[ConcatenateInputs=True](w26, w27, w30, -1, -1, w29) -> w31
          Flattened Byte Array To Variant(data string=w25, error in=w18, type string=w31) -> (error out=w32, variant out=w33)
          call "Set Data Name.gvi"(Data=w33, Data Name=w17, error in (no error)=w32) -> (Renamed Data=w2, error out=w1)
          # >> Array Name >>
          call "Clear Errors.gvi"(error in=w20)
        }
      }
    }
    frame Error {
      w1 = $"error in (no error)"
      w2 = variant()
      w3 = u32[] []
    }
  }
  $"Size(s)" <- w3
  $"1D VArray" <- w2
  $"error out" <- w1
