vi "Set Cluster Element by Name.gvi"   [LabVIEW Platform Developer Preview 0.1.0]
# Returns a cluster with element replaced with new element value. If Element name unwired, New Element Value data name is used. Data type of the new element is not checked for compatibility with replaced element.
inputs:
  "Cluster": variant, required
  "New Element Value": variant, required
  "Element Name (\"\": New Element Data Name)": string
  "error in (no error)": error
outputs:
  "VCluster out": variant
  "found?": bool
  "error out": error
uses:
  openg::library::variant data::Set Data Name.gvi
  openg::library::variant data::Get Data Name.gvi
  openg::library::variant data::Cluster to Array of VData.gvi
  openg::library::variant data::Get Cluster Element Names.gvi
  openg::library::variant data::Array of VData to VCluster.gvi
diagram:
  case ($"Element Name (\"\": New Element Data Name)") {
    frame "False", Default {
      call "Set Data Name.gvi"(Data=$"New Element Value", Data Name=$"Element Name (\"\": New Element Data Name)", error in (no error)=$"error in (no error)") -> (Renamed Data=w2, error out=w3)
      w1 = $"Element Name (\"\": New Element Data Name)"
    }
    frame "" {
      call "Get Data Name.gvi"(Data=$"New Element Value", error in (no error)=$"error in (no error)") -> (Data Name=w1, error out=w3)
      w2 = $"New Element Value"
    }
  }
  call "Cluster to Array of VData.gvi"(Cluster=$Cluster, error in (no error)=w3) -> (Array of VData=w4, error out=w5)
  call "Get Cluster Element Names.gvi"(Cluster=$Cluster, error in (no error)=w5) -> (Element Names=w6, error out=w7)
  Search 1D Array(1D array=w6, element=w1) -> (index of element=w8)
  Is Greater Or Equal To 0(x=w8) -> w9
  $"found?" <- w9
  call "Get Data Name.gvi"(Data=$Cluster, error in (no error)=w7) -> (Data Name=w10, error out=w11)
  Replace Array Subset(inArray=w4, index=w8, new=w2) -> w12
  call "Array of VData to VCluster.gvi"(Array=w12, Cluster Name=w10, error in (no error)=w11) -> (VCluster=w13, error out=w14)
  $"VCluster out" <- w13
  $"error out" <- w14
