vi "Set Data Name.gvi"   [LabVIEW Platform Developer Preview 0.1.0]
# Changes the Data Name of Variant Data.
# Note: Variant attributes will persist after this operation.
inputs:
  "Data": variant, required
  "Data Name": string, required
  "error in (no error)": error
outputs:
  "Renamed Data": variant
  "error out": error
uses:
  openg::library::variant data::Get Variant Attributes.gvi
  openg::library::variant data::Variant to Header Info.gvi
  openg::library::variant data::Get PString.gvi
  NI::G Core::Error::Legacy::Clear Errors.gvi
  openg::library::variant data::Get Last PString.gvi
  openg::library::error::Build Error Cluster.gvi
diagram:
  case ($"error in (no error)") {
    frame No Error {
      call "Get Variant Attributes.gvi"(Variant=$Data, error in=$"error in (no error)") -> (duplicate Variant=w3, names=w4, value(s)=w5, error out=w6)
      call "Variant to Header Info.gvi"(Variant=w3) -> (Type Descriptor Header=w7, Type Descriptor=w8, data string=w9)
      # Flattening a Variant to String will remove attributes.
      # Persist attriubutes and then write back to Variant when it is Unflattened from String
      Type Cast(type=u8[] [], x=w9) -> w10
      Property Node(instance in=w7) -> ("type"=w11, "# elements"=w12)
      Type Cast(type=string "", x=w8) -> w13
      # Data is named
      case (w11) {
        frame "I8".."CXT", "Boolean", "Variant" {
          w14 = w6
          w15 = 2
        }
        frame "Enum U8".."Enum U64" {
          s1 = 6  # shift register
          for (N = w12) {
            call "Get PString.gvi"(String=w13, offset (0)=s1) -> (offset past PString=w16)
            next s1 = w16
          }
          Increment(x=s1) -> w17
          Quotient And Remainder(x=w17, y=2) -> (floor(x/y)=w15)
          w14 = w6
        }
        frame "SGL PQ".."CXT PQ" {
          C Code Node("x"=w12) -> ("x"=w15, Error Out=w18)
          ~~~
          // Code in a Expression Node was converted to code in a C Node.
          // Review the converted code to ensure it has the same behavior
          // as the original code.


          // ORIGINAL CODE:

          // x*2+3


          // CONVERTED CODE:

          x = x*2+3;
          ~~~
          call "Clear Errors.gvi"(error in=w18)
          w14 = w6
        }
        frame "String", "Path".."Pict" {
          w14 = w6
          w15 = 4
        }
        frame "Array" {
          C Code Node("x"=w12) -> ("x"=w19, Error Out=w20)
          ~~~
          // Code in a Expression Node was converted to code in a C Node.
          // Review the converted code to ensure it has the same behavior
          // as the original code.


          // ORIGINAL CODE:

          // 2*x+3


          // CONVERTED CODE:

          x = 2*x+3;
          ~~~
          call "Clear Errors.gvi"(error in=w20)
          Array Index(array=w8) -> (out0[w19]=w21)
          Quotient And Remainder(x=w21, y=2) -> (floor(x/y)=w22)
          Add(w19, w22) -> w15
          w14 = w6
        }
        frame "Cluster" {
          s2 = 3  # shift register
          for (N = w12) {
            Array Index(array=w8) -> (out0[s2]=w23)
            Quotient And Remainder(x=w23, y=2) -> (floor(x/y)=w24)
            Add(w24, s2) -> w25
            next s2 = w25
          }
          w14 = w6
          w15 = s2
        }
        frame "Waveform" {
          call "Get Last PString.gvi"(String=w13) -> (PString Offset=w26)
          # Waveform type descriptor is not documented
          # Attempt to identify a PString at the end of the
          # type descriptor.
          Quotient And Remainder(x=w26, y=2) -> (floor(x/y)=w15)
          w14 = w6
        }
        frame "Refnum" {
          # Refnums type descriptors are not documented
          # Attempt to identify a PString at the end of the
          # type descriptor.
          call "Get Last PString.gvi"(String=w13) -> (PString Offset=w27)
          Quotient And Remainder(x=w27, y=2) -> (floor(x/y)=w15)
          w14 = w6
        }
        frame Default {
          Format Into String(formatString="Unexpected Datatype <%s>", w11) -> w28
          call "Build Error Cluster.gvi"(code="Argument error"(1), String to Prepend to source ("")=w28) -> (error out=w29)
          # Unexpected Datatype
          Merge Errors(w29, w6) -> (error out=w14)
          w15 = 0
        }
      }
      Array Subset(array=w8, length0=w15) -> w30
      case ($"Data Name") {
        frame "" {
          # New name empty - reseet named bit
          Array Index(array=w30) -> (out0[1]=w32)
          Logical And(not 0x4000, w32) -> w33
          Replace Array Subset(inArray=w30, index=1, new=w33) -> w31
        }
        frame Default {
          Array Index(array=w30) -> (out0[1]=w34)
          Logical Or(0x4000, w34) -> w35
          Replace Array Subset(inArray=w30, index=1, new=w35) -> w36
          String Length(string=$"Data Name") -> (length=w37)
          Quotient And Remainder(x=w37, y=2) -> (x-y*floor(x/y)=w38)
          # Set named bit
          To Unsigned Byte Integer(number=w37) -> w39
          Type Cast(type=string "", x=w39) -> w40
          case (w38) {
            frame 0, Default {
              Concatenate Strings(w40, $"Data Name", "") -> w41
            }
            frame 1 {
              Concatenate Strings(w40, $"Data Name") -> w41
            }
          }
          Type Cast(type=w36, x=w41) -> w42
          Build Array[ConcatenateInputs=True](w36, w42) -> w31
        }
      }
      Array Size(array=w31) -> (size(s)=w43)
      Multiply(w43, 2) -> w44
      Replace Array Subset(inArray=w31, index=_, new=w44) -> w45
      Flattened Byte Array To Variant(data string=w10, error in=w14, type string=w45) -> (error out=w46, variant out=w47)
      s3 = w46  # shift register
      s4 = w47  # shift register
      for {
        w48 = each element of w5
        w49 = each element of w4
        Set Variant Attribute(error in=s3, name=w49, value=w48, variant=s4) -> (error out=w50, variant out=w51)
        next s3 = w50
        next s4 = w51
      }
      w1 = s3
      w2 = s4
    }
    frame Error {
      w1 = $"error in (no error)"
      w2 = variant()
    }
  }
  $"Renamed Data" <- w2
  $"error out" <- w1
