vi "Set Enum String Value.gvi"   [LabVIEW Platform Developer Preview 0.1.0]
# Sets an enum's integer value to the position within the enum's strings matching the String Value input. Returns Default Enum Value if an error occurs.
inputs:
  "Default Enum Value": variant, required
  "String Value": string, required
  "error in (no error)": error
outputs:
  "Enum": variant
  "error out": error
uses:
  openg::library::variant data::Variant to Header Info.gvi
  openg::library::error::Build Error Cluster.gvi
  openg::library::variant data::Get PString.gvi
diagram:
  case ($"error in (no error)") {
    frame No Error {
      call "Variant to Header Info.gvi"(Variant=$"Default Enum Value") -> (Type Descriptor Header=w3, Type Descriptor=w4, data string=w5)
      Property Node(instance in=w3) -> ("type"=w6, "# elements"=w7)
      case (w6) {
        frame Default {
          Format Into String(formatString="Unexpected Datatype <%s>", w6) -> w8
          call "Build Error Cluster.gvi"(code="Argument error"(1), String to Prepend to source ("")=w8) -> (error out=w1)
          w2 = $"Default Enum Value"
        }
        frame "Enum U8".."Enum U64" {
          String Length(string=w5) -> (length=w9)
          Type Cast(type=string "", x=w4) -> w10
          s1 = 6  # shift register
          for (N = w7) {
            call "Get PString.gvi"(String=w10, offset (0)=s1) -> (PString=w12, offset past PString=w13)
            append w12 to w11
            next s1 = w13
          }
          Search 1D Array(1D array=w11, element=$"String Value") -> (index of element=w14)
          case (w14) {
            frame -1 {
              Format Into String(formatString="Unknown Enum Value <%s>", $"String Value") -> w15
              call "Build Error Cluster.gvi"(code="Argument error"(1), String to Prepend to source ("")=w15) -> (error out=w1)
              w2 = $"Default Enum Value"
            }
            frame Default {
              case (w9) {
                frame 1 {
                  To Unsigned Byte Integer(number=w14) -> w16
                  Flatten To Byte Array(anything=w16) -> (data bytes=w17)
                  Flattened Byte Array To Variant(data string=w17, type string=w4) -> (error out=w1, variant out=w2)
                }
                frame 2 {
                  To Unsigned Word Integer(number=w14) -> w18
                  Flatten To Byte Array(anything=w18) -> (data bytes=w19)
                  Flattened Byte Array To Variant(data string=w19, type string=w4) -> (error out=w1, variant out=w2)
                }
                frame 4, Default {
                  To Unsigned Long Integer(number=w14) -> w20
                  Flatten To Byte Array(anything=w20) -> (data bytes=w21)
                  Flattened Byte Array To Variant(data string=w21, type string=w4) -> (error out=w1, variant out=w2)
                }
              }
            }
          }
        }
      }
    }
    frame Error {
      w1 = $"error in (no error)"
      w2 = $"Default Enum Value"
    }
  }
  $Enum <- w2
  $"error out" <- w1
