vi "Size of Data from TD.gvi"   [LabVIEW Platform Developer Preview 0.1.0]
# Returns the size of data of the TD.
# The VI will return the following bytes of the listed datatypes:
# 1 byte - I8, U8, Enum U8, Boolean
# 2 bytes - 16, U16, Enum U16
# 4 bytes - I32, U32, SGL, Enum U32, Refnum
# 8 bytes - I64, U64, DBL, CSG, Enum U64
# 16 bytes - EXT, CDB
# 32 bytes - CXT
# -1 -  String, Path, Array
# Sum of Bytes - Cluster, VI calls itself recursively
inputs:
  "Type Descriptor": "Type Descriptor.gtype", required
  "error in (no error)": error
outputs:
  "Size of Data": i32
  "error out": error
types:
  "Type Descriptor.gtype" = i16[]
uses:
  openg::library::variant data::Get Header from TD.gvi
  openg::library::error::Build Error Cluster.gvi
  openg::library::variant data::Split Cluster TD.gvi
  openg::library::variant data::Size of Data from TD.gvi
diagram:
  call "Get Header from TD.gvi"(Type Descriptor=$"Type Descriptor") -> (Type Descriptor Header=w1)
  Property Node(instance in=w1) -> ("type"=w2)
  case ($"error in (no error)") {
    frame No Error {
      case (w2) {
        frame "<Null>", Default {
          Format Into String(formatString="Unexpected Datatype <%s>", w2) -> w5
          call "Build Error Cluster.gvi"(code="Argument error"(1), String to Prepend to source ("")=w5) -> (error out=w3)
          # Unexpected Datatype
          w4 = 0
        }
        frame "I8", "U8", "Enum U8" {
          # 1 Byte
          w3 = no error
          w4 = 1
        }
        frame "I16", "U16", "Enum U16" {
          # 2 Bytes
          w3 = no error
          w4 = 2
        }
        frame "I32", "U32", "SGL", "Enum U32", "Refnum" {
          # 4 Bytes
          w3 = no error
          w4 = 4
        }
        frame "I64", "U64", "DBL", "CSG", "Enum U64" {
          # 8 Bytes
          w3 = no error
          w4 = 8
        }
        frame "EXT", "CDB" {
          # 16 Bytes
          w3 = no error
          w4 = 16
        }
        frame "CXT" {
          # 32 Bytes
          w3 = no error
          w4 = 32
        }
        frame "Boolean" {
          w3 = no error
          w4 = 1
        }
        frame "String", "Path", "Array" {
          w3 = no error
          w4 = -1
        }
        frame "Cluster" {
          call "Split Cluster TD.gvi"(Type Descriptor=$"Type Descriptor") -> (Type Descriptors=w6, error out=w7)
          s1 = w7  # shift register
          for {
            w8 = each element of w6
            Property Node(instance in=w8) -> ("Type Descriptor"=w10)
            call "Size of Data from TD.gvi"(Type Descriptor=w10, error in (no error)=s1) -> (Size of Data=w11, error out=w12)
            append w11 to w9
            next s1 = w12
          }
          Is Greater Or Equal To 0(x=w9) -> w13
          And Array Elements(Boolean array=w13) -> (logical AND=w14)
          case (w14) {
            frame False, Default {
              w4 = -1
            }
            frame True {
              Add Array Elements(numeric array=w9) -> (sum=w4)
            }
          }
          w3 = s1
        }
      }
    }
    frame Error {
      w3 = $"error in (no error)"
      w4 = 0
    }
  }
  $"error out" <- w3
  $"Size of Data" <- w4
