vi "Strip Units.gvi"   [LabVIEW Platform Developer Preview 0.1.0]
# Converts a number with or without units to pure number.
inputs:
  "Number or 1D array with units": variant, required
  "error in (no error)": error
outputs:
  "Pure Number(s) (base units)": variant
  "error out": error
uses:
  openg::library::variant data::Variant to Header Info.gvi
  openg::library::error::Build Error Cluster.gvi
  openg::library::variant data::Array Size(s).gvi
  openg::library::variant data::Get Array Element TDEnum.gvi
diagram:
  case ($"error in (no error)") {
    frame No Error {
      call "Variant to Header Info.gvi"(Variant=$"Number or 1D array with units") -> (Type Descriptor Header=w3, Type Descriptor=w4, data string=w5)
      Property Node(instance in=w3) -> ("type"=w6)
      case (w6) {
        frame Default {
          Format Into String(formatString="Unexpected Datatype <%s>", w6) -> w7
          call "Build Error Cluster.gvi"(code="Argument error"(1), String to Prepend to source ("")=w7) -> (error out=w1)
          w2 = variant()
        }
        frame "SGL".."CXT" {
          w1 = no error
          w2 = $"Number or 1D array with units"
        }
        frame "SGL PQ" {
          Type Cast(type=u8[] [], x=w5) -> w8
          w9 = f32 0  # SGL
          Unflatten From Byte Array(data bytes=w8, type=w9) -> (value=w10)
          To Variant(anything=w10) -> w2
          w1 = no error
        }
        frame "DBL PQ" {
          Type Cast(type=u8[] [], x=w5) -> w11
          w12 = f64 0  # DBL
          Unflatten From Byte Array(data bytes=w11, type=w12) -> (value=w13)
          To Variant(anything=w13) -> w2
          w1 = no error
        }
        frame "EXT PQ" {
          Type Cast(type=u8[] [], x=w5) -> w14
          w15 = f64 0  # EXT
          Unflatten From Byte Array(data bytes=w14, type=w15) -> (value=w16)
          To Variant(anything=w16) -> w2
          w1 = no error
        }
        frame "CSG PQ" {
          w17 = c64 0+0i  # CSG
          Type Cast(type=u8[] [], x=w5) -> w18
          Unflatten From Byte Array(data bytes=w18, type=w17) -> (value=w19)
          To Variant(anything=w19) -> w2
          w1 = no error
        }
        frame "CDB PQ" {
          w20 = c128 0+0i  # CDB
          Type Cast(type=u8[] [], x=w5) -> w21
          Unflatten From Byte Array(data bytes=w21, type=w20) -> (value=w22)
          To Variant(anything=w22) -> w2
          w1 = no error
        }
        frame "CXT PQ" {
          w23 = c128 0+0i  # CXT
          Type Cast(type=u8[] [], x=w5) -> w24
          Unflatten From Byte Array(data bytes=w24, type=w23) -> (value=w25)
          To Variant(anything=w25) -> w2
          w1 = no error
        }
        frame "Array" {
          call "Array Size(s).gvi"(Array=$"Number or 1D array with units") -> (N dims=w26)
          call "Get Array Element TDEnum.gvi"(Array=$"Number or 1D array with units") -> (Element Type=w27)
          case (w26) {
            frame Default {
              call "Build Error Cluster.gvi"(code="Argument error"(1), String to Prepend to source ("")="1D Array expected ") -> (error out=w1)
              w2 = variant()
            }
            frame 1 {
              case (w27) {
                frame Default {
                  Format Into String(formatString="Unexpected Datatype <%s>", w27) -> w28
                  call "Build Error Cluster.gvi"(code="Argument error"(1), String to Prepend to source ("")=w28) -> (error out=w1)
                  w2 = variant()
                }
                frame "SGL".."CXT" {
                  w1 = no error
                  w2 = $"Number or 1D array with units"
                }
                frame "SGL PQ" {
                  Type Cast(type=u8[] [], x=w5) -> w29
                  w30 = f32[] []  # SGL
                  Unflatten From Byte Array(data bytes=w29, type=w30) -> (value=w31)
                  To Variant(anything=w31) -> w2
                  w1 = no error
                }
                frame "DBL PQ" {
                  Type Cast(type=u8[] [], x=w5) -> w32
                  w33 = f64[] []  # DBL
                  Unflatten From Byte Array(data bytes=w32, type=w33) -> (value=w34)
                  To Variant(anything=w34) -> w2
                  w1 = no error
                }
                frame "EXT PQ" {
                  Type Cast(type=u8[] [], x=w5) -> w35
                  w36 = f64[] []  # EXT
                  Unflatten From Byte Array(data bytes=w35, type=w36) -> (value=w37)
                  To Variant(anything=w37) -> w2
                  w1 = no error
                }
                frame "CSG PQ" {
                  w38 = c64[] []  # CSG
                  Type Cast(type=u8[] [], x=w5) -> w39
                  Unflatten From Byte Array(data bytes=w39, type=w38) -> (value=w40)
                  To Variant(anything=w40) -> w2
                  w1 = no error
                }
                frame "CDB PQ" {
                  w41 = c128[] []  # CDB
                  Type Cast(type=u8[] [], x=w5) -> w42
                  Unflatten From Byte Array(data bytes=w42, type=w41) -> (value=w43)
                  To Variant(anything=w43) -> w2
                  w1 = no error
                }
                frame "CXT PQ" {
                  w44 = c128[] []  # CXT
                  Type Cast(type=u8[] [], x=w5) -> w45
                  Unflatten From Byte Array(data bytes=w45, type=w44) -> (value=w46)
                  To Variant(anything=w46) -> w2
                  w1 = no error
                }
              }
            }
          }
        }
      }
    }
    frame Error {
      w1 = $"error in (no error)"
      w2 = variant()
    }
  }
  $"Pure Number(s) (base units)" <- w2
  $"error out" <- w1
