vi "Unwrap VVariant.gvi"   [LabVIEW Platform Developer Preview 0.1.0]
# Extracts a variant contained within a variant
inputs:
  "VVariant": variant, required
  "error in (no error)": error
outputs:
  "Variant": variant
  "error out": error
uses:
  openg::library::variant data::Variant to Header Info.gvi
  openg::library::error::Build Error Cluster.gvi
diagram:
  case ($"error in (no error)") {
    frame No Error {
      call "Variant to Header Info.gvi"(Variant=$VVariant) -> (Type Descriptor Header=w3)
      Property Node(instance in=w3) -> ("type"=w4)
      case (w4) {
        frame Default {
          Format Into String(formatString="Unexpected Datatype <%s>", w4) -> w5
          call "Build Error Cluster.gvi"(code="Argument error"(1), String to Prepend to source ("")=w5) -> (error out=w1)
          w2 = variant()
        }
        frame "Variant" {
          Variant To Data(type=variant variant(), variant=$VVariant) -> (data=w2, error out=w1)
        }
      }
    }
    frame Error {
      w1 = $"error in (no error)"
      w2 = variant()
    }
  }
  $Variant <- w2
  $"error out" <- w1
