vi "Variant Manipulation Templ.gvi"   [LabVIEW Platform Developer Preview 0.1.0]
inputs:
  "Variant": variant, required
  "error in (no error)": error
outputs:
  "error out": error
uses:
  openg::library::variant data::Variant to Header Info.gvi
  openg::library::error::Build Error Cluster.gvi
diagram:
  case ($"error in (no error)") {
    frame No Error {
      call "Variant to Header Info.gvi"(Variant=$Variant) -> (Type Descriptor Header=w2, Type Descriptor=w3, data string=w4)
      Property Node(instance in=w2) -> ("type"=w5)
      case (w5) {
        frame Default {
          Format Into String(formatString="Unexpected Datatype <%s>", w5) -> w6
          call "Build Error Cluster.gvi"(code="Argument error"(1), String to Prepend to source ("")=w6) -> (error out=w1)
        }
        frame "I8" {
          # Manipulate Variant Data
          # according to type
          w1 = no error
        }
      }
    }
    frame Error {
      w1 = $"error in (no error)"
    }
  }
  $"error out" <- w1
