vi "Variant to Header Info.gvi"   [LabVIEW Platform Developer Preview 0.1.0]
# Returns flattened string and type descriptor of variant data, plus selected type info.
inputs:
  "Variant": variant, required
outputs:
  "Type Descriptor Header": "Type Descriptor Header.gtype"  # Holds the info contained in a type descriptor header.
  "Type Descriptor": "Type Descriptor.gtype"
  "data string": string
types:
  "Type Descriptor Enumeration.gtype" = enum{"<Null>", "I8", "I16", "I32", "I64", "U8", "U16", "U32", "U64", "SGL", "DBL", "EXT", "CSG", "CDB", "CXT", "0x0F", "0x10", "0x11", "0x12", "0x13", "0x14", "Enum U8", "Enum U16", "Enum U32", "Enum U64", "SGL PQ", "DBL PQ", "EXT PQ", "CSG PQ", "CDB PQ", "CXT PQ", "0x1F", "0x20", "Boolean", "0x22", "0x23", "0x24", "0x25", "0x26", "0x27", "0x28", "0x29", "0x2A", "0x2B", "0x2C", "0x2D", "0x2E", "0x2F", "String", "0x31", "Path", "Pict", "0x34", "0x35", "0x36", "DAQ", "0x38", "0x39", "0x3A", "0x3B"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}
  "Type Descriptor Header.gtype" = cluster{"length": u16, "private": u8, "type": "Type Descriptor Enumeration.gtype", "# elements": u16}
  "Type Descriptor.gtype" = i16[]
uses:
  openg::library::variant data::Get Header from TD.gvi
diagram:
  Variant To Flattened Byte Array(variant=$Variant) -> (data string=w1, type string=w2)
  call "Get Header from TD.gvi"(Type Descriptor=w2) -> (Type Descriptor Header=w3)
  $"Type Descriptor Header" <- w3
  $"Type Descriptor" <- w2
  Type Cast(type=string "", x=w1) -> w4
  $"data string" <- w4
