vi "ZLIB Block Size.gvi"   [LabVIEW Platform Developer Preview 0.1.0]
# Support function for block handling calculations.
inputs:
  "block size (100000)": u32 = 100000
  "length in": u32  # The code input identifies the error or warning. The pop-up option Explain Error (or Explain Warning) gives more information about the error displayed.
outputs:
  "block len": u32  # The code input identifies the error or warning. The pop-up option Explain Error (or Explain Warning) gives more information about the error displayed.
  "length rem": u32  # The code input identifies the error or warning. The pop-up option Explain Error (or Explain Warning) gives more information about the error displayed.
diagram:
  Max And Min(x=$"block size (100000)", y=$"length in") -> (min(x,y)=w1: u32)
  Subtract(x=$"length in", y=w1) -> w2
  $"length rem" <- w2
  $"block len" <- w1
