vi "ZLIB Common Path to Specific Path.gvi"   [LabVIEW Platform Developer Preview 0.1.0]
inputs:
  "common path": string
outputs:
  "specific path": path
diagram:
  case ($"common path") {
    frame Default {
      Open Application Reference() -> (application reference=w2, error out=w3)
      Property Node[IsPlaceholderNodeForConversion=True](instance in=w2, error in=w3) -> ("App.TargetOS"=w4, error out=w5, instance out=w6)
      case (w4) {
        frame "invalid OS target", Default {
          w7 = $"common path"
        }
        frame "Mac OS" {
          case ($"common path") {
            frame "..", "../" {
              w7 = "::"
            }
            frame ".", "./" {
              w7 = ":"
            }
            frame Default {
              s1 = $"common path"  # shift register
              while (iteration -> i1) {
                Match Pattern(regular expression="\\.\\./", string=s1) -> (after substring=w8, before substring=w9)
                String Length(string=w8) -> (length=w10)
                Is Not Equal To 0(x=w10) -> w11
                next s1 = w8
                continue if w11
              }
              Is Equal To 0(x=i1) -> w12
              Increment(x=i1) -> w13
              Select(s=w12, t=i1, f=w13) -> w14
              for (N = w14) {
                append ":" to w15
              }
              Concatenate Strings(w15) -> w16
              Concatenate Strings(w16, w9) -> w17
              String Length(string=w17) -> (length=w18)
              s2 = w17  # shift register
              for (N = w18) (iteration -> i2) {
                String Subset(length (rest)=1, offset (0)=i2, string=w17) -> w19
                case (w19) {
                  frame Default {
                    w20 = s2
                  }
                  frame "/" {
                    Search Or Split String(offset=i2, string=s2) -> (match + rest of string=w21, substring before match=w22)
                    String Length(string=w21) -> (length=w23)
                    Decrement(x=w23) -> w24
                    String Subset(length (rest)=w24, offset (0)=1, string=w21) -> w25
                    Concatenate Strings(w22, ":", w25) -> w20
                  }
                }
                next s2 = w20
              }
              String Subset(length (rest)=1, string=s2) -> w26
              case (w26) {
                frame Default {
                  Concatenate Strings(":", s2) -> w7
                }
                frame ":" {
                  String Subset(length (rest)=1, offset (0)=1, string=s2) -> w27
                  case (w27) {
                    frame Default {
                      String Length(string=s2) -> (length=w28)
                      Decrement(x=w28) -> w29
                      String Subset(length (rest)=w29, offset (0)=1, string=s2) -> w7
                    }
                    frame ":" {
                      w7 = s2
                    }
                  }
                }
              }
            }
          }
        }
        frame "Windows 3.1".."Windows 95/NT" {
          String Length(string=$"common path") -> (length=w30)
          s3 = $"common path"  # shift register
          for (N = w30) (iteration -> i3) {
            String Subset(length (rest)=1, offset (0)=i3, string=$"common path") -> w31
            case (w31) {
              frame Default {
                w32 = s3
              }
              frame "/" {
                Search Or Split String(offset=i3, string=s3) -> (match + rest of string=w33, substring before match=w34)
                String Length(string=w33) -> (length=w35)
                Decrement(x=w35) -> w36
                String Subset(length (rest)=w36, offset (0)=1, string=w33) -> w37
                Concatenate Strings(w34, "\\", w37) -> w32
              }
            }
            next s3 = w32
          }
          String Subset(length (rest)=1, string=s3) -> w38
          # "\\" in the case selector corresponds
          # to a string value of \
          String Subset(length (rest)=2, string=s3) -> w39
          case (w38) {
            frame Default {
              w7 = s3
            }
            frame "\\" {
              case (w39) {
                frame Default {
                  Search Or Split String(offset=2, string=s3) -> (match + rest of string=w40, substring before match=w41)
                  String Subset(length (rest)=1, offset (0)=1, string=w41) -> w42
                  Concatenate Strings(w42, ":", w40) -> w7
                }
                frame "\\\\" {
                  # "\\\\" in the case selector corresponds
                  # to a string value of \\
                  w7 = s3
                }
              }
            }
          }
        }
      }
      String To Path(string=w7) -> (path=w1)
      Close Reference(error in (no error)=w5, reference=w6)
    }
    frame "<Not A Path>" {
      w1 = path constant
    }
  }
  $"specific path" <- w1
