vi "ZLIB Convert File Info.gvi"   [LabVIEW Platform Developer Preview 0.1.0]
# Convert the file information from the ZIP API format to our LabVIEW format.
inputs:
  "uncompress file info in": "ZLIB Uncompress File Info.gtype"
  "extra field": string
  "comment": string
outputs:
  "file info out": "ZLIB File Info.gtype"
panel controls:
  "dummy file info": "ZLIB File Info.gtype"
types:
  "ZLIB File Info.gtype" = cluster{"version": u32, "version needed": u32, "encrypted": bool, "flag": u32, "compression": i32, "dos date": u32, "crc": u32, "compressed size": u32, "uncompressed size": u32, "extra info": string, "file comment": string, "disk num start": u32, "internal fa": u32, "external fa": u32, "file timestamp": u32}
  T1 = cluster{"sec": i32, "min": i32, "hour": i32, "mday": i32, "mon": i32, "year": i32}
  "ZLIB Uncompress File Info.gtype" = cluster{"version": u32, "version needed": u32, "flag": u32, "compression": u32, "dos date": u32, "crc": u32, "compressed size": u32, "uncompressed size": u32, "size filename": u32, "size file extra": u32, "size file comment": u32, "disk num start": u32, "internal fa": u32, "external fa": u32, "date time": T1}
diagram:
  Property Node(instance in=$"uncompress file info in") -> ("version"=w1, "version needed"=w2, "flag"=w3, "compression"=w4, "dos date"=w5, "crc"=w6, "compressed size"=w7, "uncompressed size"=w8, "disk num start"=w9, "internal fa"=w10, "external fa"=w11, "date time:sec"=w12, "date time:min"=w13, "date time:hour"=w14, "date time:mday"=w15, "date time:mon"=w16, "date time:year"=w17)
  GetDateTimeInSecsCompatVI() -> (double precision float Output 0=w18)  # GetDateTimeInSecsCompatVI (Placeholder)
  LV70U32ToDateRec(Time Input 0=w18) -> (date time rec Output 1=w19)  # LV70U32ToDateRec (Placeholder)
  Increment(x=w16) -> w20
  Property Node(instance in=w19, "second"=w12, "minute"=w13, "hour"=w14, "day of month"=w15, "month"=w20, "year"=w17) -> (instance out=w21)
  LV70DateRecToU32(date time rec Input 0=w21) -> (Time Output 1=w22)  # LV70DateRecToU32 (Placeholder)
  Logical And(1, w3) -> w23
  Is Not Equal To 0(x=w23) -> w24
  Property Node(instance in=$"dummy file info", "encrypted"=w24, "version"=w1, "version needed"=w2, "flag"=w3, "compression"=w4, "dos date"=w5, "crc"=w6, "compressed size"=w7, "uncompressed size"=w8, "extra info"=$"extra field", "file comment"=$comment, "disk num start"=w9, "internal fa"=w10, "external fa"=w11, "file timestamp"=w22) -> (instance out=w25)
  $"file info out" <- w25
