vi "ZLIB Copy Raw File.gvi"   [LabVIEW Platform Developer Preview 0.1.0]
# Copies a file in raw mode from an unzip session into a zip session.
inputs:
  "unzip Refnum": "ZLIB Unzip Handle.gtype", required
  "name (empty: use current)": string
  "error in (no error)": error
  "zip Refnum": "ZLIB Zip Handle.gtype", required
outputs:
  "unzip Refnum out": "ZLIB Unzip Handle.gtype"
  "error out": error
  "zip Refnum out": "ZLIB Zip Handle.gtype"
types:
  "ZLIB Unzip Handle.gtype" = i32
  "ZLIB Zip Handle.gtype" = i32
uses:
  OpenG.Zip::ZLIB Locate File.gvi
  OpenG.Zip::ZLIB Get Current File Info.gvi
  OpenG.Zip::ZLIB Move Raw File.gvi
diagram:
  case ($"name (empty: use current)") {
    frame Default {
      call "ZLIB Locate File.gvi"(unzip Refnum=$"unzip Refnum", name (empty: -)=$"name (empty: use current)", error in (no error)=$"error in (no error)") -> (unzip Refnum out=w1, error out=w2)
    }
    frame "" {
      w1 = $"unzip Refnum"
      w2 = $"error in (no error)"
    }
  }
  call "ZLIB Get Current File Info.gvi"(unzip Refnum=w1, error in (no error)=w2) -> (unzip Refnum out=w3, name=w4, file info=w5, error out=w6)
  call "ZLIB Move Raw File.gvi"(unzip Refnum=w3, name=w4, file info=w5, error in (no error)=w6, zip Refnum=$"zip Refnum") -> (unzip Refnum out=w7, error out=w8, zip Refnum out=w9)
  $"zip Refnum out" <- w9
  $"unzip Refnum out" <- w7
  $"error out" <- w8
