vi "ZLIB Extract File.gvi"   [LabVIEW Platform Developer Preview 0.1.0]
# Extracts a file in an unzip session to a target path.
inputs:
  "unzip Refnum": "ZLIB Unzip Handle.gtype", required
  "target path": path, required
  "internal name (same as target)": string
  "error in (no error)": error
  "overwrite (F)": bool
  "password (none)": string
    # Specify the password to use to decrypt the files in the archive, if it is encrypted. Leave this parameter empty if the archive is not encrypted.
    # Note: The supported encryption algorithme is the one used in the original pkzip utility. Some versions of pkzip have some quirks in the encryption algorithme and this function does not try to work around all of them. Also note that newer versions of WinZip (probably >= 8.0) use their own non-standard password encryption and therefore can't be decrypted by this routine.
outputs:
  "unzip Refnum out": "ZLIB Unzip Handle.gtype"
  "error out": error
types:
  "ZLIB Unzip Handle.gtype" = i32
uses:
  OpenG.Zip::ZLIB Locate File.gvi
  OpenG.Zip::ZLIB Get Current File Info.gvi
  OpenG.Zip::ZLIB Get File.gvi
diagram:
  Is Empty String Or Path(string/path=$"internal name (same as target)") -> w1
  case (w1) {
    frame True {
      Strip Path(path=$"target path") -> (name=w2)
    }
    frame False {
      w2 = $"internal name (same as target)"
    }
  }
  call "ZLIB Locate File.gvi"(unzip Refnum=$"unzip Refnum", name (empty: -)=w2, error in (no error)=$"error in (no error)") -> (unzip Refnum out=w3, error out=w4)
  call "ZLIB Get Current File Info.gvi"(unzip Refnum=w3, error in (no error)=w4) -> (unzip Refnum out=w5, file info=w6, error out=w7)
  call "ZLIB Get File.gvi"(unzip Refnum=w5, target path=$"target path", file info=w6, error in (no error)=w7, overwrite (F)=$"overwrite (F)", password (none)=$"password (none)") -> (unzip Refnum out=w8, error out=w9)
  $"unzip Refnum out" <- w8
  $"error out" <- w9
