vi "ZLIB File Information.gvi"   [LabVIEW Platform Developer Preview 0.1.0]
# Retrives specific information for a disk file preparing a Mac resource files as MACBIN data file fork.
inputs:
  "file path": path
  "encode MacBinary (F)": bool
  "error in (no error)": error
outputs:
  "file path out": path
  "directory": bool
  "file attributes": u32
  "error out": error
  "created macbinary": bool
  "file timestamp": u32
uses:
  OpenG.Mac Binary::MACBIN Resource File Info Core.gvi
  OpenG.Mac Binary::MACBIN Encode MacBinary.gvi
diagram:
  Property Node(instance in=$"error in (no error)") -> ("status"=w1)
  # internal and external fa
  # #define _A_NORMAL       0x00    /* Normal file - No read/write restrictions */
  # #define _A_RDONLY       0x01    /* Read only file */
  # #define _A_HIDDEN       0x02    /* Hidden file */
  # #define _A_SYSTEM       0x04    /* System file */
  # #define _A_SUBDIR       0x10    /* Subdirectory */
  # #define _A_ARCH         0x20    /* Archive file */
  #
  # #define _M_MACBINARY 0x8000 /* Encoded MacBinary file before compression */
  case (w1) {
    frame False, Default {
      Librarian Path Location(path Input 0=$"file path", error in (no error) Input 1=$"error in (no error)") -> (path is in a VI library Output 2=w8, error out Output 5=w9)  # Librarian Path Location (Placeholder)
      case (w8) {
        frame False, Default {
          call "MACBIN Resource File Info Core.gvi"(resource file=$"file path", error in (no error)=w9) -> (resource file out=w10, is directory=w3, file info out=w11, error out=w12)
          Property Node(instance in=w11) -> ("mod date"=w2, "res size"=w13, "finder flags"=w14)
          Is Greater Than 0(x=w13) -> w15
          Logical And(not w3, w15, $"encode MacBinary (F)") -> w7
          case (w7) {
            frame False, Default {
              Boolean To Integer(Boolean=w3) -> (0, 1=w16)
              To Unsigned Long Integer(number=w16) -> w17
              Logical Shift(x=w17, y=4) -> w18
              Get Permissions(error in=w12, path=w10) -> (error out=w5, path out=w4, permissions=w19)
              Logical And(w19, 128) -> w20
              Is Equal To 0(x=w20) -> w21
              Boolean To Integer(Boolean=w21) -> (0, 1=w22)
              To Unsigned Long Integer(number=w22) -> w23
              Logical And(w14, 0x4000) -> w24
              Is Not Equal To 0(x=w24) -> w25
              Boolean To Integer(Boolean=w25) -> (0, 1=w26)
              To Unsigned Long Integer(number=w26) -> w27
              Logical Shift(x=w27, y=1) -> w28
              Add(w18, w23, w28) -> w6
            }
            frame True {
              call "MACBIN Encode MacBinary.gvi"(data file=w10, error in (no error)=w12) -> (macbinary file out=w4, error out=w5)
              w6 = 0x8000
            }
          }
          Logical And(w14, 0x8000) -> w29
          Is Not Equal To 0(x=w29)
        }
        frame True {
          Get VI Library File Info(path Input 0=$"file path", error in (no error) Input 1=w9) -> (file information Output 2=w30, error out Output 3=w31)  # Get VI Library File Info (Placeholder)
          Property Node(instance in=w30) -> ("last mod date"=w2)
          Temp Filename() -> (file in tmp dir Output 0=w32)  # Temp Filename (Placeholder)
          Copy In Or Out Of VI Library(error in (no error) Input 3=w31, destination Input 6=w32, source Input 7=$"file path") -> (dup destination Output 4=w4, error out Output 5=w5)  # Copy In Or Out Of VI Library (Placeholder)
          w6 = 0
          w7 = TRUE
          w3 = FALSE
        }
      }
    }
    frame True {
      w2 = 0
      w3 = FALSE
      w4 = $"file path"
      w5 = $"error in (no error)"
      w6 = 0
      w7 = FALSE
    }
  }
  $directory <- w3
  $"file timestamp" <- w2
  $"created macbinary" <- w7
  $"file path out" <- w4
  $"file attributes" <- w6
  $"error out" <- w5
