vi "ZLIB Get File CRC32.gvi"   [LabVIEW Platform Developer Preview 0.1.0]
# Calculates the CRC32 for the entire file.
inputs:
  "file path": path
  "error in (no error)": error
outputs:
  "file crc32": u32
  "error out": error
uses:
  OpenG.Mac Binary::MACBIN Open File Refnum.gvi
  OpenG.Zip::ZLIB Block Size.gvi
  OpenG.Zip::ZLIB CRC32.gvi
diagram:
  call "MACBIN Open File Refnum.gvi"(file path=$"file path", open mode (0)="read-only", deny mode (2)="deny write-only", error in (no error)=$"error in (no error)") -> (file refnum=w1, error out=w2)
  Get File Size(error in=w2, file=w1) -> (error out=w3, refnum out=w4, size (in bytes)=w5)
  Property Node(instance in=w3) -> ("status"=w6)
  To Long Integer(number=w5) -> w7
  case (w6) {
    frame False, Default {
      To Unsigned Long Integer(number=w7) -> w10
      s1 = 0  # shift register
      s2 = w3  # shift register
      s3 = w4  # shift register
      s4 = w10  # shift register
      s5 = 0  # shift register
      while {
        call "ZLIB Block Size.gvi"(length in=s4) -> (block len=w11, length rem=w12)
        Set File Position(error in=s2, offset (in bytes) (0)=s1, refnum=s3) -> (error out=w13, refnum out=w14)
        Read From Binary File(count=w11, error in=w13, file (use dialog)=w14) -> (data=w15, error out=w16, refnum out=w17)
        Get File Position(error in=w16, refnum=w17) -> (error out=w18, offset (in bytes) (0)=w19)
        To Long Integer(number=w19) -> w20
        Property Node(instance in=w18) -> ("status"=w21)
        case (w21) {
          frame False, Default {
            call "ZLIB CRC32.gvi"(previous crc32=s5, buffer=w15, error in (no error)=w18) -> (new crc32=w25, error out=w22)
            Property Node(instance in=w22) -> ("status"=w26)
            Is Greater Than 0(x=w12) -> w27
            Logical And(w27, not w26) -> w23
            w24 = w12
          }
          frame True {
            w22 = w18
            w23 = FALSE
            w24 = w12
            w25 = s5
          }
        }
        next s1 = w20
        next s2 = w22
        next s4 = w24
        next s5 = w25
        continue if w23
      }
      Close File(error in=s2, refnum=s3) -> (error out=w8)
      w9 = s5
    }
    frame True {
      w8 = w3
      w9 = 0
    }
  }
  $"file crc32" <- w9
  $"error out" <- w8
