vi "ZLIB Move Raw File.gvi"   [LabVIEW Platform Developer Preview 0.1.0]
# Copies the currently selected file from an unzip archive into another zip archive without the need for decompressing an recompressing it. This allows to copy even password protected files between archives and in this way the new file in the zip archive will inherit the password from the original file.
inputs:
  "unzip Refnum": "ZLIB Unzip Handle.gtype"
  "name": string
  "file info": "ZLIB File Info.gtype"
  "error in (no error)": error
  "zip Refnum": "ZLIB Zip Handle.gtype"
outputs:
  "unzip Refnum out": "ZLIB Unzip Handle.gtype"
  "error out": error
  "zip Refnum out": "ZLIB Zip Handle.gtype"
types:
  "ZLIB File Info.gtype" = cluster{"version": u32, "version needed": u32, "encrypted": bool, "flag": u32, "compression": i32, "dos date": u32, "crc": u32, "compressed size": u32, "uncompressed size": u32, "extra info": string, "file comment": string, "disk num start": u32, "internal fa": u32, "external fa": u32, "file timestamp": u32}
  "ZLIB Unzip Handle.gtype" = i32
  "ZLIB Zip Handle.gtype" = i32
uses:
  OpenG.Zip::ZLIB Open Read File.gvi
  OpenG.Zip::ZLIB Read Local Extra Data.gvi
  OpenG.Zip::ZLIB Open Write File.gvi
  OpenG.Zip::ZLIB Transfer Raw File.gvi
  OpenG.Zip::ZLIB Close Write File.gvi
  OpenG.Zip::ZLIB Close Read File.gvi
diagram:
  call "ZLIB Open Read File.gvi"(unzip Refnum=$"unzip Refnum", error in (no error)=$"error in (no error)", raw mode (F)=TRUE) -> (unzip Refnum out=w1, error out=w2)
  call "ZLIB Read Local Extra Data.gvi"(unzip Refnum=w1, error in (no error)=w2) -> (unzip Refnum out=w3, local extra data=w4, error out=w5)
  Property Node(instance in=$"file info") -> ("compressed size"=w6, "uncompressed size"=w7, "crc"=w8)
  call "ZLIB Open Write File.gvi"(zip Refnum=$"zip Refnum", filename=$name, file info=$"file info", error in (no error)=w5, raw mode (F)=TRUE, local extra data=w4) -> (zip Refnum out=w9, error out=w10)
  call "ZLIB Transfer Raw File.gvi"(zip Refnum=w9, unzip Refnum=w3, compressed size=w6, error in (no error)=w10) -> (zip Refnum out=w11, unzip Refnum out=w12, error out=w13)
  call "ZLIB Close Write File.gvi"(zip Refnum=w11, uncompressed size=w7, crc32=w8, error in (no error)=w13) -> (zip Refnum out=w14, error out=w15)
  call "ZLIB Close Read File.gvi"(unzip Refnum=w12, error in (no error)=w15) -> (unzip Refnum out=w16, error out=w17)
  $"unzip Refnum out" <- w16
  $"error out" <- w17
  $"zip Refnum out" <- w14
