vi "ZLIB Specific Path to Common Path.gvi"   [LabVIEW Platform Developer Preview 0.1.0]
inputs:
  "specific path": path
outputs:
  "common path": string
diagram:
  Is Not A Number Or Path Or Refnum(number=$"specific path") -> w1
  case (w1) {
    frame False, Default {
      Path To String(path=$"specific path") -> (string=w3)
      Open Application Reference() -> (application reference=w4, error out=w5)
      Property Node[IsPlaceholderNodeForConversion=True](instance in=w4, error in=w5) -> ("App.TargetOS"=w6, error out=w7, instance out=w8)
      case (w6) {
        frame "invalid OS target", Default {
          w2 = w3
        }
        frame "Mac OS" {
          case (w3) {
            frame Default {
              String Subset(length (rest)=1, string=w3) -> w9
              case (w9) {
                frame Default {
                  Concatenate Strings(":", w3) -> w10
                  w11 = 0
                }
                frame ":" {
                  String Length(string=w3) -> (length=w12)
                  Decrement(x=w12) -> w13
                  String Subset(length (rest)=w13, offset (0)=1, string=w3) -> w14
                  Match Pattern(regular expression="^:*", string=w14) -> (after substring=w10, match substring=w15)
                  String Length(string=w15) -> (length=w11)
                }
              }
              for (N = w11) {
                append "../" to w16
              }
              Concatenate Strings(w16, w10) -> w17
              String Length(string=w17) -> (length=w18)
              s1 = w17  # shift register
              for (N = w18) (iteration -> i1) {
                String Subset(length (rest)=1, offset (0)=i1, string=w17) -> w19
                case (w19) {
                  frame Default {
                    w20 = s1
                  }
                  frame ":" {
                    Search Or Split String(offset=i1, string=s1) -> (match + rest of string=w21, substring before match=w22)
                    String Length(string=w21) -> (length=w23)
                    Decrement(x=w23) -> w24
                    String Subset(length (rest)=w24, offset (0)=1, string=w21) -> w25
                    Concatenate Strings(w22, "/", w25) -> w20
                  }
                }
                next s1 = w20
              }
              w2 = s1
            }
            frame "" {
              w2 = w3
            }
          }
        }
        frame "Windows 3.1".."Windows 95/NT" {
          String Subset(length (rest)=1, offset (0)=1, string=w3) -> w26
          case (w26) {
            frame Default {
              w27 = w3
            }
            frame ":" {
              Search Or Split String(offset=2, string=w3) -> (match + rest of string=w28, substring before match=w29)
              String Subset(length (rest)=1, string=w29) -> w30
              Concatenate Strings("\\", w30, w28) -> w27
            }
          }
          String Length(string=w27) -> (length=w31)
          s2 = w27  # shift register
          for (N = w31) (iteration -> i2) {
            # "\\" in the case selector corresponds
            # to a string value of \
            String Subset(length (rest)=1, offset (0)=i2, string=w27) -> w32
            case (w32) {
              frame Default {
                w33 = s2
              }
              frame "\\" {
                Search Or Split String(offset=i2, string=s2) -> (match + rest of string=w34, substring before match=w35)
                String Length(string=w34) -> (length=w36)
                Decrement(x=w36) -> w37
                String Subset(length (rest)=w37, offset (0)=1, string=w34) -> w38
                Concatenate Strings(w35, "/", w38) -> w33
              }
            }
            next s2 = w33
          }
          w2 = s2
        }
      }
      Close Reference(error in (no error)=w7, reference=w8)
    }
    frame True {
      w2 = "<Not A Path>"
    }
  }
  $"common path" <- w2
