vi "ZLIB Store File.gvi"   [LabVIEW Platform Developer Preview 0.1.0]
# Adds a file to an archive in a zip session.
inputs:
  "zip Refnum": "ZLIB Zip Handle.gtype", required
  "source path": path, required
  "internal name (same as source name)": path
  "error in (no error)": error
  "global extra data": string
  "local extra data": string
  "comment": string
  "password (none)": string
    # Specify the password to use to decrypt the files in the archive, if it is encrypted. Leave this parameter empty if the archive is not encrypted.
    # Note: The supported encryption algorithme is the one used in the original pkzip utility. Some versions of pkzip have some quirks in the encryption algorithme and this function does not try to work around all of them. Also note that newer versions of WinZip (probably >= 8.0) use their own non-standard password encryption and therefore can't be decrypted by this routine.
outputs:
  "zip Refnum out": "ZLIB Zip Handle.gtype"
  "error out": error
panel controls:
  "file info": "ZLIB File Info.gtype" = {"flag"=4294967295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}
types:
  "ZLIB Zip Handle.gtype" = i32
  "ZLIB File Info.gtype" = cluster{"version": u32, "version needed": u32, "encrypted": bool, "flag": u32, "compression": i32, "dos date": u32, "crc": u32, "compressed size": u32, "uncompressed size": u32, "extra info": string, "file comment": string, "disk num start": u32, "internal fa": u32, "external fa": u32, "file timestamp": u32}
uses:
  OpenG.Zip::ZLIB File Information.gvi
  OpenG.Zip::ZLIB Get File CRC32.gvi
  OpenG.Zip::ZLIB Specific Path to Common Path.gvi
  OpenG.Zip::ZLIB Open Write File.gvi
  OpenG.Zip::ZLIB Write File.gvi
  OpenG.Zip::ZLIB Close Write File.gvi
diagram:
  call "ZLIB File Information.gvi"(file path=$"source path", encode MacBinary (F)=TRUE, error in (no error)=$"error in (no error)") -> (file path out=w1, directory=w2, file attributes=w3, error out=w4, created macbinary=w5, file timestamp=w6)
  # if password is not empty determine the crc32 of the file and pass it to the open file function
  case ($"password (none)") {
    frame Default {
      call "ZLIB Get File CRC32.gvi"(file path=w1, error in (no error)=w4) -> (file crc32=w8, error out=w7)
    }
    frame "" {
      w7 = w4
      w8 = 0
    }
  }
  Is Empty String Or Path(string/path=$"internal name (same as source name)") -> w9
  case (w9) {
    frame False, Default {
      call "ZLIB Specific Path to Common Path.gvi"(specific path=$"internal name (same as source name)") -> (common path=w10)
    }
    frame True {
      Strip Path(path=$"source path") -> (name=w10)
    }
  }
  case (w2) {
    frame False, Default {
      w11 = w10
    }
    frame True {
      Concatenate Strings(w10, "/") -> w11
    }
  }
  w12 = -1  # -1: use default compression
  Property Node(instance in=$"file info", "crc"=w8, "internal fa"=w3, "external fa"=w3, "file timestamp"=w6, "extra info"=$"global extra data", "file comment"=$comment, "compression"=w12) -> (instance out=w13)
  call "ZLIB Open Write File.gvi"(zip Refnum=$"zip Refnum", filename=w11, file info=w13, error in (no error)=w7, local extra data=$"local extra data", password (none)=$"password (none)") -> (zip Refnum out=w14, error out=w15)
  case (w2) {
    frame False, Default {
      call "ZLIB Write File.gvi"(zip Refnum=w14, source path=w1, error in (no error)=w15) -> (zip Refnum out=w17, error out=w16)
    }
    frame True {
      w16 = w15
      w17 = w14
    }
  }
  call "ZLIB Close Write File.gvi"(zip Refnum=w17, error in (no error)=w16) -> (zip Refnum out=w18, error out=w19)
  $"zip Refnum out" <- w18
  # Throw away
  # intermediate MacBinary
  case (w5) {
    frame False, Default {
      w20 = w19
    }
    frame True {
      Delete File Or Folder(error in=w19, path (use dialog)=w1) -> (error out=w20)
    }
  }
  $"error out" <- w20
