vi "ZLIB Store Stream.gvi"   [LabVIEW Platform Developer Preview 0.1.0]
# Adds a file to an archive in a zip session.
inputs:
  "zip Refnum": "ZLIB Zip Handle.gtype", required
  "source stream": string, required
  "internal name": string, required
  "error in (no error)": error
  "global extra data": string
  "local extra data": string
  "comment": string
  "password (none)": string
    # Specify the password to use to decrypt the files in the archive, if it is encrypted. Leave this parameter empty if the archive is not encrypted.
    # Note: The supported encryption algorithme is the one used in the original pkzip utility. Some versions of pkzip have some quirks in the encryption algorithme and this function does not try to work around all of them. Also note that newer versions of WinZip (probably >= 8.0) use their own non-standard password encryption and therefore can't be decrypted by this routine.
outputs:
  "zip Refnum out": "ZLIB Zip Handle.gtype"
  "error out": error
panel controls:
  "file info": "ZLIB File Info.gtype" = {"flag"=4294967295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}
types:
  "ZLIB Zip Handle.gtype" = i32
  "ZLIB File Info.gtype" = cluster{"version": u32, "version needed": u32, "encrypted": bool, "flag": u32, "compression": i32, "dos date": u32, "crc": u32, "compressed size": u32, "uncompressed size": u32, "extra info": string, "file comment": string, "disk num start": u32, "internal fa": u32, "external fa": u32, "file timestamp": u32}
uses:
  OpenG.Zip::ZLIB CRC32.gvi
  OpenG.Zip::ZLIB Open Write File.gvi
  OpenG.Zip::ZLIB Write Stream.gvi
  OpenG.Zip::ZLIB Close Write File.gvi
diagram:
  # if password is not empty determine the crc32 of the stream and pass it to the open file function
  case ($"source stream") {
    frame Default {
      w1 = $"internal name"
    }
    frame "" {
      Concatenate Strings($"internal name", "/") -> w1
    }
  }
  case ($"password (none)") {
    frame Default {
      call "ZLIB CRC32.gvi"(buffer=$"source stream", error in (no error)=$"error in (no error)") -> (new crc32=w3, error out=w2)
    }
    frame "" {
      w2 = $"error in (no error)"
      w3 = 0
    }
  }
  w4 = -1  # -1: use default compression
  Get Current Time() -> (current time=w5)
  To Double Precision Float(number=w5) -> w6
  Property Node(instance in=$"file info", "crc"=w3, "internal fa"=0, "external fa"=0, "file timestamp"=w6, "extra info"=$"global extra data", "file comment"=$comment, "compression"=w4) -> (instance out=w7)
  call "ZLIB Open Write File.gvi"(zip Refnum=$"zip Refnum", filename=w1, file info=w7, error in (no error)=w2, local extra data=$"local extra data", password (none)=$"password (none)") -> (zip Refnum out=w8, error out=w9)
  case ($"source stream") {
    frame Default {
      call "ZLIB Write Stream.gvi"(zip Refnum=w8, byte stream=$"source stream", error in (no error)=w9) -> (zip Refnum out=w11, error out=w10)
    }
    frame "" {
      w10 = w9
      w11 = w8
    }
  }
  call "ZLIB Close Write File.gvi"(zip Refnum=w11, error in (no error)=w10) -> (zip Refnum out=w12, error out=w13)
  $"zip Refnum out" <- w12
  $"error out" <- w13
