vi "MACBIN Decode MacBinary.gvi"   [LabVIEW Platform Developer Preview 0.1.0]
# Decodes a Macintosh File from MacBinary format.
inputs:
  "macbinary file": path, required
  "data file": path
  "resource file": path
  "error in (no error)": error
outputs:
  "macbinary file out": path
  "data file out": path
  "resource file out": path
  "error out": error
uses:
  OpenG.Mac Binary::MACBIN Read Header.gvi
  OpenG.Mac Binary::MACBIN Copy Fork From File.gvi
diagram:
  # Read header
  call "MACBIN Read Header.gvi"(macbinary file=$"macbinary file", data file=$"data file", resource file=$"resource file", error in (no error)=$"error in (no error)") -> (macbin filerefnum=w1, data filerefnum=w2, res file refnum=w3, error out=w4, res length=w5, data length=w6)
  # Copy data fork
  call "MACBIN Copy Fork From File.gvi"(macbinary Refnum=w1, fork Refnum=w2, error out=w4, length=w6) -> (macbinary Refnum out=w7, forkname out=w8, error out 2=w9)
  $"data file out" <- w8
  # Copy resource fork
  call "MACBIN Copy Fork From File.gvi"(macbinary Refnum=w7, fork Refnum=w3, error out=w9, length=w5) -> (macbinary Refnum out=w10, forkname out=w11, error out 2=w12)
  $"resource file out" <- w11
  Close File(error in=w12, refnum=w10) -> (error out=w13, path=w14)
  $"macbinary file out" <- w14
  $"error out" <- w13
