vi "MD5 ti.gvi"   [LabVIEW Platform Developer Preview 0.1.0]
# Computes ti.
# MD5 Algorithm
# www.visecurity.com
inputs:
  "i": i32
outputs:
  "ti": u32
diagram:
  To Double Precision Float(number=$i) -> w1
  Sine(x=w1) -> w2
  Absolute Value(x=w2) -> w3
  Scale By Power Of 2(n=32, x=1) -> w4
  Multiply(w3, w4) -> w5
  Quotient And Remainder(x=w5, y=1) -> (floor(x/y)=w6)
  To Unsigned Long Integer(number=w6) -> w7
  $ti <- w7
