vi "Create Msg Queue.gvi"   [LabVIEW Platform Developer Preview 0.1.0]
# Looks up an existing message queue or creates a new message queue and returns a refnum that you can use when calling other message queue VIs.
inputs:
  "name (unnamed)": string  # name contains the name of the queue that you are looking up or creating.
  "size (unbounded)": i32 = -1  # size specifies the maximum number of elements the queue holds.
  "return existing (F)": bool  # return existing specifies whether you want to create a new queue if one with that name does not exist.
  "error in (no error)": error
outputs:
  "msg queue": "Msg Queue RefNum.gtype"  # queue is a reference to an existing or newly created queue.
  "created new": bool  # created new returns TRUE if a new queue was created.
  "error out": error
types:
  "Msg Queue RefNum.gtype" = i32
uses:
  OpenG.Message Queue::Cast Queue to Msg Queue.gvi
diagram:
  Create Queue(name (unnamed) Input 0=$"name (unnamed)", size (unbounded) Input 1=$"size (unbounded)", return existing (F) Input 2=$"return existing (F)", error in (no error) Input 3=$"error in (no error)") -> (queue out Output 4=w1, created new Output 5=w2, error out Output 6=w3)  # Create Queue (Placeholder)
  call "Cast Queue to Msg Queue.gvi"(queue=w1) -> (msg queue=w4)
  $"msg queue" <- w4
  $"created new" <- w2
  $"error out" <- w3
