vi "Flush Msg Queue.gvi"   [LabVIEW Platform Developer Preview 0.1.0]
# Removes all elements from message queue.
inputs:
  "msg queue": "Msg Queue RefNum.gtype", required  # queue is a reference associated with a queue.
  "error in (no error)": error
outputs:
  "msg queue out": "Msg Queue RefNum.gtype"  # queue out has the same value as queue.
  "massages": "Msg Cluster.gtype"[]
  "error out": error
types:
  "Msg Queue RefNum.gtype" = i32
  "Msg Cluster.gtype" = GenericRefnum
uses:
  OpenG.Message Queue::Cast Msg Queue to Queue.gvi
  OpenG.Message Queue::Cast Queue to Msg Queue.gvi
  OpenG.Message Queue::Cast Msgs to Msg Clusters.gvi
diagram:
  call "Cast Msg Queue to Queue.gvi"(msg queue=$"msg queue") -> (queue=w1)
  Flush Queue(queue Input 0=w1, error in (no error) Input 1=$"error in (no error)") -> (queue out Output 2=w2, elements Output 3=w3, error out Output 4=w4)  # Flush Queue (Placeholder)
  call "Cast Queue to Msg Queue.gvi"(queue=w2) -> (msg queue=w5)
  $"msg queue out" <- w5
  call "Cast Msgs to Msg Clusters.gvi"(queue elements=w3) -> (massages=w6)
  $massages <- w6
  $"error out" <- w4
