vi "Not A Msg Queue.gvi"   [LabVIEW Platform Developer Preview 0.1.0]
# Returns TRUE if message queue is not a valid message queue refnum.
inputs:
  "msg queue": "Msg Queue RefNum.gtype", required  # queue is a reference associated with a queue.
outputs:
  "not a msg queue": bool  # not a queue returns TRUE if queue is not a valid queue reference.
types:
  "Msg Queue RefNum.gtype" = i32
uses:
  OpenG.Message Queue::Cast Msg Queue to Queue.gvi
diagram:
  call "Cast Msg Queue to Queue.gvi"(msg queue=$"msg queue") -> (queue=w1)
  Not A Queue(queue Input 0=w1) -> w2  # Not A Queue (Placeholder)
  $"not a msg queue" <- w2
