vi "GIF.Read.Unpack.ChangeRowLength.gvi"   [LabVIEW Platform Developer Preview 0.1.0]
inputs:
  "Image in": u8[]
  "image width": i16
  "+1/-1 (T/F)": bool
outputs:
  "Image out": u8[]
diagram:
  case ($"+1/-1 (T/F)") {
    frame True {
      Increment(x=$"image width") -> w2
      Array Size(array=$"Image in") -> (size(s)=w3)
      Quotient And Remainder(x=w3, y=$"image width") -> (floor(x/y)=w4, x-y*floor(x/y)=w5)
      Is Greater Than 0(x=w5) -> w6
      Boolean To Integer(Boolean=w6) -> (0, 1=w7)
      Add(w7, w4) -> w8
      Reshape Array(inArray=$"Image in", size=w8, size=$"image width") -> w9
      Multiply(w8, w2) -> w10
      w11 = 0  # U8
      Initialize Array(element=w11, size=w10) -> w12
      s1 = w12  # shift register
      for (N = w8) (iteration -> i1) {
        w13 = each element of w9
        Multiply(i1, w2) -> w14
        Add(w14, $"image width") -> w15
        Replace Array Subset(inArray=s1, index=w14, new=w13) -> w16
        Replace Array Subset(inArray=w16, index=w15, new=255) -> w17
        next s1 = w17
      }
      w1 = s1
    }
    frame False {
      Decrement(x=$"image width") -> w18
      Array Size(array=$"Image in") -> (size(s)=w19)
      Quotient And Remainder(x=w19, y=$"image width") -> (floor(x/y)=w20, x-y*floor(x/y)=w21)
      Is Greater Than 0(x=w21) -> w22
      Boolean To Integer(Boolean=w22) -> (0, 1=w23)
      Add(w23, w20) -> w24
      Reshape Array(inArray=$"Image in", size=w24, size=$"image width") -> w25
      Multiply(w24, w18) -> w26
      w27 = 0  # U8
      Initialize Array(element=w27, size=w26) -> w28
      s2 = w28  # shift register
      for (N = w24) (iteration -> i2) (after $"image width") {
        w29 = each element of w25
        Multiply(i2, w18) -> w30
        Array Subset(array=w29, length0=w18) -> w31
        Replace Array Subset(inArray=s2, index=w30, new=w31) -> w32
        next s2 = w32
      }
      w1 = s2
    }
  }
  $"Image out" <- w1
