vi "GIF.Read.Unpack.gvi"   [LabVIEW Platform Developer Preview 0.1.0]
inputs:
  "Raw GIF89a bytes": u8[]
  "error in (no error)": error
outputs:
  "Picture Array": "imagedata.gtype"[]
  "Delay (ms)": u32[]
  "error out": error
panel controls:
  "Unpack in-progress": T2
types:
  T1 = cluster{"left": i16, "top": i16, "right": i16, "bottom": i16}
  "imagedata.gtype" = cluster{"image type": i32, "image depth": i32, "image": u8[], "mask": u8[], "colors": u32[], "Rectangle": T1}
  T2 = cluster{"ColorMapFollows": bool, "image data": "imagedata.gtype", "BGColor": u8, "CR": u8, "NextIndex": i32, "GlobalDepth": i32, "CodeSize": i32, "Delay(ms)": i32, "GlobalColors": u32[]}
uses:
  OpenG.Picture::GIF.Read.Unpack.State.gvi
  OpenG.Picture::Util.Error.Build.gvi
  OpenG.Picture::Util.Pic.GIF.Block.PackUnpack.gvi
  OpenG.Picture::Util.Cmprs.LZW.CU_CompressUncompress.gvi
  OpenG.Picture::GIF.Read.Unpack.Interlace.gvi
  OpenG.Picture::GIF.Read.Unpack.ChangeRowLength.gvi
diagram:
  case ($"error in (no error)") {
    frame No Error {
      Property Node(instance in=$"Unpack in-progress", "ColorMapFollows"=FALSE) -> (instance out=w4)
      Property Node(instance in=$"Unpack in-progress") -> ("image data"=w5)
      Initialize Array(element=w5) -> w6
      s1 = w4  # shift register
      s2 = "Begin"  # shift register
      s3 = w6  # shift register
      s4 = uninitialised  # shift register
      while {
        Property Node(instance in=s1) -> ("ColorMapFollows"=w7, "NextIndex"=w8)
        Array Index(array=$"Raw GIF89a bytes") -> (out0[w8]=w9, out1[_]=w10)
        call "GIF.Read.Unpack.State.gvi"(State in=s2, NextCharacter=w9, NextLabel=w10, ColorMap=w7, error in (no error)=$"error in (no error)") -> (New State=w11, error out=w12)
        case (w11) {
          frame "Header", Default {
            Property Node(instance in=s1, "image data:image type"=0, "image data:image"=u8[] [], "image data:mask"=u8[] [], "image data:colors"=u32[] [], "NextIndex"=6) -> (instance out=w13)
            Array Subset(array=$"Raw GIF89a bytes", length0=6) -> w17
            Byte Array To String(encoding="Extended ASCII", unsigned byte array=w17) -> (string=w18)
            To Upper Case(string=w18) -> w19
            Is Equal(x="GIF89A", y=w19) -> w20
            Is Equal(x="GIF87A", y=w19) -> w21
            Logical Or(w20, w21) -> w22
            case (w22) {
              frame False, Default {
                w23 = "Error in GIF Header (first 6 bytes of raw data.)\nExpected: \"GIF87a\" or\"GIF89a\"\nFound: \"%s\" (%s)\n\n"
                Array To Spreadsheet String(array=w17, delimiter=", ", format string="0x02x") -> (spreadsheet string=w24)
                Format Into String(formatString=w23, w18, w24) -> w25
                call "Util.Error.Build.gvi"(Source=w25, code=-1, Status=TRUE, error in (no error)=w12) -> (error out=w1)
              }
              frame True {
                w1 = w12
              }
            }
            w14 = default
            w15 = default
            w16 = default
          }
          frame "LS_LSDescriptor" {
            Array Index(array=$"Raw GIF89a bytes") -> (out0[w8]=w26, out1[_]=w27, out2[_]=w28, out3[_]=w29, out4[_]=w30, out5[_]=w31)
            # Global Color Table Flag       1 Bit
            # Color Resolution              3 Bits
            # Sort Flag                     1 Bit
            # Size of Global Color Table    3 Bits
            Join Numbers(high(x)=w27, low(x)=w26) -> w32
            Join Numbers(high(x)=w29, low(x)=w28) -> w33
            Logical And(w30, 0x80) -> w34
            Is Greater Than 0(x=w34) -> w35
            Logical Shift(x=w30, y=4) -> w36
            Logical And(w36, 7) -> w37
            Increment(x=w37) -> w38
            Logical And(w30, 7) -> w39
            Increment(x=w39) -> w40
            Property Node(instance in=s1, "image data:Rectangle:right"=w32, "image data:Rectangle:bottom"=w33, "GlobalDepth"=w40, "CR"=w38, "ColorMapFollows"=w35, "BGColor"=w31, "image data:image type"=0, "NextIndex"=13) -> (instance out=w13)
            w1 = w12
            w14 = default
            w15 = default
            w16 = default
          }
          frame "LS_GCTable" {
            Property Node(instance in=s1) -> ("GlobalDepth"=w41)
            Power Of 2(x=w41) -> w42
            s5 = w8  # shift register
            for (N = w42) {
              Array Index(array=$"Raw GIF89a bytes") -> (out0[s5]=w44, out1[_]=w45, out2[_]=w46)
              RGB to Color(R Input 0=w44, G Input 1=w45, B Input 2=w46) -> (Color Output 3=w47)  # RGB to Color (Placeholder)
              Add(s5, 3) -> w48
              append w47 to w43
              next s5 = w48
            }
            Property Node(instance in=s1, "ColorMapFollows"=FALSE, "GlobalColors"=w43, "NextIndex"=s5) -> (instance out=w13)
            w1 = w12
            w14 = default
            w15 = default
            w16 = default
          }
          frame "Data_LGD_SPB" {
            Add(w8, 2) -> w49
            # Only/ALL Data cases need to preserve Picture-buffer
            # Skip/ignore special-purpose blocks and embedded application-data.
            w50 = FALSE  # F=>Unpack
            call "Util.Pic.GIF.Block.PackUnpack.gvi"(Pack/Unpack (T/F)=w50, BlockBytes in=$"Raw GIF89a bytes", StartIndex=w49, error in (no error)=w12, Calling routine="unpacking LogicalScreen\\Data\\SpecialPurpose block.") -> (LastIndex=w51, error out=w1)
            Property Node(instance in=s1, "NextIndex"=w51) -> (instance out=w13)
            w14 = default
            w15 = s3
            w16 = s4
          }
          frame "Data_GB_GRB_PTE" {
            Add(w8, 2) -> w52
            w53 = FALSE  # F=>Unpack
            call "Util.Pic.GIF.Block.PackUnpack.gvi"(Pack/Unpack (T/F)=w53, BlockBytes in=$"Raw GIF89a bytes", StartIndex=w52, error in (no error)=w12, Calling routine="unpacking LogicalScreen\\Data\\Plain-text block.") -> (LastIndex=w54, error out=w55)
            # Skip special-purpose blocks and embedded application-data.
            case (w55) {
              frame No Error {
                w56 = "Error - this version of the GIF reader doesn't unpack plain-text extensions.  (Though it could with a bit more work ;^)"
                call "Util.Error.Build.gvi"(Source=w56, code=-1, Status=TRUE, error in (no error)=w55) -> (error out=w1)
              }
              frame Error {
                w1 = w55
              }
            }
            Property Node(instance in=s1, "NextIndex"=w54) -> (instance out=w13)
            w14 = default
            w15 = s3
            w16 = s4
          }
          frame "Data_GB_GCE" {
            Add(w8, 8) -> w57
            Add(4, w8) -> w58
            Array Index(array=$"Raw GIF89a bytes") -> (out0[w58]=w59, out1[_]=w60)
            Join Numbers(high(x)=w60, low(x)=w59) -> w61
            To Unsigned Long Integer(number=w61) -> w62
            # Get Frame-delay (don't add to delay-array here, may be a plain-text image - which will be ignored)
            Multiply(10, w62) -> w63
            Property Node(instance in=s1, "Delay(ms)"=w63, "NextIndex"=w57) -> (instance out=w13)
            w1 = w12
            w14 = default
            w15 = s3
            w16 = s4
          }
          frame "Data_GB_GRB_TBI_IDesc" {
            Increment(x=w8) -> w64
            Array Index(array=$"Raw GIF89a bytes") -> (out0[w64]=w65, out1[_]=w66, out2[_]=w67, out3[_]=w68, out4[_]=w69, out5[_]=w70, out6[_]=w71, out7[_]=w72, out8[_]=w73)
            Logical And(w73, 0x80) -> w74
            Is Greater Than 0(x=w74) -> w75
            Add(w8, 10) -> w76
            Logical And(w73, 0x40) -> w77
            Logical And(w73, 0x7) -> w78
            Increment(x=w78) -> w79
            # 44 (0x2C) = ImageDescriptor GraphicRenderingBlock
            Join Numbers(high(x)=w66, low(x)=w65) -> w80
            To Word Integer(number=w80) -> w81
            Join Numbers(high(x)=w68, low(x)=w67) -> w82
            To Word Integer(number=w82) -> w83
            Join Numbers(high(x)=w70, low(x)=w69) -> w84
            To Word Integer(number=w84) -> w85
            Join Numbers(high(x)=w72, low(x)=w71) -> w86
            To Word Integer(number=w86) -> w87
            Property Node(instance in=s1, "image data:Rectangle:left"=w81, "image data:Rectangle:top"=w83, "image data:Rectangle:right"=w85, "image data:Rectangle:bottom"=w87, "image data:image type"=w77, "image data:image depth"=w79, "ColorMapFollows"=w75, "NextIndex"=w76) -> (instance out=w88)
            case (w75) {
              frame False, Default {
                Property Node(instance in=w88) -> ("GlobalDepth"=w89, "GlobalColors"=w90)
                Property Node(instance in=w88, "image data:image depth"=w89, "image data:colors"=w90) -> (instance out=w13)
              }
              frame True {
                w13 = w88
              }
            }
            w1 = w12
            w14 = default
            w15 = s3
            w16 = s4
          }
          frame "Data_GB_GRB_TBI_CMap" {
            Property Node(instance in=s1) -> ("image data:image depth"=w91)
            Is Greater(x=9, y=w91) -> w92
            case (w92) {
              frame False, Default {
                w93 = "Error: Unexpected \"image depth\".\nFound: %d\nExpected a value less than 9"
                Format Into String(formatString=w93, w91) -> w94
                call "Util.Error.Build.gvi"(Source=w94, code=-1, Status=TRUE, error in (no error)=w12) -> (error out=w1)
                w13 = s1
              }
              frame True {
                Power Of 2(x=w91) -> w95
                s6 = w8  # shift register
                for (N = w95) {
                  Array Index(array=$"Raw GIF89a bytes") -> (out0[s6]=w97, out1[_]=w98, out2[_]=w99)
                  RGB to Color(R Input 0=w97, G Input 1=w98, B Input 2=w99) -> (Color Output 3=w100)  # RGB to Color (Placeholder)
                  Add(s6, 3) -> w101
                  append w100 to w96
                  next s6 = w101
                }
                Property Node(instance in=s1, "ColorMapFollows"=FALSE, "image data:colors"=w96, "NextIndex"=s6) -> (instance out=w13)
                w1 = w12
              }
            }
            w14 = default
            w15 = s3
            w16 = s4
          }
          frame "Data_GB_GRB_TBI_ImageData" {
            Property Node(instance in=s1) -> ("Delay(ms)"=w102, "image data:image type"=w103, "image data:Rectangle:right"=w104)
            Build Array[ConcatenateInputs=True](s4, w102) -> w16
            # 1st byte of first block
            Increment(x=w8) -> w105
            w106 = FALSE  # F=>Unpack
            # Width
            call "Util.Pic.GIF.Block.PackUnpack.gvi"(Pack/Unpack (T/F)=w106, BlockBytes in=$"Raw GIF89a bytes", StartIndex=w105, error in (no error)=w12, Calling routine="unpacking TableBasedImage ImageData.") -> (BlockBytes out=w107, LastIndex=w108, error out=w109)
            Logical Exclusive Or(w103, w103) -> w110
            # LZW bits
            Array Index(array=$"Raw GIF89a bytes") -> (out0[w8]=w111)
            call "Util.Cmprs.LZW.CU_CompressUncompress.gvi"(Compress/Decompress (T/F)=w106, Data=w107, LZWBits=w111, error in (no error)=w109) -> (Data out=w112, error out=w1)
            case (w103) {
              frame Default {
                w113 = w112
              }
              frame 64 {
                call "GIF.Read.Unpack.Interlace.gvi"(Interlaced=w112, Columns=w104) -> (Flat=w113)
              }
            }
            # Previous case borrowed "image-type" to hold "Interlace-flag"
            # Unbundle "Interlace-flag" before writing zero to "image type".
            Quotient And Remainder(x=w104, y=2) -> (x-y*floor(x/y)=w114)
            Is Greater Than 0(x=w114) -> w115
            case (w115) {
              frame False {
                w116 = w113
              }
              frame True {
                # Pad image to even-
                # width "right" and
                # "bottom" Don't change.
                call "GIF.Read.Unpack.ChangeRowLength.gvi"(Image in=w113, image width=w104, +1/-1 (T/F)=TRUE) -> (Image out=w116)
              }
            }
            Property Node(instance in=s1, "NextIndex"=w108, "image data:image type"=w110, "image data:image"=w116) -> (instance out=w13)
            # build arrays in tandem
            Property Node(instance in=w13) -> ("image data"=w117)
            Build Array[ConcatenateInputs=True](s3, w117) -> w15
            w14 = default
          }
          frame "End_Of_File" {
            w13 = s1
            w1 = w12
            w14 = TRUE
            w15 = s3
            w16 = s4
          }
        }
        $"Unpack in-progress" <- w13
        Property Node(instance in=w1) -> ("status"=w118)
        Logical Or(w14, w118) -> w119
        next s1 = w13
        next s2 = w11
        next s3 = w15
        next s4 = w16
        stop if w119
      }
      w2 = s3
      w3 = s4
    }
    frame Error {
      w1 = $"error in (no error)"
      w2 = default
      w3 = default
    }
  }
  $"Delay (ms)" <- w3
  $"Picture Array" <- w2
  $"error out" <- w1
