vi "GIF.Write.Pack.Data.gvi"   [LabVIEW Platform Developer Preview 0.1.0]
inputs:
  "LV image data": "imagedata.gtype"  # image data returns information about the pixmap so you can use the Draw Flattened Pixmap VI to draw the pixmap as a picture or use the Graphics Formats VIs to save the pixmap to a file.
  "error in (no error)": error
  "Delay (ms)": u32
outputs:
  "Pack in-progress out": u8[]
  "error out": error
types:
  T1 = cluster{"left": i16, "top": i16, "right": i16, "bottom": i16}
  "imagedata.gtype" = cluster{"image type": i32, "image depth": i32, "image": u8[], "mask": u8[], "colors": u32[], "Rectangle": T1}
uses:
  NI::G Core::Picture::Color to RGBA.gvi
  OpenG.Picture::GIF.Write.Pack.Data.NormalizeImage.gvi
  OpenG.Picture::Util.Cmprs.LZW.CU_CompressUncompress.gvi
  OpenG.Picture::Util.Pic.GIF.Block.PackUnpack.gvi
diagram:
  Property Node(instance in=$"LV image data") -> ("Rectangle:right"=w1, "Rectangle:bottom"=w2, "colors"=w3, "image"=w4)
  Array Size(array=w3) -> (size(s)=w5)
  Is Greater Than 0(x=w5) -> w6
  case (w6) {
    frame False, Default {
      w7 = default
      w8 = default
    }
    frame True {
      Decrement(x=w5) -> w9
      Logarithm Base 2(x=w9) -> w10
      Round Toward Negative Infinity(x=w10) -> w11
      To Unsigned Byte Integer(number=w11) -> w12
      Logical Or(w12, 0x80) -> w8
      # Color table
      Multiply(w5, 3) -> w13
      Initialize Array(element=3, size=w13) -> w14
      s1 = w14  # shift register
      for (iteration -> i1) {
        w15 = each element of w3
        Multiply(i1, 3) -> w16
        call "Color to RGBA.gvi"(color=w15) -> (red=w17, green=w18, blue=w19)
        Increment(x=w16) -> w20
        Increment(x=w20) -> w21
        Replace Array Subset(inArray=s1, index=w16, new=w17, index=w20, new=w18, index=w21, new=w19) -> w22
        Type Cast(type=u32 0, x=w15)
        next s1 = w22
      }
      w7 = s1
    }
  }
  w23 = 8  # CodeSize(8bits)
  To Unsigned Byte Integer(number=w23) -> w24
  w25 = TRUE  # T=>Pack
  call "GIF.Write.Pack.Data.NormalizeImage.gvi"(ImageIn=w4, right=w1, bottom=w2) -> (ImageOut=w26)
  call "Util.Cmprs.LZW.CU_CompressUncompress.gvi"(Compress/Decompress (T/F)=w25, Data=w26, LZWBits=w23, error in (no error)=$"error in (no error)") -> (Data out=w27, error out=w28)
  # Data_GB_GRB_TBI_LocalColorTable
  call "Util.Pic.GIF.Block.PackUnpack.gvi"(Pack/Unpack (T/F)=w25, BlockBytes in=w27, error in (no error)=w28) -> (BlockBytes out=w29, error out=w30)
  # Data_GB_GRB_TBI_ImageData
  Build Array[ConcatenateInputs=True](w24, w29) -> w31
  w32 = 0xFF  # Application-Extension Label
  w33 = 0x21  # Extension introducer
  String To Byte Array(encoding="Extended ASCII", string="NETSCAPE") -> (unsigned byte array=w34)
  # I forget what these
  # three bytes mean.
  Split Number(x=0x302E32) -> (high(x)=w35, low(x)=w36)
  Split Number(x=w35) -> w37
  Split Number(x=w36) -> (high(x)=w38, low(x)=w39)
  # Data_GB_GraphicControlExtension
  w40 = 0x0  # BlockTerm
  # Data_SPB_ApplicationExtension
  Build Array[ConcatenateInputs=True](w33, w32, 0xB, w34, w39, w38, w37, 3, 1, 0, 0, w40) -> w41
  w42 = 0xF9  # Application-Extension Label
  w43 = 0x21  # Extension introducer
  w44 = 0x4  # BlockLength
  w45 = 0x4  # PackedField
  # Convert ms to sec/100
  Quotient And Remainder(x=$"Delay (ms)", y=10) -> (floor(x/y)=w46, x-y*floor(x/y)=w47)
  Is Less Or Equal(x=5, y=w47) -> w48
  Boolean To Integer(Boolean=w48) -> (0, 1=w49)
  Add(w49, w46) -> w50
  To Unsigned Word Integer(number=w50) -> w51
  Split Number(x=w51) -> (high(x)=w52, low(x)=w53)
  w54 = 0xFF  # TransColNdx
  w55 = 0x0  # BlockTerm
  Build Array(w43, w42, w44, w45, w53, w52, w54, w55) -> w56
  # Data_GB_GRB_TBI_ImageDescriptor
  Split Number(x=w2) -> (high(x)=w57, low(x)=w58)
  Split Number(x=w1) -> (high(x)=w59, low(x)=w60)
  # <GIF Data Stream> ::=     Header <Logical Screen> <Data>* Trailer
  #
  # <Logical Screen> ::=      Logical Screen Descriptor [Global Color Table]
  #
  # <Data> ::=                <Graphic Block>  |
  #                           <Special-Purpose Block>
  #
  # <Graphic Block> ::=       [Graphic Control Extension] <Graphic-Rendering Block>
  #
  # <Graphic-Rendering Block> ::=  <Table-Based Image>  |
  #                                Plain Text Extension
  #
  # <Table-Based Image> ::=   Image Descriptor [Local Color Table] Image Data
  #
  # <Special-Purpose Block> ::=    Application Extension  |
  #                                Comment Extension
  Build Array(0x2C, 0x0, 0x0, 0x0, 0x0, w60, w59, w58, w57, w8) -> w61
  # 8+11
  Build Array[ConcatenateInputs=True](w41, w56, w61, w7, w31) -> w62
  $"Pack in-progress out" <- w62
  $"error out" <- w30
