vi "GIF.Write.Pack.gvi"   [LabVIEW Platform Developer Preview 0.1.0]
inputs:
  "Images": "imagedata.gtype"[]
  "error in (no error)": error
  "Delay (ms)": u32[]
outputs:
  "Array": u8[]
  "error out": error
types:
  T1 = cluster{"left": i16, "top": i16, "right": i16, "bottom": i16}
  "imagedata.gtype" = cluster{"image type": i32, "image depth": i32, "image": u8[], "mask": u8[], "colors": u32[], "Rectangle": T1}
uses:
  OpenG.Picture::GIF.Write.Pack.LogicalScreen.gvi
  OpenG.Picture::GIF.Write.Pack.Data.gvi
diagram:
  Array Index(array=$Images) -> (out0[0]=w1)
  sequence {
    frame 0 {
      call "GIF.Write.Pack.LogicalScreen.gvi"(LV image data=w1, error in (no error)=$"error in (no error)") -> (Pack in-progress out=w2, error out=w3)
    }
  }
  Property Node(instance in=w1, "colors"=u32[] []) -> (instance out=w4)
  # Let first image populate Global Color Table.
  # So, first image doesn't need a local Color table.
  Replace Array Subset(inArray=$Images, index=0, new=w4) -> w5
  # Logical Screen
  case (w3) {
    frame No Error {
      w8 = u8[] []  # [U8]
      s1 = w3  # shift register
      s2 = w8  # shift register
      for (iteration -> i1) {
        w9 = each element of w5
        # Don't auto-index delays-array.
        # Let image-array [only] determine iterations.
        Array Index(array=$"Delay (ms)") -> (out0[i1]=w10)
        case (s1) {
          frame No Error {
            call "GIF.Write.Pack.Data.gvi"(LV image data=w9, error in (no error)=s1, Delay (ms)=w10) -> (Pack in-progress out=w13, error out=w11)
            Build Array[ConcatenateInputs=True](s2, w13) -> w12
          }
          frame Error {
            w11 = s1
            w12 = default
          }
        }
        next s1 = w11
        next s2 = w12
      }
      w6 = s1
      w7 = s2
    }
    frame Error {
      w6 = w3
      w7 = default
    }
  }
  w14 = "GIF89a"  # Header
  String To Byte Array(encoding="Extended ASCII", string=w14) -> (unsigned byte array=w15)
  # Data
  w16 = 0x3B  # Terminator
  Build Array[ConcatenateInputs=True](w15, w2, w7, w16) -> w17
  $Array <- w17
  $"error out" <- w6
