vi "Read GIF File (Animated).gvi"   [LabVIEW Platform Developer Preview 0.1.0]
# Reads a multi-frame (animated) Compuserve GIF file. If no path is specified, a file dialog is used to find the file.
inputs:
  "path to GIF file": path, required  # path to BMP file specifies the path to and name of the bitmap file to read.
  "error in (no error)": error
outputs:
  "path": path  # path to BMP file specifies the path to and name of the bitmap file to read.
  "images data": "imagedata.gtype"[]
  "animated?": bool
  "error out": error
  "Delay (ms)": u32[]
types:
  T1 = cluster{"left": i16, "top": i16, "right": i16, "bottom": i16}
  "imagedata.gtype" = cluster{"image type": i32, "image depth": i32, "image": u8[], "mask": u8[], "colors": u32[], "Rectangle": T1}
uses:
  NI::G Core::File IO (General)::Current VIs Path.gvi
  OpenG.Picture::GIF.Read.Unpack.gvi
diagram:
  # Read GIF
  # Unpack GIF
  # - This VI builds an array of LabVIEW image controls - one for each image encountered in the target GIF.
  case ($"error in (no error)") {
    frame No Error {
      Is Empty String Or Path(string/path=$"path to GIF file") -> w6
      # Empty Path?
      case (w6) {  # Show File Dialog?
        frame False, Default {
          w7 = default
          w8 = $"path to GIF file"
        }
        frame True {
          call "Current VIs Path.gvi"() -> (path=w9)
          File Dialog[FileDialogSelectionMode=File, NewOrExistingMode=New](pattern (all files)="*.gif", start path=w9) -> (cancelled=w7, error out=w10, selected path=w8)
          Property Node(instance in=w10)
        }
      }
      # cancelled?
      case (w7) {  # Read Cancelled?
        frame False, Default {
          Open Or Create Or Replace File(error in=$"error in (no error)", file path (use dialog)=w8) -> (error out=w11, refnum out=w12)
          Get File Size(error in=w11, file=w12) -> (error out=w13, refnum out=w14, size (in bytes)=w15)
          To Long Integer(number=w15) -> w16
          Read From Binary File(count=w16, error in=w13, file (use dialog)=w14) -> (data=w17, error out=w18, refnum out=w19)
          String To Byte Array(encoding="Extended ASCII", string=w17) -> (unsigned byte array=w20)
          call "GIF.Read.Unpack.gvi"(Raw GIF89a bytes=w20, error in (no error)=w18) -> (Picture Array=w2, Delay (ms)=w4, error out=w1)
          Array Size(array=w2) -> (size(s)=w21)
          Is Greater Than 0(x=w21) -> w5
          Close File(refnum=w19)
          w3 = w8
        }
        frame True {
          w1 = $"error in (no error)"
          w2 = default
          w3 = w8
          w4 = default
          w5 = default
        }
      }
    }
    frame Error {
      w1 = $"error in (no error)"
      w2 = default
      w3 = $"path to GIF file"
      w4 = default
      w5 = default
    }
  }
  $path <- w3
  $"animated?" <- w5
  $"images data" <- w2
  $"Delay (ms)" <- w4
  $"error out" <- w1
