vi "Read GIF File.gvi"   [LabVIEW Platform Developer Preview 0.1.0]
# Reads a single-frame (non-animated) Compuserve GIF file. If no path is specified, a file dialog is used to find the file.
inputs:
  "path to GIF file": path, required  # path to BMP file specifies the path to and name of the bitmap file to read.
  "error in (no error)": error
outputs:
  "path": path  # path to BMP file specifies the path to and name of the bitmap file to read.
  "image data": "imagedata.gtype"  # image data returns information about the pixmap so you can use the Draw Flattened Pixmap VI to draw the pixmap as a picture or use the Graphics Formats VIs to save the pixmap to a file.
  "error out": error
types:
  T1 = cluster{"left": i16, "top": i16, "right": i16, "bottom": i16}
  "imagedata.gtype" = cluster{"image type": i32, "image depth": i32, "image": u8[], "mask": u8[], "colors": u32[], "Rectangle": T1}
uses:
  OpenG.Picture::Read GIF File (Animated).gvi
diagram:
  case ($"error in (no error)") {
    frame No Error {
      call "Read GIF File (Animated).gvi"(path to GIF file=$"path to GIF file", error in (no error)=$"error in (no error)") -> (path=w3, images data=w4, error out=w1)
      Array Index(array=w4) -> (out0[0]=w2)
    }
    frame Error {
      w1 = $"error in (no error)"
      w2 = default
      w3 = $"path to GIF file"
    }
  }
  $path <- w3
  $"image data" <- w2
  $"error out" <- w1
