vi "Util.Cmprs.LZW.CU.BitStream.gvi"   [LabVIEW Platform Developer Preview 0.1.0]
inputs:
  "PackUnpack": bool
  "Codes in": i16[]
  "Chars in": u8[]
  "error in (no error)": error
  "Bits": i32
outputs:
  "Chars out": u8[]
  "Codes out": i16[]
  "error out": error
panel indicators:
  "Error": bool
uses:
  OpenG.Picture::Util.Cmprs.LZW.CU.BitStream.Width.gvi
  OpenG.Picture::Util.Error.Build.gvi
diagram:
  w1 = 0  # Bit pos. (I32)
  Power Of 2(x=$Bits) -> w2
  To Word Integer(number=w2) -> w3
  call "Util.Cmprs.LZW.CU.BitStream.Width.gvi"(Code=w3, Reset=w3, ImageBits=$Bits) -> (Bit Width next=w4)
  # Pack/Unpack?
  case ($PackUnpack) {
    frame False, Default {
      sequence {
        frame 0 {
          w6 = 0  # I16
          Initialize Array(element=w6) -> w7
          $Error <- $PackUnpack
        }
      }
      Array Size(array=$"Chars in") -> (size(s)=w8)
      Multiply(8, w8) -> w9
      s1 = w1  # shift register
      s2 = w4  # shift register
      s3 = w7  # shift register
      while {
        Add(s1, s2) -> w11
        Add(w11, s2) -> w12
        Is Less Or Equal(x=w12, y=w9) -> w13
        case (s2) {
          frame 2 {
            w14 = 0x3
            w15 = w13
          }
          frame 3 {
            w14 = 0x7
            w15 = w13
          }
          frame 4 {
            w14 = 0xF
            w15 = w13
          }
          frame 5 {
            w14 = 0x1F
            w15 = w13
          }
          frame 6 {
            w14 = 0x3F
            w15 = w13
          }
          frame 7 {
            w14 = 0x7F
            w15 = w13
          }
          frame 8 {
            w14 = 0xFF
            w15 = w13
          }
          frame 9 {
            w14 = 0x1FF
            w15 = w13
          }
          frame 10 {
            w14 = 0x3FF
            w15 = w13
          }
          frame 11 {
            w14 = 0x7FF
            w15 = w13
          }
          frame 12 {
            w14 = 0xFFF
            w15 = w13
          }
          frame Default {
            $Error <- w13
            w14 = 0x1FF
            w15 = FALSE
          }
        }
        Quotient And Remainder(x=s1, y=8) -> (floor(x/y)=w16, x-y*floor(x/y)=w17)
        Negate(x=w17) -> w18
        Array Index(array=$"Chars in") -> (out0[w16]=w19, out1[_]=w20, out2[_]=w21)
        Join Numbers(high(x)=w20, low(x)=w19) -> w22
        To Unsigned Word Integer(number=0) -> w23
        Join Numbers(high(x)=w23, low(x)=w21) -> w24
        To Unsigned Word Integer(number=w24) -> w25
        Join Numbers(high(x)=w25, low(x)=w22) -> w26
        Logical Shift(x=w26, y=w18) -> w27
        Logical And(w27, w14) -> w28
        To Word Integer(number=w28) -> w29
        Build Array[ConcatenateInputs=True](s3, w29) -> w30
        call "Util.Cmprs.LZW.CU.BitStream.Width.gvi"(Code=w29, Reset=w3, ImageBits=$Bits) -> (Bit Width next=w31)
        w10 = s2
        next s1 = w11
        next s2 = w31
        next s3 = w30
        continue if w15
      }
      $"Codes out" <- s3
      sequence (after s1) {
        frame 0 {
          case ($Error) {
            frame False, Default {
              w5 = $"error in (no error)"
            }
            frame True {
              w32 = "Error: Unexpected (impossible) bit width encountered while unpacking LZW codes.  Legal values are from 2 to 12.\nFound: %d"
              Format Into String(formatString=w32, w10) -> w33
              call "Util.Error.Build.gvi"(Source=w33, code=-1, Status=TRUE, error in (no error)=$"error in (no error)") -> (error out=w5)
            }
          }
        }
      }
    }
    frame True {
      w34 = 0  # U8
      Initialize Array(element=w34) -> w35
      s4 = w1  # shift register
      s5 = w35  # shift register
      for {
        w36 = each element of $"Codes in"
        Quotient And Remainder(x=s4, y=8) -> (x-y*floor(x/y)=w37)
        Is Greater Than 0(x=w37) -> w38
        call "Util.Cmprs.LZW.CU.BitStream.Width.gvi"(Code=w36, Reset=w3, ImageBits=$Bits) -> (Bit Width=w39)
        Add(w37, w39) -> w40
        case (w38) {
          frame False, Default {
            Split Number(x=w36) -> (high(x)=w42, low(x)=w43)
            Build Array[ConcatenateInputs=True](s5, w43, w42) -> w41
          }
          frame True {
            To Unsigned Long Integer(number=w36) -> w44
            Logical Shift(x=w44, y=w37) -> w45
            Split Number(x=w45) -> (high(x)=w46, low(x)=w47)
            Split Number(x=w47) -> (high(x)=w48, low(x)=w49)
            Split Number(x=w46) -> w50
            Is Less(x=16, y=w40) -> w51
            Array Size(array=s5) -> (size(s)=w52)
            Decrement(x=w52) -> w53
            Array Index(array=s5) -> (out0[w53]=w54)
            Logical Or(w54, w49) -> w55
            Replace Array Subset(inArray=s5, index=w53, new=w55) -> w56
            case (w51) {
              frame False, Default {
                Build Array[ConcatenateInputs=True](w56, w48) -> w41
              }
              frame True {
                Build Array[ConcatenateInputs=True](w56, w48, w50) -> w41
              }
            }
          }
        }
        next s4 = w40
        next s5 = w41
      }
      $"Chars out" <- s5
      w5 = $"error in (no error)"
    }
  }
  $"error out" <- w5
