vi "Util.Cmprs.LZW.CU_CompressUncompress.gvi"   [LabVIEW Platform Developer Preview 0.1.0]
inputs:
  "Compress/Decompress (T/F)": bool
  "Data": u8[]
  "LZWBits": i32
  "error in (no error)": error
outputs:
  "Data out": u8[]
  "error out": error
uses:
  OpenG.Picture::Util.Cmprs.LZW.CU.BitStream.gvi
  OpenG.Picture::Util.Cmprs.LZW.CU.StringsTable.gvi
diagram:
  # While packing, the conversion from Char to Code occurs in the outer loop, an the conversion of Code to Packed in the Sub-VI.
  # While unpacking, the conversion from Packed to Code occors in the outer loop, and the conversion from Code to Chars in the Sub-VI
  case ($"Compress/Decompress (T/F)") {
    frame False, Default {
      # Unpack bit-packed data-stream into array of LZW codes [U16]
      # Decompress LZW codes to data.
      call "Util.Cmprs.LZW.CU.BitStream.gvi"(PackUnpack=$"Compress/Decompress (T/F)", Chars in=$Data, error in (no error)=$"error in (no error)", Bits=$LZWBits) -> (Codes out=w3, error out=w4)
      call "Util.Cmprs.LZW.CU.StringsTable.gvi"(Pack=$"Compress/Decompress (T/F)", Codes in=w3, error in (no error)=w4, Bits=$LZWBits) -> (Chars out=w1, error out=w2)
    }
    frame True {
      # Compress data into LZW codes.
      # Bit-pack LZW codes.
      call "Util.Cmprs.LZW.CU.StringsTable.gvi"(Pack=$"Compress/Decompress (T/F)", Chars in=$Data, error in (no error)=$"error in (no error)", Bits=$LZWBits) -> (Codes out=w5, error out=w6)
      call "Util.Cmprs.LZW.CU.BitStream.gvi"(PackUnpack=$"Compress/Decompress (T/F)", Codes in=w5, error in (no error)=w6, Bits=$LZWBits) -> (Chars out=w1, error out=w2)
    }
  }
  $"Data out" <- w1
  $"error out" <- w2
