vi "Util.Pic.GIF.Block.PackUnpack.gvi"   [LabVIEW Platform Developer Preview 0.1.0]
inputs:
  "Pack/Unpack (T/F)": bool
  "BlockBytes in": u8[]  # image is an array of bytes that describes the color of each pixel in the image in raster order. The value of image depth determines how LabVIEW interprets the value of this output.
  "StartIndex": i32
  "error in (no error)": error
  "Calling routine": string
outputs:
  "BlockBytes out": u8[]  # image is an array of bytes that describes the color of each pixel in the image in raster order. The value of image depth determines how LabVIEW interprets the value of this output.
  "LastIndex": i32
  "error out": error
uses:
  OpenG.Picture::Util.Error.Build.gvi
diagram:
  case ($"Pack/Unpack (T/F)") {
    frame False, Default {
      Array Size(array=$"BlockBytes in") -> (size(s)=w3)
      s1 = $StartIndex  # shift register
      s2 = u8[] []  # shift register
      while {
        Array Index(array=$"BlockBytes in") -> (out0[s1]=w4)
        Increment(x=s1) -> w5
        Add(w4, w5) -> w6
        Is Greater(x=w3, y=w6) -> w7
        Is Not Equal To 0(x=w4) -> w8
        Logical And(w8, w7) -> w9
        case (w9) {
          frame False, Default {
            # Return next index
            # Skip 0 (terminate) byte
            case (w7) {
              frame False, Default {
                w12 = "Unexpected end of data while reading GIF.\nError occurred during: %s"
                Format Into String(formatString=w12, $"Calling routine") -> w13
                call "Util.Error.Build.gvi"(Source=w13, code=-1, Status=TRUE, error in (no error)=$"error in (no error)") -> (error out=w2)
              }
              frame True {
                w2 = $"error in (no error)"
              }
            }
            w10 = w5
            w11 = s2
          }
          frame True {
            Array Subset(array=$"BlockBytes in", index0=w5, length0=w4) -> w14
            Build Array[ConcatenateInputs=True](s2, w14) -> w11
            w10 = w6
            w2 = $"error in (no error)"
          }
        }
        next s1 = w10
        next s2 = w11
        continue if w9
      }
      $LastIndex <- s1
      w1 = s2
    }
    frame True {
      Array Size(array=$"BlockBytes in") -> (size(s)=w15)
      Quotient And Remainder(x=w15, y=255) -> (floor(x/y)=w16, x-y*floor(x/y)=w17)
      sequence {
        frame 0 {
          # Pack Full blocks (255 bytes)
          case (w16) {
            frame 0 {
              w18 = default
            }
            frame Default {
              for (N = w16) (iteration -> i1) {
                Multiply(i1, 255) -> w20
                Array Subset(array=$"BlockBytes in", index0=w20, length0=255) -> w21
                Build Array[ConcatenateInputs=True](255, w21) -> w22
                append w22 to w19
              }
              Array Size(array=w19) -> (size(s)=w23)
              Multiply Array Elements(numeric array=w23) -> (product=w24)
              Reshape Array(inArray=w19, size=w24) -> w18
            }
          }
        }
        frame 1 {
          # pack remaining bytes/block in image
          case (w17) {
            frame 0 {
              w25 = default
            }
            frame Default {
              To Unsigned Byte Integer(number=w17) -> w26
              Multiply(w16, 255) -> w27
              # build a block containing remainder data
              Array Subset(array=$"BlockBytes in", index0=w27) -> w28
              Build Array[ConcatenateInputs=True](w26, w28) -> w25
            }
          }
        }
      }
      Build Array[ConcatenateInputs=True](w18, w25, 0) -> w1
      w2 = $"error in (no error)"
    }
  }
  $"BlockBytes out" <- w1
  $"error out" <- w2
