vi "VI Tree - picture.gvi"   [LabVIEW Platform Developer Preview 0.1.0]
panel controls:
  "Case Constant (See Context Help)": bool
    # LabVIEW created this control from a constant that was wired to a Case structure. In LabVIEW 7.1 and earlier, subVIs could be kept in memory by wiring a constant to a Case structure and placing the subVI in a case that would not be executed. For example, you could wire a True constant to the Case structure and place a subVI in the False case of the Case structure, and LabVIEW would load the subVI along with the calling VI. This no longer works in LabVIEW 8.0 because the Case structure is optimized to remove code that will not be executed. Changing the constant to a control ensures that this VI behaves as it did in LabVIEW 7.1 and earlier. If the intent is not to keep subVIs in memory, you can change this control back to a constant by right-clicking the control and selecting Change to Constant from the shortcut menu. The proper way to keep a subVI in memory without calling it is to use a Static VI Reference.
uses:
  OpenG.Picture::Read GIF File.gvi
  OpenG.Picture::Write GIF File.gvi
  OpenG.Picture::Read GIF File (Animated).gvi
  OpenG.Picture::Write GIF File (Animated).gvi
  OpenG.Picture::Flatten Pixmaps - GIF.gvi
  OpenG.Picture::Draw Image from File.gvi
diagram:
  case ($"Case Constant (See Context Help)") {
    frame False, Default { }
    frame True {
      call "Read GIF File.gvi"(path to GIF file=path "") -> (path=w1, image data=w2, error out=w3)
      call "Write GIF File.gvi"(path to GIF file=w1, image data=w2, error in (no error)=w3)
      call "Read GIF File (Animated).gvi"(path to GIF file=path "") -> (path=w4, images data=w5, error out=w6, Delay (ms)=w7)
      call "Write GIF File (Animated).gvi"(path to GIF file=w4, images data=w5, error in (no error)=w6, delay (ms)=w7)
      call "Flatten Pixmaps - GIF.gvi"()
      call "Draw Image from File.gvi"(path to image file=path "")
    }
  }
