vi "MEM IO Read Longs.gvi"   [LabVIEW Platform Developer Preview 0.1.0]
# This function reads in a number of long words starting at the specified physical memory adres.
inputs:
  "address": u32  # Physical adres from which to start reading.
  "type": u32[]
  "size": i32  # Number of long words to read.
  "error in (no error)": error
outputs:
  "data": u32[]
  "error out": error
uses:
  OpenG.Port IO::ogportio.sli::PortIOReadMem_2
  OpenG.Port IO::PORT IO Error Translation.gvi
diagram:
  Property Node(instance in=$"error in (no error)") -> ("status"=w1)
  case (w1) {
    frame False, Default {
      Multiply($size, 4) -> w4
      Reshape Array(inArray=$type, size=$size) -> w5
      call "PortIOReadMem_2"(address in=$address, size in=w4, unit in=4, value in=w5) -> (return=w6, value out=w3)
      call "PORT IO Error Translation.gvi"(win error=w6, error in (no error)=$"error in (no error)") -> (error out=w2)
    }
    frame True {
      w2 = $"error in (no error)"
      w3 = $type
    }
  }
  $data <- w3
  $"error out" <- w2
