vi "MEM IO Write Bytes.gvi"   [LabVIEW Platform Developer Preview 0.1.0]
# This function writes out a number of bytes starting at the specified physical memory adres.
inputs:
  "address": u32  # Physical adres from which to start reading.
  "data": u8[]
  "error in (no error)": error
outputs:
  "error out": error
uses:
  OpenG.Port IO::ogportio.sli::PortIOWriteMem
  OpenG.Port IO::PORT IO Error Translation.gvi
diagram:
  Property Node(instance in=$"error in (no error)") -> ("status"=w1)
  case (w1) {
    frame False, Default {
      Array Size(array=$data) -> (size(s)=w3)
      call "PortIOWriteMem"(address in=$address, size in=w3, unit in=1, value in=$data) -> (return=w4)
      call "PORT IO Error Translation.gvi"(win error=w4, error in (no error)=$"error in (no error)") -> (error out=w2)
    }
    frame True {
      w2 = $"error in (no error)"
    }
  }
  $"error out" <- w2
