vi "PORT IO Disable Range.gvi"   [LabVIEW Platform Developer Preview 0.1.0]
# This function disables user space access to a range of IO ports for the current process. This function has no effect on Windows 95/98/ME based operating systems.
inputs:
  "start address": u16
  "size": u16
  "error in (no error)": error
outputs:
  "error out": error
uses:
  OpenG.Port IO::ogportio.sli::PortIOReleasePort
  OpenG.Port IO::PORT IO Error Translation.gvi
diagram:
  Property Node(instance in=$"error in (no error)") -> ("status"=w1)
  case (w1) {
    frame False, Default {
      call "PortIOReleasePort"(process in=0, start in=$"start address", size in=$size) -> (return=w3)
      call "PORT IO Error Translation.gvi"(win error=w3, error in (no error)=$"error in (no error)") -> (error out=w2)
    }
    frame True {
      w2 = $"error in (no error)"
    }
  }
  $"error out" <- w2
