vi "PORT IO Get Version.gvi"   [LabVIEW Platform Developer Preview 0.1.0]
# The version number contains the device driver version number in the high order word and the user space shared library version number in the low order word. For Windows 95/98/ME there is no device driver and the high order word is set to 0.
# The two version numbers are in hexadecimal notation "major, minor, bugfix" (eg. 0x0115 for major = 1, minor = 1, fix = 5).
# The called library function determines on Windows NT based systems if the device driver has been already installed and activated and in the case it hasn't will do so automatically. For this to work however the current user needs to have administrator rights and the ogportio.sys driver needs to be present in the same directory as the called shared library ogportio.dll file.
inputs:
  "error in (no error)": error
outputs:
  "version": u32  # The version number contains the device driver version number in the high order word and the user space shared library version number in the low order word. For Windows 95/98/ME there is no device driver and the high order word is set to 0. The two version numbers are in hexadecimal notation "major, minor, bugfix" (eg. 0x0115 for major = 1, minor = 1, fix = 5).
  "error out": error
uses:
  OpenG.Port IO::ogportio.sli::PortIOGetVersion
  OpenG.Port IO::PORT IO Error Translation.gvi
diagram:
  Property Node(instance in=$"error in (no error)") -> ("status"=w1)
  case (w1) {
    frame False, Default {
      call "PortIOGetVersion"(version in=0) -> (return=w4, version out=w2)
      call "PORT IO Error Translation.gvi"(win error=w4, error in (no error)=$"error in (no error)") -> (error out=w3)
    }
    frame True {
      w2 = 0
      w3 = $"error in (no error)"
    }
  }
  $version <- w2
  $"error out" <- w3
