vi "PORT IO Uninstall Driver.gvi"   [LabVIEW Platform Developer Preview 0.1.0]
# This VI uninstalls the device driver if it is installed. The current user needs to have administrator rights for this to work properly.
inputs:
  "error in (no error)": error
outputs:
  "error out": error
uses:
  OpenG.Port IO::ogportio.sli::RemovePortIO
  OpenG.Port IO::PORT IO Error Translation.gvi
diagram:
  Property Node(instance in=$"error in (no error)") -> ("status"=w1)
  case (w1) {
    frame False, Default {
      call "RemovePortIO"() -> (return=w3)
      call "PORT IO Error Translation.gvi"(win error=w3, error in (no error)=$"error in (no error)") -> (error out=w2)
    }
    frame True {
      w2 = $"error in (no error)"
    }
  }
  $"error out" <- w2
