vi "Number to Proper Engl Text.gvi"   [LabVIEW Platform Developer Preview 0.1.0]
# Converts a number to proper English text.  Rounds off to whole numbers and can handle up to 10^63 (vigintillion) places.
inputs:
  "Numeric": f64, required
outputs:
  "String": string
panel indicators:
  "hasHundredsPlace": bool
  "hasTensPlace": bool
  "isTeen": bool
  "hasOnesPlace": bool
diagram:
  Format Into String(formatString="%0.0f", $Numeric) -> w1
  Reverse String(string=w1) -> (reversed=w2)
  String Length(string=w1) -> (length=w3)
  Divide(x=w3, y=3) -> w4
  Round Toward Positive Infinity(x=w4) -> w5
  s1 = w2  # shift register
  for (N = w5) {
    Search Or Split String(offset=3, string=s1) -> (match + rest of string=w7, substring before match=w8)
    append w8 to w6
    next s1 = w7
  }
  Reverse String(string=w6) -> (reversed=w9)
  Reverse 1D Array(array=w9) -> (reversed array=w10)
  s2 = ""  # shift register
  for (N -> w11) (iteration -> i1) {
    w12 = each element of w10
    Reverse String(string=w12) -> (reversed=w13)
    sequence {
      frame 0 {
        $isTeen <- FALSE
        $hasOnesPlace <- FALSE
        $hasTensPlace <- FALSE
        $hasHundredsPlace <- FALSE
      }
      frame 1 {
        String Length(string=w13) -> (length=w14)
        Is Equal(x=w14, y=3) -> w15
        case (w15) {
          frame False, Default { }
          frame True {
            String Subset(length (rest)=1, offset (0)=2, string=w13) -> w16
            Is Not Equal(x=w16, y="0") -> w17
            $hasHundredsPlace <- w17
          }
        }
        Is Greater Or Equal(x=w14, y=1) -> w18
        case (w18) {
          frame False, Default { }
          frame True {
            String Subset(length (rest)=1, offset (0)=0, string=w13) -> w19
            Is Not Equal(x=w19, y="0") -> w20
            $hasOnesPlace <- w20
          }
        }
        Is Greater Or Equal(x=w14, y=2) -> w21
        case (w21) {
          frame False, Default { }
          frame True {
            String Subset(length (rest)=1, offset (0)=1, string=w13) -> w22
            Is Not Equal(x=w22, y="0") -> w23
            $hasTensPlace <- w23
            Is Equal(x=w22, y="1") -> w24
            String Subset(length (rest)=1, offset (0)=0, string=w13) -> w25
            Is Not Equal(x=w25, y="0") -> w26
            Logical And(w24, w26) -> w27
            $isTeen <- w27
          }
        }
      }
      frame 2 {
        w28 = "\none\ntwo\nthree\nfour\nfive\nsix\nseven\neight\nnine"  # onesPlaceDict
        case ($hasHundredsPlace) {
          frame False, Default {
            w29 = ""
          }
          frame True {
            String Subset(length (rest)=1, offset (0)=2, string=w13) -> w30
            Scan From String(inputString=w30, default=1) -> (out0=w31)
            Pick Line(line index=w31, multi-line string=w28) -> (output string=w32)
            Concatenate Strings("", w32, " hundred") -> w29
          }
        }
        w33 = "\nten\ntwenty\nthirty\nforty\nfifty\nsixty\nseventy\neighty\nninety"  # tensPlaceDict
        Logical And($hasTensPlace, not $isTeen) -> w34
        case (w34) {
          frame False, Default {
            w35 = w29
          }
          frame True {
            Is Empty String Or Path(string/path=w29) -> w36
            Concatenate Strings(w29, " ") -> w37
            Select(s=w36, t=w29, f=w37) -> w38
            String Subset(length (rest)=1, offset (0)=1, string=w13) -> w39
            Scan From String(inputString=w39, default=1) -> (out0=w40)
            Pick Line(line index=w40, multi-line string=w33) -> (output string=w41)
            Concatenate Strings(w38, w41) -> w35
          }
        }
        w42 = "\neleven\ntwelve\nthirteen\nfourteen\nfifteen\nsixteen\nseventeen\neighteen\nnineteen"  # teensDict
        case ($isTeen) {
          frame False, Default {
            case ($hasOnesPlace) {
              frame False, Default {
                w43 = w35
              }
              frame True {
                case ($hasTensPlace) {
                  frame False, Default {
                    Is Empty String Or Path(string/path=w35) -> w45
                    Concatenate Strings(w35, " ") -> w46
                    Select(s=w45, t=w35, f=w46) -> w44
                  }
                  frame True {
                    Concatenate Strings(w35, "-") -> w44
                  }
                }
                String Subset(length (rest)=1, offset (0)=0, string=w13) -> w47
                Scan From String(inputString=w47, default=1) -> (out0=w48)
                Pick Line(line index=w48, multi-line string=w28) -> (output string=w49)
                Concatenate Strings(w44, w49) -> w43
              }
            }
          }
          frame True {
            Is Empty String Or Path(string/path=w35) -> w50
            Concatenate Strings(w35, " ") -> w51
            Select(s=w50, t=w35, f=w51) -> w52
            String Subset(length (rest)=1, offset (0)=0, string=w13) -> w53
            Scan From String(inputString=w53, default=1) -> (out0=w54)
            Pick Line(line index=w54, multi-line string=w42) -> (output string=w55)
            Concatenate Strings(w52, w55) -> w43
          }
        }
      }
    }
    Subtract(x=w11, y=i1) -> w56
    Decrement(x=w56) -> w57
    w58 = """
thousand
million
billion
trillion
quadrillion
quintillion
sextillion
septillion
octillion
nonillion
decillion
undecillion
duodecillion
tredecillion
uattuordecillion
quindecillion
sexdecillion
septendecillion
octodecillion
novemdecillion
vigintillion"""  # largeNamesDict
    Is Empty String Or Path(string/path=w43) -> w59
    case (w59) {
      frame False, Default {
        Is Empty String Or Path(string/path=s2) -> w61
        Concatenate Strings(s2, " ") -> w62
        Select(s=w61, t=s2, f=w62) -> w63
        Concatenate Strings(w63, w43) -> w64
        Pick Line(line index=w57, multi-line string=w58) -> (output string=w65)
        Is Empty String Or Path(string/path=w65) -> w66
        Concatenate Strings(w64, " ", w65) -> w67
        Select(s=w66, t=w64, f=w67) -> w60
      }
      frame True {
        w60 = s2
      }
    }
    next s2 = w60
  }
  Is Empty String Or Path(string/path=s2) -> w68
  Select(s=w68, t="zero", f=s2) -> w69
  $String <- w69
