vi "Trim Whitespace (String).gvi"   [LabVIEW Platform Developer Preview 0.1.0]
# Removes leading and/or trailing whitespace from a string.
# Whitespace is defined as any of the following characters (where values are in the format: dec, hex, string):
#   tab = 9, 0x09, \t
#   newline = 10,  0x0A, \n
#   vertical tab = 11, 0x0B, \0B
#   form feed = 12, 0x0C, \f
#   carriage return = 13, 0x0D, \r
#   space = 32, 0x20, \s
# This VI 's execution is set to subroutine
# This VI is reentrant
inputs:
  "String in": string, required
  "Remove (leading and trailing)": enum{"leading", "trailing", "both"} = "both"
outputs:
  "String out": string
diagram:
  # ASCII Whitespace Lookup Table returns True for the ASCII Characters (where values are in the format: dex, hex, string):
  #   tab = 9, 0x09, \t
  #   newline = 10,  0x0A, \n
  #   vertical tab = 11, 0x0B, \0B
  #   form feed = 12, 0x0C, \f
  #   carriage return = 13, 0x0D, \r
  #   space = 32, 0x20, \s
  #
  # Lookup Table has been optimized to contain values for the first 33 ASCII Characters (0 to 0x20) as indexing any other Character would return False.
  w1 = [FALSE, FALSE, FALSE, FALSE, FALSE, FALSE, FALSE, FALSE, FALSE, TRUE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]  # ASCII Whitespace Lookup Table
  String To Byte Array(encoding="Extended ASCII", string=$"String in") -> (unsigned byte array=w2)
  case ($"Remove (leading and trailing)") {  # Beginning of String
    frame Default {
      for (iteration -> i1) {
        w4 = each element of w2
        To Long Integer(number=w4) -> w5
        Array Index(array=w1) -> (out0[w5]=w6)
        continue if w6
      }
      w3 = i1
    }
    frame "trailing" {
      w3 = default
    }
  }
  String Length(string=$"String in") -> (length=w7)
  Reverse 1D Array(array=w2) -> (reversed array=w8)
  case ($"Remove (leading and trailing)") {  # End of String
    frame Default {
      for (iteration -> i2) {
        w10 = each element of w8
        To Long Integer(number=w10) -> w11
        Array Index(array=w1) -> (out0[w11]=w12)
        continue if w12
      }
      Boolean To Integer(Boolean=w12) -> (0, 1=w13)
      To Long Integer(number=w13) -> w14
      Add(w14, i2) -> w9
    }
    frame "leading" {
      w9 = default
    }
  }
  Add(w7, not w3, not w9) -> w15
  String Subset(length (rest)=w15, offset (0)=w3, string=$"String in") -> w16
  $"String out" <- w16
