vi "Trim Whitespace Lookup Table.gvi"   [LabVIEW Platform Developer Preview 0.1.0]
panel indicators:
  "ASCII Whitespace Lookup Table": bool[]
diagram:
  w1 = 256  # Number of Characters in U8
  # Generate ASCII Whitespace Lookup Table
  #
  # This lookup table is used in 'Trim Whitespace (String).vi'
  #
  # 1. Return If (ASCII Characters 0 to 255 == Whitespace) using Lexical Class primative
  # 2. Optimize the Lookup Table by subsetting the array.
  #       Find the last Whitespace element and remove all elements after that
  for (N = w1) (iteration -> i1) {
    w3 = 2  # Whitespace Class
    To Unsigned Byte Integer(number=i1) -> w4
    Build Array(w4) -> w5
    Byte Array To String(encoding="Extended ASCII", unsigned byte array=w5) -> (string=w6)
    Lexical Class(character=w6) -> (class=w7)
    # 1.
    Is Equal(x=w7, y=w3) -> w8
    append w8 to w2
  }
  Array Size(array=w2) -> (size(s)=w9)
  Reverse 1D Array(array=w2) -> (reversed array=w10)
  # 2.
  Search 1D Array(1D array=w10, element=TRUE) -> (index of element=w11)
  Subtract(x=w9, y=w11) -> w12
  Array Subset(array=w2, length0=w12) -> w13
  $"ASCII Whitespace Lookup Table" <- w13
