vi "Periodic Trigger.gvi"   [LabVIEW Platform Developer Preview 0.1.0]
# This VI will periodically output a Boolean TRUE on a specified time interval.  The internal timer's counter can be reset to zero, via the "reset" Boolean input.
inputs:
  "time (ms)": u32, required
  "reset": bool
outputs:
  "Triggered": bool
  "time since last call": u32
  "timer value": u32
diagram:
  Is First Call() -> w1
  Logical Or(w1, $reset) -> w2
  s1 = uninitialised  # shift register
  s2 = uninitialised  # shift register
  while {
    Tick Count() -> (timer value=w3)
    Select(s=w2, t=w3, f=s1) -> w4
    Subtract(x=w3, y=w4) -> w5
    $"time since last call" <- w5
    Select(s=w2, t=w3, f=s2) -> w6
    Subtract(x=w3, y=w6) -> w7
    Is Greater(x=w7, y=$"time (ms)") -> w8
    Select(s=w8, t=w3, f=w6) -> w9
    $"timer value" <- w7
    $Triggered <- w8
    next s1 = w3
    next s2 = w9
    continue if FALSE
  }
