vi "VI Tree - time.gvi"   [LabVIEW Platform Developer Preview 0.1.0]
uses:
  OpenG.Time::Wait Until Next ms Multiple.gvi
  OpenG.Time::Tick Count (ms).gvi
  OpenG.Time::Wait (ms).gvi
  OpenG.Time::Periodic Trigger.gvi
diagram:
  call "Wait Until Next ms Multiple.gvi"(milliseconds to wait=0)  # Wait Until Next ms Multiple (OpenG)
  call "Tick Count (ms).gvi"()  # Tick Count (ms) (OpenG)
  call "Wait (ms).gvi"(milliseconds to wait=0)  # Wait (ms) (OpenG)
  call "Periodic Trigger.gvi"(time (ms)=0)
