vi "Wait Until Next ms Multiple.gvi"   [LabVIEW Platform Developer Preview 0.1.0]
# Wait Until Next ms Multiple primitive with added error handling.  This VI will not wait if an error is passed into it unless the Wait on Error input is set to TRUE.
inputs:
  "milliseconds to wait": u32, required
  "Wait on Error (FALSE)": bool
  "error in (no error)": error
outputs:
  "millisecond timer value": u32
  "error out": error
diagram:
  # Wait if No Error or Wait on Error
  Property Node(instance in=$"error in (no error)") -> ("status"=w1)
  Logical Or(not w1, $"Wait on Error (FALSE)") -> w2
  case (w2) {
    frame False, Default {
      Tick Count() -> (timer value=w3)
    }
    frame True {
      Wait Until Next Multiple(multiple to wait=$"milliseconds to wait") -> (timer value=w3)
    }
  }
  $"millisecond timer value" <- w3
  $"error out" <- $"error in (no error)"
