vi "Encode Section and Key Names.gvi"   [LabVIEW Platform Developer Preview 0.1.0]
# Encodes and decodes section and key names.
# Escapes the following:
#     \ (escape code special character escaped as \\)
#     \00-\1F (non-printable chars)
#     "[", "]", and "=" (INI syntax elements)
#     \FE ("þ") and \FF ("ÿ") (legacy encoding)
# Legacy encoding encodes brackets, "[" and "]", as special characters "þ" and "ÿ".
inputs:
  "string": string, required
  "use legacy encoding scheme? (FALSE)": bool
outputs:
  "encoded string": string
diagram:
  case ($"use legacy encoding scheme? (FALSE)") {
    frame False, Default {
      # Convert CR and LF hex to "\r" and "\n" for improved readability.
      Search And Replace String(input string=$string, replace all (F)=TRUE, replace string ("")="\\\\", search string="\\") -> (result string=w2)
      # escape the following:
      #
      #     \00-\1F (non-printable chars)
      #     "[", "]", and "=" (INI syntax elements)
      #     \FE ("þ") and \FF ("ÿ") (legacy encoding)
      w3 = "[\\00\\01\\02\\03\\04\\05\\06\\07\\08\\09\\0A\\0B\\0C\\0D\\0E\\0F\\10\\11\\12\\13\\14\\15\\16\\17\\18\\19\\1A\\1B\\1C\\1D\\1E\\1F[\\]=\\FE\\FF]"  # Escaped Characters
      # Current Encoding Scheme
      # Replace all "\" characters with "\\"
      s1 = w2  # shift register
      s2 = 0  # shift register
      while {  # While Found a Character to Escape: Escape Character
        # Search for character
        Match Pattern(offset (0)=s2, regular expression=w3, string=s1) -> (after substring=w4, before substring=w5, match substring=w6, offset past match=w7)
        Is Not Equal(x=w7, y=-1) -> w8
        # Character Found?
        # found a char?
        # continue?
        case (w8) {  # Escape Character as "\xx"
          frame False, Default {
            w9 = w5
          }
          frame True {
            To Unsigned Byte Integer(number=0) -> w10
            Type Cast(type=w10, x=w6) -> w11
            Format Into String(formatString="\\\\%02x", initString=w5, w11) -> w12
            # convert char to U8 and format it as "\xx".
            Concatenate Strings(w12, w4) -> w9
          }
        }
        next s1 = w9
        next s2 = w7
        continue if w8
      }
      Search And Replace String(input string=s1, replace all (F)=TRUE, replace string ("")="\\r", search string="\\0D") -> (result string=w13)
      Search And Replace String(input string=w13, replace all (F)=TRUE, replace string ("")="\\n", search string="\\0A") -> (result string=w1)
    }
    frame True {
      # Legacy Encoding Scheme
      # Normal Display
      # Encode brackets, "[" and "]", as special characters "þ" and "ÿ".
      Search And Replace String(input string=$string, replace all (F)=TRUE, replace string ("")="þ", search string="[") -> (result string=w14)
      # Normal Display
      Search And Replace String(input string=w14, replace all (F)=TRUE, replace string ("")="ÿ", search string="]") -> (result string=w1)
    }
  }
  $"encoded string" <- w1
