vi "Read Panel from INI.gvi"   [LabVIEW Platform Developer Preview 0.1.0]
# Read the values of the controls on the Front Panel of VI ref from a standard LabVIEW configuration (INI) file.
# Use this VI in conjunction with the Write Panel to INI from the OpenG Variant Config palette.
inputs:
  "refnum": "Config Data RefNum.gtype", required  # refnum is the reference number of the configuration data
  "VI ref": VIRefnum, required
  "error in (no error)": error
outputs:
  "refnum out": "Config Data RefNum.gtype"  # refnum is the reference number of the configuration data
  "error out": error
types:
  "Config Data RefNum.gtype" = i32
uses:
  OpenG.Variant Configuration::Read Key (Variant).gvi
diagram:
  $"refnum out" <- $refnum
  w1 = TRUE  # controls
  Invoke Node: Ctrl Val.Get All(VI ref Input 0=$"VI ref", error in (no error) Input 1=$"error in (no error)", Controls Input 2=w1) -> (VI ref Output 0=w2, error out Output 1=w3, Get All Control Values Variant Output 2=w4)  # Invoke Node: Ctrl Val.Get All (Placeholder)
  w5 = FALSE  # indicators
  Invoke Node: Ctrl Val.Get All(VI ref Input 0=w2, error in (no error) Input 1=w3, Controls Input 2=w5) -> (VI ref Output 0=w6, error out Output 1=w7, Get All Control Values Variant Output 2=w8)  # Invoke Node: Ctrl Val.Get All (Placeholder)
  Build Array[ConcatenateInputs=True](w8, w4) -> w9
  Property Node[IsPlaceholderNodeForConversion=True](instance in=w6, error in=w7) -> ("Name"=w10, instance out=w11)
  s1 = w7  # shift register
  for {
    w12 = each element of w9
    Property Node(instance in=w12) -> ("Name"=w13, "Variant Data"=w14)
    call "Read Key (Variant).gvi"(refnum=$refnum, key (optional)=w13, type=w14, error in (no error)=s1, section=w10) -> (key-value=w15, error out=w16)
    Invoke Node: Ctrl Val.Set(VI ref Input 0=w11, error in (no error) Input 1=w16, Control Name Input 2=w13, Value Input 3=w15) -> (error out Output 1=w17)  # Invoke Node: Ctrl Val.Set (Placeholder)
    next s1 = w17
  }
  $"error out" <- s1
