vi "Get Last PString.gvi"   [LabVIEW Platform Developer Preview 0.1.0]
# Returns the last PString from the end of the string and the offset of the beginning of the string.
inputs:
  "String": string, required
outputs:
  "Last PString": string
  "PString Offset": i32
diagram:
  # Remove Pad, if present
  Match Pattern(regular expression="$", string=$String) -> (before substring=w1)
  String Length(string=w1) -> (length=w2)
  String Length(string=w1) -> (length=w3)
  while (iteration -> i1) {
    Is Equal(x=w3, y=i1) -> w4
    Increment(x=i1) -> w5
    Subtract(x=w3, y=w5) -> w6
    String Subset(length (rest)=1, offset (0)=w6, string=w1) -> w7
    Type Cast(type=u8 0, x=w7) -> w8
    Is Equal(x=w8, y=i1) -> w9
    Logical Or(w9, w4) -> w10
    stop if w10
  }
  Subtract(x=w2, y=w8) -> w11
  String Subset(offset (0)=w11, string=w1) -> w12
  $"Last PString" <- w12
  $"PString Offset" <- w11
