vi "Get PString.gvi"   [LabVIEW Platform Developer Preview 0.1.0]
# Returns the PString starting at offset.
inputs:
  "String": string, required
  "offset (0)": i32
outputs:
  "PString": string
  "offset past PString": i32
diagram:
  String To Byte Array(encoding="Extended ASCII", string=$String) -> (unsigned byte array=w1)
  Array Index(array=w1) -> (out0[$"offset (0)"]=w2)
  # # of chars
  Increment(x=$"offset (0)") -> w3
  Add(w2, w3) -> w4
  $"offset past PString" <- w4
  String Subset(length (rest)=w2, offset (0)=w3, string=$String) -> w5
  $PString <- w5
