vi "Split Cluster TD.gvi"   [LabVIEW Platform Developer Preview 0.1.0]
# Splits the TD of a Cluster into its elements TDs.
inputs:
  "Type Descriptor": "Type Descriptor.gtype", required
  "error in (no error)": error
outputs:
  "Type Descriptors": T1[]
  "error out": error
types:
  "Type Descriptor.gtype" = i16[]
  T1 = cluster{"Type Descriptor": "Type Descriptor.gtype"}
  "Type Descriptor__ogtk.gtype" = i16[]
  T2 = cluster{"Element 1": "Type Descriptor__ogtk.gtype"}
uses:
  OpenG.Variant Data::Get Header from TD.gvi
  OpenG.Error::Build Error Cluster.gvi
diagram:
  case ($"error in (no error)") {
    frame No Error {
      call "Get Header from TD.gvi"(Type Descriptor=$"Type Descriptor") -> (Type Descriptor Header=w3)
      Property Node(instance in=w3) -> ("type"=w4, "# elements"=w5)
      case (w4) {
        frame Default {
          Format Into String(formatString="Unexpected Datatype <%s>", w4) -> w6
          call "Build Error Cluster.gvi"(code="Argument error"(1), String to Prepend to source ("")=w6) -> (error out=w2)
          w1 = cluster{"Element 1": i16[]}[] []
        }
        frame "Cluster" {
          w7 = 3  # Offset past Cluster TD Header
          s1 = w7  # shift register
          for (N = w5) {  # For Each Element in Cluster
            # cluster element offset
            w8 = 2  # bytes per I16
            Array Index(array=$"Type Descriptor") -> (out0[s1]=w9)
            To Unsigned Word Integer(number=w9) -> w10
            Quotient And Remainder(x=w10, y=w8) -> (floor(x/y)=w11)
            # Convert length to U16 before math.
            # Get TD Length
            To Long Integer(number=w11) -> w12
            # this offset + this length = next offset
            Add(w12, s1) -> w13
            # Get Element TD Subset from Cluster TD
            Array Subset(array=$"Type Descriptor", index0=s1, length0=w12) -> w14
            Property Node(instance in=T2 {all zero or empty}, "Element 1"=w14) -> (instance out=w15)
            append w15 to w1
            next s1 = w13
          }
          w2 = no error
        }
      }
    }
    frame Error {
      w1 = cluster{"Element 1": i16[]}[] []
      w2 = $"error in (no error)"
    }
  }
  $"error out" <- w2
  $"Type Descriptors" <- w1
