vi "VI Tree - lvdata.gvi"   [LabVIEW Platform Developer Preview 0.1.0]
panel controls:
  "Type Descriptor Enumeration": "Type Descriptor Enumeration.gtype" = "<Null>"
  "Refnum Code": "Refnum Code.gtype" = "Not a Refnum"
  "Base Units": "Base Units.gtype" = "radian"
  "Physical Units": "Physical Units.gtype"
  "Type Descriptor": "Type Descriptor.gtype"
  "Waveform Subtype Enum": "Waveform Subtype Enum.gtype" = "<Not a Waveform Type>"
  "Refnum Subtype Enum": "Refnum Subtype Enum.gtype" = "Generic"
panel indicators:
  "Type Descriptor Header": "Type Descriptor Header.gtype"  # Holds the info contained in a type descriptor header.
types:
  "Type Descriptor Enumeration.gtype" = enum{"<Null>", "I8", "I16", "I32", "I64", "U8", "U16", "U32", "U64", "SGL", "DBL", "EXT", "CSG", "CDB", "CXT", "0x0F", "0x10", "0x11", "0x12", "0x13", "0x14", "Enum U8", "Enum U16", "Enum U32", "Enum U64", "SGL PQ", "DBL PQ", "EXT PQ", "CSG PQ", "CDB PQ", "CXT PQ", "0x1F", "0x20", "Boolean", "0x22", "0x23", "0x24", "0x25", "0x26", "0x27", "0x28", "0x29", "0x2A", "0x2B", "0x2C", "0x2D", "0x2E", "0x2F", "String", "0x31", "Path", "Pict", "0x34", "0x35", "0x36", "DAQ", "0x38", "0x39", "0x3A", "0x3B"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}
  "Type Descriptor Header.gtype" = cluster{"length": u16, "private": u8, "type": "Type Descriptor Enumeration.gtype", "# elements": u16}
  "Refnum Code.gtype" = enum{"Not a Refnum", "Datalog File", "Byte Stream File", "0x03", "Occurence", "TCP", "0x06", "ActiveX", "Generic VI Server Class", "Menu", "0x0A", "IMAQ Session", "0x0C", "0x0D", "VISA", "IVI", "UDP"}
  "Base Units.gtype" = enum{"radian", "steradian", "second", "meter", "kilogram", "ampere", "kelvin", "mole", "candela"}
  T1 = enum{"radian", "steradian", "second", "meter", "kilogram", "ampere", "kelvin", "mole", "candela"}
  "Physical Units.gtype" = cluster{"Base Units": T1, "Exponent": i16}
  "Type Descriptor.gtype" = i16[]
  "Waveform Subtype Enum.gtype" = enum{"<Not a Waveform Type>", "0x01", "Analog 16-bit signed", "Analog Double-Precision", "0x04", "Analog Single Precision", "Timestamp", "Digital Data", "Digital Waveform", "Dynamic Data", "Analog Extended-Precision", "Analog 8-bit unsigned", "Analog 16-bit unsigned", "Analog 32-bit unsigned", "Analog 8-bit signed", "Analog 32-bit signed", "Analog Complex Single-Precision", "Analog Complex Double-Precision", "Analog Complex Extended Precision", "Analog 64-bit signed", "Analog 64-bit unsigned"}
  "Refnum Subtype Enum.gtype" = enum{"Generic", "Datalog File Refnum", "Byte Stream File Refnum", "Device Refnum", "Occurence Refnum", "TCP Connection Refnum", "VISA Refnum (Obsolete)", "Automation Renum", "VI Server Refnum", "Menu Refnum", "IVI Refnum (Obsolete)", "IMAQ Session", "0x0C", "Datasocket Refnum", "VISA Resource", "IVI Logical Name", "UDP Connection Refnum", "Notifier Refnum", "Queue Refnum", "IrDA Refnum", "Hardware Plugin Refnum", "Hardware Plugin Tag Refnum", "DAQmx Refnum", "Event Registration Refnum", ".NET Refnum", "User Event Refnum", "0x1A", "Event Callback", "0x1C", "0x1D", "Only Used Internal to LabVIEW", "Bluetooth", "Data Value References", "RT FIFO", "TDM Streaming"}
  T2 = cluster{"Type Descriptor": "Type Descriptor.gtype"}
uses:
  OpenG.Variant Data::Get TDEnum from TD.gvi
  OpenG.Variant Data::Get Data Name.gvi
  OpenG.Variant Data::Array Size(s).gvi
  OpenG.Variant Data::Cluster to VArray.gvi
  OpenG.Variant Data::Get Cluster Element Names.gvi
  OpenG.Variant Data::Get Strings from Enum.gvi
  OpenG.Variant Data::LVOOP Get Default Object.gvi
  OpenG.Variant Data::Get Default Data from TD.gvi
  OpenG.Variant Data::Reshape Array to 1D VArray.gvi
  OpenG.Variant Data::Set Cluster Element by Name.gvi
  OpenG.Variant Data::Array to VCluster.gvi
  OpenG.Variant Data::Set Enum String Value.gvi
  OpenG.Variant Data::Set Data Name.gvi
  OpenG.Variant Data::Get Header from TD.gvi
  OpenG.Variant Data::LVOOP Is Default Value.gvi
  OpenG.Variant Data::Get Data Name from TD.gvi
  OpenG.Variant Data::Index Array.gvi
  OpenG.Variant Data::No of Elements in Cluster.gvi
  OpenG.Variant Data::Get Variant Attributes.gvi
  OpenG.Variant Data::Cluster to Array of VData.gvi
  OpenG.Variant Data::Unwrap VVariant.gvi
  OpenG.Variant Data::Size of Data from TD.gvi
  OpenG.Variant Data::Get Cluster Element by Name.gvi
  OpenG.Variant Data::LVOOP Is Same Or Descendant Class.gvi
  OpenG.Variant Data::Replace Array Element.gvi
  OpenG.Variant Data::Array of VData to VCluster.gvi
  OpenG.Variant Data::Get Default Data from Variant.gvi
  OpenG.Variant Data::Split Cluster TD.gvi
  OpenG.Variant Data::Get Cluster Elements TDs.gvi
  OpenG.Variant Data::Array to Array of VData.gvi
  OpenG.Variant Data::LVOOP Return Class Name.gvi
  OpenG.Variant Data::Variant to Header Info.gvi
  OpenG.Variant Data::Parse String with TDs.gvi
  OpenG.Variant Data::Get GOOP Object Type.gvi
  OpenG.Variant Data::Array of VData to VArray.gvi
  OpenG.Variant Data::Array Dim(s) from TD.gvi
  OpenG.Variant Data::Strip Units.gvi
  OpenG.Variant Data::Get TDEnum from Data.gvi
  OpenG.Variant Data::Get Data TD from Datalog Ref.gvi
  OpenG.Variant Data::Get Waveform Type Enum from Data.gvi
  OpenG.Variant Data::Get Element TD from Array TD.gvi
  OpenG.Variant Data::Get Array Element TD.gvi
  OpenG.Variant Data::Get Physical Units.gvi
  OpenG.Variant Data::Get Refnum Type Enum from Data.gvi
  OpenG.Variant Data::Get Physical Units from TD.gvi
  OpenG.Variant Data::Get Array Element TDEnum.gvi
  OpenG.Variant Data::Variant Constant.gvi
  OpenG.Variant Data::Compute 1D Index.gvi
  OpenG.Variant Data::Remove Typedefs from Variant.gvi
  OpenG.Variant Data::Reshape 1D Array.gvi
  OpenG.Variant Data::Get Last PString.gvi
  OpenG.Variant Data::Get Strings from Enum TD.gvi
  OpenG.Variant Data::Get Array Element Default Data.gvi
  OpenG.Variant Data::Get PString.gvi
  OpenG.Variant Data::Get Waveform Type Enum from TD.gvi
  OpenG.Variant Data::Get Refnum Type Enum from TD.gvi
  OpenG.Variant Data::Variant Manipulation Templ.gvi
diagram:
  # Type Descriptor
  call "Get TDEnum from TD.gvi"(Type Descriptor="Type Descriptor.gtype" [])
  # Variant
  call "Get Data Name.gvi"(Data=variant())
  # VArray
  call "Array Size(s).gvi"(Array=variant())
  # VArray <==> VCluster
  call "Cluster to VArray.gvi"(Cluster=variant())
  # VCluster
  call "Get Cluster Element Names.gvi"(Cluster=variant())
  # VEnum
  call "Get Strings from Enum.gvi"(Enum=variant())
  # LVOOP
  call "LVOOP Get Default Object.gvi"(Object=gObject constant)
  call "Get Default Data from TD.gvi"(Type Descriptor="Type Descriptor.gtype" [])
  call "Reshape Array to 1D VArray.gvi"(MultiD Array=variant())
  call "Set Cluster Element by Name.gvi"(Cluster=variant(), New Element Value=variant())
  call "Array to VCluster.gvi"(Array=variant())
  # VVariant
  call "Set Enum String Value.gvi"(Default Enum Value=variant(), String Value="")
  call "Set Data Name.gvi"(Data=variant(), Data Name="")
  call "Get Header from TD.gvi"(Type Descriptor="Type Descriptor.gtype" [])
  call "LVOOP Is Default Value.gvi"(Object=gObject constant)
  call "Get Data Name from TD.gvi"(Type Descriptor="Type Descriptor.gtype" [])
  call "Index Array.gvi"(MultiD Array=variant())
  call "No of Elements in Cluster.gvi"(Cluster=variant())
  call "Get Variant Attributes.gvi"(Variant=variant())
  call "Cluster to Array of VData.gvi"(Cluster=variant())
  call "Unwrap VVariant.gvi"(VVariant=variant())
  call "Size of Data from TD.gvi"(Type Descriptor="Type Descriptor.gtype" [])
  call "Get Cluster Element by Name.gvi"(Cluster=variant(), Element Name="")
  call "LVOOP Is Same Or Descendant Class.gvi"(Object=gObject constant, Possible Descendant Object=gObject constant)  # Is Same Or Descendant Class?
  call "Replace Array Element.gvi"(MultiD Array=variant(), New Element=variant())
  call "Array of VData to VCluster.gvi"(Array=variant[] [])
  call "Get Default Data from Variant.gvi"(Variant=variant())
  call "Split Cluster TD.gvi"(Type Descriptor="Type Descriptor.gtype" [])
  call "Get Cluster Elements TDs.gvi"(Cluster=variant())
  call "Array to Array of VData.gvi"(MultiD Array=variant())
  call "LVOOP Return Class Name.gvi"(Object=gObject constant)
  call "Variant to Header Info.gvi"(Variant=variant())
  call "Parse String with TDs.gvi"(Type Descriptors=T2[] [], Data string="")
  # Other
  call "Get GOOP Object Type.gvi"(GOOP Refnum=variant())
  call "Array of VData to VArray.gvi"(1D Array of VData=variant[] [], Array Name="")
  call "Array Dim(s) from TD.gvi"(Array Type Descriptor="Type Descriptor.gtype" [])
  # VNumeric
  call "Strip Units.gvi"(Number or 1D array with units=variant())
  call "Get TDEnum from Data.gvi"(Data=variant())
  call "Get Data TD from Datalog Ref.gvi"(Datalog Refnum=variant())
  # Typedef & Template
  call "Get Waveform Type Enum from Data.gvi"(Data=variant())
  call "Get Element TD from Array TD.gvi"(Array Type Descriptor="Type Descriptor.gtype" [])
  call "Get Array Element TD.gvi"(Array=variant())
  call "Get Physical Units.gvi"(Float or Array of Floats=variant())
  call "Get Refnum Type Enum from Data.gvi"(Data=variant())
  call "Get Physical Units from TD.gvi"(Float or Array Type Descriptor="Type Descriptor.gtype" [])
  call "Get Array Element TDEnum.gvi"(Array=variant())
  call "Variant Constant.gvi"()
  # Utilities
  call "Compute 1D Index.gvi"(Indices=u32[] [], Size(s)=u32[] [])
  call "Remove Typedefs from Variant.gvi"(Variant with typedefs=variant())
  call "Reshape 1D Array.gvi"(1D Array=variant(), Size(s)=u32[] [])
  call "Get Last PString.gvi"(String="")
  call "Get Strings from Enum TD.gvi"(Type Descriptor="Type Descriptor.gtype" [])
  call "Get Array Element Default Data.gvi"(Array=variant())
  call "Get PString.gvi"(String="")
  call "Get Waveform Type Enum from TD.gvi"(Type Descriptor="Type Descriptor.gtype" [])
  call "Get Refnum Type Enum from TD.gvi"(Type Descriptor="Type Descriptor.gtype" [])
  call "Variant Manipulation Templ.gvi"(Variant=variant())
