vi "Close Generic Object Refnum (Array).gvi"   [LabVIEW Platform Developer Preview 0.1.0]
inputs:
  "Gen Refnum Array": GenericRefnum[], required
  "error in (no error)": error
outputs:
  "error out": error
uses:
  OpenG.Application Control::Close Generic Object Refnum (Scalar).gvi
diagram:
  for {
    w1 = each element of $"Gen Refnum Array"
    call "Close Generic Object Refnum (Scalar).gvi"(Gen Refnum=w1) -> (error out=w3)
    append w3 to w2
  }
  Merge Errors($"error in (no error)", w2) -> (error out=w4)
  $"error out" <- w4
