vi "Current VIs Parents Ref.gvi"   [LabVIEW Platform Developer Preview 0.1.0]
# Gets a reference to the parent of the VI calling this function.  This is useful for creating reusable VIs that opperate on their parent.
# Note: The Calling VI's Reference should be closed, when finished with.
outputs:
  "Calling VI's Reference": VIRefnum
diagram:
  Open VI Reference() -> (vi reference=w1)
  $"Calling VI's Reference" <- w1
  Call Chain() -> (callchain=w2)
  Array Index(array=w2)
  # 0x02 => Open Templates for Editing.  If called by a template, then need template reference.
