vi "Dist Build App from LLB (proxy).gvi"   [LabVIEW Platform Developer Preview 0.1.0]
# "Call By Reference" proxy for .\project\prodisttol.llb\Dist Build App from LLB.vi
# THIS VI IS DEPRECIATED. The dynamically called LabVIEW VI is no longer included with LabVIEW. Please use the Application Builder instead.
# This VI is not supported in LabVIEW Version 7.0+ and will generate the following error (#15) "(App Builder required) Dist Build App from LLB (proxy).vi in <>".
inputs:
  "paths": T1, required
  "error in": error
  "lvrt res flags": i32
  "active x server": string
  "mac mem size (k)": u32
  "include run-time DLL": bool
outputs:
  "error out": error
panel controls:
  "VI Refnum (for type)": StrictVIRefnum<"function ">
  "LV7 VI Refnum (for type)": StrictVIRefnum<"function ">
  "LV6.1 VI Refnum (for type)": StrictVIRefnum<"function ">
types:
  T1 = cluster{"destination executable": path, "source llb": path, "source shell": path, "custom icon": path}
uses:
  openg.library.file::Application Directory.gvi
  openg.library.error::Build Error Cluster.gvi
diagram:
  # THIS VI IS DEPRECIATED. The dynamically called LabVIEW VI is no longer included with LabVIEW. Please use the Application Builder instead.
  #
  # This VI is not supported in LabVIEW Version 7.0+ and will generate the following error (#15) "(App Builder required) Dist Build App from LLB (proxy).vi in <>".
  case ($"error in") {
    frame No Error {
      Property Node[IsPlaceholderNodeForConversion=True]() -> ("App.Version"=w2)
      call "Application Directory.gvi"(Relative path (.)=path "project\\prodisttool.llb\\Dist Build App from LLB.vi") -> (Application Directory (+ Relative)=w3)
      case (w2) {
        frame "6.0", "6.0.1", "6.0.2" {
          Open VI Reference(type specifier VI Refnum (for type only)=$"VI Refnum (for type)") -> (error out=w4, vi reference=w5)
          case (w4) {
            frame No Error {
              CallByReference(VI Refnum (for type) Input 0=w5, include run-time DLL Input 2=$"include run-time DLL", active x server Input 3=$"active x server", mac mem size (k) Input 4=$"mac mem size (k)", lvrt res flags Input 5=$"lvrt res flags", paths Input 7=$paths) -> (VI Refnum (for type) Output 0=w6, Error IO Output 1=w7, error out Output 2=w8)  # CallByReference (Placeholder)
              Select(s=w7, t=w7, f=w8) -> w1
            }
            frame Error {
              w9 = "Resource not found"(15)  # Error Code
              call "Build Error Cluster.gvi"(code=w9, String to Prepend to source ("")="App Builder required") -> (error out=w1)
              w6 = w5
            }
          }
          Close Reference(reference=w6)
        }
        frame "6.1" {
          Open VI Reference(type specifier VI Refnum (for type only)=$"LV6.1 VI Refnum (for type)") -> (error out=w10, vi reference=w11)
          case (w10) {
            frame No Error {
              CallByReference(LV6.1 VI Refnum (for type) Input 0=w11, include run-time DLL Input 2=$"include run-time DLL", active x server Input 3=$"active x server", mac mem size (k) Input 4=$"mac mem size (k)", lvrt res flags Input 5=$"lvrt res flags", paths Input 8=$paths) -> (LV6.1 VI Refnum (for type) Output 0=w12, Error IO Output 1=w13, error out Output 2=w14)  # CallByReference (Placeholder)
              Select(s=w13, t=w13, f=w14) -> w1
            }
            frame Error {
              w15 = "Resource not found"(15)  # Error Code
              call "Build Error Cluster.gvi"(code=w15, String to Prepend to source ("")="App Builder required") -> (error out=w1)
              w12 = w11
            }
          }
          Close Reference(reference=w12)
        }
        frame "7.0", Default {
          Open VI Reference(type specifier VI Refnum (for type only)=$"LV7 VI Refnum (for type)") -> (error out=w16, vi reference=w17)
          case (w16) {
            frame No Error {
              CallByReference(LV7 VI Refnum (for type) Input 0=w17, paths Input 2=$paths, lvrt res flags Input 3=$"lvrt res flags", active x server Input 4=$"active x server", mac mem size (k) Input 9=$"mac mem size (k)", include run-time DLL Input 10=$"include run-time DLL") -> (LV7 VI Refnum (for type) Output 0=w18, Error IO Output 1=w19, error out Output 3=w20)  # CallByReference (Placeholder)
              Select(s=w19, t=w19, f=w20) -> w1
            }
            frame Error {
              w21 = "Resource not found"(15)  # Error Code
              call "Build Error Cluster.gvi"(code=w21, String to Prepend to source ("")="App Builder required") -> (error out=w1)
              w18 = w17
            }
          }
          Close Reference(reference=w18)
        }
      }
    }
    frame Error {
      w1 = $"error in"
    }
  }
  $"error out" <- w1
