vi "Get Text Label Decs from VI.gvi"   [LabVIEW Platform Developer Preview 0.1.0]
# Returns references to the free labels (floating text) on a VI's Front Panel.
inputs:
  "VI Refnum": VIRefnum, required
  "error in (no error)": error
outputs:
  "dup VI Refnum": VIRefnum
  "FP Floating Text Labels": GenericRefnum[]
  "error out": error
types:
  T1 = enum{"0 <undefined>", "1 <undefined>", "2 <undefined>", "Generic", "Decoration", "Text", "Control", "ColorBox", "Boolean", "RefNum", "Variant", "Path", "ListBox", "Table", "Array", "Picture", "ActiveXContainer", "Numeric", "Digital", "NamedNumeric", "ColorRamp", "Slide", "GraphOrChart", "WaveformChart", "WaveformGraph", "IntensityChart", "IntensityGraph", "String", "IOName", "ComboBox", "Cluster", "Panel", "Knob", "NumWithScale", "Ring", "Enum", "GObject", "Plot", "Cursor", "NumericText", "Scale", "ColorScale", "GraphScale", "ColorGraphScale", "TypedRefNum", "OldKnobScale", "MCListbox", "MeasureData", "BVTag", "DAQName", "VISAName", "IVIName", "SlideScale", "TabControl", "Page", "TabArrayTabControl", "ConPane"}
diagram:
  $"dup VI Refnum" <- $"VI Refnum"
  case ($"error in (no error)") {
    frame No Error {
      Property Node[IsPlaceholderNodeForConversion=True](instance in=$"VI Refnum", error in=$"error in (no error)") -> ("Panel"=w3, error out=w4)
      Property Node[IsPlaceholderNodeForConversion=True](instance in=w3, error in=w4) -> ("Decos[]"=w5, error out=w6, instance out=w7)
      Close Reference(error in (no error)=w6, reference=w7) -> (error out=w8)
      Initialize Array(element=Not A Refnum, size=0) -> w9
      s1 = w9  # shift register
      s2 = w8  # shift register
      for {
        w10 = each element of w5
        Property Node[IsPlaceholderNodeForConversion=True](instance in=w10, error in=s2) -> ("ClassID"=w11, error out=w12, instance out=w13)
        Type Cast(type=T1 "0 <undefined>", x=w11) -> w14
        Is Equal(x=w14, y="Text") -> w15
        case (w15) {
          frame False, Default {
            Close Reference(error in (no error)=w12, reference=w13) -> (error out=w17)
            w16 = s1
          }
          frame True {
            To More Specific Class(error in=w12, reference=w13, target class=GenericRefnum constant) -> (error out=w17, specific class reference=w18)
            Build Array[ConcatenateInputs=True](s1, w18) -> w16
          }
        }
        next s1 = w16
        next s2 = w17
      }
      w1 = s1
      w2 = s2
    }
    frame Error {
      Initialize Array(element=Not A Refnum, size=0) -> w1
      w2 = $"error in (no error)"
    }
  }
  $"FP Floating Text Labels" <- w1
  $"error out" <- w2
