vi "Is One Frontmost.gvi"   [LabVIEW Platform Developer Preview 0.1.0]
# Tests whether the front panel of any of the specified VIs is currently the frontmost window. If so, a reference to that VI is returned.
# Generates no errors.
# Copyright © 2003 by Paul F. Sullivan.  All rights reserved.  You are only permitted the usage indicated in your license agreement.
inputs:
  "VI names": string[], required
  "error in": error
outputs:
  "VI name": string
  "yes": bool
  "VI Refnum": VIRefnum
  "error out": error
diagram:
  Property Node[IsPlaceholderNodeForConversion=True]() -> (instance out=w1)
  Type Cast(type=w1, x=Not A Refnum) -> w2
  case ($"error in") {
    frame No Error {
      Array Size(array=$"VI names") -> (size(s)=w6)
      Is Greater Than 0(x=w6) -> w7
      case (w7) {  # Any VIs to test?
        frame False, Default {
          w3 = w2
          w4 = FALSE
          w5 = ""
        }
        frame True {
          Decrement(x=w6) -> w8
          while (iteration -> i1) {  # Find frontmost panel.
            w9 = each element of $"VI names"
            # ~1 ms per iteration
            Open VI Reference() -> (vi reference=w10)
            Property Node[IsPlaceholderNodeForConversion=True](instance in=w10) -> ("Front Panel.IsFrontmost"=w4, instance out=w11)
            case (w4) {
              frame False, Default {
                Close Reference(reference=w11)
                w3 = w2
                w5 = ""
              }
              frame True {
                w3 = w11
                w5 = w9
              }
            }
            Is Less Or Equal(x=w8, y=i1) -> w12
            Logical Or(w4, w12) -> w13
            stop if w13
          }
        }
      }
    }
    frame Error {
      w3 = w2
      w4 = FALSE
      w5 = ""
    }
  }
  $"VI Refnum" <- w3
  $"VI name" <- w5
  $yes <- w4
  $"error out" <- $"error in"
