vi "Mangle VI Name (String).gvi"   [LabVIEW Platform Developer Preview 0.1.0]
# Mangles a VI's name by applying a namespace string suffix.
# Name may be a path or a string.
# For example:
# Name => "Widget.vi"
# Namespace => "OpenG"
# Mangled Name => "Widget__OpenG.vi"
# Name => "Widget"
# Namespace => "OpenG"
# Mangled Name => "Widget__OpenG"
# Name => "Widget.vi"
# Namespace => "" (Note: blank string means do not mangle)
# Mangled Name => "Widget.vi"
inputs:
  "Name": string, required
  "Namespace (\"\": don't mangle)": string
  "error in (no error)": error
outputs:
  "Mangled Name": string
  "error out": error
uses:
  openg.library.file::Strip Path Extension - String.gvi
  openg.library.error::Build Error Cluster.gvi
diagram:
  case ($"error in (no error)") {
    frame No Error {
      Is Empty String Or Path(string/path=$Name) -> w3
      # /*Is Name input null?*/
      case (w3) {
        frame False, Default {
          Is Empty String Or Path(string/path=$"Namespace (\"\": don't mangle)") -> w4
          case (w4) {
            frame False, Default {
              call "Strip Path Extension - String.gvi"(path=$Name) -> (root=w5, extension=w6)
              Is Empty String Or Path(string/path=w6) -> w7
              # /*If no file extension then don't add period*/
              Select(s=w7, t="", f=".") -> w8
              Format Into String(formatString="%s__%s%s%s", w5, $"Namespace (\"\": don't mangle)", w8, w6) -> (outString=w1, errOut=w2)
            }
            frame True {
              w1 = $Name
              w2 = no error
            }
          }
        }
        frame True {
          # /*If either input is null, output an error*/
          call "Build Error Cluster.gvi"(code="Argument error"(1), String to Prepend to source ("")="Namespace or VI name not defined") -> (error out=w2)
          w1 = ""
        }
      }
    }
    frame Error {
      w1 = ""
      w2 = $"error in (no error)"
    }
  }
  $"Mangled Name" <- w1
  $"error out" <- w2
