vi "Open Untitled VI.gvi"   [LabVIEW Platform Developer Preview 0.1.0]
# Creates and opens a new Untitled VI.  A reference to the newly created VI will be returned if a TRUE is wired to the "Return Refnum", otherwise "Not a Refnum" is returned.  The front panel of the newly create VI will be opened unless a FALSE is wired to the "Open Front Panel" input.
inputs:
  "Return Refnum? (FALSE)": bool
  "Open Front Panel? (TRUE)": bool = TRUE
outputs:
  "VI Refnum": VIRefnum
  "error out": error
uses:
  openg.library.file::Current VI's Path.gvi
diagram:
  Open VI Reference() -> (error out=w1, vi reference=w2)
  Property Node[IsPlaceholderNodeForConversion=True](instance in=w2, "Front Panel.Open"=$"Open Front Panel? (TRUE)", error in=w1) -> (error out=w3, instance out=w4)
  case ($"Return Refnum? (FALSE)") {
    frame False, Default {
      Close Reference(error in (no error)=w3, reference=w4) -> (error out=w5)
      w6 = Not A Refnum
    }
    frame True {
      w5 = w3
      w6 = w4
    }
  }
  $"VI Refnum" <- w6
  call "Current VI's Path.gvi"(Relative path (.)=path "..\\Untitled.vit")
  $"error out" <- w5
