vi "Save VI ConPane Image.gvi"   [LabVIEW Platform Developer Preview 0.1.0]
# Save an image to file of a VI's Connector Pane.
inputs:
  "VI Path": path, required
  "Image File Path": path, required
  "error in (no error)": error
  "Image Format": enum{"PNG", "JPEG", "GIF"} = "GIF", required
  "Image Depth (256)": i32 = 256
outputs:
  "error out": error
uses:
  openg.library.file::Strip Path - Traditional.gvi
  openg.library.file::Temporary Directory.gvi
  openg.library.file::Build Path - Traditional.gvi
  openg.library.file::Create Dir if Non-Existant.gvi
  openg.library.file::Delete Recursive.gvi
diagram:
  case ($"error in (no error)") {
    frame No Error {
      call "Strip Path - Traditional.gvi"(path=$"VI Path") -> (name=w2)
      call "Temporary Directory.gvi"() -> (Temporary Directory (+ Relative)=w3)
      call "Build Path - Traditional.gvi"(base path=w3, name or relative path=w2) -> (appended path=w4)
      call "Create Dir if Non-Existant.gvi"(Directory Path=w4) -> (dup Directory Path=w5)
      Pick Line(line index=$"Image Format", multi-line string="png\njpg\ngif") -> (output string=w6)
      Format Into String(formatString="%sc.%s", w2, w6) -> w7
      call "Build Path - Traditional.gvi"(base path=w5, name or relative path=w7) -> (appended path=w8)
      Delete File Or Folder(path (use dialog)=$"Image File Path") -> (deleted path=w9)
      Concatenate Strings(w2, ".html") -> w10
      call "Build Path - Traditional.gvi"(base path=w5, name or relative path=w10) -> (appended path=w11)
      Open VI Reference(error in (no error)=$"error in (no error)") -> (error out=w12, vi reference=w13)
      Invoke Node: Print.VI To HTML( Input 0=w13, error in (no error) Input 1=w12, HTML File Path Input 2=w11, Format Input 4="Using SubVI", Image Format Input 5=$"Image Format", Image Depth Input 6=$"Image Depth (256)", Image Directory Input 7=w5) -> ( Output 0=w14, error out Output 1=w15)  # Invoke Node: Print.VI To HTML (Placeholder)
      Close Reference(error in (no error)=w15, reference=w14) -> (error out=w16)
      Copy File Or Folder(error in=w16, source path=w8, target path (use dialog)=w9) -> (error out=w17)
      call "Delete Recursive.gvi"(Path=w5, Recursive? (FALSE)=TRUE, Ignore Read-Only? (FALSE)=TRUE, error in (no error)=w17) -> (error out=w1)
    }
    frame Error {
      w1 = $"error in (no error)"
    }
  }
  $"error out" <- w1
