vi "Set Control Value {Variant}.gvi"   [LabVIEW Platform Developer Preview 0.1.0]
# Sets the value of the named control to that of the variant data.  If Control Name is not specified, then the variant data name of the Value input will be used in its place.
inputs:
  "VI Refnum": VIRefnum, required
  "Value": variant, required
  "Control Name (\"\": use variant name)": string
  "error in (no error)": error
outputs:
  "VI Refnum dup": VIRefnum
  "error out": error
uses:
  openg.library.variant data::Get Data Name.gvi
diagram:
  case ($"error in (no error)") {
    frame No Error {
      # Empty String?
      Is Empty String Or Path(string/path=$"Control Name (\"\": use variant name)") -> w3
      # Use Variant Data Name?
      case (w3) {
        frame False, Default {
          w4 = $Value
          w5 = $"error in (no error)"
          w6 = $"Control Name (\"\": use variant name)"
        }
        frame True {
          call "Get Data Name.gvi"(Data=$Value, error in (no error)=$"error in (no error)") -> (Data dup=w4, Data Name=w6, error out=w5)
        }
      }
      Invoke Node: Ctrl Val.Set(VI Refnum Input 0=$"VI Refnum", error in (no error) Input 1=w5, Control Name Input 2=w6, Value Input 3=w4) -> (VI Refnum Output 0=w1, error out Output 1=w2)  # Invoke Node: Ctrl Val.Set (Placeholder)
    }
    frame Error {
      w1 = $"VI Refnum"
      w2 = $"error in (no error)"
    }
  }
  $"VI Refnum dup" <- w1
  $"error out" <- w2
