vi "UnMangle VI Name (Path).gvi"   [LabVIEW Platform Developer Preview 0.1.0]
# Unmangles a VI's name by removing a namespace string suffix.
# Name may be a path or a string.
# For example:
# Mangled Name => "Widget__OpenG.vi"
# Unmangled Name => "Widget.vi"
# Namespace => "OpenG"
# Mangled Name => "Widget__OpenG"
# Unmangled Name => "Widget"
# Namespace => "OpenG"
# Mangled Name => "Widget.vi"
# Unmangled Name => "Widget.vi"
# Namespace => "" (Note: blank string means do not mangle)
inputs:
  "Mangled Name": path, required
  "error in (no error)": error
outputs:
  "UnMangled Name": path
  "Namespace": string
  "error out": error
uses:
  OpenG.Application Control::UnMangle VI Name (String).gvi
  openg.library.error::Build Error Cluster.gvi
diagram:
  case ($"error in (no error)") {
    frame No Error {
      # /*Is input null?*/
      Is Empty String Or Path(string/path=$"Mangled Name") -> w4
      case (w4) {
        frame False, Default {
          Strip Path(path=$"Mangled Name") -> (name=w5, stripped path=w6)
          call "UnMangle VI Name (String).gvi"(Mangled Name=w5, error in (no error)=$"error in (no error)") -> (UnMangled Name=w7, Namespace=w2, error out=w3)
          Build Path(base path=w6, name or relative path=w7) -> (appended path=w1)
        }
        frame True {
          call "Build Error Cluster.gvi"(code="Argument error"(1), String to Prepend to source ("")="Namespace or VI name not defined") -> (error out=w3)
          w1 = $"Mangled Name"
          w2 = ""
        }
      }
    }
    frame Error {
      w1 = $"Mangled Name"
      w2 = ""
      w3 = $"error in (no error)"
    }
  }
  $"UnMangled Name" <- w1
  $Namespace <- w2
  $"error out" <- w3
