vi "UnMangle VI Name (String).gvi"   [LabVIEW Platform Developer Preview 0.1.0]
# Unmangles a VI's name by removing a namespace string suffix.
# Name may be a path or a string.
# For example:
# Mangled Name => "Widget__OpenG.vi"
# Unmangled Name => "Widget.vi"
# Namespace => "OpenG"
# Mangled Name => "Widget__OpenG"
# Unmangled Name => "Widget"
# Namespace => "OpenG"
# Mangled Name => "Widget.vi"
# Unmangled Name => "Widget.vi"
# Namespace => "" (Note: blank string means do not mangle)
inputs:
  "Mangled Name": string, required
  "error in (no error)": error
outputs:
  "UnMangled Name": string
  "Namespace": string
  "error out": error
uses:
  openg.library.file::Strip Path Extension - String.gvi
  openg.library.error::Build Error Cluster.gvi
diagram:
  case ($"error in (no error)") {
    frame No Error {
      Is Empty String Or Path(string/path=$"Mangled Name") -> w4
      # /*Is input null?*/
      case (w4) {
        frame False, Default {
          Reverse String(string=$"Mangled Name") -> (reversed=w5)
          Match Pattern(regular expression="__", string=w5) -> (after substring=w6, before substring=w7, offset past match=w8)
          # /*Strip File Extension and then find first double-underscore from the back?*/
          Reverse String(string=w7) -> (reversed=w9)
          Reverse String(string=w6) -> (reversed=w10)
          # /*Has namespace?*/
          Is Greater Or Equal To 0(x=w8) -> w11
          case (w11) {
            frame True {
              call "Strip Path Extension - String.gvi"(path=w9) -> (root=w2, extension=w12)
              Is Empty String Or Path(string/path=w12) -> w13
              # /*If no file extension then don't add period*/
              Select(s=w13, t="", f=".") -> w14
              Format Into String(formatString="%s%s%s", w10, w14, w12) -> w3
            }
            frame False {
              # /*If no namespace, then pass name through, unchanged*/
              w2 = ""
              w3 = $"Mangled Name"
            }
          }
          w1 = no error
        }
        frame True {
          # /*If either input is null, output an error*/
          call "Build Error Cluster.gvi"(code="Argument error"(1), String to Prepend to source ("")="Namespace or VI name not defined") -> (error out=w1)
          w2 = ""
          w3 = ""
        }
      }
    }
    frame Error {
      w1 = $"error in (no error)"
      w2 = ""
      w3 = ""
    }
  }
  $"UnMangled Name" <- w3
  $Namespace <- w2
  $"error out" <- w1
