vi "Wait on VIs Unloaded from Memory.gvi"   [LabVIEW Platform Developer Preview 0.1.0]
# Waits until the VIs specified by "VIs to Wait on" are unloaded from memory or a timeout occurs.
inputs:
  "VIs to Wait on": string[], required
  "ms Timout (100ms)": u32 = 100
  "ms Polling Rate (1 ms)": u32 = 1
  "error in (no error)": error
outputs:
  "Timeout?": bool
  "error out": error
diagram:
  case ($"error in (no error)") {
    frame No Error {
      Tick Count() -> (timer value=w3)
      while {
        Wait(time to wait=$"ms Polling Rate (1 ms)") -> (timer value=w4)
        Subtract(x=w4, y=w3) -> w5
        Is Greater Or Equal(x=w5, y=$"ms Timout (100ms)") -> w1
        Property Node[IsPlaceholderNodeForConversion=True]() -> ("App.AllVIs"=w6)
        for {
          w7 = each element of $"VIs to Wait on"
          Search 1D Array(1D array=w6, element=w7) -> (index of element=w9)
          Is Greater Or Equal To 0(x=w9) -> w10
          append w10 to w8
        }
        Or Array Elements(Boolean array=w8) -> (logical OR=w11)
        Logical Or(not w11, w1) -> w12
        stop if w12
      }
      w2 = $"error in (no error)"
    }
    frame Error {
      w1 = FALSE
      w2 = $"error in (no error)"
    }
  }
  $"Timeout?" <- w1
  $"error out" <- w2
