vi "is OpenG.gvi"   [LabVIEW Platform Developer Preview 0.1.0]
# Checks if a VI's path is in OpenG Library directory or subdirectory, where OpenG Library is location at \_OpenG.llb.
inputs:
  "VI reference": VIRefnum, required
  "error in (no error)": error
outputs:
  "dup VI reference": VIRefnum
  "is OpenG VI?": bool
  "error out": error
uses:
  openg.library.file::OpenG Library.gvi
diagram:
  Property Node[IsPlaceholderNodeForConversion=True](instance in=$"VI reference", error in=$"error in (no error)") -> ("Path"=w1, error out=w2, instance out=w3)
  $"dup VI reference" <- w3
  $"error out" <- w2
  call "OpenG Library.gvi"() -> (OpenG Library (+ Relative)=w4)
  Path To Array Of Strings(path=w1) -> (array of strings=w5)
  Path To Array Of Strings(path=w4) -> (array of strings=w6)
  Array Size(array=w6) -> (size(s)=w7)
  Array Subset(array=w5, length0=w7) -> w8
  Array Of Strings To Path(array of strings=w8) -> (path=w9)
  Is Equal(x=w9, y=w4) -> w10
  $"is OpenG VI?" <- w10
