vi "Dictionary Clear.gvi"   [LabVIEW Platform Developer Preview 0.1.0]
# Clears (Empties) the dictionary.
inputs:
  "dictionary": "Dictionary Object RefNum.gtype", required  # dictionary is a reference associated with a dictionary.
  "error in (no error)": error
outputs:
  "dictionary out": "Dictionary Object RefNum.gtype"  # dictionary out has the same value as dictionary.
  "error out": error
types:
  "Dictionary Object RefNum.gtype" = i32
uses:
  OpenG.Dictionary::Dictionary Get Data to Modify.gvi
  OpenG.Dictionary::Dictionary Set Modified Data.gvi
diagram:
  call "Dictionary Get Data to Modify.gvi"(Object RefNum=$dictionary, error in (no error)=$"error in (no error)") -> (Dup Object RefNum=w1, Data out=w2, timed out=w3, error out=w4)
  case (w3) {
    frame False, Default {
      Property Node(instance in=w2, "keys"=variant[] [], "values"=variant[] []) -> (instance out=w7)
      call "Dictionary Set Modified Data.gvi"(Object RefNum=w1, Data in=w7) -> (dup Object RefNum=w6, error out=w8)
      Select(s=w8, t=w8, f=w4) -> w5
    }
    frame True {
      # Error or timed out
      w5 = w4
      w6 = w1
    }
  }
  $"dictionary out" <- w6
  $"error out" <- w5
