vi "Dictionary Close Object Reference.gvi"   [LabVIEW Platform Developer Preview 0.1.0]
inputs:
  "Object RefNum": "Dictionary Object RefNum.gtype"
  "error in (no error)": error
outputs:
  "error out": error
types:
  "Dictionary Object RefNum.gtype" = i32
uses:
  OpenG.Dictionary::Dictionary Get Instance Semaphore RefNum.gvi
  OpenG.Dictionary::Dictionary Object Data Store VI Ref Type.gvi
diagram:
  call "Dictionary Get Instance Semaphore RefNum.gvi"(Object RefNum=$"Object RefNum", error out=$"error in (no error)") -> (dup Object RefNum=w1, semaphore=w2, error in (no error)=w3)
  Destroy Semaphore(semaphore Input 0=w2, error in (no error) Input 1=w3) -> (error out Output 3=w4)  # Destroy Semaphore (Placeholder)
  call "Dictionary Object Data Store VI Ref Type.gvi"() -> (VI Refnum (Object Data Store.vi Type)=w5)
  Flatten To Byte Array(anything=w1) -> (data bytes=w6)
  Unflatten From Byte Array(data bytes=w6, type=w5) -> (value=w7)
  Close Reference(reference=w7) -> (error out=w8)
  Select(s=w8, t=w8, f=w4) -> w9
  $"error out" <- w9
