vi "Dictionary Copy.gvi"   [LabVIEW Platform Developer Preview 0.1.0]
# Creates and returns a copy of the dictionary.
inputs:
  "dictionary": "Dictionary Object RefNum.gtype", required  # dictionary is a reference associated with a dictionary.
  "error in (no error)": error
outputs:
  "dictionary out": "Dictionary Object RefNum.gtype"  # dictionary out has the same value as dictionary.
  "new dictionary out": "Dictionary Object RefNum.gtype"  # dictionary is a reference to the new dictionary copy.
  "error out": error
types:
  "Dictionary Object RefNum.gtype" = i32
  T1 = cluster{"Variant": variant, "Variant_2": variant}
uses:
  OpenG.Dictionary::Dictionary Get Data.gvi
  OpenG.Dictionary::Dictionary Create.gvi
diagram:
  call "Dictionary Get Data.gvi"(Object RefNum=$dictionary, error in (no error)=$"error in (no error)") -> (Dup Object RefNum=w1, Data out=w2, error out=w3)
  $"dictionary out" <- w1
  Property Node(instance in=w3) -> ("status"=w4)
  case (w4) {
    frame False, Default {
      Property Node(instance in=w2) -> ("keys"=w7, "values"=w8)
      # Put your own code here
      for {
        w9 = each element of w7
        w10 = each element of w8
        Property Node(instance in=T1 {all zero or empty}, "Variant"=w9, "Variant_2"=w10) -> (instance out=w12)
        append w12 to w11
      }
      call "Dictionary Create.gvi"(initial dictionary (empty)=w11, error in (no error)=w3) -> (dictionary out=w6, error out=w5)
    }
    frame True {
      # Error
      w5 = w3
      w6 = Not A Refnum
    }
  }
  $"new dictionary out" <- w6
  $"error out" <- w5
