vi "Dictionary Data Core.gvi"   [LabVIEW Platform Developer Preview 0.1.0]
# LV2 Style Global for the GOOP data
inputs:
  "Object RefNum": "Dictionary Object RefNum.gtype"
  "Data in": "Dictionary Data.gtype"
  "task (read)": "Dictionary Object Data Core Task Enum.gtype" = "read"
  "error in (no error)": error
outputs:
  "dup Object RefNum": "Dictionary Object RefNum.gtype"
  "Data out": "Dictionary Data.gtype"
  "error out": error
types:
  "Dictionary Data.gtype" = cluster{"keys": variant[], "values": variant[]}
  "Dictionary Object Data Core Task Enum.gtype" = enum{"read", "write", "init"}
  "Dictionary Object RefNum.gtype" = i32
uses:
  OpenG.Dictionary::Dictionary Object Data Store VI Ref Type.gvi
  OpenG.Dictionary::Dictionary Default Data.gvi
diagram:
  $"dup Object RefNum" <- $"Object RefNum"
  case ($"error in (no error)") {
    frame No Error {
      Flatten To Byte Array(anything=$"Object RefNum") -> (data bytes=w3)
      call "Dictionary Object Data Store VI Ref Type.gvi"() -> (VI Refnum (Object Data Store.vi Type)=w4)
      Unflatten From Byte Array(data bytes=w3, type=w4) -> (value=w5)
      CallByReference(VI Refnum (Object Data Store.vi Type) Input 0=w5, Data in Input 2=$"Data in", task (read) Input 3=$"task (read)") -> (error out Output 1=w1, Data in Output 2=w2)  # CallByReference (Placeholder)
    }
    frame Error {
      call "Dictionary Default Data.gvi"() -> (Data out=w2)
      w1 = $"error in (no error)"
    }
  }
  $"Data out" <- w2
  $"error out" <- w1
