vi "Dictionary Delete Element.gvi"   [LabVIEW Platform Developer Preview 0.1.0]
# Deletes the element associated with key from the dictionary.
inputs:
  "dictionary": "Dictionary Object RefNum.gtype", required  # dictionary is a reference associated with a dictionary.
  "key": variant, required  # This is the key of the item to be deleted from the dictionary
  "error in (no error)": error
outputs:
  "dictionary out": "Dictionary Object RefNum.gtype"  # dictionary out has the same value as dictionary.
  "error out": error
types:
  "Dictionary Object RefNum.gtype" = i32
uses:
  OpenG.Dictionary::Dictionary Get Data to Modify.gvi
  OpenG.Dictionary::Dictionary Set Modified Data.gvi
diagram:
  call "Dictionary Get Data to Modify.gvi"(Object RefNum=$dictionary, error in (no error)=$"error in (no error)") -> (Dup Object RefNum=w1, Data out=w2, timed out=w3, error out=w4)
  case (w3) {
    frame False, Default {
      Property Node(instance in=w2) -> ("values"=w7, "keys"=w8)
      Search 1D Array(1D array=w8, element=$key) -> (index of element=w9)
      Delete From Array(inArray=w8, index0=w9) -> w10
      Delete From Array(inArray=w7, index0=w9) -> w11
      Property Node(instance in=w2, "values"=w11, "keys"=w10) -> (instance out=w12)
      call "Dictionary Set Modified Data.gvi"(Object RefNum=w1, Data in=w12) -> (dup Object RefNum=w6, error out=w13)
      Select(s=w13, t=w13, f=w4) -> w5
    }
    frame True {
      # Error or timed out
      w5 = w4
      w6 = w1
    }
  }
  $"dictionary out" <- w6
  $"error out" <- w5
