vi "Dictionary Get Data.gvi"   [LabVIEW Platform Developer Preview 0.1.0]
# Gets the GOOP data structure without mutex
inputs:
  "Object RefNum": "Dictionary Object RefNum.gtype"
  "error in (no error)": error
outputs:
  "Dup Object RefNum": "Dictionary Object RefNum.gtype"
  "Data out": "Dictionary Data.gtype"
  "error out": error
types:
  "Dictionary Data.gtype" = cluster{"keys": variant[], "values": variant[]}
  "Dictionary Object RefNum.gtype" = i32
uses:
  OpenG.Dictionary::Dictionary Data Core.gvi
  OpenG.Dictionary::Dictionary Default Data.gvi
diagram:
  case ($"error in (no error)") {
    frame No Error {
      call "Dictionary Data Core.gvi"(Object RefNum=$"Object RefNum", task (read)="read", error in (no error)=$"error in (no error)") -> (dup Object RefNum=w3, Data out=w2, error out=w1)
    }
    frame Error {
      call "Dictionary Default Data.gvi"() -> (Data out=w2)
      w1 = $"error in (no error)"
      w3 = $"Object RefNum"
    }
  }
  $"Dup Object RefNum" <- w3
  $"Data out" <- w2
  $"error out" <- w1
