vi "Dictionary Get Instance Semaphore RefNum.gvi"   [LabVIEW Platform Developer Preview 0.1.0]
inputs:
  "Object RefNum": "Dictionary Object RefNum.gtype"
  "error out": error
outputs:
  "dup Object RefNum": "Dictionary Object RefNum.gtype"
  "semaphore": "Semaphore RefNum.gtype"  # semaphore is a reference to an existing or newly created semaphore.
  "error in (no error)": error
types:
  "Dictionary Object RefNum.gtype" = i32
  "Semaphore RefNum.gtype" = i32
uses:
  OpenG.Dictionary::Dictionary Object Ref Type.gvi
diagram:
  $"dup Object RefNum" <- $"Object RefNum"
  call "Dictionary Object Ref Type.gvi"() -> (Object RefNum Type=w1)
  ReadDataLog(Object RefNum Type Input 2=w1) -> ( Output 1=w2)  # ReadDataLog (Placeholder)
  Flatten To Byte Array(anything=$"Object RefNum") -> (data bytes=w3)
  Unflatten From Byte Array(data bytes=w3, type=u32 0) -> (value=w4)
  # Unbundle enum inside refnum using "Read File" trick
  Format Into String(formatString="%s - %x", errIn=$"error out", w2, w4) -> (outString=w5, errOut=w6)
  Create Semaphore(name (unnamed) Input 0=w5, error in (no error) Input 3=w6) -> (semaphore Output 4=w7, error out Output 6=w8)  # Create Semaphore (Placeholder)
  $semaphore <- w7
  $"error in (no error)" <- w8
