vi "Dictionary Get Value.gvi"   [LabVIEW Platform Developer Preview 0.1.0]
# Returns the value associated with key, if it exists.  If the dictionary has the specified key, then found? will be TRUE.
# lock dictionary if key is found? will lock the dictionary (only if the key is found), preventing dictionary modifications until it is unlocked.  Locking a dictionary is useful when the values of keys store compound data, which might be modified in multiple locations.  The dictionary may be unlocked using the unlock dictionary input of the Update Dictionary function.
inputs:
  "dictionary": "Dictionary Object RefNum.gtype", required  # dictionary is a reference associated with a dictionary.
  "key": variant, required  # The function looks for this key in the dictionary
  "error in": error
  "lock dictionary if key is found? (FALSE)": bool  # This boolean input will lock the dictionary, preventing dictionary modifications until it is unlocked. Locking a dictionary is useful when the values of keys store compound data, which might be modified in multiple locations.
outputs:
  "dictionary out": "Dictionary Object RefNum.gtype"  # dictionary out has the same value as dictionary.
  "value": variant  # This value is an output of the function associated with supplied key in the dictionary
  "found?": bool  # found?: This boolean returns TRUE if key found, else returns FALSE
  "error out": error
types:
  "Dictionary Object RefNum.gtype" = i32
uses:
  OpenG.Dictionary::Dictionary Get Data.gvi
  OpenG.Dictionary::Dictionary Get Data to Modify.gvi
  OpenG.Dictionary::Dictionary Set Modified Data.gvi
diagram:
  case ($"lock dictionary if key is found? (FALSE)") {
    frame False, Default {
      call "Dictionary Get Data.gvi"(Object RefNum=$dictionary, error in (no error)=$"error in") -> (Dup Object RefNum=w3, Data out=w1, error out=w2)
    }
    frame True {
      call "Dictionary Get Data to Modify.gvi"(Object RefNum=$dictionary, error in (no error)=$"error in") -> (Dup Object RefNum=w3, Data out=w1, error out=w2)
    }
  }
  Property Node(instance in=w2) -> ("status"=w4)
  case (w4) {
    frame False, Default {
      Property Node(instance in=w1) -> ("values"=w9, "keys"=w10)
      Search 1D Array(1D array=w10, element=$key) -> (index of element=w11)
      # Put your own code here
      Is Greater Or Equal To 0(x=w11) -> w6
      # Data locked and key not found?
      Logical And($"lock dictionary if key is found? (FALSE)", not w6) -> w12
      case (w12) {  # Unlock Data?
        frame False, Default {
          w5 = w2
          w8 = w3
        }
        frame True {
          call "Dictionary Set Modified Data.gvi"(Object RefNum=w3, Data in=w1, error in (no error)=w2) -> (dup Object RefNum=w8, error out=w5)
        }
      }
      Array Index(array=w9) -> (out0[w11]=w7)
    }
    frame True {
      # Error
      w5 = w2
      w6 = FALSE
      w7 = variant()
      w8 = w3
    }
  }
  $"dictionary out" <- w8
  $value <- w7
  $"found?" <- w6
  $"error out" <- w5
