vi "Dictionary Get Values.gvi"   [LabVIEW Platform Developer Preview 0.1.0]
# Returns all of the values within the dictionary.
# lock dictionary will lock the dictionary, preventing dictionary modifications until it is unlocked.  Locking a dictionary is useful when the values of keys store compound data, which might be modified in multiple locations.  The dictionary may be unlocked using the unlock dictionary input of the Update Dictionary function.
inputs:
  "dictionary": "Dictionary Object RefNum.gtype", required  # dictionary is a reference associated with a dictionary.
  "error in": error
  "lock dictionary? (FALSE)": bool  # This boolean input will lock the dictionary, preventing dictionary modifications until it is unlocked. Locking a dictionary is useful when the values of keys store compound data, which might be modified in multiple locations.
outputs:
  "dictionary out": "Dictionary Object RefNum.gtype"  # dictionary out has the same value as dictionary.
  "values": variant[]  # This is an array of all the values read from the dictionary.
  "error out": error
types:
  "Dictionary Object RefNum.gtype" = i32
uses:
  OpenG.Dictionary::Dictionary Get Data.gvi
  OpenG.Dictionary::Dictionary Get Data to Modify.gvi
diagram:
  case ($"lock dictionary? (FALSE)") {
    frame False, Default {
      call "Dictionary Get Data.gvi"(Object RefNum=$dictionary, error in (no error)=$"error in") -> (Dup Object RefNum=w3, Data out=w1, error out=w2)
    }
    frame True {
      call "Dictionary Get Data to Modify.gvi"(Object RefNum=$dictionary, error in (no error)=$"error in") -> (Dup Object RefNum=w3, Data out=w1, error out=w2)
    }
  }
  $"dictionary out" <- w3
  Property Node(instance in=w2) -> ("status"=w4)
  case (w4) {
    frame False, Default {
      # Put your own code here
      Property Node(instance in=w1) -> ("values"=w6)
      w5 = w2
    }
    frame True {
      # Error
      w5 = w2
      w6 = variant[] []
    }
  }
  $values <- w6
  $"error out" <- w5
