vi "Dictionary Has Key.gvi"   [LabVIEW Platform Developer Preview 0.1.0]
# Determines if the supplied key is present in the dictionary.
inputs:
  "dictionary": "Dictionary Object RefNum.gtype", required  # dictionary is a reference associated with a dictionary.
  "key": variant, required  # This is the key to be searched in the dictionary
  "error in (no error)": error
outputs:
  "dictionary out": "Dictionary Object RefNum.gtype"  # dictionary out has the same value as dictionary.
  "Has Key?": bool  # This boolean returns TRUE if key found, else returns FALSE
  "error out": error
types:
  "Dictionary Object RefNum.gtype" = i32
uses:
  OpenG.Dictionary::Dictionary Get Data.gvi
diagram:
  call "Dictionary Get Data.gvi"(Object RefNum=$dictionary, error in (no error)=$"error in (no error)") -> (Dup Object RefNum=w1, Data out=w2, error out=w3)
  $"dictionary out" <- w1
  Property Node(instance in=w3) -> ("status"=w4)
  case (w4) {
    frame False, Default {
      Property Node(instance in=w2) -> ("keys"=w7)
      Search 1D Array(1D array=w7, element=$key) -> (index of element=w8)
      # Put your own code here
      Is Greater Or Equal To 0(x=w8) -> w6
      w5 = w3
    }
    frame True {
      # Error
      w5 = w3
      w6 = FALSE
    }
  }
  $"Has Key?" <- w6
  $"error out" <- w5
