vi "Dictionary New.gvi"   [LabVIEW Platform Developer Preview 0.1.0]
# Initializes the GOOP object
inputs:
  "Data in": "Dictionary Data.gtype"
  "error in (no error)": error
outputs:
  "Object RefNum": "Dictionary Object RefNum.gtype"
  "error out": error
types:
  "Dictionary Data.gtype" = cluster{"keys": variant[], "values": variant[]}
  "Dictionary Object RefNum.gtype" = i32
uses:
  OpenG.Dictionary::Dictionary Open Object Reference.gvi
  OpenG.Dictionary::Dictionary Get Data to Modify.gvi
  OpenG.Dictionary::Dictionary Set Modified Data.gvi
  OpenG.Dictionary::Dictionary Object Ref Type.gvi
diagram:
  case ($"error in (no error)") {
    frame No Error {
      call "Dictionary Open Object Reference.gvi"(error in (no error)=$"error in (no error)") -> (Object RefNum=w3, error out=w4)
      call "Dictionary Get Data to Modify.gvi"(Object RefNum=w3, error in (no error)=w4) -> (Dup Object RefNum=w5, error out=w6)
      call "Dictionary Set Modified Data.gvi"(Object RefNum=w5, Data in=$"Data in", error in (no error)=w6) -> (dup Object RefNum=w2, error out=w1)
    }
    frame Error {
      call "Dictionary Object Ref Type.gvi"() -> (Object RefNum Type=w2)
      w1 = $"error in (no error)"
    }
  }
  $"Object RefNum" <- w2
  $"error out" <- w1
