vi "Dictionary Pop Item.gvi"   [LabVIEW Platform Developer Preview 0.1.0]
# Removes and returns a single Item (key - value pair) from the dictionary.
inputs:
  "dictionary": "Dictionary Object RefNum.gtype", required  # dictionary is a reference associated with a dictionary.
  "error in (no error)": error
outputs:
  "dictionary out": "Dictionary Object RefNum.gtype"  # dictionary out has the same value as dictionary.
  "item": cluster{"key": variant, "value": variant}  # This a cluster of first item (key - value pair) present in the dictionary
  "error out": error
types:
  "Dictionary Object RefNum.gtype" = i32
  T1 = cluster{"Variant": variant, "Variant_2": variant}
uses:
  OpenG.Dictionary::Dictionary Get Data to Modify.gvi
  OpenG.Dictionary::Dictionary Set Modified Data.gvi
diagram:
  call "Dictionary Get Data to Modify.gvi"(Object RefNum=$dictionary, error in (no error)=$"error in (no error)") -> (Dup Object RefNum=w1, Data out=w2, timed out=w3, error out=w4)
  case (w3) {
    frame False, Default {
      Property Node(instance in=w2) -> ("values"=w8, "keys"=w9)
      Delete From Array(inArray=w8) -> (outArray=w10, deleted=w11)
      Delete From Array(inArray=w9) -> (outArray=w12, deleted=w13)
      Property Node(instance in=w2, "values"=w10, "keys"=w12) -> (instance out=w14)
      call "Dictionary Set Modified Data.gvi"(Object RefNum=w1, Data in=w14) -> (dup Object RefNum=w6, error out=w15)
      Select(s=w15, t=w15, f=w4) -> w5
      Property Node(instance in=T1 {all zero or empty}, "Variant"=w13, "Variant_2"=w11) -> (instance out=w7)
    }
    frame True {
      # Error or timed out
      w5 = w4
      w6 = w1
      w7 = T1 {all zero or empty}
    }
  }
  $"dictionary out" <- w6
  $"error out" <- w5
  $item <- w7
