vi "VI Tree - dictionary.gvi"   [LabVIEW Platform Developer Preview 0.1.0]
types:
  "Dictionary Key Value Pair Cluster.gtype" = cluster{"key": variant, "value": variant}
uses:
  OpenG.Dictionary::Dictionary Create.gvi
  OpenG.Dictionary::Dictionary Destroy.gvi
  OpenG.Dictionary::Dictionary Not a Dictionary.gvi
  OpenG.Dictionary::Dictionary Copy.gvi
  OpenG.Dictionary::Dictionary Get Status.gvi
  OpenG.Dictionary::Dictionary Get Value.gvi
  OpenG.Dictionary::Dictionary Has Key.gvi
  OpenG.Dictionary::Dictionary Get Values.gvi
  OpenG.Dictionary::Dictionary Get Keys.gvi
  OpenG.Dictionary::Dictionary Pop Item.gvi
  OpenG.Dictionary::Dictionary Get Items.gvi
  OpenG.Dictionary::Dictionary Delete Element.gvi
  OpenG.Dictionary::Dictionary Clear.gvi
  OpenG.Dictionary::Dictionary Update (by scalar value).gvi
  OpenG.Dictionary::Dictionary Update (by value).gvi
  OpenG.Dictionary::Dictionary Update (by reference).gvi
  OpenG.Dictionary::Dictionary Object Data Store VI Ref Type.gvi
  OpenG.Dictionary::Dictionary Object Ref Type.gvi
  OpenG.Dictionary::Dictionary Default Data.gvi
  OpenG.Dictionary::Dictionary Set Modified Data.gvi
  OpenG.Dictionary::Dictionary New.gvi
  OpenG.Dictionary::Dictionary Get Data to Modify.gvi
  OpenG.Dictionary::Dictionary Get Data.gvi
  OpenG.Dictionary::Dictionary Delete.gvi
  OpenG.Dictionary::Dictionary Get Instance Semaphore RefNum.gvi
  OpenG.Dictionary::Dictionary Data Core.gvi
  OpenG.Dictionary::Dictionary Open Object Reference.gvi
  OpenG.Dictionary::Dictionary Close Object Reference.gvi
  OpenG.Dictionary::Dictionary Object Data Store.gvi
diagram:
  sequence {  # API
    frame 0 {
      call "Dictionary Create.gvi"() -> (dictionary out=w1)
      call "Dictionary Destroy.gvi"(dictionary=w1)
      call "Dictionary Not a Dictionary.gvi"(dictionary=w1)
      call "Dictionary Copy.gvi"(dictionary=w1)
      call "Dictionary Get Status.gvi"(dictionary=w1)
      call "Dictionary Get Value.gvi"(dictionary=w1, key=variant()) -> (dictionary out=w2)
      call "Dictionary Has Key.gvi"(dictionary=w2, key=variant())
      call "Dictionary Get Values.gvi"(dictionary=w1) -> (dictionary out=w3)
      call "Dictionary Get Keys.gvi"(dictionary=w3)
      call "Dictionary Pop Item.gvi"(dictionary=w1) -> (dictionary out=w4)
      call "Dictionary Get Items.gvi"(dictionary=w4)
      call "Dictionary Delete Element.gvi"(dictionary=w1, key=variant()) -> (dictionary out=w5)
      call "Dictionary Clear.gvi"(dictionary=w5)
      w6 = "Dictionary Key Value Pair Cluster.gtype" {all zero or empty}
      call "Dictionary Update (by scalar value).gvi"(dictionary=w1, key-value=w6) -> (dictionary out=w7)
      call "Dictionary Update (by scalar value).gvi"(dictionary=w7, key-value=w6)
      Build Array(w6) -> w8
      call "Dictionary Update (by value).gvi"(dictionary=w7, dictionary with updates=w8)
      call "Dictionary Update (by reference).gvi"(dictionary=w7, dictionary with updates=w7)
      call "Dictionary Update (by scalar value).gvi"(dictionary=w1, key-value=w6)
    }
  }
  sequence {  # Type "Constants"
    frame 0 {
      # /*Dynamic Data Store VI Interface Type "Constant"*/
      # /*GOOP Object "Constant"*/
      call "Dictionary Object Data Store VI Ref Type.gvi"()
      # /*Object Data Cluster "Constant"*/
      call "Dictionary Object Ref Type.gvi"()
      call "Dictionary Default Data.gvi"()
    }
  }
  sequence {  # Main Components
    frame 0 {
      # /*Sets data and then releases semaphore*/
      call "Dictionary Set Modified Data.gvi"()
      # /*Creates a new object*/
      call "Dictionary New.gvi"()
      # /*Gets data after acquiring a semaphore*/
      call "Dictionary Get Data to Modify.gvi"()
      # /*Gets data without acquiring a semaphore*/
      call "Dictionary Get Data.gvi"()
      # /*Deletes the object*/
      call "Dictionary Delete.gvi"()
      # /*Gets a unique semaphore for Dynamic Data Store VI instance*/
      call "Dictionary Get Instance Semaphore RefNum.gvi"()
      # /*Reads and writes data to the Dynamic Data Store VI*/
      call "Dictionary Data Core.gvi"()
      # /*Opens a reference to the Dynamic Data Store VI*/
      call "Dictionary Open Object Reference.gvi"()
      # /*Closes the reference to the Dynamic Data Store VI*/
      # /*Dynamic Data Store VI*/
      call "Dictionary Close Object Reference.gvi"()
      # Dynamic
      call "Dictionary Object Data Store.gvi"()
    }
  }
