vi "Convert Dirs to VI Libraries (proxy).gvi"   [LabVIEW Platform Developer Preview 0.1.0]
# Converts an array of Directories into VI Library (.llb) files.
# Note: This VI dynamically calls the LabVIEW subVI "Convert Dirs to VI Libraries.vi" located at \project\llbedit.llb (as it is not in the VI search paths).
inputs:
  "directories": path[]
  "error in (no error)": error
outputs:
  "error out": error
panel controls:
  "type specifier": StrictVIRefnum<"function ">
uses:
  openg.library.file::Application Directory.gvi
  openg.library.file::Convert File Extension (Path).gvi
diagram:
  call "Application Directory.gvi"(Relative path (.)=path "project\\llbedit.llb\\Convert Dirs to VI Libraries.vi")
  # Call the VI dynamically because it is not
  # usually in the VI search paths
  Open VI Reference(error in (no error)=$"error in (no error)", type specifier VI Refnum (for type only)=$"type specifier") -> (error out=w1, vi reference=w2)
  # /*Remove ".llb" suffix from folder name, if present,
  # otherwise it will choke*/
  s1 = w1  # shift register
  for {
    w3 = each element of $directories
    call "Convert File Extension (Path).gvi"(file name=w3) -> (new filename=w5, prev ending=w6)
    Match Pattern(regular expression="\\.[Ll][Ll][Bb]$", string=w6) -> (offset past match=w7)
    case (w7) {
      frame Default {
        Move File Or Folder(error in=s1, source path=w3, target path (use dialog)=w5) -> (error out=w9, new path=w8)
      }
      frame -1 {
        w8 = w3
        w9 = s1
      }
    }
    append w8 to w4
    next s1 = w9
  }
  CallByReference(type specifier Input 0=w2, Error IO Input 1=s1, directories Input 2=w4) -> (type specifier Output 0=w10, Error IO Output 1=w11)  # CallByReference (Placeholder)
  Close Reference(error in (no error)=w11, reference=w10) -> (error out=w12)
  $"error out" <- w12
