vi "ZLIB CRC32.gvi"   [LabVIEW Platform Developer Preview 0.1.0]
# Calculates the CRC32 value of a buffer. The previous CRC32 value can be used to pass in the crc32 of a previous buffer in a series of buffers from a data stream.
inputs:
  "previous crc32": u32
  "buffer": string
  "error in (no error)": error
outputs:
  "new crc32": u32
  "error out": error
uses:
  OpenG.Zip::lvzlib.sli::lvzip_crc32
diagram:
  Property Node(instance in=$"error in (no error)") -> ("status"=w1)
  case (w1) {
    frame False, Default {
      String To Byte Array(encoding="Extended ASCII", string=$buffer) -> (unsigned byte array=w4)
      Array Size(array=w4) -> (size(s)=w5)
      call "lvzip_crc32"(crc in=$"previous crc32", buf in=w4, len in=w5) -> (return=w3)
      w2 = $"error in (no error)"
    }
    frame True {
      w2 = $"error in (no error)"
      w3 = $"previous crc32"
    }
  }
  $"error out" <- w2
  $"new crc32" <- w3
