vi "ZLIB Close Read File.gvi"   [LabVIEW Platform Developer Preview 0.1.0]
# Closes a file opened with ZLIB Open Read File.
inputs:
  "unzip Refnum": "ZLIB Unzip Handle.gtype"
  "target path": path
  "file timestamp (no change)": u32
  "error in (no error)": error
outputs:
  "unzip Refnum out": "ZLIB Unzip Handle.gtype"
  "error out": error
types:
  "ZLIB Unzip Handle.gtype" = i32
uses:
  OpenG.Zip::lvzlib.sli::lvzip_unzCloseCurrentFile
  openg.library.error::Build Error Cluster.gvi
  openg.library.file::File Info.gvi
diagram:
  $"unzip Refnum out" <- $"unzip Refnum"
  Property Node(instance in=$"error in (no error)") -> ("status"=w1)
  Type Cast(type=u32 0, x=$"unzip Refnum") -> w2
  call "lvzip_unzCloseCurrentFile"(unzFile in=w2) -> (return=w3)
  case (w1) {
    frame False, Default {
      case (w3) {
        frame Default {
          call "Build Error Cluster.gvi"(code="File not found"(7)) -> (error out=w4)
        }
        frame -105 {
          # CRC error
          Delete File Or Folder(error in=$"error in (no error)", path (use dialog)=$"target path")
          call "Build Error Cluster.gvi"(code="Generic file I/O error"(6)) -> (error out=w4)
        }
        frame 0 {
          case ($"file timestamp (no change)") {
            frame 0 {
              w4 = $"error in (no error)"
            }
            frame Default {
              call "File Info.gvi"(file=$"target path", error in (no error)=$"error in (no error)") -> (file out=w5, file info=w6, error out=w7)
              Property Node(instance in=w6, "modification date"=$"file timestamp (no change)") -> (instance out=w8)
              call "File Info.gvi"(file=w5, file info 2=w8, error in (no error)=w7, update (F)=TRUE) -> (error out=w4)
            }
          }
        }
      }
    }
    frame True {
      w4 = $"error in (no error)"
    }
  }
  $"error out" <- w4
