vi "ZLIB Close Unzip Archive.gvi"   [LabVIEW Platform Developer Preview 0.1.0]
# Closes an unzip session.
inputs:
  "unzip Refnum": "ZLIB Unzip Handle.gtype", required
  "error in (no error)": error
outputs:
  "error out": error
types:
  "ZLIB Unzip Handle.gtype" = i32
uses:
  OpenG.Zip::lvzlib.sli::lvzip_unzClose
  openg.library.error::Build Error Cluster.gvi
diagram:
  Property Node(instance in=$"error in (no error)") -> ("status"=w1)
  Type Cast(type=u32 0, x=$"unzip Refnum") -> w2
  call "lvzip_unzClose"(unzFile in=w2) -> (return=w3)
  case (w1) {
    frame False, Default {
      case (w3) {
        frame Default {
          call "Build Error Cluster.gvi"(code="File not found"(7)) -> (error out=w4)
        }
        frame 0 {
          w4 = $"error in (no error)"
        }
      }
    }
    frame True {
      w4 = $"error in (no error)"
    }
  }
  $"error out" <- w4
