vi "ZLIB Close Write File.gvi"   [LabVIEW Platform Developer Preview 0.1.0]
# Closes a file opened with ZLIB Open Write File.vi and commits all data to the archive. The parameters uncompressed size and crc32 are necessary if the file was opened to be added in raw mode, otherwise the correct values are calculated automatically in this function.
inputs:
  "zip Refnum": "ZLIB Zip Handle.gtype"
  "uncompressed size": u32  # The uncompressed size of the file added in raw mode. For normally added files this parameters is ignored.
  "crc32": u32  # The crc32 of the file added in raw mode. For normally added files this parameters is ignored.
  "error in (no error)": error
outputs:
  "zip Refnum out": "ZLIB Zip Handle.gtype"
  "error out": error
types:
  "ZLIB Zip Handle.gtype" = i32
uses:
  OpenG.Zip::lvzlib.sli::lvzip_zipCloseFileInZipRaw
  openg.library.error::Build Error Cluster.gvi
diagram:
  Property Node(instance in=$"error in (no error)") -> ("status"=w1)
  Type Cast(type=u32 0, x=$"zip Refnum") -> w2
  call "lvzip_zipCloseFileInZipRaw"(unzFile in=w2, uncompressedSize in=$"uncompressed size", crc32 in=$crc32) -> (return=w3)
  case (w1) {
    frame False, Default {
      case (w3) {
        frame Default {
          call "Build Error Cluster.gvi"(code="File not found"(7)) -> (error out=w4)
        }
        frame 0 {
          w4 = $"error in (no error)"
        }
      }
    }
    frame True {
      w4 = $"error in (no error)"
    }
  }
  $"error out" <- w4
  $"zip Refnum out" <- $"zip Refnum"
