vi "ZLIB Close Zip Archive.gvi"   [LabVIEW Platform Developer Preview 0.1.0]
# Closes a zip session.
inputs:
  "zip Refnum": "ZLIB Zip Handle.gtype", required
  "global comment (use original comment for existing files)": string  # Global comment to add to the zip archive. If the archive was opened in append to archive mode, previously present global comments will only be preserved, if this string is left empty. If you want to add extra information to the global comments, you will have to retrieve the original global comment when opening the ZIP archive and append the desired information yourself.
  "error in (no error)": error
outputs:
  "memory stream": string
  "error out": error
types:
  "ZLIB Zip Handle.gtype" = i32
uses:
  OpenG.Zip::lvzlib.sli::lvzip_zipClose2
  OpenG.Zip::lvzlib.sli::lvzip_zipClose2_2
  openg.library.error::Build Error Cluster.gvi
diagram:
  Type Cast(type=u32 0, x=$"zip Refnum") -> w1
  case ($"global comment (use original comment for existing files)") {
    frame "" {
      call "lvzip_zipClose2"(unzFile in=w1, globComment in=0) -> (return=w2, stream out=w3)
    }
    frame Default {
      call "lvzip_zipClose2_2"(unzFile in=w1, globComment in=$"global comment (use original comment for existing files)") -> (return=w2, stream out=w3)
    }
  }
  Property Node(instance in=$"error in (no error)") -> ("status"=w4)
  case (w4) {
    frame False, Default {
      case (w2) {
        frame Default {
          call "Build Error Cluster.gvi"(code="File not found"(7)) -> (error out=w5)
        }
        frame 0 {
          w5 = $"error in (no error)"
        }
      }
    }
    frame True {
      w5 = $"error in (no error)"
    }
  }
  $"error out" <- w5
  $"memory stream" <- w3
