vi "ZLIB Compress Directory.gvi"   [LabVIEW Platform Developer Preview 0.1.0]
# This function compresses an entire directory and eventually its subdirectories into a ZIP file. The root directory must be defined and if no root directory is passed to the function it will prompt the user for such a directory with the file dialog. If no archive name is specified this function will create a file with the same name and in the same location as the root directory, by removing any possible extension from the root directory name and appending the ending .zip to it.
# Include subdirectories will control if this function recursively includes any subdirectories and its content from the root directory.
# password, if not empty, will encrypt all the newly added files in the archive in such a way that they can only be extracted with the password later on.
inputs:
  "root directory (file dialog)": path  # The main directory from which the function should create an archive.
  "archive name (root directory with .zip ending)": path  # The archive name to create or append to. If this is left unwired, the function will create an archive with the same name as the root directory but with the ending .zip.
  "include subdirectories (F)": bool  # If this boolean is true all subdirectories will be included recursivley into the archive.
  "error in (no error)": error
  "append (create new)": "ZLIB Open ZIP Mode.gtype" = "create new"  # This parameter defines how the file(s) should be added to the archive. Possible values are: 0: create new creates a new archive and adds the file(s) to it] 1: append to file creates a new archive as above and adds it to the end of an already existing file 2: append to archive appends the file(s) to an existing archive extending its contents
  "password (none)": string
    # Specify the password to use to encrypt the newly added files in the archive. Leave this parameter empty if the new files should not be encrypted.
    # Note: The supported encryption algorithme is the one used in the original pkzip utility. Some versions of pkzip have some quirks in the encryption algorithme and this function does not try to work around all of them. Also note that newer versions of WinZip (probably >= 8.0) use their own non-standard password encryption and therefore can't be decrypted by this routine.
outputs:
  "root directory out": path  # The main directory which was archived.
  "archive name out": path  # The actual name of the archive. If an archive name has been specified, this is the same name as the input, otherwise this indicates the name which was generated to create the archive.
  "error out": error
types:
  "ZLIB Open ZIP Mode.gtype" = enum{"create new", "append to end", "append to archive"}
uses:
  openg.library.file::Valid Path - Traditional.gvi
  openg.library.file::List Directory Recursive.gvi
  openg.library.file::Convert File Extension (Path).gvi
  OpenG.Zip::ZLIB Open Zip Archive.gvi
  openg.library.file::Compare Two Paths - Scalar.gvi
  OpenG.Zip::ZLIB Store File.gvi
  OpenG.Zip::ZLIB Close Zip Archive.gvi
  openg.library.error::Build Error Cluster.gvi
diagram:
  Property Node(instance in=$"error in (no error)") -> ("status"=w1)
  case (w1) {
    frame False, Default {
      call "Valid Path - Traditional.gvi"(path=$"root directory (file dialog)") -> (valid=w5)
      case (w5) {
        frame False, Default {
          File Dialog[FileDialogSelectionMode=File, NewOrExistingMode=New](prompt="Select Top Level directory to compress ") -> (cancelled=w7, error out=w8, selected path=w6)
          Property Node(instance in=w8)
        }
        frame True {
          w6 = $"root directory (file dialog)"
          w7 = FALSE
        }
      }
      case (w7) {
        frame False, Default {
          case ($"include subdirectories (F)") {
            frame True {
              call "List Directory Recursive.gvi"(Path=w6, error in (no error)=$"error in (no error)") -> (file paths=w11, dir paths=w12, error out=w10)
              Build Array[ConcatenateInputs=True](w12, w11) -> w9
            }
            frame False {
              List Folder(error in=$"error in (no error)", path=w6) -> (error out=w10, file names=w13, path out=w14)
              for {
                w15 = each element of w13
                Build Path(base path=w14, name or relative path=w15) -> (appended path=w16)
                append w16 to w9
              }
            }
          }
          # ZIP files should also contain a file entry for each
          # subdirectory they contain, but not for the '.' dir.
          call "Valid Path - Traditional.gvi"(path=$"archive name (root directory with .zip ending)") -> (valid=w17)
          case (w17) {
            frame False, Default {
              call "Convert File Extension (Path).gvi"(file name=w6, new ending (none)="zip") -> (new filename=w4)
            }
            frame True {
              w4 = $"archive name (root directory with .zip ending)"
            }
          }
          call "ZLIB Open Zip Archive.gvi"(archive name=w4, append (create new)=$"append (create new)", error in (no error)=w10) -> (zip Refnum=w18, error out=w19)
          s1 = w18  # shift register
          s2 = w19  # shift register
          for {
            w20 = each element of w9
            call "Compare Two Paths - Scalar.gvi"(path1=w6, path2=w20) -> (relative path from 1 to 2=w21)
            call "ZLIB Store File.gvi"(zip Refnum=s1, source path=w20, internal name (same as source name)=w21, error in (no error)=s2, password (none)=$"password (none)") -> (zip Refnum out=w22, error out=w23)
            next s1 = w22
            next s2 = w23
          }
          call "ZLIB Close Zip Archive.gvi"(zip Refnum=s1, error in (no error)=s2) -> (error out=w2)
          w3 = w6
        }
        frame True {
          call "Build Error Cluster.gvi"(code="Cancelled by user"(43)) -> (error out=w2)
          w3 = w6
          w4 = $"archive name (root directory with .zip ending)"
        }
      }
    }
    frame True {
      w2 = $"error in (no error)"
      w3 = $"root directory (file dialog)"
      w4 = $"archive name (root directory with .zip ending)"
    }
  }
  $"error out" <- w2
  $"archive name out" <- w4
  $"root directory out" <- w3
