vi "ZLIB Compress Files.gvi"   [LabVIEW Platform Developer Preview 0.1.0]
# This function compresses a number of files into a ZIP file. Thearchive name must be defined and if no archive name is passed to the function it will prompt the user for such a archive name with the file dialog.
# password, if not empty, will encrypt all the newly added files in the archive in such a way that they can only be extracted with the password later on.
inputs:
  "archive name (file dialog)": path  # The archive name to create or append to. If this is left unwired, the function will prompt the user for a archive file name.
  "file names": path[], required
  "internal names (file name without path)": path[]
  "error in (no error)": error
  "append (create new)": "ZLIB Open ZIP Mode.gtype" = "create new"  # This parameter defines how the file(s) should be added to the archive. Possible values are: 0: create new creates a new archive and adds the file(s) to it] 1: append to file creates a new archive as above and adds it to the end of an already existing file 2: append to archive appends the file(s) to an existing archive extending its contents
  "password (none)": string
    # Specify the password to use to encrypt the newly added files in the archive. Leave this parameter empty if the new files should not be encrypted.
    # Note: The supported encryption algorithme is the one used in the original pkzip utility. Some versions of pkzip have some quirks in the encryption algorithme and this function does not try to work around all of them. Also note that newer versions of WinZip (probably >= 8.0) use their own non-standard password encryption and therefore can't be decrypted by this routine.
outputs:
  "archive name out": path  # The actual name of the archive. If an archive name has been specified, this is the same name as the input, otherwise this indicates the name which was selected by the user for the archive.
  "error out": error
types:
  "ZLIB Open ZIP Mode.gtype" = enum{"create new", "append to end", "append to archive"}
uses:
  openg.library.file::Valid Path - Traditional.gvi
  OpenG.Zip::ZLIB Open Zip Archive.gvi
  openg.library.file::Strip Path - Arrays.gvi
  OpenG.Zip::ZLIB Store File.gvi
  OpenG.Zip::ZLIB Close Zip Archive.gvi
  openg.library.error::Build Error Cluster.gvi
diagram:
  Property Node(instance in=$"error in (no error)") -> ("status"=w1)
  case (w1) {
    frame False, Default {
      call "Valid Path - Traditional.gvi"(path=$"archive name (file dialog)") -> (valid=w4)
      case (w4) {
        frame False, Default {
          File Dialog[FileDialogSelectionMode=File, NewOrExistingMode=New](pattern (all files)="*.zip", prompt="Select archive name to compress the files into ") -> (cancelled=w6, error out=w7, selected path=w5)
          Property Node(instance in=w7)
        }
        frame True {
          w5 = $"archive name (file dialog)"
          w6 = FALSE
        }
      }
      case (w6) {
        frame False, Default {
          call "ZLIB Open Zip Archive.gvi"(archive name=w5, append (create new)=$"append (create new)", error in (no error)=$"error in (no error)") -> (zip Refnum=w8, error out=w9)
          Array Size(array=$"internal names (file name without path)") -> (size(s)=w10)
          Is Less Or Equal To 0(x=w10) -> w11
          case (w11) {
            frame False, Default {
              w12 = $"internal names (file name without path)"
            }
            frame True {
              call "Strip Path - Arrays.gvi"(path=$"file names") -> (name=w13)
              String To Path(string=w13) -> (path=w12)
            }
          }
          s1 = w8  # shift register
          s2 = w9  # shift register
          for {
            w14 = each element of $"file names"
            w15 = each element of w12
            call "ZLIB Store File.gvi"(zip Refnum=s1, source path=w14, internal name (same as source name)=w15, error in (no error)=s2, password (none)=$"password (none)") -> (zip Refnum out=w16, error out=w17)
            next s1 = w16
            next s2 = w17
          }
          call "ZLIB Close Zip Archive.gvi"(zip Refnum=s1, error in (no error)=s2) -> (error out=w2)
          w3 = w5
        }
        frame True {
          call "Build Error Cluster.gvi"(code="Cancelled by user"(43)) -> (error out=w2)
          w3 = w5
        }
      }
    }
    frame True {
      w2 = $"error in (no error)"
      w3 = $"archive name (file dialog)"
    }
  }
  $"archive name out" <- w3
  $"error out" <- w2
