vi "ZLIB Deflate.gvi"   [LabVIEW Platform Developer Preview 0.1.0]
# Compresses data passed into "input".  Valid compressions levels are 0(least) to 9(greatest) with 0 being no compression. Compression level -1 is the default compression for the zlib library and is normally equal to 6. Returns the deflated output data, and the length of the output.
# Returns "Generic Error" (42) when the zlib routine encountered any errors.
inputs:
  "input": string
  "compression level (default)": i32 = -1
  "error in (no error)": error
outputs:
  "deflated output": string
  "length": i32
  "error out": error
uses:
  OpenG.Zip::lvzlib.sli::lvzip_compress2
  openg.library.error::Build Error Cluster.gvi
diagram:
  Property Node(instance in=$"error in (no error)") -> ("status"=w1)
  case (w1) {
    frame False, Default {
      String To Byte Array(encoding="Extended ASCII", string=$input) -> (unsigned byte array=w5)
      Array Size(array=w5) -> (size(s)=w6)
      # 1.01 * input length + 12
      Quotient And Remainder(x=w6, y=100) -> (floor(x/y)=w7)
      Add(w7, 13, w6) -> w8
      Initialize Array(element=0, size=w8) -> w9
      call "lvzip_compress2"(pDest in=w9, destLen in=w8, pSource in=w5, sourceLen in=w6, level in=$"compression level (default)") -> (return=w10, pDest out=w11, destLen out=w4)
      Is Less Than 0(x=w10) -> w12
      case (w12) {
        frame False, Default {
          w2 = $"error in (no error)"
        }
        frame True {
          call "Build Error Cluster.gvi"(code="Generic error"(42)) -> (error out=w2)
        }
      }
      Array Subset(array=w11, length0=w4) -> w13
      Byte Array To String(encoding="Extended ASCII", unsigned byte array=w13) -> (string=w3)
    }
    frame True {
      w2 = $"error in (no error)"
      w3 = ""
      w4 = 0
    }
  }
  $"error out" <- w2
  $"deflated output" <- w3
  $length <- w4
