vi "ZLIB Delete Files From Archive.gvi"   [LabVIEW Platform Developer Preview 0.1.0]
# This function accepts a zip archive file name and deletes the specified files from it. It does this by creating a temporary file and copying all files which must not be deleted into this file and when everything was successful, it replaces the original archive with the temporary copy.
# The copying happens in raw mode which means that the files are not decompressed and compressed again and also that even password protected files are just copied over into the new archive without any problems, keeping their passwords.
inputs:
  "archive name (file dialog)": path  # The archive to delete files from. If this is left empty a file dialog will prompt the user to select the archive from which to delete the files.
  "files to delete": path[]  # This array specifies the files to delete from an archive. This name must be the entire internal name in the archive for files which are situated in subdirectories inside of the archive.
  "error in (no error)": error
outputs:
  "archive name out": path  # The actual name of the archive. If an archive name has been specified, this is the same name as the input, otherwise this indicates the name which was selected by the user for the archive.
  "error out": error
uses:
  openg.library.file::Valid Path - Traditional.gvi
  openg.library.file::Temporary Filename.gvi
  OpenG.Zip::ZLIB Open Zip Archive.gvi
  OpenG.Zip::ZLIB Open Unzip Archive.gvi
  OpenG.Zip::ZLIB Get Global Info.gvi
  OpenG.Zip::ZLIB Specific Path to Common Path.gvi
  OpenG.Zip::ZLIB Go To Next File.gvi
  OpenG.Zip::ZLIB Go To First File.gvi
  OpenG.Zip::ZLIB Get Current File Info.gvi
  OpenG.Zip::ZLIB Move Raw File.gvi
  OpenG.Zip::ZLIB Close Unzip Archive.gvi
  OpenG.Zip::ZLIB Close Zip Archive.gvi
  openg.library.file::Force File Move.gvi
  openg.library.error::Build Error Cluster.gvi
diagram:
  Property Node(instance in=$"error in (no error)") -> ("status"=w1)
  case (w1) {
    frame False, Default {
      call "Valid Path - Traditional.gvi"(path=$"archive name (file dialog)") -> (valid=w4)
      case (w4) {
        frame False, Default {
          File Dialog[FileDialogSelectionMode=File, NewOrExistingMode=New](prompt="Select file to delete the specified files from") -> (cancelled=w6, error out=w7, selected path=w5)
          Property Node(instance in=w7)
        }
        frame True {
          w5 = $"archive name (file dialog)"
          w6 = FALSE
        }
      }
      case (w6) {
        frame False, Default {
          call "Temporary Filename.gvi"(error in (no error)=$"error in (no error)") -> (file in tmp dir=w8, error out=w9)
          call "ZLIB Open Zip Archive.gvi"(archive name=w8, error in (no error)=w9) -> (zip Refnum=w10, error out=w11)
          call "ZLIB Open Unzip Archive.gvi"(archive name=w5, error in (no error)=w11) -> (unzip Refnum=w12, error out=w13)
          call "ZLIB Get Global Info.gvi"(unzip Refnum=w12, error in (no error)=w13) -> (unzip Refnum out=w14, global comment=w15, nEntry=w16, error out=w17)
          for {
            w18 = each element of $"files to delete"
            call "ZLIB Specific Path to Common Path.gvi"(specific path=w18) -> (common path=w20)
            append w20 to w19
          }
          s1 = w14  # shift register
          s2 = w17  # shift register
          s3 = w10  # shift register
          s4 = TRUE  # shift register
          for (N = w16) {
            case (s4) {
              frame False, Default {
                call "ZLIB Go To Next File.gvi"(unzip Refnum=s1, error in (no error)=s2) -> (unzip Refnum out=w21, error out=w22)
              }
              frame True {
                call "ZLIB Go To First File.gvi"(unzip Refnum=s1, error in (no error)=s2) -> (unzip Refnum out=w21, error out=w22)
              }
            }
            call "ZLIB Get Current File Info.gvi"(unzip Refnum=w21, error in (no error)=w22) -> (unzip Refnum out=w23, name=w24, file info=w25, error out=w26)
            Search 1D Array(1D array=w19, element=w24) -> (index of element=w27)
            case (w27) {
              frame 0, Default {
                w28 = w23
                w29 = w26
                w30 = s3
              }
              frame -1 {
                call "ZLIB Move Raw File.gvi"(unzip Refnum=w23, name=w24, file info=w25, error in (no error)=w26, zip Refnum=s3) -> (unzip Refnum out=w28, error out=w29, zip Refnum out=w30)
              }
            }
            next s1 = w28
            next s2 = w29
            next s3 = w30
            next s4 = FALSE
          }
          call "ZLIB Close Unzip Archive.gvi"(unzip Refnum=s1, error in (no error)=s2) -> (error out=w31)
          call "ZLIB Close Zip Archive.gvi"(zip Refnum=s3, global comment (use original comment for existing files)=w15, error in (no error)=w31) -> (error out=w32)
          call "Force File Move.gvi"(target=w5, source=w8, error in (no error)=w32) -> (error out=w2)
          w3 = w5
        }
        frame True {
          call "Build Error Cluster.gvi"(code="Cancelled by user"(43)) -> (error out=w2)
          w3 = w5
        }
      }
    }
    frame True {
      w2 = $"error in (no error)"
      w3 = $"archive name (file dialog)"
    }
  }
  $"archive name out" <- w3
  $"error out" <- w2
