vi "ZLIB Enumerate File Contents Old.gvi"   [LabVIEW Platform Developer Preview 0.1.0]
# Lists all the information contained in the file of an unzip session.
inputs:
  "unzip Refnum": "ZLIB Unzip Handle.gtype", required
  "error in (no error)": error
outputs:
  "unzip Refnum out": "ZLIB Unzip Handle.gtype"
  "file names": string[]
  "file infos": "ZLIB File Info Old.gtype"[]
  "error out": error
  "extra data": string[]
  "global comment": string
  "file comments": string[]
panel controls:
  "file info": "ZLIB File Info Old.gtype"
types:
  "ZLIB File Info Old.gtype" = cluster{"version": u32, "version needed": u32, "flag": u32, "compression": u32, "dos date": u32, "crc": u32, "compressed size": u32, "uncompressed size": u32, "size filename": u32, "size file extra": u32, "size file comment": u32, "disk num start": u32, "internal fa": u32, "external fa": u32, "file timestamp": u32}
  "ZLIB Unzip Handle.gtype" = i32
uses:
  OpenG.Zip::ZLIB Get Global Info.gvi
  OpenG.Zip::ZLIB Go To Next File.gvi
  OpenG.Zip::ZLIB Go To First File.gvi
  OpenG.Zip::ZLIB Get Current File Info.gvi
diagram:
  call "ZLIB Get Global Info.gvi"(unzip Refnum=$"unzip Refnum", error in (no error)=$"error in (no error)") -> (unzip Refnum out=w1, global comment=w2, nEntry=w3, error out=w4)
  $"global comment" <- w2
  w5 = $"file info"
  s1 = w1  # shift register
  s2 = w4  # shift register
  s3 = TRUE  # shift register
  for (N = w3) {
    case (s3) {
      frame False, Default {
        call "ZLIB Go To Next File.gvi"(unzip Refnum=s1, error in (no error)=s2) -> (unzip Refnum out=w10, error out=w11)
      }
      frame True {
        call "ZLIB Go To First File.gvi"(unzip Refnum=s1, error in (no error)=s2) -> (unzip Refnum out=w10, error out=w11)
      }
    }
    call "ZLIB Get Current File Info.gvi"(unzip Refnum=w10, error in (no error)=w11) -> (unzip Refnum out=w12, name=w13, file info=w14, error out=w15)
    Property Node(instance in=w14) -> ("extra info"=w16, "file comment"=w17, "version"=w18, "version needed"=w19, "flag"=w20, "compression"=w21, "dos date"=w22, "crc"=w23, "compressed size"=w24, "uncompressed size"=w25, "extra info"=w26, "file comment"=w27, "disk num start"=w28, "internal fa"=w29, "external fa"=w30, "file timestamp"=w31)
    String Length(string=w13) -> (length=w32)
    String Length(string=w26) -> (length=w33)
    String Length(string=w27) -> (length=w34)
    Property Node(instance in=w5, "version"=w18, "version needed"=w19, "flag"=w20, "compression"=w21, "dos date"=w22, "crc"=w23, "compressed size"=w24, "uncompressed size"=w25, "size filename"=w32, "size file extra"=w33, "size file comment"=w34, "disk num start"=w28, "internal fa"=w29, "external fa"=w30, "file timestamp"=w31) -> (instance out=w35)
    append w13 to w6
    append w17 to w7
    append w35 to w8
    append w16 to w9
    next s1 = w12
    next s2 = w15
    next s3 = FALSE
  }
  $"extra data" <- w9
  $"file comments" <- w7
  $"unzip Refnum out" <- s1
  $"file infos" <- w8
  $"file names" <- w6
  $"error out" <- s2
