vi "ZLIB Enumerate File Contents.gvi"   [LabVIEW Platform Developer Preview 0.1.0]
# Lists all the information contained in the file of an unzip session.
inputs:
  "unzip Refnum": "ZLIB Unzip Handle.gtype"
  "error in (no error)": error
outputs:
  "unzip Refnum out": "ZLIB Unzip Handle.gtype"
  "file names": string[]
  "file infos": "ZLIB File Info.gtype"[]
  "error out": error
  "global comment": string
types:
  "ZLIB File Info.gtype" = cluster{"version": u32, "version needed": u32, "encrypted": bool, "flag": u32, "compression": i32, "dos date": u32, "crc": u32, "compressed size": u32, "uncompressed size": u32, "extra info": string, "file comment": string, "disk num start": u32, "internal fa": u32, "external fa": u32, "file timestamp": u32}
  "ZLIB Unzip Handle.gtype" = i32
uses:
  OpenG.Zip::ZLIB Get Global Info.gvi
  OpenG.Zip::ZLIB Go To Next File.gvi
  OpenG.Zip::ZLIB Go To First File.gvi
  OpenG.Zip::ZLIB Get Current File Info.gvi
diagram:
  call "ZLIB Get Global Info.gvi"(unzip Refnum=$"unzip Refnum", error in (no error)=$"error in (no error)") -> (unzip Refnum out=w1, global comment=w2, nEntry=w3, error out=w4)
  $"global comment" <- w2
  s1 = w1  # shift register
  s2 = w4  # shift register
  s3 = TRUE  # shift register
  for (N = w3) {
    case (s3) {
      frame False, Default {
        call "ZLIB Go To Next File.gvi"(unzip Refnum=s1, error in (no error)=s2) -> (unzip Refnum out=w7, error out=w8)
      }
      frame True {
        call "ZLIB Go To First File.gvi"(unzip Refnum=s1, error in (no error)=s2) -> (unzip Refnum out=w7, error out=w8)
      }
    }
    call "ZLIB Get Current File Info.gvi"(unzip Refnum=w7, error in (no error)=w8) -> (unzip Refnum out=w9, name=w10, file info=w11, error out=w12)
    append w10 to w5
    append w11 to w6
    next s1 = w9
    next s2 = w12
    next s3 = FALSE
  }
  $"file names" <- w5
  $"file infos" <- w6
  $"unzip Refnum out" <- s1
  $"error out" <- s2
