vi "ZLIB Extract All Files To Dir.gvi"   [LabVIEW Platform Developer Preview 0.1.0]
# This function accepts a zip archive file name and extracts all its files into the directory specified in the root directory input. If no archive file input is specified a file dialog prompts the user to select an archive file. If no root directory is specified a directory with the same name minus file extension and in the same location as the archive is created. Files in archives can have relative paths, which this function will respect, creating subdirectories as needed in the root directory.
# password specifies a necessary password if the archive is encrypted. Leave this parameter empty if the password is not encrypted.
inputs:
  "archive name (file dialog)": path  # The archive to extract files from. If this is left empty a file dialog will prompt the user to select the archive from which to extract the files.
  "root directory (archive name without ending)": path  # The root directory name to extract the files in the archive into. If this is left unwired, the function will use or create a directory with the same name as the archive name but without the .zip ending.
  "error in (no error)": error
  "password (none)": string
    # Specify the password to use to decrypt the files in the archive, if it is encrypted. Leave this parameter empty if the archive is not encrypted.
    # Note: The supported encryption algorithme is the one used in the original pkzip utility. Some versions of pkzip have some quirks in the encryption algorithme and this function does not try to work around all of them. Also note that newer versions of WinZip (probably >= 8.0) use their own non-standard password encryption and therefore can't be decrypted by this routine.
outputs:
  "archive name out": path  # The actual name of the archive. If an archive name has been specified, this is the same name as the input, otherwise this indicates the name which was selected by the user for the archive.
  "root directory out": path  # The main directory which was archived.
  "error out": error
uses:
  openg.library.file::Valid Path - Traditional.gvi
  openg.library.file::Convert File Extension (Path).gvi
  OpenG.Zip::ZLIB Open Unzip Archive.gvi
  OpenG.Zip::ZLIB Get Global Info.gvi
  OpenG.Zip::ZLIB Go To Next File.gvi
  OpenG.Zip::ZLIB Go To First File.gvi
  OpenG.Zip::ZLIB Get Current File Info.gvi
  OpenG.Zip::ZLIB Common Path to Specific Path.gvi
  OpenG.Zip::ZLIB Get File.gvi
  OpenG.Zip::ZLIB Close Unzip Archive.gvi
  openg.library.error::Build Error Cluster.gvi
diagram:
  Property Node(instance in=$"error in (no error)") -> ("status"=w1)
  case (w1) {
    frame False, Default {
      call "Valid Path - Traditional.gvi"(path=$"archive name (file dialog)") -> (valid=w5)
      case (w5) {
        frame False, Default {
          File Dialog[FileDialogSelectionMode=File, NewOrExistingMode=New](prompt="Select file to extract all files from") -> (cancelled=w7, error out=w8, selected path=w6)
          Property Node(instance in=w8)
        }
        frame True {
          w6 = $"archive name (file dialog)"
          w7 = FALSE
        }
      }
      case (w7) {
        frame False, Default {
          call "Valid Path - Traditional.gvi"(path=$"root directory (archive name without ending)") -> (valid=w9)
          case (w9) {
            frame False, Default {
              call "Convert File Extension (Path).gvi"(file name=w6) -> (new filename=w4)
            }
            frame True {
              w4 = $"root directory (archive name without ending)"
            }
          }
          call "ZLIB Open Unzip Archive.gvi"(archive name=w6, error in (no error)=$"error in (no error)") -> (unzip Refnum=w10, error out=w11)
          call "ZLIB Get Global Info.gvi"(unzip Refnum=w10, error in (no error)=w11) -> (unzip Refnum out=w12, nEntry=w13, error out=w14)
          s1 = w12  # shift register
          s2 = w14  # shift register
          s3 = TRUE  # shift register
          for (N = w13) {
            case (s3) {
              frame False, Default {
                call "ZLIB Go To Next File.gvi"(unzip Refnum=s1, error in (no error)=s2) -> (unzip Refnum out=w15, error out=w16)
              }
              frame True {
                call "ZLIB Go To First File.gvi"(unzip Refnum=s1, error in (no error)=s2) -> (unzip Refnum out=w15, error out=w16)
              }
            }
            call "ZLIB Get Current File Info.gvi"(unzip Refnum=w15, error in (no error)=w16) -> (unzip Refnum out=w17, name=w18, file info=w19, error out=w20)
            call "ZLIB Common Path to Specific Path.gvi"(common path=w18) -> (specific path=w21)
            Build Path(base path=w4, name or relative path=w21) -> (appended path=w22)
            call "ZLIB Get File.gvi"(unzip Refnum=w17, target path=w22, file info=w19, error in (no error)=w20, password (none)=$"password (none)") -> (unzip Refnum out=w23, error out=w24)
            next s1 = w23
            next s2 = w24
            next s3 = FALSE
          }
          call "ZLIB Close Unzip Archive.gvi"(unzip Refnum=s1, error in (no error)=s2) -> (error out=w2)
          w3 = w6
        }
        frame True {
          call "Build Error Cluster.gvi"(code="Cancelled by user"(43)) -> (error out=w2)
          w3 = w6
          w4 = $"root directory (archive name without ending)"
        }
      }
    }
    frame True {
      w2 = $"error in (no error)"
      w3 = $"archive name (file dialog)"
      w4 = $"root directory (archive name without ending)"
    }
  }
  $"archive name out" <- w3
  $"root directory out" <- w4
  $"error out" <- w2
