vi "ZLIB Extract Stream.gvi"   [LabVIEW Platform Developer Preview 0.1.0]
# Extracts a file in an unzip session to a target path.
inputs:
  "unzip Refnum": "ZLIB Unzip Handle.gtype", required
  "internal name": string, required
  "error in (no error)": error
  "password (none)": string
    # Specify the password to use to decrypt the files in the archive, if it is encrypted. Leave this parameter empty if the archive is not encrypted.
    # Note: The supported encryption algorithme is the one used in the original pkzip utility. Some versions of pkzip have some quirks in the encryption algorithme and this function does not try to work around all of them. Also note that newer versions of WinZip (probably >= 8.0) use their own non-standard password encryption and therefore can't be decrypted by this routine.
outputs:
  "unzip Refnum out": "ZLIB Unzip Handle.gtype"
  "byte stream": string
  "error out": error
panel indicators:
  "read only": bool
types:
  "ZLIB Unzip Handle.gtype" = i32
uses:
  OpenG.Zip::ZLIB Locate File.gvi
  OpenG.Zip::ZLIB Get Current File Info.gvi
  OpenG.Zip::ZLIB Open Read File.gvi
  OpenG.Zip::ZLIB Read Compressed Stream.gvi
  OpenG.Zip::ZLIB Close Read File.gvi
  openg.library.error::Build Error Cluster.gvi
diagram:
  call "ZLIB Locate File.gvi"(unzip Refnum=$"unzip Refnum", name (empty: -)=$"internal name", error in (no error)=$"error in (no error)") -> (unzip Refnum out=w1, error out=w2)
  call "ZLIB Get Current File Info.gvi"(unzip Refnum=w1, error in (no error)=w2) -> (unzip Refnum out=w3, file info=w4, error out=w5)
  Property Node(instance in=w4) -> ("uncompressed size"=w6, "external fa"=w7)
  Logical And(w7, 0x8000) -> w8
  Is Not Equal To 0(x=w8) -> w9
  Logical And(w7, 0x10) -> w10
  Is Not Equal To 0(x=w10) -> w11
  case (w11) {
    frame False, Default {
      call "ZLIB Open Read File.gvi"(unzip Refnum=w3, error in (no error)=w5, password (none)=$"password (none)") -> (unzip Refnum out=w15, error out=w16)
      call "ZLIB Read Compressed Stream.gvi"(unzip Refnum=w15, uncompressed size=w6, error in (no error)=w16) -> (unzip Refnum out=w17, byte stream=w14, error out=w18)
      call "ZLIB Close Read File.gvi"(unzip Refnum=w17, error in (no error)=w18) -> (unzip Refnum out=w13, error out=w19)
      case (w9) {
        frame False, Default {
          w12 = w19
        }
        frame True {
          # MacBinary to memory
          call "Build Error Cluster.gvi"(code="Manager call not supported"(53)) -> (error out=w12)
        }
      }
    }
    frame True {
      w12 = w5
      w13 = w3
      w14 = ""
    }
  }
  $"byte stream" <- w14
  $"unzip Refnum out" <- w13
  $"error out" <- w12
  Logical And(w7, 0x1) -> w20
  Is Not Equal To 0(x=w20) -> w21
  $"read only" <- w21
