vi "ZLIB Get Current File Info Old.gvi"   [LabVIEW Platform Developer Preview 0.1.0]
# Gets the info of the current file in an archive in an unzip session.
inputs:
  "unzip Refnum": "ZLIB Unzip Handle.gtype", required
  "error in (no error)": error
outputs:
  "unzip Refnum out": "ZLIB Unzip Handle.gtype"
  "name": string
  "comment": string
  "error out": error
  "extra field": string
  "file info": "ZLIB File Info Old.gtype"
types:
  "ZLIB Unzip Handle.gtype" = i32
  "ZLIB File Info Old.gtype" = cluster{"version": u32, "version needed": u32, "flag": u32, "compression": u32, "dos date": u32, "crc": u32, "compressed size": u32, "uncompressed size": u32, "size filename": u32, "size file extra": u32, "size file comment": u32, "disk num start": u32, "internal fa": u32, "external fa": u32, "file timestamp": u32}
uses:
  OpenG.Zip::ZLIB Get Current File Info.gvi
diagram:
  call "ZLIB Get Current File Info.gvi"(unzip Refnum=$"unzip Refnum", error in (no error)=$"error in (no error)") -> (unzip Refnum out=w1, name=w2, file info=w3, error out=w4)
  Property Node(instance in=w3) -> ("extra info"=w5, "file comment"=w6, "version"=w7, "version needed"=w8, "flag"=w9, "compression"=w10, "dos date"=w11, "crc"=w12, "compressed size"=w13, "uncompressed size"=w14, "extra info"=w15, "file comment"=w16, "disk num start"=w17, "internal fa"=w18, "external fa"=w19, "file timestamp"=w20)
  $"extra field" <- w5
  $comment <- w6
  String Length(string=w15) -> (length=w21)
  String Length(string=w16) -> (length=w22)
  String Length(string=w2) -> (length=w23)
  Property Node(instance in=$"file info", "version"=w7, "version needed"=w8, "flag"=w9, "compression"=w10, "dos date"=w11, "crc"=w12, "compressed size"=w13, "uncompressed size"=w14, "size filename"=w23, "size file extra"=w21, "size file comment"=w22, "disk num start"=w17, "internal fa"=w18, "external fa"=w19, "file timestamp"=w20) -> (instance out=w24)
  $"file info" <- w24
  $"unzip Refnum out" <- w1
  $name <- w2
  $"error out" <- w4
