vi "ZLIB Get Current File Info.gvi"   [LabVIEW Platform Developer Preview 0.1.0]
# Gets the info of the current file in an archive in an unzip session.
inputs:
  "unzip Refnum": "ZLIB Unzip Handle.gtype", required
  "error in (no error)": error
outputs:
  "unzip Refnum out": "ZLIB Unzip Handle.gtype"
  "name": string
  "file info": "ZLIB File Info.gtype"
  "error out": error
types:
  "ZLIB Unzip Handle.gtype" = i32
  "ZLIB File Info.gtype" = cluster{"version": u32, "version needed": u32, "encrypted": bool, "flag": u32, "compression": i32, "dos date": u32, "crc": u32, "compressed size": u32, "uncompressed size": u32, "extra info": string, "file comment": string, "disk num start": u32, "internal fa": u32, "external fa": u32, "file timestamp": u32}
  T1 = cluster{"sec": i32, "min": i32, "hour": i32, "mday": i32, "mon": i32, "year": i32}
  "ZLIB Uncompress File Info__ogtk.gtype" = cluster{"version": u32, "version needed": u32, "flag": u32, "compression": u32, "dos date": u32, "crc": u32, "compressed size": u32, "uncompressed size": u32, "size filename": u32, "size file extra": u32, "size file comment": u32, "disk num start": u32, "internal fa": u32, "external fa": u32, "date time": T1}
uses:
  OpenG.Zip::lvzlib.sli::lvzip_unzGetCurrentFileInfo
  openg.library.error::Build Error Cluster.gvi
  OpenG.Zip::lvzlib.sli::lvzip_unzGetCurrentFileInfo_2
  OpenG.Zip::ZLIB Convert File Info.gvi
diagram:
  Property Node(instance in=$"error in (no error)") -> ("status"=w1)
  case (w1) {
    frame False, Default {
      Type Cast(type=u32 0, x=$"unzip Refnum") -> w7
      call "lvzip_unzGetCurrentFileInfo"(unzFile in=w7, fileInfo in="ZLIB Uncompress File Info__ogtk.gtype" {all zero or empty}, fileName in=0, fileNameLen in=0, extraField in=0, extraFieldLen in=0, comment in=0, commentLen in=0) -> (return=w8, unzFile out=w9, fileInfo out=w10)
      case (w8) {
        frame Default {
          call "Build Error Cluster.gvi"(code="File not found"(7)) -> (error out=w2)
          w3 = w10
          w4 = ""
          w5 = ""
          w6 = ""
        }
        frame 0 {
          Property Node(instance in=w10) -> ("size filename"=w11, "size file extra"=w12, "size file comment"=w13)
          Increment(x=w11) -> w14
          Increment(x=w13) -> w15
          Initialize Array(element=0, size=w12) -> w16
          Initialize Array(element=0, size=w14) -> w17
          Byte Array To String(encoding="Extended ASCII", unsigned byte array=w17) -> (string=w18)
          Initialize Array(element=0, size=w15) -> w19
          Byte Array To String(encoding="Extended ASCII", unsigned byte array=w19) -> (string=w20)
          call "lvzip_unzGetCurrentFileInfo_2"(unzFile in=w9, fileInfo in=w10, fileName in=w18, fileNameLen in=w14, extraField in=w16, extraFieldLen in=w12, comment in=w20, commentLen in=w15) -> (return=w21, fileInfo out=w3, fileName out=w4, extraField out=w22, comment out=w5)
          case (w21) {
            frame 0 { }
            frame Default {
              call "Build Error Cluster.gvi"(code="File not found"(7)) -> (error out=w23)
            }
          }
          Byte Array To String(encoding="Extended ASCII", unsigned byte array=w22) -> (string=w6)
          w2 = $"error in (no error)"
        }
      }
    }
    frame True {
      w2 = $"error in (no error)"
      w3 = "ZLIB Uncompress File Info__ogtk.gtype" {all zero or empty}
      w4 = ""
      w5 = ""
      w6 = ""
    }
  }
  $"error out" <- w2
  $name <- w4
  call "ZLIB Convert File Info.gvi"(uncompress file info in=w3, extra field=w6, comment=w5) -> (file info out=w24)
  $"file info" <- w24
  $"unzip Refnum out" <- $"unzip Refnum"
