vi "ZLIB Get File.gvi"   [LabVIEW Platform Developer Preview 0.1.0]
# Extracts the currently selected file inside the archive into an external file.
inputs:
  "unzip Refnum": "ZLIB Unzip Handle.gtype"
  "target path": path
  "file info": "ZLIB File Info.gtype"
  "error in (no error)": error
  "overwrite (F)": bool
  "password (none)": string
    # Specify the password to use to decrypt the files in the archive, if it is encrypted. Leave this parameter empty if the archive is not encrypted.
    # Note: The supported encryption algorithme is the one used in the original pkzip utility. Some versions of pkzip have some quirks in the encryption algorithme and this function does not try to work around all of them. Also note that newer versions of WinZip (probably >= 8.0) use their own non-standard password encryption and therefore can't be decrypted by this routine.
outputs:
  "unzip Refnum out": "ZLIB Unzip Handle.gtype"
  "error out": error
types:
  "ZLIB File Info.gtype" = cluster{"version": u32, "version needed": u32, "encrypted": bool, "flag": u32, "compression": i32, "dos date": u32, "crc": u32, "compressed size": u32, "uncompressed size": u32, "extra info": string, "file comment": string, "disk num start": u32, "internal fa": u32, "external fa": u32, "file timestamp": u32}
  "ZLIB Unzip Handle.gtype" = i32
uses:
  OpenG.Zip::ZLIB Open Read File.gvi
  OpenG.Zip::ZLIB Read Compressed File.gvi
  OpenG.Zip::ZLIB Close Read File.gvi
  OpenG.Mac Binary::MACBIN Decode MacBinary.gvi
  openg.library.file::Create Dir if Non-Existant.gvi
diagram:
  Property Node(instance in=$"file info") -> ("uncompressed size"=w1, "file timestamp"=w2, "external fa"=w3)
  Logical And(w3, 0x8000) -> w4
  Is Not Equal To 0(x=w4) -> w5
  Logical And(w3, 0x10) -> w6
  Is Not Equal To 0(x=w6) -> w7
  Logical And(w3, 0x1) -> w8
  Is Not Equal To 0(x=w8) -> w9
  Select(s=w9, t=365, f=493) -> w10
  case (w7) {
    frame False, Default {
      call "ZLIB Open Read File.gvi"(unzip Refnum=$"unzip Refnum", error in (no error)=$"error in (no error)", password (none)=$"password (none)") -> (unzip Refnum out=w13, error out=w14)
      call "ZLIB Read Compressed File.gvi"(unzip Refnum=w13, target path=$"target path", uncompressed size=w1, error in (no error)=w14, overwrite (F)=$"overwrite (F)") -> (unzip Refnum out=w15, error out=w16)
      call "ZLIB Close Read File.gvi"(unzip Refnum=w15, target path=$"target path", file timestamp (no change)=w2, error in (no error)=w16) -> (unzip Refnum out=w12, error out=w11)
      case (w5) {
        frame False, Default {
          Set Permissions(error in=w11, path=$"target path", permissions=w10) -> (error out=w17)
        }
        frame True {
          call "MACBIN Decode MacBinary.gvi"(macbinary file=$"target path", error in (no error)=w11) -> (macbinary file out=w18, error out=w19)
          Delete File Or Folder(error in=w19, path (use dialog)=w18) -> (error out=w20)
        }
      }
    }
    frame True {
      call "Create Dir if Non-Existant.gvi"(Directory Path=$"target path", permissions (0755)=w10, error in (no error)=$"error in (no error)") -> (error out=w11)
      w12 = $"unzip Refnum"
    }
  }
  $"unzip Refnum out" <- w12
  $"error out" <- w11
