vi "ZLIB Get Global Info.gvi"   [LabVIEW Platform Developer Preview 0.1.0]
# Gets the global info of an archive in an unzip session.
inputs:
  "unzip Refnum": "ZLIB Unzip Handle.gtype", required
  "error in (no error)": error
outputs:
  "unzip Refnum out": "ZLIB Unzip Handle.gtype"
  "global comment": string
  "nEntry": u32
  "error out": error
types:
  "ZLIB Unzip Handle.gtype" = i32
uses:
  OpenG.Zip::lvzlib.sli::lvzip_unzGetGlobalInfo
  OpenG.Zip::lvzlib.sli::lvzip_unzGetGlobalComment
  openg.library.error::Build Error Cluster.gvi
diagram:
  $"unzip Refnum out" <- $"unzip Refnum"
  Property Node(instance in=$"error in (no error)") -> ("status"=w1)
  w2 = cluster{"nEntry": u32, "commentLen": u32} {all zero or empty}
  case (w1) {
    frame False, Default {
      Type Cast(type=u32 0, x=$"unzip Refnum") -> w6
      call "lvzip_unzGetGlobalInfo"(unzFile in=w6, info in=w2) -> (return=w7, unzFile out=w8, info out=w9)
      case (w7) {
        frame Default {
          w4 = ""
          w5 = 0
          w10 = w7
        }
        frame 0 {
          Property Node(instance in=w9) -> ("nEntry"=w5, "commentLen"=w11)
          Increment(x=w11) -> w12
          Initialize Array(element=0, size=w12) -> w13
          Byte Array To String(encoding="Extended ASCII", unsigned byte array=w13) -> (string=w14)
          call "lvzip_unzGetGlobalComment"(unzFile in=w8, comment in=w14, commentLen in=w12) -> (return=w10, comment out=w4)
        }
      }
      case (w10) {
        frame 0.. {
          w3 = $"error in (no error)"
        }
        frame Default {
          call "Build Error Cluster.gvi"(code="File not found"(7)) -> (error out=w3)
        }
      }
    }
    frame True {
      w3 = $"error in (no error)"
      w4 = ""
      w5 = 0
    }
  }
  $"error out" <- w3
  $"global comment" <- w4
  $nEntry <- w5
