vi "ZLIB Inflate.gvi"   [LabVIEW Platform Developer Preview 0.1.0]
# Inflates data previously deflated with ZLIB Deflate.  "input" is the deflated data string and this vi returns the restored data in "inflated output".
# In order to return the restored data a buffer needs to be allocated. The user of this routine should have stored the size of the original data outside of the compressed data and provide this size to the "expected length" input. Alternatively if the original size is unknown, leaving that parameter open will initially try with double the input buffer size and then retry 3 times each time doubling the buffer size again. This should work for data compressible up to 94%. Since a new buffer is allocated each time again and the data is decompressed into this buffer each time again, it is a good idea to actually provide the correct buffer size whenever possible to improve performance.
# This VI uses the ZLIB compression routines.
# Returns "Generic Error" (42) when the zlib routine encountered any errors.
inputs:
  "input": string
  "expected length (try out)": i32
  "error in (no error)": error
outputs:
  "inflated output": string
  "length": i32
  "error out": error
uses:
  OpenG.Zip::lvzlib.sli::lvzip_uncompress
  openg.library.error::Build Error Cluster.gvi
diagram:
  Property Node(instance in=$"error in (no error)") -> ("status"=w1)
  case (w1) {
    frame False, Default {
      String To Byte Array(encoding="Extended ASCII", string=$input) -> (unsigned byte array=w5)
      Array Size(array=w5) -> (size(s)=w6)
      Is Greater Than 0(x=$"expected length (try out)") -> w7
      case (w7) {
        frame False, Default {
          Logical Shift(x=w6, y=1) -> w8
        }
        frame True {
          w8 = $"expected length (try out)"
        }
      }
      s1 = w8  # shift register
      while (iteration -> i1) {
        Logical Shift(x=s1, y=1) -> w9
        Initialize Array(element=0, size=s1) -> w10
        call "lvzip_uncompress"(pDest in=w10, destLen in=s1, pSource in=w5, sourceLen in=w6) -> (return=w11, pDest out=w12, destLen out=w3)
        Is Not Equal(x=w11, y=-5) -> w13
        Is Greater(x=i1, y=3) -> w14
        Logical Or[output inverted](w13, w14, w7) -> w15
        next s1 = w9
        continue if w15
      }
      # The buffer needs to be large enough. If the caller didn't specify a buffer length to use
      # we try four times to double the output buffer size. This allows for compression up to ~95%
      Is Less Than 0(x=w11) -> w16
      case (w16) {
        frame False, Default {
          w2 = $"error in (no error)"
        }
        frame True {
          call "Build Error Cluster.gvi"(code="Generic error"(42)) -> (error out=w2)
        }
      }
      Array Subset(array=w12, length0=w3) -> w17
      Byte Array To String(encoding="Extended ASCII", unsigned byte array=w17) -> (string=w4)
    }
    frame True {
      w2 = $"error in (no error)"
      w3 = 0
      w4 = ""
    }
  }
  $"error out" <- w2
  $"inflated output" <- w4
  $length <- w3
