vi "ZLIB Initialize Stream Functions.gvi"   [LabVIEW Platform Developer Preview 0.1.0]
# Initialize the function pointers for zip and unzip sessions for memory based streams.
inputs:
  "stream": string
  "error in (no error)": error
outputs:
  "fileFuncs": u8[]
  "error out": error
uses:
  OpenG.Zip::lvzlib.sli::InitializeFileFuncs
  openg.library.error::Build Error Cluster.gvi
  OpenG.Zip::lvzlib.sli::InitializeFileFuncs_3
diagram:
  call "InitializeFileFuncs"(fileFuncs in=0, mem in=0) -> (return=w1)
  case (w1) {
    frame 0..31 {
      call "Build Error Cluster.gvi"(code="Generic file I/O error"(6)) -> (error out=w3)
      w2 = u8[] []
    }
    frame Default {
      Initialize Array(element=0, size=w1) -> w4
      call "InitializeFileFuncs_3"(fileFuncs in=w4, mem in=$stream) -> (fileFuncs out=w2)
      w3 = $"error in (no error)"
    }
  }
  $"error out" <- w3
  $fileFuncs <- w2
