vi "ZLIB Locate File.gvi"   [LabVIEW Platform Developer Preview 0.1.0]
# Locates a file in an archive in an unzip session.
inputs:
  "unzip Refnum": "ZLIB Unzip Handle.gtype", required
  "name (empty: -)": string
  "error in (no error)": error
outputs:
  "unzip Refnum out": "ZLIB Unzip Handle.gtype"
  "error out": error
types:
  "ZLIB Unzip Handle.gtype" = i32
uses:
  OpenG.Zip::lvzlib.sli::lvzip_unzLocateFile
  openg.library.error::Build Error Cluster.gvi
diagram:
  $"unzip Refnum out" <- $"unzip Refnum"
  Property Node(instance in=$"error in (no error)") -> ("status"=w1)
  case (w1) {
    frame False, Default {
      Type Cast(type=u32 0, x=$"unzip Refnum") -> w3
      call "lvzip_unzLocateFile"(unzFile in=w3, fileName in=$"name (empty: -)", caseSens in="platform specific"(0)) -> (return=w4)
      case (w4) {
        frame Default {
          call "Build Error Cluster.gvi"(code="File not found"(7)) -> (error out=w2)
        }
        frame 0 {
          w2 = $"error in (no error)"
        }
      }
    }
    frame True {
      w2 = $"error in (no error)"
    }
  }
  $"error out" <- w2
