vi "ZLIB Open Read File.gvi"   [LabVIEW Platform Developer Preview 0.1.0]
# Opens a file entry in a ZIP archive for reading from it.
inputs:
  "unzip Refnum": "ZLIB Unzip Handle.gtype"
  "error in (no error)": error
  "raw mode (F)": bool
  "password (none)": string
    # Specify the password to use to decrypt the files in the archive, if it is encrypted. Leave this parameter empty if the archive is not encrypted.
    # Note: The supported encryption algorithme is the one used in the original pkzip utility. Some versions of pkzip have some quirks in the encryption algorithme and this function does not try to work around all of them. Also note that newer versions of WinZip (probably >= 8.0) use their own non-standard password encryption and therefore can't be decrypted by this routine.
outputs:
  "unzip Refnum out": "ZLIB Unzip Handle.gtype"
  "method": i32
  "level": i32
  "error out": error
types:
  "ZLIB Unzip Handle.gtype" = i32
uses:
  OpenG.Zip::lvzlib.sli::lvzip_unzOpenCurrentFile3
  OpenG.Zip::lvzlib.sli::lvzip_unzOpenCurrentFile2
  openg.library.error::Build Error Cluster.gvi
diagram:
  Property Node(instance in=$"error in (no error)") -> ("status"=w1)
  case (w1) {
    frame False, Default {
      Boolean To Integer(Boolean=$"raw mode (F)") -> (0, 1=w6)
      Type Cast(type=u32 0, x=$"unzip Refnum") -> w7
      case ($"password (none)") {
        frame Default {
          call "lvzip_unzOpenCurrentFile3"(unzFile in=w7, method in=0, level in=0, raw in=w6, password in=$"password (none)") -> (return=w8, method out=w5, level out=w4)
        }
        frame "" {
          call "lvzip_unzOpenCurrentFile2"(unzFile in=w7, method in=0, level in=0, raw in=w6) -> (return=w8, method out=w5, level out=w4)
        }
      }
      case (w8) {
        frame Default {
          call "Build Error Cluster.gvi"(code="File not found"(7)) -> (error out=w2)
        }
        frame 0 {
          w2 = $"error in (no error)"
        }
      }
      w3 = $"unzip Refnum"
    }
    frame True {
      w2 = $"error in (no error)"
      w3 = $"unzip Refnum"
      w4 = 0
      w5 = 0
    }
  }
  $"unzip Refnum out" <- w3
  $"error out" <- w2
  $method <- w5
  $level <- w4
