vi "ZLIB Open Unzip Archive.gvi"   [LabVIEW Platform Developer Preview 0.1.0]
# Opens an unzip session.
inputs:
  "archive name": path, required
  "error in (no error)": error
outputs:
  "unzip Refnum": "ZLIB Unzip Handle.gtype"
  "error out": error
types:
  "ZLIB Unzip Handle.gtype" = i32
uses:
  OpenG.Zip::ZLIB Path to Path String.gvi
  OpenG.Zip::ZLIB Initialize File Functions.gvi
  OpenG.Zip::lvzlib.sli::lvzip_unzOpen2
  openg.library.error::Build Error Cluster.gvi
diagram:
  Property Node(instance in=$"error in (no error)") -> ("status"=w1)
  case (w1) {
    frame False, Default {
      File Or Directory Info(error in=$"error in (no error)", path=$"archive name") -> (error out=w4, path out=w5)
      # Verify file exists
      call "ZLIB Path to Path String.gvi"(LV file path=w5, error in (no error)=w4) -> (path string=w6, error in (no error) 2=w7)
      call "ZLIB Initialize File Functions.gvi"(error in (no error)=w7) -> (fileFuncs=w8, error out=w9)
      Property Node(instance in=w9) -> ("status"=w10)
      case (w10) {
        frame False, Default {
          call "lvzip_unzOpen2"(path in=w6, fileFuncs in=w8) -> (return=w11)
          Type Cast(type=$"unzip Refnum", x=w11) -> w2
          case (w11) {
            frame 0 {
              call "Build Error Cluster.gvi"(code="File not found"(7)) -> (error out=w3)
            }
            frame Default {
              w3 = w9
            }
          }
        }
        frame True {
          w2 = Not A Refnum
          w3 = w9
        }
      }
    }
    frame True {
      w2 = Not A Refnum
      w3 = $"error in (no error)"
    }
  }
  $"unzip Refnum" <- w2
  $"error out" <- w3
