vi "ZLIB Open Unzip Stream.gvi"   [LabVIEW Platform Developer Preview 0.1.0]
# Opens an unzip session.
inputs:
  "archive stream": string, required
  "error in (no error)": error
outputs:
  "unzip Refnum": "ZLIB Unzip Handle.gtype"
  "error out": error
types:
  "ZLIB Unzip Handle.gtype" = i32
uses:
  OpenG.Zip::ZLIB Initialize Stream Functions.gvi
  OpenG.Zip::lvzlib.sli::lvzip_unzOpen2
  openg.library.error::Build Error Cluster.gvi
diagram:
  Property Node(instance in=$"error in (no error)") -> ("status"=w1)
  case (w1) {
    frame False, Default {
      call "ZLIB Initialize Stream Functions.gvi"(stream=$"archive stream", error in (no error)=$"error in (no error)") -> (fileFuncs=w4, error out=w5)
      Property Node(instance in=w5) -> ("status"=w6)
      case (w6) {
        frame False, Default {
          call "lvzip_unzOpen2"(path in="", fileFuncs in=w4) -> (return=w7)
          Type Cast(type=$"unzip Refnum", x=w7) -> w2
          case (w7) {
            frame 0 {
              call "Build Error Cluster.gvi"(code="File not found"(7)) -> (error out=w3)
            }
            frame Default {
              w3 = w5
            }
          }
        }
        frame True {
          w2 = Not A Refnum
          w3 = w5
        }
      }
    }
    frame True {
      w2 = Not A Refnum
      w3 = $"error in (no error)"
    }
  }
  $"unzip Refnum" <- w2
  $"error out" <- w3
