vi "ZLIB Open Write File.gvi"   [LabVIEW Platform Developer Preview 0.1.0]
# Creates a new entry in the ZIP archive for a new file.
inputs:
  "zip Refnum": "ZLIB Zip Handle.gtype"
  "filename": string
  "file info": "ZLIB File Info.gtype" = {"flag"=4294967295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}
  "error in (no error)": error
  "raw mode (F)": bool
  "local extra data": string
  "password (none)": string
    # Specify the password to use to decrypt the files in the archive, if it is encrypted. Leave this parameter empty if the archive is not encrypted.
    # Note: The supported encryption algorithme is the one used in the original pkzip utility. Some versions of pkzip have some quirks in the encryption algorithme and this function does not try to work around all of them. Also note that newer versions of WinZip (probably >= 8.0) use their own non-standard password encryption and therefore can't be decrypted by this routine.
outputs:
  "zip Refnum out": "ZLIB Zip Handle.gtype"
  "error out": error
types:
  "ZLIB Zip Handle.gtype" = i32
  "ZLIB File Info.gtype" = cluster{"version": u32, "version needed": u32, "encrypted": bool, "flag": u32, "compression": i32, "dos date": u32, "crc": u32, "compressed size": u32, "uncompressed size": u32, "extra info": string, "file comment": string, "disk num start": u32, "internal fa": u32, "external fa": u32, "file timestamp": u32}
  T1 = cluster{"sec": i32, "min": i32, "hour": i32, "mday": i32, "mon": i32, "year": i32}
  "ZLIB Compress File Info__ogtk.gtype" = cluster{"date time": T1, "dosTime": u32, "internal fa": u32, "external fa": u32}
uses:
  OpenG.Zip::lvzlib.sli::lvzip_zipOpenNewFileInZip3
  OpenG.Zip::lvzlib.sli::lvzip_zipOpenNewFileInZip3_2
  openg.library.error::Build Error Cluster.gvi
diagram:
  $"zip Refnum out" <- $"zip Refnum"
  Property Node(instance in=$"error in (no error)") -> ("status"=w1)
  case (w1) {
    frame False, Default {
      Property Node(instance in=$"file info") -> ("file timestamp"=w3, "dos date"=w4, "internal fa"=w5, "external fa"=w6, "extra info"=w7, "file comment"=w8, "compression"=w9, "crc"=w10)
      Type Cast(type=u32 0, x=$"zip Refnum") -> w11
      Is Not Equal To 0(x=w9) -> w12
      Select(s=w12, t=8, f=w9) -> w13
      Boolean To Integer(Boolean=$"raw mode (F)") -> (0, 1=w14)
      String Length(string=$"local extra data") -> (length=w15)
      String Length(string=w7) -> (length=w16)
      LV70U32ToDateRec(Time Input 0=w3) -> (date time rec Output 1=w17)  # LV70U32ToDateRec (Placeholder)
      Property Node(instance in=w17) -> ("second"=w18, "minute"=w19, "hour"=w20, "day of month"=w21, "month"=w22, "year"=w23)
      Decrement(x=w22) -> w24
      Property Node(instance in="ZLIB Compress File Info__ogtk.gtype" {all zero or empty}, "date time:sec"=w18, "date time:min"=w19, "date time:hour"=w20, "date time:mday"=w21, "date time:mon"=w24, "date time:year"=w23, "dosTime"=w4, "internal fa"=w5, "external fa"=w6) -> (instance out=w25)
      case ($"password (none)") {
        frame Default {
          call "lvzip_zipOpenNewFileInZip3"(unzFile in=w11, fileName in=$filename, fileInfo in=w25, extraFieldLocal in=$"local extra data", extraFieldLocalLen in=w15, extraFieldGlobal in=w7, extraFieldGlobalLen in=w16, comment in=w8, method in=w13, level in=w9, raw in=w14, windowBits in=-15, memLevel in=8, strategy in=0, password in=$"password (none)", crc in=w10) -> (return=w26)
        }
        frame "" {
          call "lvzip_zipOpenNewFileInZip3_2"(unzFile in=w11, fileName in=$filename, fileInfo in=w25, extraFieldLocal in=$"local extra data", extraFieldLocalLen in=w15, extraFieldGlobal in=w7, extraFieldGlobalLen in=w16, comment in=w8, method in=w13, level in=w9, raw in=w14, windowBits in=-15, memLevel in=8, strategy in=0, password in=0, crc in=0) -> (return=w26)
        }
      }
      case (w26) {
        frame Default {
          call "Build Error Cluster.gvi"(code="File not found"(7)) -> (error out=w2)
        }
        frame 0 {
          w2 = $"error in (no error)"
        }
      }
    }
    frame True {
      w2 = $"error in (no error)"
    }
  }
  $"error out" <- w2
