vi "ZLIB Open Zip Archive.gvi"   [LabVIEW Platform Developer Preview 0.1.0]
# Opens a zip session.
inputs:
  "archive name": path, required  # The name of the archive file to open or create.
  "append (create new)": "ZLIB Open ZIP Mode.gtype" = "create new"  # This parameter defines how the file(s) should be added to the archive. Possible values are: 0: create new creates a new archive and adds the file(s) to it] 1: append to file creates a new archive as above and adds it to the end of an already existing file 2: append to archive appends the file(s) to an existing archive extending its contents
  "error in (no error)": error
outputs:
  "zip Refnum": "ZLIB Zip Handle.gtype"
  "globalComment": string  # a global comment for the entire archive
  "error out": error
types:
  "ZLIB Zip Handle.gtype" = i32
  "ZLIB Open ZIP Mode.gtype" = enum{"create new", "append to end", "append to archive"}
uses:
  OpenG.Zip::ZLIB Path to Path String.gvi
  OpenG.Zip::ZLIB Initialize File Functions.gvi
  OpenG.Zip::lvzlib.sli::lvzip_zipOpen2
  openg.library.file::LabVIEW.sli::LStrPrintf
  openg.library.error::Build Error Cluster.gvi
diagram:
  Property Node(instance in=$"error in (no error)") -> ("status"=w1)
  case (w1) {
    frame False, Default {
      call "ZLIB Path to Path String.gvi"(LV file path=$"archive name", error in (no error)=$"error in (no error)") -> (path string=w5, error in (no error) 2=w6)
      call "ZLIB Initialize File Functions.gvi"(error in (no error)=w6) -> (fileFuncs=w7, error out=w8)
      Property Node(instance in=w8) -> ("status"=w9)
      case (w9) {
        frame False, Default {
          call "lvzip_zipOpen2"(path in=w5, append in=$"append (create new)", globalComment in=0, fileFuncs in=w7) -> (return=w10, globalComment out=w11)
          Type Cast(type=$"zip Refnum", x=w10) -> w2
          case (w10) {
            frame 0 {
              w4 = ""
              w12 = "File not found"(7)
            }
            frame Default {
              case (w11) {
                frame 0 {
                  w4 = ""
                  w12 = 0
                }
                frame Default {
                  call "LStrPrintf"(dest in="", fmt in="%s", param in=w11) -> (return=w12, dest out=w4)
                }
              }
            }
          }
          case (w12) {
            frame 0 {
              w3 = w8
            }
            frame Default {
              call "Build Error Cluster.gvi"(code=w12) -> (error out=w3)
            }
          }
        }
        frame True {
          w2 = Not A Refnum
          w3 = w8
          w4 = ""
        }
      }
    }
    frame True {
      w2 = Not A Refnum
      w3 = $"error in (no error)"
      w4 = ""
    }
  }
  $"zip Refnum" <- w2
  $"error out" <- w3
  $globalComment <- w4
