vi "ZLIB Open Zip Stream.gvi"   [LabVIEW Platform Developer Preview 0.1.0]
# Opens a zip session.
inputs:
  "archive stream": string, required  # The name of the archive file to open or create.
  "append (create new)": "ZLIB Open ZIP Mode.gtype" = "create new"  # This parameter defines how the file(s) should be added to the archive. Possible values are: 0: create new creates a new archive and adds the file(s) to it] 1: append to file creates a new archive as above and adds it to the end of an already existing file 2: append to archive appends the file(s) to an existing archive extending its contents
  "error in (no error)": error
outputs:
  "zip Refnum": "ZLIB Zip Handle.gtype"
  "globalComment": string  # a global comment for the entire archive
  "error out": error
types:
  "ZLIB Zip Handle.gtype" = i32
  "ZLIB Open ZIP Mode.gtype" = enum{"create new", "append to end", "append to archive"}
uses:
  OpenG.Zip::ZLIB Initialize Stream Functions.gvi
  OpenG.Zip::lvzlib.sli::lvzip_zipOpen2
  openg.library.file::LabVIEW.sli::LStrPrintf
  openg.library.error::Build Error Cluster.gvi
diagram:
  Property Node(instance in=$"error in (no error)") -> ("status"=w1)
  case (w1) {
    frame False, Default {
      call "ZLIB Initialize Stream Functions.gvi"(stream=$"archive stream", error in (no error)=$"error in (no error)") -> (fileFuncs=w5, error out=w6)
      Property Node(instance in=w6) -> ("status"=w7)
      case (w7) {
        frame False, Default {
          call "lvzip_zipOpen2"(path in="", append in=$"append (create new)", globalComment in=0, fileFuncs in=w5) -> (return=w8, globalComment out=w9)
          Type Cast(type=$"zip Refnum", x=w8) -> w2
          case (w8) {
            frame 0 {
              w4 = ""
              w10 = "File not found"(7)
            }
            frame Default {
              case (w9) {
                frame 0 {
                  w4 = ""
                  w10 = 0
                }
                frame Default {
                  call "LStrPrintf"(dest in="", fmt in="%s", param in=w9) -> (return=w10, dest out=w4)
                }
              }
            }
          }
          case (w10) {
            frame 0 {
              w3 = w6
            }
            frame Default {
              call "Build Error Cluster.gvi"(code=w10) -> (error out=w3)
            }
          }
        }
        frame True {
          w2 = Not A Refnum
          w3 = w6
          w4 = ""
        }
      }
    }
    frame True {
      w2 = Not A Refnum
      w3 = $"error in (no error)"
      w4 = ""
    }
  }
  $"zip Refnum" <- w2
  $"error out" <- w3
  $globalComment <- w4
