vi "ZLIB Path to Path String.gvi"   [LabVIEW Platform Developer Preview 0.1.0]
# Converts a LabVIEW path into a platform specific path string. Almost the same
# as the LabVIEW Path To String function but converts on MacOSX from the HFS
# path syntax into a posix path.
inputs:
  "LV file path": path
  "error in (no error)": error
outputs:
  "path string": string
  "error in (no error) 2": error
uses:
  OpenG.Zip::lvzlib.sli::LVPath_ToText
  OpenG.Zip::lvzlib.sli::LVPath_ToText_2
  openg.library.error::Build Error Cluster.gvi
diagram:
  Property Node(instance in=$"error in (no error)") -> ("status"=w1)
  case (w1) {
    frame True {
      Path To String(path=$"LV file path") -> (string=w2)
      w3 = $"error in (no error)"
    }
    frame False {
      call "LVPath_ToText"(path in=$"LV file path", string in="", len in=0) -> (return=w4, path out=w5, string out=w6, len out=w7)
      case (w4) {
        frame Default {
          w8 = w4
          w2 = w6
        }
        frame 0 {
          Initialize Array(element=0, size=w7) -> w9
          Byte Array To String(encoding="Extended ASCII", unsigned byte array=w9) -> (string=w10)
          call "LVPath_ToText_2"(path in=w5, string in=w10, len in=w7) -> (return=w8, string out=w2)
        }
      }
      case (w8) {
        frame Default {
          call "Build Error Cluster.gvi"(code=w8) -> (error out=w3)
        }
        frame 0 {
          w3 = $"error in (no error)"
        }
      }
    }
  }
  $"error in (no error) 2" <- w3
  $"path string" <- w2
