vi "ZLIB Read Compressed File.gvi"   [LabVIEW Platform Developer Preview 0.1.0]
# Copies a file from a ZIP archive to disk.
inputs:
  "unzip Refnum": "ZLIB Unzip Handle.gtype"
  "target path": path
  "uncompressed size": u32
  "error in (no error)": error
  "overwrite (F)": bool
  "permissions (0755)": i16 = 493
outputs:
  "unzip Refnum out": "ZLIB Unzip Handle.gtype"
  "error out": error
types:
  "ZLIB Unzip Handle.gtype" = i32
uses:
  openg.library.file::Create Dir if Non-Existant.gvi
  OpenG.Zip::ZLIB Block Size.gvi
  OpenG.Zip::lvzlib.sli::lvzip_unzReadCurrentFile
  openg.library.error::Build Error Cluster.gvi
diagram:
  $"unzip Refnum out" <- $"unzip Refnum"
  compatOverwrite(overwrite (F) Input 0=$"overwrite (F)") -> w1  # compatOverwrite (Placeholder)
  Strip Path(path=$"target path") -> (stripped path=w2)
  call "Create Dir if Non-Existant.gvi"(Directory Path=w2, permissions (0755)=$"permissions (0755)", error in (no error)=$"error in (no error)") -> (error out=w3)
  Open Or Create Or Replace File(error in=w3, file path (use dialog)=$"target path", operation (0:open)=w1) -> (error out=w4, refnum out=w5)
  Set Permissions(error in=w4, path=$"target path", permissions=$"permissions (0755)") -> (error out=w6)
  Property Node(instance in=w6) -> ("status"=w7)
  case (w7) {
    frame False, Default {
      call "ZLIB Block Size.gvi"(length in=$"uncompressed size") -> (block len=w9, length rem=w10)
      Initialize Array(element=0, size=w9) -> w11
      Type Cast(type=u32 0, x=$"unzip Refnum") -> w12
      s1 = w9  # shift register
      s2 = w10  # shift register
      s3 = w5  # shift register
      s4 = w6  # shift register
      s5 = 0  # shift register
      while {
        call "lvzip_unzReadCurrentFile"(unzFile in=w12, buffer in=w11, size in=s1) -> (return=w13, buffer out=w14)
        Is Less Or Equal To 0(x=w13) -> w15
        case (w13) {
          frame ..-1 {
            call "Build Error Cluster.gvi"(code="File not found"(7)) -> (error out=w16)
            w17 = 0
            w18 = s3
            w19 = s2
            w20 = s1
          }
          frame 0 {
            w16 = s4
            w17 = 0
            w18 = s3
            w19 = s2
            w20 = s1
          }
          frame 1.. {
            Array Subset(array=w14, length0=s1) -> w21
            Set File Position(error in=s4, offset (in bytes) (0)=s5, refnum=s3) -> (error out=w22, refnum out=w23)
            Write To Binary File(data=w21, error in=w22, file (use dialog)=w23, prepend=FALSE) -> (error out=w24, refnum out=w25)
            Get File Position(error in=w24, refnum=w25) -> (error out=w16, offset (in bytes) (0)=w26, refnum out=w18)
            To Long Integer(number=w26) -> w17
            call "ZLIB Block Size.gvi"(length in=s2) -> (block len=w20, length rem=w19)
          }
        }
        Property Node(instance in=w16) -> ("status"=w27)
        Logical Or[output inverted](w27, w15) -> w28
        next s1 = w20
        next s2 = w19
        next s3 = w18
        next s4 = w16
        next s5 = w17
        continue if w28
      }
      Close File(error in=s4, refnum=s3) -> (error out=w8)
    }
    frame True {
      w8 = w6
    }
  }
  $"error out" <- w8
