vi "ZLIB Read Compressed Stream.gvi"   [LabVIEW Platform Developer Preview 0.1.0]
# Copies a byte stream from an unzip session to memory.
inputs:
  "unzip Refnum": "ZLIB Unzip Handle.gtype"
  "uncompressed size": u32
  "error in (no error)": error
outputs:
  "unzip Refnum out": "ZLIB Unzip Handle.gtype"
  "byte stream": string
  "error out": error
types:
  "ZLIB Unzip Handle.gtype" = i32
uses:
  OpenG.Zip::lvzlib.sli::lvzip_unzReadCurrentFile
  openg.library.error::Build Error Cluster.gvi
diagram:
  $"unzip Refnum out" <- $"unzip Refnum"
  Property Node(instance in=$"error in (no error)") -> ("status"=w1)
  case (w1) {
    frame False, Default {
      Initialize Array(element=0, size=$"uncompressed size") -> w4
      Type Cast(type=u32 0, x=$"unzip Refnum") -> w5
      call "lvzip_unzReadCurrentFile"(unzFile in=w5, buffer in=w4, size in=$"uncompressed size") -> (return=w6, buffer out=w7)
      case (w6) {
        frame ..-1 {
          call "Build Error Cluster.gvi"(code="File not found"(7)) -> (error out=w2)
          w3 = ""
        }
        frame 0.. {
          Reshape Array(inArray=w7, size=w6) -> w8
          Byte Array To String(encoding="Extended ASCII", unsigned byte array=w8) -> (string=w3)
          w2 = $"error in (no error)"
        }
      }
    }
    frame True {
      w2 = $"error in (no error)"
      w3 = ""
    }
  }
  $"error out" <- w2
  $"byte stream" <- w3
