vi "ZLIB Read Local Extra Data.gvi"   [LabVIEW Platform Developer Preview 0.1.0]
# Read the local extra data from the local header for the currently open file in the archive.
inputs:
  "unzip Refnum": "ZLIB Unzip Handle.gtype"
  "error in (no error)": error
outputs:
  "unzip Refnum out": "ZLIB Unzip Handle.gtype"
  "local extra data": string
  "error out": error
types:
  "ZLIB Unzip Handle.gtype" = i32
uses:
  OpenG.Zip::lvzlib.sli::lvzip_unzGetLocalExtrafield
  OpenG.Zip::lvzlib.sli::lvzip_unzGetLocalExtrafield_2
  openg.library.error::Build Error Cluster.gvi
diagram:
  Property Node(instance in=$"error in (no error)") -> ("status"=w1)
  case (w1) {
    frame False, Default {
      Type Cast(type=u32 0, x=$"unzip Refnum") -> w5
      call "lvzip_unzGetLocalExtrafield"(unzFile in=w5, buffer in=0, len in=0) -> (return=w6, unzFile out=w7)
      Increment(x=w6) -> w8
      Initialize Array(element=0, size=w8) -> w9
      call "lvzip_unzGetLocalExtrafield_2"(unzFile in=w7, method in=w9, len in=w8) -> (return=w10, method out=w11)
      case (w10) {
        frame ..-1 {
          call "Build Error Cluster.gvi"(code="File not found"(7)) -> (error out=w2)
        }
        frame 0.. {
          w2 = $"error in (no error)"
        }
      }
      Byte Array To String(encoding="Extended ASCII", unsigned byte array=w11) -> (string=w4)
      w3 = $"unzip Refnum"
    }
    frame True {
      w2 = $"error in (no error)"
      w3 = $"unzip Refnum"
      w4 = ""
    }
  }
  $"unzip Refnum out" <- w3
  $"error out" <- w2
  $"local extra data" <- w4
