vi "ZLIB Transfer Raw File.gvi"   [LabVIEW Platform Developer Preview 0.1.0]
# Copies a file in raw mode from an unzip session into the ZIP file. Both file sessions must have been opened in raw mode, otherwise the created archive will be corrupted.
inputs:
  "zip Refnum": "ZLIB Zip Handle.gtype"
  "unzip Refnum": "ZLIB Unzip Handle.gtype"
  "compressed size": u32
  "error in (no error)": error
outputs:
  "zip Refnum out": "ZLIB Zip Handle.gtype"
  "unzip Refnum out": "ZLIB Unzip Handle.gtype"
  "error out": error
types:
  "ZLIB Unzip Handle.gtype" = i32
  "ZLIB Zip Handle.gtype" = i32
uses:
  OpenG.Zip::ZLIB Block Size.gvi
  OpenG.Zip::lvzlib.sli::lvzip_unzReadCurrentFile
  OpenG.Zip::lvzlib.sli::lvzip_zipWriteInFileInZip
  openg.library.error::Build Error Cluster.gvi
diagram:
  Property Node(instance in=$"error in (no error)") -> ("status"=w1)
  case (w1) {
    frame False, Default {
      Type Cast(type=u32 0, x=$"zip Refnum") -> w3
      Type Cast(type=u32 0, x=$"unzip Refnum") -> w4
      s1 = $"compressed size"  # shift register
      s2 = $"error in (no error)"  # shift register
      while {
        call "ZLIB Block Size.gvi"(length in=s1) -> (block len=w5, length rem=w6)
        Initialize Array(element=0, size=w5) -> w7
        call "lvzip_unzReadCurrentFile"(unzFile in=w4, buffer in=w7, size in=w5) -> (return=w8, buffer out=w9)
        case (w8) {
          frame 0, Default {
            call "lvzip_zipWriteInFileInZip"(unzFile in=w3, buffer in=w9, size in=w5) -> (return=w13)
            case (w13) {
              frame Default {
                call "Build Error Cluster.gvi"(code="File not found"(7)) -> (error out=w10)
              }
              frame 0 {
                w10 = s2
              }
            }
            Is Equal To 0(x=w13) -> w14
            Is Greater Than 0(x=w6) -> w15
            Logical And(w14, w15) -> w11
            w12 = w6
          }
          frame 1 {
            w10 = s2
            w11 = FALSE
            w12 = w6
          }
        }
        next s1 = w12
        next s2 = w10
        continue if w11
      }
      w2 = s2
    }
    frame True {
      w2 = $"error in (no error)"
    }
  }
  $"error out" <- w2
  $"zip Refnum out" <- $"zip Refnum"
  $"unzip Refnum out" <- $"unzip Refnum"
