vi "ZLIB VI Tree.gvi"   [LabVIEW Platform Developer Preview 0.1.0]
panel controls:
  "unzip file handle": "ZLIB Unzip Handle.gtype"
  "zip file handle": "ZLIB Zip Handle.gtype"
panel indicators:
  "file info old": "ZLIB File Info Old.gtype"
  "zip file info internal": "ZLIB Compress File Info.gtype"
  "unzip file info internal": "ZLIB Uncompress File Info.gtype"
  "file info": "ZLIB File Info.gtype"
types:
  "ZLIB File Info Old.gtype" = cluster{"version": u32, "version needed": u32, "flag": u32, "compression": u32, "dos date": u32, "crc": u32, "compressed size": u32, "uncompressed size": u32, "size filename": u32, "size file extra": u32, "size file comment": u32, "disk num start": u32, "internal fa": u32, "external fa": u32, "file timestamp": u32}
  T1 = cluster{"sec": i32, "min": i32, "hour": i32, "mday": i32, "mon": i32, "year": i32}
  "ZLIB Compress File Info.gtype" = cluster{"date time": T1, "dosTime": u32, "internal fa": u32, "external fa": u32}
  "ZLIB Uncompress File Info.gtype" = cluster{"version": u32, "version needed": u32, "flag": u32, "compression": u32, "dos date": u32, "crc": u32, "compressed size": u32, "uncompressed size": u32, "size filename": u32, "size file extra": u32, "size file comment": u32, "disk num start": u32, "internal fa": u32, "external fa": u32, "date time": T1}
  "ZLIB Unzip Handle.gtype" = i32
  "ZLIB Zip Handle.gtype" = i32
  "ZLIB File Info.gtype" = cluster{"version": u32, "version needed": u32, "encrypted": bool, "flag": u32, "compression": i32, "dos date": u32, "crc": u32, "compressed size": u32, "uncompressed size": u32, "extra info": string, "file comment": string, "disk num start": u32, "internal fa": u32, "external fa": u32, "file timestamp": u32}
uses:
  OpenG.Zip::ZLIB Extract All Files To Dir.gvi
  OpenG.Zip::ZLIB Delete Files From Archive.gvi
  OpenG.Zip::ZLIB Compress Directory.gvi
  OpenG.Zip::ZLIB Compress Files.gvi
  OpenG.Zip::ZLIB Open Zip Archive.gvi
  OpenG.Zip::ZLIB Store File.gvi
  OpenG.Zip::ZLIB Store Stream.gvi
  OpenG.Zip::ZLIB Open Unzip Archive.gvi
  OpenG.Zip::ZLIB Enumerate File Contents.gvi
  OpenG.Zip::ZLIB Extract File.gvi
  OpenG.Zip::ZLIB Extract Stream.gvi
  OpenG.Zip::ZLIB Copy Raw File.gvi
  OpenG.Zip::ZLIB Close Zip Archive.gvi
  OpenG.Zip::ZLIB Close Unzip Archive.gvi
  OpenG.Zip::ZLIB Open Unzip Stream.gvi
  OpenG.Zip::ZLIB Get Global Info.gvi
  OpenG.Zip::ZLIB Go To First File.gvi
  OpenG.Zip::ZLIB Go To Next File.gvi
  OpenG.Zip::ZLIB Locate File.gvi
  OpenG.Zip::ZLIB Get Current File Info.gvi
  OpenG.Zip::ZLIB Deflate.gvi
  OpenG.Zip::ZLIB Inflate.gvi
  OpenG.Zip::ZLIB CRC32.gvi
  OpenG.Zip::ZLIB Get Version.gvi
  OpenG.Zip::ZLIB Open Read File.gvi
  OpenG.Zip::ZLIB Read Compressed File.gvi
  OpenG.Zip::ZLIB Read Compressed Stream.gvi
  OpenG.Zip::ZLIB Read Local Extra Data.gvi
  OpenG.Zip::ZLIB Close Read File.gvi
  OpenG.Zip::ZLIB Write Stream.gvi
  OpenG.Zip::ZLIB Open Write File.gvi
  OpenG.Zip::ZLIB Write File.gvi
  OpenG.Zip::ZLIB Transfer Raw File.gvi
  OpenG.Zip::ZLIB Close Write File.gvi
  OpenG.Zip::ZLIB Block Size.gvi
  OpenG.Zip::ZLIB Convert File Info.gvi
  OpenG.Zip::ZLIB Get File CRC32.gvi
  OpenG.Zip::ZLIB Path to Path String.gvi
  OpenG.Zip::ZLIB Initialize File Functions.gvi
  OpenG.Zip::ZLIB Initialize Stream Functions.gvi
  OpenG.Zip::ZLIB Move Raw File.gvi
  OpenG.Zip::ZLIB File Information.gvi
  OpenG.Zip::ZLIB Get File.gvi
  OpenG.Zip::ZLIB Common Path to Specific Path.gvi
  OpenG.Zip::ZLIB Specific Path to Common Path.gvi
  OpenG.Zip::ZLIB Get Current File Info Old.gvi
  OpenG.Zip::ZLIB Enumerate File Contents Old.gvi
diagram:
  call "ZLIB Extract All Files To Dir.gvi"() -> (error out=w1)
  call "ZLIB Delete Files From Archive.gvi"(error in (no error)=w1) -> (error out=w2)
  # High Level Operations
  call "ZLIB Compress Directory.gvi"(error in (no error)=w2) -> (error out=w3)
  call "ZLIB Compress Files.gvi"(file names=path[] [], error in (no error)=w3)
  call "ZLIB Open Zip Archive.gvi"(archive name=path "") -> (zip Refnum=w4, error out=w5)
  # Store File into Archive
  call "ZLIB Store File.gvi"(zip Refnum=w4, source path=path "", error in (no error)=w5) -> (zip Refnum out=w6, error out=w7)
  call "ZLIB Store Stream.gvi"(zip Refnum=w6, source stream="", internal name="", error in (no error)=w7) -> (zip Refnum out=w8, error out=w9)
  call "ZLIB Open Unzip Archive.gvi"(archive name=path "") -> (unzip Refnum=w10, error out=w11)
  call "ZLIB Enumerate File Contents.gvi"(unzip Refnum=w10, error in (no error)=w11) -> (unzip Refnum out=w12, error out=w13)
  call "ZLIB Extract File.gvi"(unzip Refnum=w12, target path=path "", error in (no error)=w13) -> (unzip Refnum out=w14, error out=w15)
  # Extract Information and File from Archive
  call "ZLIB Extract Stream.gvi"(unzip Refnum=w14, internal name="", error in (no error)=w15) -> (unzip Refnum out=w16, error out=w17)
  call "ZLIB Copy Raw File.gvi"(unzip Refnum=w16, name (empty: use current)="", error in (no error)=w17, zip Refnum=w8) -> (unzip Refnum out=w18, error out=w19, zip Refnum out=w20)
  call "ZLIB Close Zip Archive.gvi"(zip Refnum=w20, error in (no error)=w9)
  call "ZLIB Close Unzip Archive.gvi"(unzip Refnum=w18, error in (no error)=w19)
  call "ZLIB Open Unzip Stream.gvi"(archive stream="") -> (unzip Refnum=w21, error out=w22)
  call "ZLIB Get Global Info.gvi"(unzip Refnum=w21, error in (no error)=w22) -> (unzip Refnum out=w23, error out=w24)
  call "ZLIB Go To First File.gvi"(unzip Refnum=w23, error in (no error)=w24) -> (unzip Refnum out=w25, error out=w26)
  call "ZLIB Go To Next File.gvi"(unzip Refnum=w25, error in (no error)=w26) -> (unzip Refnum out=w27, error out=w28)
  # Low Level Extract Information from Archive
  call "ZLIB Locate File.gvi"(unzip Refnum=w27, error in (no error)=w28) -> (unzip Refnum out=w29, error out=w30)
  call "ZLIB Get Current File Info.gvi"(unzip Refnum=w29, error in (no error)=w30) -> (unzip Refnum out=w31, error out=w32)
  call "ZLIB Close Unzip Archive.gvi"(unzip Refnum=w31, error in (no error)=w32)
  call "ZLIB Deflate.gvi"()
  # Memory deflate and inflate functions
  # Low level support functions (use with care, connector pane or name can change without notice)
  call "ZLIB Inflate.gvi"()
  call "ZLIB CRC32.gvi"()
  call "ZLIB Get Version.gvi"()
  call "ZLIB Open Read File.gvi"()
  call "ZLIB Read Compressed File.gvi"()
  call "ZLIB Read Compressed Stream.gvi"()
  call "ZLIB Read Local Extra Data.gvi"()
  call "ZLIB Close Read File.gvi"()
  call "ZLIB Write Stream.gvi"()
  call "ZLIB Open Write File.gvi"()
  call "ZLIB Write File.gvi"()
  call "ZLIB Transfer Raw File.gvi"()
  call "ZLIB Close Write File.gvi"()
  call "ZLIB Block Size.gvi"()
  call "ZLIB Convert File Info.gvi"()
  call "ZLIB Get File CRC32.gvi"()
  call "ZLIB Path to Path String.gvi"()  # ZLIB Path to LVZLIB Path String
  call "ZLIB Initialize File Functions.gvi"()
  call "ZLIB Initialize Stream Functions.gvi"()
  call "ZLIB Move Raw File.gvi"()
  call "ZLIB File Information.gvi"()
  call "ZLIB Get File.gvi"()
  # Old compatibility functions
  call "ZLIB Common Path to Specific Path.gvi"()
  call "ZLIB Specific Path to Common Path.gvi"()
  call "ZLIB Get Current File Info Old.gvi"(unzip Refnum=Not A Refnum) -> (unzip Refnum out=w33)
  call "ZLIB Enumerate File Contents Old.gvi"(unzip Refnum=w33)
