vi "ZLIB Write File.gvi"   [LabVIEW Platform Developer Preview 0.1.0]
# Writes a file from disk into the ZIP archive at the currently created file entry.
inputs:
  "zip Refnum": "ZLIB Zip Handle.gtype"
  "source path": path
  "error in (no error)": error
outputs:
  "zip Refnum out": "ZLIB Zip Handle.gtype"
  "error out": error
types:
  "ZLIB Zip Handle.gtype" = i32
uses:
  OpenG.Mac Binary::MACBIN Open File Refnum.gvi
  OpenG.Zip::ZLIB Block Size.gvi
  OpenG.Zip::lvzlib.sli::lvzip_zipWriteInFileInZip
  openg.library.error::Build Error Cluster.gvi
diagram:
  $"zip Refnum out" <- $"zip Refnum"
  call "MACBIN Open File Refnum.gvi"(file path=$"source path", open mode (0)="read-only", deny mode (2)="deny write-only", error in (no error)=$"error in (no error)") -> (file refnum=w1, error out=w2)
  Get File Size(error in=w2, file=w1) -> (error out=w3, refnum out=w4, size (in bytes)=w5)
  Property Node(instance in=w3) -> ("status"=w6)
  To Long Integer(number=w5) -> w7
  case (w6) {
    frame False, Default {
      To Unsigned Long Integer(number=w7) -> w9
      Type Cast(type=u32 0, x=$"zip Refnum") -> w10
      s1 = w9  # shift register
      s2 = w4  # shift register
      s3 = w3  # shift register
      s4 = 0  # shift register
      while {
        w11 = u8 0  # uInt8
        Set File Position(error in=s3, offset (in bytes) (0)=s4, refnum=s2) -> (error out=w12, refnum out=w13)
        call "ZLIB Block Size.gvi"(length in=s1) -> (block len=w14, length rem=w15)
        Read From Binary File(count=w14, data type=w11, error in=w12, file (use dialog)=w13) -> (data=w16, error out=w17, refnum out=w18)
        Get File Position(error in=w17, refnum=w18) -> (error out=w19, offset (in bytes) (0)=w20)
        To Long Integer(number=w20) -> w21
        Property Node(instance in=w19) -> ("status"=w22)
        case (w22) {
          frame False, Default {
            call "lvzip_zipWriteInFileInZip"(unzFile in=w10, buffer in=w16, size in=w14) -> (return=w26)
            case (w26) {
              frame Default {
                call "Build Error Cluster.gvi"(code="File not found"(7)) -> (error out=w23)
              }
              frame 0 {
                w23 = w19
              }
            }
            Is Equal To 0(x=w26) -> w27
            Is Greater Than 0(x=w15) -> w28
            Logical And(w27, w28) -> w24
            w25 = w15
          }
          frame True {
            w23 = w19
            w24 = FALSE
            w25 = w15
          }
        }
        next s1 = w25
        next s3 = w23
        next s4 = w21
        continue if w24
      }
      Close File(error in=s3, refnum=s2) -> (error out=w8)
    }
    frame True {
      w8 = w3
    }
  }
  $"error out" <- w8
