vi "ZLIB Write Stream.gvi"   [LabVIEW Platform Developer Preview 0.1.0]
# Writes a byte stream into the ZIP archive at the currently created file entry.
inputs:
  "zip Refnum": "ZLIB Zip Handle.gtype"
  "byte stream": string
  "error in (no error)": error
outputs:
  "zip Refnum out": "ZLIB Zip Handle.gtype"
  "error out": error
types:
  "ZLIB Zip Handle.gtype" = i32
uses:
  OpenG.Zip::lvzlib.sli::lvzip_zipWriteInFileInZip
  openg.library.error::Build Error Cluster.gvi
diagram:
  Property Node(instance in=$"error in (no error)") -> ("status"=w1)
  case (w1) {
    frame False, Default {
      String To Byte Array(encoding="Extended ASCII", string=$"byte stream") -> (unsigned byte array=w3)
      Array Size(array=w3) -> (size(s)=w4)
      Type Cast(type=u32 0, x=$"zip Refnum") -> w5
      call "lvzip_zipWriteInFileInZip"(unzFile in=w5, buffer in=w3, size in=w4) -> (return=w6)
      case (w6) {
        frame Default {
          call "Build Error Cluster.gvi"(code="File not found"(7)) -> (error out=w2)
        }
        frame 0 {
          w2 = $"error in (no error)"
        }
      }
    }
    frame True {
      w2 = $"error in (no error)"
    }
  }
  $"error out" <- w2
  $"zip Refnum out" <- $"zip Refnum"
