vi "MACBIN CCITT_CRC16.gvi"   [LabVIEW Platform Developer Preview 0.1.0]
inputs:
  "u8 array": u8[]
outputs:
  "Checksum": u16
panel controls:
  "CRC table": u16[] = [0, 4129, 8258, 12387, 16516, 20645, 24774, 28903, 33032, 37161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]
diagram:
  w1 = $"CRC table"
  # CCITT CRC16
  #
  # These VI calculates the CCITT CRC 16 of a byte stream.
  # Copyright 2002: Rolf Kalbermatter, rolf.kalbermatter@citengineering.com
  s1 = 0  # shift register
  for {
    w2 = each element of $"u8 array"
    Logical Shift(x=s1, y=8) -> w3
    Split Number(x=s1) -> w4
    Logical Exclusive Or(w2, w4) -> w5
    Array Index(array=w1) -> (out0[w5]=w6)
    Logical Exclusive Or(w6, w3) -> w7
    next s1 = w7
  }
  $Checksum <- s1
