vi "MACBIN Copy Fork From File.gvi"   [LabVIEW Platform Developer Preview 0.1.0]
inputs:
  "macbinary Refnum": ByteStreamFileRefnum
  "fork Refnum": ByteStreamFileRefnum
  "error out": error
  "length": i32
outputs:
  "macbinary Refnum out": ByteStreamFileRefnum
  "forkname out": path
  "error out 2": error
uses:
  OpenG.Zip::ZLIB Block Size.gvi
  OpenG.Mac Binary::MACBIN Size Padding.gvi
diagram:
  Get File Position(error in=$"error out", refnum=$"macbinary Refnum") -> (error out=w1, offset (in bytes) (0)=w2, refnum out=w3)
  To Long Integer(number=w2) -> w4
  Get File Position(error in=w1, refnum=$"fork Refnum") -> (error out=w5, offset (in bytes) (0)=w6, refnum out=w7)
  To Long Integer(number=w6) -> w8
  s1 = $length  # shift register
  s2 = w7  # shift register
  s3 = w8  # shift register
  s4 = w3  # shift register
  s5 = w5  # shift register
  s6 = w4  # shift register
  while {
    call "ZLIB Block Size.gvi"(length in=s1) -> (block len=w9, length rem=w10)
    Set File Position(error in=s5, offset (in bytes) (0)=s6, refnum=s4) -> (error out=w11, refnum out=w12)
    Read From Binary File(count=w9, error in=w11, file (use dialog)=w12) -> (data=w13, error out=w14, refnum out=w15)
    Get File Position(error in=w14, refnum=w15) -> (error out=w16, offset (in bytes) (0)=w17, refnum out=w18)
    Set File Position(error in=w16, offset (in bytes) (0)=s3, refnum=s2) -> (error out=w19, refnum out=w20)
    Write To Binary File(data=w13, error in=w19, file (use dialog)=w20, prepend=FALSE) -> (error out=w21, refnum out=w22)
    Get File Position(error in=w21, refnum=w22) -> (error out=w23, offset (in bytes) (0)=w24, refnum out=w25)
    To Long Integer(number=w24) -> w26
    To Long Integer(number=w17) -> w27
    Property Node(instance in=w23) -> ("status"=w28)
    Is Less Or Equal To 0(x=w10) -> w29
    Logical Or[output inverted](w29, w28) -> w30
    next s1 = w10
    next s2 = w25
    next s3 = w26
    next s4 = w18
    next s5 = w23
    next s6 = w27
    continue if w30
  }
  Close File(error in=s5, refnum=s2) -> (error out=w31, path=w32)
  $"forkname out" <- w32
  # ignore until multiple of 128
  call "MACBIN Size Padding.gvi"(length=s6) -> (padded length=w33)
  Set File Position(error in=w31, offset (in bytes) (0)=w33, refnum=s4) -> (error out=w34, refnum out=w35)
  $"macbinary Refnum out" <- w35
  $"error out 2" <- w34
