vi "MACBIN Copy Fork To File.gvi"   [LabVIEW Platform Developer Preview 0.1.0]
inputs:
  "macbinary Refnum": ByteStreamFileRefnum
  "fork Refnum": ByteStreamFileRefnum
  "error out": error
  "file size": i32
outputs:
  "macbinary Refnum out": ByteStreamFileRefnum
  "filename out": path
  "error out 2": error
uses:
  OpenG.Zip::ZLIB Block Size.gvi
  OpenG.Mac Binary::MACBIN Size Padding.gvi
diagram:
  Is Not A Number Or Path Or Refnum(number=$"fork Refnum") -> w1
  case (w1) {
    frame False, Default {
      Get File Position(error in=$"error out", refnum=$"macbinary Refnum") -> (error out=w5, offset (in bytes) (0)=w6, refnum out=w7)
      To Long Integer(number=w6) -> w8
      Get File Position(error in=w5, refnum=$"fork Refnum") -> (error out=w9, offset (in bytes) (0)=w10, refnum out=w11)
      To Long Integer(number=w10) -> w12
      s1 = $"file size"  # shift register
      s2 = w11  # shift register
      s3 = w12  # shift register
      s4 = w7  # shift register
      s5 = w9  # shift register
      s6 = w8  # shift register
      while {
        call "ZLIB Block Size.gvi"(length in=s1) -> (block len=w13, length rem=w14)
        Set File Position(error in=s5, offset (in bytes) (0)=s3, refnum=s2) -> (error out=w15, refnum out=w16)
        Read From Binary File(count=w13, error in=w15, file (use dialog)=w16) -> (data=w17, error out=w18, refnum out=w19)
        Get File Position(error in=w18, refnum=w19) -> (error out=w20, offset (in bytes) (0)=w21, refnum out=w22)
        Set File Position(error in=w20, offset (in bytes) (0)=s6, refnum=s4) -> (error out=w23, refnum out=w24)
        Write To Binary File(data=w17, error in=w23, file (use dialog)=w24, prepend=FALSE) -> (error out=w25, refnum out=w26)
        Get File Position(error in=w25, refnum=w26) -> (error out=w27, offset (in bytes) (0)=w28, refnum out=w29)
        To Long Integer(number=w28) -> w30
        To Long Integer(number=w21) -> w31
        Property Node(instance in=w27) -> ("status"=w32)
        Is Less Or Equal To 0(x=w14) -> w33
        Logical Or[output inverted](w33, w32) -> w34
        next s1 = w14
        next s2 = w22
        next s3 = w31
        next s4 = w29
        next s5 = w27
        next s6 = w30
        continue if w34
      }
      call "MACBIN Size Padding.gvi"(length=s6) -> (padded length=w35)
      Subtract(x=w35, y=s6) -> w36
      Initialize Array(element=0, size=w36) -> w37
      Close File(error in=s5, refnum=s2) -> (error out=w38, path=w4)
      # write 0 until multiple of 128
      Set File Position(error in=w38, offset (in bytes) (0)=s6, refnum=s4) -> (error out=w39, refnum out=w40)
      Write To Binary File(data=w37, error in=w39, file (use dialog)=w40, prepend=FALSE) -> (error out=w3, refnum out=w2)
    }
    frame True {
      w2 = $"macbinary Refnum"
      w3 = $"error out"
      w4 = path constant
    }
  }
  $"macbinary Refnum out" <- w2
  $"error out 2" <- w3
  $"filename out" <- w4
