vi "MACBIN Create Header.gvi"   [LabVIEW Platform Developer Preview 0.1.0]
inputs:
  "data file": path  # The data file or the name of the file whose data fork is opened.
  "resource file": path  # The resource file to use. On the Macintosh the resource fork of the resource file is always opened. If this is empty the VI uses the data file name to determine the resource file depending on the platform. On the Macintosh the data file name is used and the resource fork of that file is opened. On other platforms the '.rsrc' extension is appended to the data file name and that file is opened.
  "error in (no error)": error
outputs:
  "data refnum": ByteStreamFileRefnum
  "res refnum": ByteStreamFileRefnum
  "data size": i32
  "error out": error
  "header": u8[]  # The Macbinary formatted header.
  "comment": string
  "res size": i32
panel controls:
  "macbinary header": "MACBIN Macbinary Header.gtype"
types:
  "MACBIN Macbinary Header.gtype" = cluster{"Finder flags": u8, "zero0": u8, "vertical pos": u16, "horizontal pos": u16, "finder id": u16, "protected": u8, "zero1": u8, "data length": i32, "res length": i32, "creation date": u32, "last mod": u32, "comment length": i16, "Finder flags 2": u8, "file identifier": u32, "script id": u8, "ext finder flags": u8, "zero2": i32, "zero3": i32, "total length": u32, "sec hdr length": u16, "creator version": u8, "minimum version": u8}
uses:
  OpenG.Mac Binary::MACBIN Resource File Info.gvi
  OpenG.Mac Binary::MACBIN CCITT_CRC16.gvi
diagram:
  call "MACBIN Resource File Info.gvi"(data file=$"data file", resource file=$"resource file", error in (no error)=$"error in (no error)") -> (data refnum=w1, resource refnum=w2, file info out=w3, error out=w4, comment out=w5)
  $"data refnum" <- w1
  Property Node(instance in=w3) -> ("type"=w6, "creator"=w7, "data size"=w8, "res size"=w9, "creation date"=w10, "mod date"=w11)
  $"data size" <- w8
  $"res refnum" <- w2
  $"res size" <- w9
  $"error out" <- w4
  String To Byte Array(encoding="Extended ASCII", string=w6) -> (unsigned byte array=w12)
  String To Byte Array(encoding="Extended ASCII", string=w7) -> (unsigned byte array=w13)
  Strip Path(path=$"data file") -> (name=w14)
  String To Byte Array(encoding="Extended ASCII", string=w14) -> (unsigned byte array=w15)
  Reshape Array(inArray=w15, size=63) -> w16
  Array Size(array=w15) -> (size(s)=w17)
  To Unsigned Byte Integer(number=w17) -> w18
  w19 = 0  # secondary header length
  String Length(string=w5) -> (length=w20)
  Property Node(instance in=w3) -> ("finder flags"=w21, "vertical pos"=w22, "horizontal pos"=w23, "finder id"=w24, "script id"=w25, "ext finder flags"=w26)
  w27 = 129  # minimum version
  w28 = 130  # creator version
  w29 = 0  # total length
  Split Number(x=w21) -> (high(x)=w30, low(x)=w31)
  Property Node(instance in=$"macbinary header", "data length"=w8, "res length"=w9, "creation date"=w10, "last mod"=w11, "Finder flags"=w30, "Finder flags 2"=w31, "vertical pos"=w22, "horizontal pos"=w23, "finder id"=w24, "script id"=w25, "ext finder flags"=w26, "total length"=w29, "sec hdr length"=w19, "creator version"=w28, "minimum version"=w27, "comment length"=w20) -> (instance out=w32)
  Type Cast(type=w16, x=w32) -> w33
  Build Array[ConcatenateInputs=True](0, w18, w16, w12, w13, w33) -> w34
  w35 = "mBIN"  # file identifier
  String To Byte Array(encoding="Extended ASCII", string=w35) -> (unsigned byte array=w36)
  # Calculate CRC
  Replace Array Subset(inArray=w34, index=102, new=w36) -> w37
  w38 = 0  # filler
  call "MACBIN CCITT_CRC16.gvi"(u8 array=w37) -> (Checksum=w39)
  Split Number(x=w39) -> (high(x)=w40, low(x)=w41)
  Build Array[ConcatenateInputs=True](w37, w40, w41, w38, w38) -> w42
  $header <- w42
  $comment <- w5
