vi "MACBIN Encode MacBinary.gvi"   [LabVIEW Platform Developer Preview 0.1.0]
# Encodes a Macintosh File to MacBinary format.
inputs:
  "data file": path, required
  "resource file": path
  "macbinary file": path
  "error in (no error)": error
outputs:
  "data file out": path
  "resource file out": path
  "macbinary file out": path
  "error out": error
uses:
  OpenG.Mac Binary::MACBIN Create Header.gvi
  openg.library.file::Valid Path - Traditional.gvi
  OpenG.Mac Binary::MACBIN Copy Fork To File.gvi
diagram:
  call "MACBIN Create Header.gvi"(data file=$"data file", resource file=$"resource file", error in (no error)=$"error in (no error)") -> (data refnum=w1, res refnum=w2, data size=w3, error out=w4, header=w5, comment=w6, res size=w7)
  # Write header
  call "Valid Path - Traditional.gvi"(path=$"macbinary file") -> (valid=w8)
  case (w8) {
    frame False, Default {
      Strip Path(path=$"data file") -> (name=w10, stripped path=w11)
      Concatenate Strings(w10, ".bin") -> w12
      Build Path(base path=w11, name or relative path=w12) -> (appended path=w9)
    }
    frame True {
      w9 = $"macbinary file"
    }
  }
  compatOverwrite(overwrite (F) Input 0=TRUE) -> w13  # compatOverwrite (Placeholder)
  Open Or Create Or Replace File(error in=w4, file path (use dialog)=w9, operation (0:open)=w13) -> (error out=w14, refnum out=w15)
  Set File Position(error in=w14, offset (in bytes) (0)=0, refnum=w15) -> (error out=w16, refnum out=w17)
  Write To Binary File(data=w5, error in=w16, file (use dialog)=w17, prepend=FALSE) -> (error out=w18, refnum out=w19)
  # Copy data fork
  call "MACBIN Copy Fork To File.gvi"(macbinary Refnum=w19, fork Refnum=w1, error out=w18, file size=w3) -> (macbinary Refnum out=w20, filename out=w21, error out 2=w22)
  $"data file out" <- w21
  # Copy resource fork
  call "MACBIN Copy Fork To File.gvi"(macbinary Refnum=w20, fork Refnum=w2, error out=w22, file size=w7) -> (macbinary Refnum out=w23, filename out=w24, error out 2=w25)
  $"resource file out" <- w24
  # Write finder comment
  Write To Binary File(data=w6, error in=w25, file (use dialog)=w23, prepend=FALSE) -> (error out=w26, refnum out=w27)
  Close File(error in=w26, refnum=w27) -> (error out=w28, path=w29)
  SetTypeAndCreator(error in Input 0=w28, creator (no change) Input 1="mBIN", type (no change) Input 2=string "dMB3", path Input 3=w29) -> (error out Output 0=w30, path out Output 1=w31)  # SetTypeAndCreator (Placeholder)
  $"macbinary file out" <- w31
  $"error out" <- w30
