vi "MACBIN Has Resource Fork.gvi"   [LabVIEW Platform Developer Preview 0.1.0]
# Checks if a Macintosh file has a resource fork. NOP on non Macintosh systems.
inputs:
  "file path": path
  "error in (no error)": error
outputs:
  "file path out": path
  "has resource fork": bool
  "error out": error
uses:
  OpenG.Zip::lvzlib.sli::LVPath_HasResourceFork
  openg.library.error::Build Error Cluster.gvi
diagram:
  Property Node(instance in=$"error in (no error)") -> ("status"=w1)
  case (w1) {
    frame False, Default {
      call "LVPath_HasResourceFork"(path in=$"file path", hasRsrc in=0) -> (return=w5, path out=w4, hasRsrc out=w6)
      Is Not Equal To 0(x=w6) -> w3
      case (w5) {
        frame Default {
          call "Build Error Cluster.gvi"(code=w5) -> (error out=w2)
        }
        frame 0 {
          w2 = $"error in (no error)"
        }
      }
    }
    frame True {
      w2 = $"error in (no error)"
      w3 = FALSE
      w4 = $"file path"
    }
  }
  $"file path out" <- w4
  $"has resource fork" <- w3
  $"error out" <- w2
