vi "MACBIN Open File Refnum.gvi"   [LabVIEW Platform Developer Preview 0.1.0]
inputs:
  "file path": path
  "open mode (0)": T1 = "read/write"
  "deny mode (2)": T2 = "deny none"
  "error in (no error)": error
  "resource fork (F)": bool
outputs:
  "file refnum": ByteStreamFileRefnum
  "error out": error
panel controls:
  "dummy refnum": ByteStreamFileRefnum
types:
  T1 = enum{"read/write", "read-only", "write-only", "write-only (truncate)"}
  T2 = enum{"deny read/write", "deny write-only", "deny none"}
uses:
  OpenG.Zip::lvzlib.sli::LVPath_OpenFile
  openg.library.error::Build Error Cluster.gvi
diagram:
  Property Node(instance in=$"error in (no error)") -> ("status"=w1)
  case (w1) {
    frame False, Default {
      Boolean To Integer(Boolean=$"resource fork (F)") -> (0, 1=w4)
      call "LVPath_OpenFile"(refnum in=0, path in=$"file path", rsrc in=w4, openMode in=$"open mode (0)", denyMode in=$"deny mode (2)") -> (return=w5, refnum out=w6)
      Type Cast(type=$"dummy refnum", x=w6) -> w2
      case (w5) {
        frame Default {
          call "Build Error Cluster.gvi"(code=w5) -> (error out=w3)
        }
        frame 0 {
          w3 = $"error in (no error)"
        }
      }
    }
    frame True {
      w2 = $"dummy refnum"
      w3 = $"error in (no error)"
    }
  }
  $"file refnum" <- w2
  $"error out" <- w3
