vi "MACBIN Read Header.gvi"   [LabVIEW Platform Developer Preview 0.1.0]
inputs:
  "macbinary file": path
  "data file": path
  "resource file": path
  "error in (no error)": error
outputs:
  "macbin filerefnum": ByteStreamFileRefnum
  "data filerefnum": ByteStreamFileRefnum
  "res file refnum": ByteStreamFileRefnum
  "error out": error
  "res length": i32
  "data length": i32
panel controls:
  "finder info": "MACBIN Resource Header.gtype"
types:
  "MACBIN Resource Header.gtype" = cluster{"type": string, "creator": string, "data size": u32, "res size": u32, "creation date": u32, "mod date": u32, "finder flags": u16, "vertical pos": i16, "horizontal pos": i16, "finder id": u16, "script id": u8, "ext finder flags": u8}
uses:
  OpenG.Mac Binary::MACBIN Verify Header.gvi
  OpenG.Mac Binary::MACBIN Size Padding.gvi
  OpenG.Mac Binary::MACBIN Resource File Info.gvi
diagram:
  call "MACBIN Verify Header.gvi"(data file=$"macbinary file", macbinary file=$"data file", error in (no error)=$"error in (no error)") -> (file refnum=w1, data file out=w2, file offset=w3, error out=w4, macbinary version=w5, macbinary header=w6, header bytes=w7)
  Property Node(instance in=w6) -> ("sec hdr length"=w8, "comment length"=w9, "data length"=w10, "res length"=w11, "creation date"=w12, "last mod"=w13, "vertical pos"=w14, "horizontal pos"=w15, "Finder flags"=w16, "Finder flags 2"=w17, "finder id"=w18, "script id"=w19, "ext finder flags"=w20)
  call "MACBIN Size Padding.gvi"(length=w8) -> (padded length=w21)
  Add(w3, w21) -> w22
  call "MACBIN Size Padding.gvi"(length=w10) -> (padded length=w23)
  call "MACBIN Size Padding.gvi"(length=w11) -> (padded length=w24)
  Add(w22, w23, w24) -> w25
  case (w9) {
    frame 0, Default {
      w26 = ""
      w27 = w4
      w28 = w1
    }
    frame 1.. {
      Set File Position(error in=w4, offset (in bytes) (0)=w25, refnum=w1) -> (error out=w29, refnum out=w30)
      Read From Binary File(count=w9, error in=w29, file (use dialog)=w30) -> (data=w26, error out=w27, refnum out=w28)
    }
  }
  Set File Position(error in=w27, offset (in bytes) (0)=w22, refnum=w28) -> (error out=w31, refnum out=w32)
  $"macbin filerefnum" <- w32
  # Read header
  Is Greater Than 0(x=w5)
  Join Numbers(high(x)=w16, low(x)=w17) -> w33
  Array Subset(array=w7, index0=65, length0=4) -> w34
  Byte Array To String(encoding="Extended ASCII", unsigned byte array=w34) -> (string=w35)
  Array Subset(array=w7, index0=69, length0=4) -> w36
  Byte Array To String(encoding="Extended ASCII", unsigned byte array=w36) -> (string=w37)
  Property Node(instance in=$"finder info", "type"=w35, "creator"=w37, "data size"=w10, "res size"=w11, "creation date"=w12, "mod date"=w13, "vertical pos"=w14, "horizontal pos"=w15, "finder flags"=w33, "finder id"=w18, "script id"=w19, "ext finder flags"=w20) -> (instance out=w38)
  call "MACBIN Resource File Info.gvi"(data file=w2, resource file=$"resource file", file info=w38, error in (no error)=w31, write (F)=TRUE, comment=w26) -> (data refnum=w39, resource refnum=w40, error out=w41)
  $"data filerefnum" <- w39
  $"res file refnum" <- w40
  $"error out" <- w41
  $"data length" <- w10
  $"res length" <- w11
