vi "MACBIN Resource File Info Core.gvi"   [LabVIEW Platform Developer Preview 0.1.0]
inputs:
  "resource file": path
  "write (F)": bool
  "file info in": "MACBIN Resource Header.gtype"
  "error in (no error)": error
  "comment": string
outputs:
  "resource file out": path
  "is directory": bool
  "file info out": "MACBIN Resource Header.gtype"
  "error out": error
  "comment out": string
types:
  "MACBIN Resource Header.gtype" = cluster{"type": string, "creator": string, "data size": u32, "res size": u32, "creation date": u32, "mod date": u32, "finder flags": u16, "vertical pos": i16, "horizontal pos": i16, "finder id": u16, "script id": u8, "ext finder flags": u8}
  T1 = cluster{"type": u32, "creator": u32, "data size": u32, "res size": u32, "creation date": u32, "mod date": u32, "finder flags": u16, "vertical pos": i16, "horizontal pos": i16, "finder id": u16, "script id": u8, "ext finder flags": u8}
uses:
  openg.library.file::LabVIEW.sli::MoveBlock
  OpenG.Zip::lvzlib.sli::LVPath_UtilFileInfo
  openg.library.error::Build Error Cluster.gvi
diagram:
  Property Node(instance in=$"error in (no error)") -> ("status"=w1)
  case (w1) {
    frame False, Default {
      Boolean To Integer(Boolean=$"write (F)") -> (0, 1=w7)
      Property Node(instance in=$"file info in") -> ("type"=w8, "creator"=w9, "data size"=w10, "res size"=w11, "creation date"=w12, "mod date"=w13, "finder flags"=w14, "vertical pos"=w15, "horizontal pos"=w16, "finder id"=w17, "script id"=w18, "ext finder flags"=w19)
      call "MoveBlock"(src in=0x454C, dst in="LE", len in=2) -> (dst out=w20)
      Is Equal(x=w20, y="LE") -> w21
      Type Cast(type=u32 0, x=w8) -> w22
      Type Cast(type=u32 0, x=w9) -> w23
      case (w21) {
        frame False, Default {
          w24 = w23
          w25 = w22
        }
        frame True {
          Swap Bytes(data=w22) -> (byte swapped=w26)
          Swap Bytes(data=w26) -> (byte swapped=w25)
          Swap Bytes(data=w23) -> (byte swapped=w27)
          Swap Bytes(data=w27) -> (byte swapped=w24)
        }
      }
      Property Node(instance in=T1 {all zero or empty}, "type"=w25, "creator"=w24, "data size"=w10, "res size"=w11, "creation date"=w12, "mod date"=w13, "finder flags"=w14, "vertical pos"=w15, "horizontal pos"=w16, "finder id"=w17, "script id"=w18, "ext finder flags"=w19) -> (instance out=w28)
      call "LVPath_UtilFileInfo"(path in=$"resource file", write in=w7, isDir in=0, finderInfo in=w28, comment in=$comment) -> (return=w29, path out=w5, isDir out=w30, finderInfo out=w31, comment out=w2)
      Is Not Equal To 0(x=w30) -> w6
      case (w29) {
        frame 0 {
          w4 = $"error in (no error)"
        }
        frame Default {
          call "Build Error Cluster.gvi"(code=w29) -> (error out=w4)
        }
      }
      Property Node(instance in=w31) -> ("type"=w32, "creator"=w33, "data size"=w34, "res size"=w35, "creation date"=w36, "mod date"=w37, "finder flags"=w38, "vertical pos"=w39, "horizontal pos"=w40, "finder id"=w41, "script id"=w42, "ext finder flags"=w43)
      case (w21) {
        frame False, Default {
          w44 = w33
          w45 = w32
        }
        frame True {
          Swap Bytes(data=w32) -> (byte swapped=w46)
          Swap Bytes(data=w46) -> (byte swapped=w45)
          Swap Bytes(data=w33) -> (byte swapped=w47)
          Swap Bytes(data=w47) -> (byte swapped=w44)
        }
      }
      Type Cast(type=string "", x=w45) -> w48
      Type Cast(type=string "", x=w44) -> w49
      Property Node(instance in=$"file info in", "type"=w48, "creator"=w49, "data size"=w34, "res size"=w35, "creation date"=w36, "mod date"=w37, "finder flags"=w38, "vertical pos"=w39, "horizontal pos"=w40, "finder id"=w41, "script id"=w42, "ext finder flags"=w43) -> (instance out=w3)
    }
    frame True {
      w2 = $comment
      w3 = $"file info in"
      w4 = $"error in (no error)"
      w5 = $"resource file"
      w6 = FALSE
    }
  }
  $"resource file out" <- w5
  $"is directory" <- w6
  $"comment out" <- w2
  $"error out" <- w4
  $"file info out" <- w3
