vi "MACBIN Resource File Info.gvi"   [LabVIEW Platform Developer Preview 0.1.0]
inputs:
  "data file": path
  "resource file": path
  "file info": "MACBIN Resource Header.gtype"
  "error in (no error)": error
  "write (F)": bool
  "comment": string
outputs:
  "data refnum": ByteStreamFileRefnum
  "resource refnum": ByteStreamFileRefnum
  "file info out": "MACBIN Resource Header.gtype"
  "error out": error
  "comment out": string
types:
  "MACBIN Resource Header.gtype" = cluster{"type": string, "creator": string, "data size": u32, "res size": u32, "creation date": u32, "mod date": u32, "finder flags": u16, "vertical pos": i16, "horizontal pos": i16, "finder id": u16, "script id": u8, "ext finder flags": u8}
uses:
  openg.library.file::Valid Path - Traditional.gvi
  NI::G Core::File IO (General)::Get Type And Creator.gvi
  OpenG.Mac Binary::MACBIN Open File Refnum.gvi
  openg.library.error::Build Error Cluster.gvi
  OpenG.Mac Binary::MACBIN Resource File Info Core.gvi
diagram:
  Property Node[IsPlaceholderNodeForConversion=True]() -> ("App.TargetOS"=w1)
  call "Valid Path - Traditional.gvi"(path=$"resource file") -> (valid=w2)
  # In case of Macintosh and with no resource file name specified, we use the standard Mac method, retrieving the actual info from
  # the Finder and opening the resource fork handle to it. For other cases we try to have the info in a separate resource file.
  # This separate resource file is a user specified file and if no resource file name is specified we use the data file name appended with .rsrc.
  case (w2) {
    frame False, Default {
      case (w1) {
        frame Default {
          Strip Path(path=$"data file") -> (name=w5, stripped path=w6)
          Format Into String(formatString="%s.rsrc", w5) -> w7
          Build Path(base path=w6, name or relative path=w7) -> (appended path=w3)
          w4 = FALSE
        }
        frame "Mac OS", "Carbon" {
          w3 = $"data file"
          w4 = TRUE
        }
      }
    }
    frame True {
      w3 = $"resource file"
      w4 = FALSE
    }
  }
  case ($"write (F)") {
    frame False, Default {
      call "Get Type And Creator.gvi"(path=$"data file", error in=$"error in (no error)") -> (error out=w8, creator=w12, type=w13, path out=w11)
      Property Node(instance in=$"file info", "type"=w13, "creator"=w12) -> (instance out=w10)
      w9 = "read-only"
    }
    frame True {
      Property Node(instance in=$"file info") -> ("type"=w14, "creator"=w15)
      compatOverwrite(overwrite (F) Input 0=TRUE) -> w16  # compatOverwrite (Placeholder)
      Open Or Create Or Replace File(error in=$"error in (no error)", file path (use dialog)=$"data file", operation (0:open)=w16) -> (error out=w17, refnum out=w18)
      Set Permissions(error in=w17, path=$"data file", permissions=0x1FF) -> (error out=w19)
      Close File(error in=w19, refnum=w18) -> (error out=w20, path=w21)
      case (w4) {
        frame False, Default {
          w8 = w20
          w11 = w21
        }
        frame True {
          SetTypeAndCreator(error in Input 0=w20, creator (no change) Input 1=w15, type (no change) Input 2=w14, path Input 3=w21) -> (error out Output 0=w8, path out Output 1=w11)  # SetTypeAndCreator (Placeholder)
        }
      }
      w9 = "read/write"
      w10 = $"file info"
    }
  }
  call "MACBIN Open File Refnum.gvi"(file path=w11, open mode (0)=w9, error in (no error)=w8) -> (file refnum=w22, error out=w23)
  $"data refnum" <- w22
  case (w4) {
    frame False, Default {
      case (w9) {
        frame "read/write" {
          compatOverwrite(overwrite (F) Input 0=TRUE) -> w28  # compatOverwrite (Placeholder)
          Open Or Create Or Replace File(error in=w23, file path (use dialog)=w3, operation (0:open)=w28) -> (error out=w29, refnum out=w30)
          Set File Position(error in=w29, offset (in bytes) (0)=0, refnum=w30) -> (error out=w31, refnum out=w32)
          Write To Binary File(data=string "RSRCLBVW", error in=w31, file (use dialog)=w32, prepend=TRUE) -> (error out=w33, refnum out=w34)
          Get File Position(error in=w33, refnum=w34) -> (error out=w35, offset (in bytes) (0)=w36, refnum out=w37)
          To Long Integer(number=w36) -> w38
          Set File Position(error in=w35, offset (in bytes) (0)=w38, refnum=w37) -> (error out=w39, refnum out=w40)
          Write To Binary File(data=w10, error in=w39, file (use dialog)=w40, prepend=FALSE) -> (error out=w41, refnum out=w42)
          Get File Position(error in=w41, refnum=w42) -> (error out=w43, offset (in bytes) (0)=w44, refnum out=w45)
          To Long Integer(number=w44) -> w46
          Set File Position(error in=w43, offset (in bytes) (0)=w46, refnum=w45) -> (error out=w47, refnum out=w48)
          Write To Binary File(data=$comment, error in=w47, file (use dialog)=w48, prepend=TRUE) -> (error out=w25, refnum out=w24)
          w26 = w10
          w27 = $comment
        }
        frame "read-only", Default {
          call "MACBIN Open File Refnum.gvi"(file path=w3, open mode (0)=w9, error in (no error)=w23) -> (file refnum=w49, error out=w50)
          Set File Position(error in=w50, offset (in bytes) (0)=0, refnum=w49) -> (error out=w51, refnum out=w52)
          Read From Binary File(data type=string "RSRCLBVW", error in=w51, file (use dialog)=w52) -> (data=w53, error out=w54, refnum out=w55)
          Get File Position(error in=w54, refnum=w55) -> (error out=w56, offset (in bytes) (0)=w57, refnum out=w58)
          To Long Integer(number=w57) -> w59
          Is Not Equal(x=w53, y=string "RSRCLBVW") -> w60
          case (w60) {
            frame False, Default {
              w61 = w56
            }
            frame True {
              call "Build Error Cluster.gvi"(code="Resource file not found"(13)) -> (error out=w61)
            }
          }
          Set File Position(error in=w61, offset (in bytes) (0)=w59, refnum=w58) -> (error out=w62, refnum out=w63)
          Read From Binary File(data type=w10, error in=w62, file (use dialog)=w63) -> (data=w26, error out=w64, refnum out=w65)
          Get File Position(error in=w64, refnum=w65) -> (error out=w66, offset (in bytes) (0)=w67, refnum out=w68)
          To Long Integer(number=w67) -> w69
          Set File Position(error in=w66, offset (in bytes) (0)=w69, refnum=w68) -> (error out=w70, refnum out=w71)
          Read From Binary File(data type=$comment, error in=w70, file (use dialog)=w71) -> (data=w27, error out=w25, refnum out=w24)
        }
      }
    }
    frame True {
      call "MACBIN Resource File Info Core.gvi"(resource file=w3, write (F)=$"write (F)", file info in=w10, error in (no error)=w23, comment=$comment) -> (resource file out=w72, file info out=w26, error out=w73, comment out=w27)
      Property Node(instance in=w26) -> ("res size"=w74)
      case (w74) {
        frame Default {
          w24 = Not A Refnum
          w25 = w73
        }
        frame 1.. {
          call "MACBIN Open File Refnum.gvi"(file path=w72, open mode (0)=w9, error in (no error)=w73, resource fork (F)=TRUE) -> (file refnum=w24, error out=w25)
        }
      }
    }
  }
  $"resource refnum" <- w24
  $"error out" <- w25
  $"file info out" <- w26
  $"comment out" <- w27
