vi "MACBIN Size Padding.gvi"   [LabVIEW Platform Developer Preview 0.1.0]
inputs:
  "length": i32
outputs:
  "padded length": i32
panel controls:
  "padding": i32 = 128
diagram:
  Quotient And Remainder(x=$length, y=$padding) -> (x-y*floor(x/y)=w1)
  case (w1) {
    frame 0 {
      w2 = $length
    }
    frame Default {
      Add($length, not w1, $padding) -> w2
    }
  }
  $"padded length" <- w2
