vi "MACBIN VI Tree.gvi"   [LabVIEW Platform Developer Preview 0.1.0]
panel controls:
  "macbinary header": "MACBIN Macbinary Header.gtype"
  "finder info": "MACBIN Resource Header.gtype"
types:
  "MACBIN Macbinary Header.gtype" = cluster{"Finder flags": u8, "zero0": u8, "vertical pos": u16, "horizontal pos": u16, "finder id": u16, "protected": u8, "zero1": u8, "data length": i32, "res length": i32, "creation date": u32, "last mod": u32, "comment length": i16, "Finder flags 2": u8, "file identifier": u32, "script id": u8, "ext finder flags": u8, "zero2": i32, "zero3": i32, "total length": u32, "sec hdr length": u16, "creator version": u8, "minimum version": u8}
  "MACBIN Resource Header.gtype" = cluster{"type": string, "creator": string, "data size": u32, "res size": u32, "creation date": u32, "mod date": u32, "finder flags": u16, "vertical pos": i16, "horizontal pos": i16, "finder id": u16, "script id": u8, "ext finder flags": u8}
uses:
  OpenG.Mac Binary::DecodemacBinary.gvi
  OpenG.Mac Binary::EncodemacBinary.gvi
  OpenG.Mac Binary::MACBIN Decode MacBinary.gvi
  OpenG.Mac Binary::MACBIN Encode MacBinary.gvi
  OpenG.Mac Binary::MACBIN Read Header.gvi
  OpenG.Mac Binary::MACBIN Verify Header.gvi
  OpenG.Mac Binary::MACBIN Copy Fork From File.gvi
  OpenG.Mac Binary::MACBIN Create Header.gvi
  OpenG.Mac Binary::MACBIN Copy Fork To File.gvi
  OpenG.Mac Binary::MACBIN Has Resource Fork.gvi
  OpenG.Mac Binary::MACBIN Resource File Info.gvi
  OpenG.Mac Binary::MACBIN Open File Refnum.gvi
  OpenG.Mac Binary::MACBIN Resource File Info Core.gvi
  OpenG.Mac Binary::MACBIN Size Padding.gvi
diagram:
  call "DecodemacBinary.gvi"()
  call "EncodemacBinary.gvi"()
  call "MACBIN Decode MacBinary.gvi"(macbinary file=path "")
  call "MACBIN Encode MacBinary.gvi"(data file=path "")
  call "MACBIN Read Header.gvi"()
  call "MACBIN Verify Header.gvi"()
  call "MACBIN Copy Fork From File.gvi"()
  call "MACBIN Create Header.gvi"()
  call "MACBIN Copy Fork To File.gvi"()
  call "MACBIN Has Resource Fork.gvi"()
  call "MACBIN Resource File Info.gvi"()
  call "MACBIN Open File Refnum.gvi"()  # MACBIN Open Resource Fork
  call "MACBIN Resource File Info Core.gvi"()
  call "MACBIN Size Padding.gvi"()
