vi "MACBIN Verify Header.gvi"   [LabVIEW Platform Developer Preview 0.1.0]
inputs:
  "data file": path
  "macbinary file": path
  "error in (no error)": error
outputs:
  "file refnum": ByteStreamFileRefnum
  "data file out": path
  "file offset": i32
  "error out": error
  "macbinary version": i32
  "macbinary header": "MACBIN Macbinary Header.gtype"
  "header bytes": u8[]
panel controls:
  "dummy header": "MACBIN Macbinary Header.gtype"
types:
  "MACBIN Macbinary Header.gtype" = cluster{"Finder flags": u8, "zero0": u8, "vertical pos": u16, "horizontal pos": u16, "finder id": u16, "protected": u8, "zero1": u8, "data length": i32, "res length": i32, "creation date": u32, "last mod": u32, "comment length": i16, "Finder flags 2": u8, "file identifier": u32, "script id": u8, "ext finder flags": u8, "zero2": i32, "zero3": i32, "total length": u32, "sec hdr length": u16, "creator version": u8, "minimum version": u8}
uses:
  OpenG.Mac Binary::MACBIN Open File Refnum.gvi
  OpenG.Mac Binary::MACBIN CCITT_CRC16.gvi
  openg.library.error::Build Error Cluster.gvi
  openg.library.file::Valid Path - Traditional.gvi
diagram:
  call "MACBIN Open File Refnum.gvi"(file path=$"macbinary file", error in (no error)=$"error in (no error)") -> (file refnum=w1, error out=w2)
  Set File Position(error in=w2, offset (in bytes) (0)=0, refnum=w1) -> (error out=w3, refnum out=w4)
  Read From Binary File(count=128, data type=u8 0, error in=w3, file (use dialog)=w4) -> (data=w5, error out=w6, refnum out=w7)
  Get File Position(error in=w6, refnum=w7) -> (error out=w8, offset (in bytes) (0)=w9, refnum out=w10)
  $"file refnum" <- w10
  Property Node(instance in=w8) -> ("status"=w11)
  case (w11) {
    frame False, Default {
      s1 = uninitialised  # shift register
      s2 = $"dummy header"  # shift register
      s3 = uninitialised  # shift register
      while (iteration -> i1) {
        case (i1) {
          frame 0 {
            Array Index(array=w5) -> (out0[_]=w20, out1[_]=w21, out2[74]=w22, out3[82]=w23)
            # Test that (if one of this is false we have not a macbinary file):
            # - the original version byte (offset 0) is 0,
            # - the filename length is at least 1 and at most 63 chars
            # - byte offset 74 and 82 are both 0
            Array Subset(array=w5, index0=2, length0=w21) -> w24
            # file name
            Byte Array To String(encoding="Extended ASCII", unsigned byte array=w24) -> (string=w17)
            Is Equal To 0(x=w20) -> w25
            Is Equal To 0(x=w22) -> w26
            Is Equal To 0(x=w23) -> w27
            In Range And Coerce(lower limit=1, upper limit=64, x=w21) -> (In Range?=w28)
            Logical And(w28, w25, w26, w27) -> w16
            w18 = s2
            w19 = w16
          }
          frame 1 {
            Array Index(array=w5) -> (out0[124]=w29, out1[_]=w30)
            Join Numbers(high(x)=w29, low(x)=w30) -> w31
            Is Equal To 0(x=w31) -> w32
            # Test that (if all of these are true we have a MacBinary1 file:
            # - file identifier is 0,
            # - creator version is 0
            # - minimum version is 0
            # - CRC is 0
            Array Subset(array=w5, index0=73) -> w33
            Type Cast(type=s2, x=w33) -> w18
            Property Node(instance in=w18) -> ("file identifier"=w34, "creator version"=w35, "minimum version"=w36)
            Is Equal To 0(x=w34) -> w37
            Is Equal To 0(x=w35) -> w38
            Is Equal To 0(x=w36) -> w39
            Logical And[output inverted](w37, w38, w39, w32) -> w16
            w17 = s3
            w19 = s1
          }
          frame 2 {
            Array Index(array=w5) -> (out0[124]=w40, out1[_]=w41)
            Join Numbers(high(x)=w40, low(x)=w41) -> w42
            Array Subset(array=w5, length0=124) -> w43
            call "MACBIN CCITT_CRC16.gvi"(u8 array=w43) -> (Checksum=w44)
            Is Equal(x=w42, y=w44) -> w19
            Property Node(instance in=s2) -> ("file identifier"=w45, "creator version"=w46, "minimum version"=w47)
            Is Equal(x=w46, y=129) -> w48
            Is Equal(x=w47, y=129) -> w49
            # Test that (if all of these are true we have a MacBinary2 file):
            # - file identifier is 0 (according to standard) or 'mBin' (often seen)
            # - creator version is 129
            # - minimum version is 129
            # - CRC is valid
            Array Subset(array=w5, index0=102, length0=4) -> w50
            Byte Array To String(encoding="Extended ASCII", unsigned byte array=w50) -> (string=w51)
            Is Equal(x=w51, y="mBIN") -> w52
            Is Equal To 0(x=w45) -> w53
            Logical Or(w52, w53) -> w54
            Logical And[output inverted](w54, w48, w49, w19) -> w16
            w17 = s3
            w18 = s2
          }
          frame 3 {
            Array Subset(array=w5, index0=102, length0=4) -> w55
            Byte Array To String(encoding="Extended ASCII", unsigned byte array=w55) -> (string=w56)
            Is Equal(x=w56, y="mBIN") -> w57
            Property Node(instance in=s2) -> ("creator version"=w58, "minimum version"=w59)
            # Test that (if all of these are true we have a MacBinary2 file:
            # - file identifier is 'mBin',
            # - creator version is 130
            # - minimum version is 129
            # - CRC is valid (already checked previously)
            Is Equal(x=130, y=w58) -> w60
            Is Equal(x=w59, y=129) -> w61
            Logical And[output inverted](w60, w61, w57, s1) -> w16
            w17 = s3
            w18 = s2
            w19 = s1
          }
          frame Default {
            # We have a file which is not MacBinary or non standard somehow
            w16 = FALSE
            w17 = s3
            w18 = s2
            w19 = FALSE
          }
        }
        next s1 = w19
        next s2 = w18
        next s3 = w17
        continue if w16
      }
      case (s1) {
        frame False, Default {
          call "Build Error Cluster.gvi"(code="Generic error"(42), String to Prepend to source ("")="Bad MacBinary Header") -> (error out=w14)
          w12 = 0
          w15 = $"data file"
        }
        frame True {
          call "Valid Path - Traditional.gvi"(path=$"data file") -> (valid=w62)
          case (w62) {
            frame False, Default {
              # no data path specified,
              # copy it in the same directory
              # as the macbinary file
              Strip Path(path=$"macbinary file") -> (stripped path=w63)
              Build Path(base path=w63, name or relative path=s3) -> (appended path=w15)
            }
            frame True {
              File Or Directory Info(path=$"data file") -> (directory=w64, path out=w65)
              case (w64) {
                frame False, Default {
                  w15 = w65
                }
                frame True {
                  Build Path(base path=w65, name or relative path=s3) -> (appended path=w15)
                }
              }
            }
          }
          w12 = i1
          w14 = w8
        }
      }
      w13 = s2
    }
    frame True {
      w12 = 0
      w13 = $"dummy header"
      w14 = w8
      w15 = $"data file"
    }
  }
  $"macbinary header" <- w13
  $"data file out" <- w15
  $"macbinary version" <- w12
  $"error out" <- w14
  $"header bytes" <- w5
  To Long Integer(number=w9) -> w66
  $"file offset" <- w66
