vi "Cast Msg to Msg Cluster.gvi"   [LabVIEW Platform Developer Preview 0.1.0]
# Type casts (unflattens) a message string to a message cluster.
inputs:
  "queue element": string, required  # elements is an array of elements removed from the queue.
outputs:
  "message cluster": "Msg Cluster.gtype"
types:
  "Msg Cluster.gtype" = GenericRefnum
uses:
  OpenG.Message Queue::Default Message Cluster.gvi
diagram:
  call "Default Message Cluster.gvi"() -> (default message cluster=w1)
  Unflatten From Byte Array(data bytes=$"queue element", type=w1) -> (value=w2)
  $"message cluster" <- w2
