vi "Destroy Msg Queue.gvi"   [LabVIEW Platform Developer Preview 0.1.0]
# Destroys the specified message queue and returns any messages that are in the queue and optionally destroys all response notifiers. All Insert Msg Queue Element and Remove Msg Queue Element VIs that are currently waiting on this queue will time out immediately and return an error.
inputs:
  "msg queue": "Msg Queue RefNum.gtype", required  # queue is a reference associated with a queue.
  "Destroy Response Notifiers? (T)": bool
  "error in (no error)": error
outputs:
  "queue name": string  # queue name is the name of the queue.
  "massages": "Msg Cluster.gtype"[]
  "error out": error
types:
  "Msg Queue RefNum.gtype" = i32
  "Msg Cluster.gtype" = GenericRefnum
uses:
  OpenG.Message Queue::Cast Msg Queue to Queue.gvi
  OpenG.Message Queue::Cast Msgs to Msg Clusters.gvi
diagram:
  call "Cast Msg Queue to Queue.gvi"(msg queue=$"msg queue") -> (queue=w1)
  Destroy Queue(queue Input 0=w1, error in (no error) Input 1=$"error in (no error)") -> (queue name Output 2=w2, remaining elements Output 3=w3, error out Output 4=w4)  # Destroy Queue (Placeholder)
  $"queue name" <- w2
  call "Cast Msgs to Msg Clusters.gvi"(queue elements=w3) -> (massages=w5)
  $massages <- w5
  $"error out" <- w4
  case ($"Destroy Response Notifiers? (T)") {
    frame False, Default { }
    frame True {
      # /*Destroy any response notifiers remaining in queue*/
      for {
        w6 = each element of w5
        Property Node(instance in=w6) -> ("response notifier"=w7)
        Destroy Notifier(notifier Input 0=w7)  # Destroy Notifier (Placeholder)
      }
    }
  }
