vi "Get Msg Queue Status.gvi"   [LabVIEW Platform Developer Preview 0.1.0]
# Returns current status information of message queue.
inputs:
  "msg queue": "Msg Queue RefNum.gtype", required  # queue is a reference associated with a queue.
  "return elements (F)": bool  # return elements specifies whether the function returns the elements in the queue.
  "error in (no error)": error
outputs:
  "msg queue out": "Msg Queue RefNum.gtype"  # queue out has the same value as queue.
  "# pending to remove": i32  # # pending to remove is the number of Remove Queue Element functions currently waiting to remove an element from queue.
  "# pending to insert": i32  # # pending to insert is the number of Insert Queue Element functions currently waiting to insert an element into queue.
  "error out": error
  "queue size": i32  # queue size returns the maximum number of elements allowed in the queue. -1 indicates the there is no limit to the size of the queue.
  "name": string  # name is the name of the queue.
  "messages": "Msg Cluster.gtype"[]
  "# elements in queue": i32  # # elements in queue returns the current number of elements in the queue.
types:
  "Msg Queue RefNum.gtype" = i32
  "Msg Cluster.gtype" = GenericRefnum
uses:
  OpenG.Message Queue::Cast Msg Queue to Queue.gvi
  OpenG.Message Queue::Cast Queue to Msg Queue.gvi
  OpenG.Message Queue::Cast Msgs to Msg Clusters.gvi
diagram:
  call "Cast Msg Queue to Queue.gvi"(msg queue=$"msg queue") -> (queue=w1)
  Get Queue Status(queue Input 0=w1, return elements (F) Input 1=$"return elements (F)", error in (no error) Input 2=$"error in (no error)") -> (queue out Output 3=w2, # pending to remove Output 4=w3, # pending to insert Output 5=w4, error out Output 6=w5, queue size Output 7=w6, name Output 8=w7, elements Output 9=w8, # elements in queue Output 10=w9)  # Get Queue Status (Placeholder)
  $"queue size" <- w6
  $name <- w7
  call "Cast Queue to Msg Queue.gvi"(queue=w2) -> (msg queue=w10)
  $"msg queue out" <- w10
  $"error out" <- w5
  $"# pending to remove" <- w3
  $"# pending to insert" <- w4
  $"# elements in queue" <- w9
  call "Cast Msgs to Msg Clusters.gvi"(queue elements=w8) -> (massages=w11)
  $messages <- w11
