vi "Insert Msg Queue Element.gvi"   [LabVIEW Platform Developer Preview 0.1.0]
# Inserts an element into a message queue.
inputs:
  "msg queue": "Msg Queue RefNum.gtype", required  # queue is a reference associated with a queue.
  "message": string, required  # queue element is the element inserted into the queue.
  "ms timeout (-1)": i32 = -1  # ms timeout specifies how many milliseconds the VI waits for available space in the queue.
  "error in (no error)": error
  "at front (F)": bool  # at front specifies if the queue element will be inserted at the beginning of the queue.
  "Generate Response Notifier (F)": bool
outputs:
  "msg queue out": "Msg Queue RefNum.gtype"  # queue out has the same value as queue.
  "response notifier": "Notifier RefNum.gtype"  # notifier is a reference to an existing or newly created notifier.
  "timed out": bool  # timed out returns TRUE if no space is available before the VI times out or if an error occurs.
  "error out": error
types:
  "Msg Queue RefNum.gtype" = i32
  "Notifier RefNum.gtype" = i32
uses:
  OpenG.Message Queue::Default Message Cluster.gvi
  OpenG.Message Queue::Cast Msg Queue to Queue.gvi
  OpenG.Message Queue::Cast Queue to Msg Queue.gvi
diagram:
  case ($"error in (no error)") {
    frame No Error {
      call "Default Message Cluster.gvi"() -> (default message cluster=w5)
      Property Node(instance in=w5, "message"=$message) -> (instance out=w6)
      case ($"Generate Response Notifier (F)") {
        frame False, Default {
          w7 = $"error in (no error)"
          w8 = w6
        }
        frame True {
          Create Notifier(error in (no error) Input 2=$"error in (no error)") -> (notifier out Output 3=w9, error out Output 5=w7)  # Create Notifier (Placeholder)
          Property Node(instance in=w6, "response notifier"=w9) -> (instance out=w8)
        }
      }
      call "Cast Msg Queue to Queue.gvi"(msg queue=$"msg queue") -> (queue=w10)
      Flatten To Byte Array(anything=w8) -> (data bytes=w11)
      Insert Queue Element(queue Input 0=w10, queue element Input 1=w11, ms timeout (-1) Input 2=$"ms timeout (-1)", error in (no error) Input 3=w7, at front (F) Input 7=$"at front (F)") -> (queue out Output 4=w12, timed out Output 5=w2, error out Output 6=w3)  # Insert Queue Element (Placeholder)
      Property Node(instance in=w3) -> ("status"=w13)
      # /*Destroy Response Notifier, if any errors occur*/
      case (w13) {
        frame False, Default {
          Property Node(instance in=w8) -> ("response notifier"=w4)
        }
        frame True {
          Property Node(instance in=w8) -> ("response notifier"=w14)
          Destroy Notifier(notifier Input 0=w14)  # Destroy Notifier (Placeholder)
          w4 = Not A Refnum
        }
      }
      call "Cast Queue to Msg Queue.gvi"(queue=w12) -> (msg queue=w1)
    }
    frame Error {
      w1 = Not A Refnum
      w2 = FALSE
      w3 = $"error in (no error)"
      w4 = Not A Refnum
    }
  }
  $"response notifier" <- w4
  $"msg queue out" <- w1
  $"error out" <- w3
  $"timed out" <- w2
