vi "Remove Msg Queue Element.gvi"   [LabVIEW Platform Developer Preview 0.1.0]
# Removes an element from a message queue.
inputs:
  "msg queue": "Msg Queue RefNum.gtype", required  # queue is a reference associated with a queue.
  "ms timeout (-1)": i32 = -1  # ms timeout specifies how many milliseconds the function should wait for an element to become available in the queue.
  "error in (no error)": error
outputs:
  "msg queue out": "Msg Queue RefNum.gtype"  # queue out has the same value as queue.
  "message": "Msg Cluster.gtype"
  "timed out": bool  # timed out returns TRUE if no element became available before the VI timed out or if an error occurred.
  "error out": error
types:
  "Msg Queue RefNum.gtype" = i32
  "Msg Cluster.gtype" = GenericRefnum
uses:
  OpenG.Message Queue::Cast Msg Queue to Queue.gvi
  OpenG.Message Queue::Cast Queue to Msg Queue.gvi
  OpenG.Message Queue::Cast Msg to Msg Cluster.gvi
diagram:
  call "Cast Msg Queue to Queue.gvi"(msg queue=$"msg queue") -> (queue=w1)
  Remove Queue Element(queue Input 0=w1, ms timeout (-1) Input 1=$"ms timeout (-1)", error in (no error) Input 2=$"error in (no error)") -> (queue out Output 3=w2, queue element Output 4=w3, timed out Output 5=w4, error out Output 6=w5)  # Remove Queue Element (Placeholder)
  call "Cast Queue to Msg Queue.gvi"(queue=w2) -> (msg queue=w6)
  $"msg queue out" <- w6
  call "Cast Msg to Msg Cluster.gvi"(queue element=w3) -> (message cluster=w7)
  $message <- w7
  $"timed out" <- w4
  $"error out" <- w5
