vi "VI Tree - Msg Queue.gvi"   [LabVIEW Platform Developer Preview 0.1.0]
panel controls:
  "Case Constant (See Context Help)": bool
    # LabVIEW created this control from a constant that was wired to a Case structure. In LabVIEW 7.1 and earlier, subVIs could be kept in memory by wiring a constant to a Case structure and placing the subVI in a case that would not be executed. For example, you could wire a True constant to the Case structure and place a subVI in the False case of the Case structure, and LabVIEW would load the subVI along with the calling VI. This no longer works in LabVIEW 8.0 because the Case structure is optimized to remove code that will not be executed. Changing the constant to a control ensures that this VI behaves as it did in LabVIEW 7.1 and earlier. If the intent is not to keep subVIs in memory, you can change this control back to a constant by right-clicking the control and selecting Change to Constant from the shortcut menu. The proper way to keep a subVI in memory without calling it is to use a Static VI Reference.
panel indicators:
  "message cluster": "Msg Cluster.gtype"
  "msg queue": "Msg Queue RefNum.gtype"  # queue is a reference to an existing or newly created queue.
types:
  "Msg Cluster.gtype" = GenericRefnum
  "Msg Queue RefNum.gtype" = i32
uses:
  OpenG.Message Queue::Create Msg Queue.gvi
  OpenG.Message Queue::Get Msg Queue Status.gvi
  OpenG.Message Queue::Insert Msg Queue Element.gvi
  OpenG.Message Queue::Flush Msg Queue.gvi
  OpenG.Message Queue::Not A Msg Queue.gvi
  OpenG.Message Queue::Remove Msg Queue Element.gvi
  OpenG.Message Queue::Destroy Msg Queue.gvi
  OpenG.Message Queue::Default Message Cluster.gvi
  OpenG.Message Queue::Cast Msg Queue to Queue.gvi
  OpenG.Message Queue::Cast Queue to Msg Queue.gvi
  OpenG.Message Queue::Cast Msgs to Msg Clusters.gvi
  OpenG.Message Queue::Cast Msg to Msg Cluster.gvi
diagram:
  case ($"Case Constant (See Context Help)") {
    frame False, Default { }
    frame True {
      # API
      call "Create Msg Queue.gvi"() -> (msg queue=w1)
      # Utility
      call "Get Msg Queue Status.gvi"(msg queue=w1)
      call "Insert Msg Queue Element.gvi"(msg queue=w1, message="")
      call "Flush Msg Queue.gvi"(msg queue=w1)
      call "Not A Msg Queue.gvi"(msg queue=w1)
      call "Remove Msg Queue Element.gvi"(msg queue=w1)
      # Type Def
      call "Destroy Msg Queue.gvi"(msg queue=w1)
      call "Default Message Cluster.gvi"()
      # Type Conversion
      call "Cast Msg Queue to Queue.gvi"(msg queue=w1) -> (queue=w2)
      call "Cast Queue to Msg Queue.gvi"(queue=w2)
      call "Cast Msgs to Msg Clusters.gvi"(queue elements=string[] [])
      call "Cast Msg to Msg Cluster.gvi"(queue element="")
    }
  }
