vi "Draw Image from File.gvi"   [LabVIEW Platform Developer Preview 0.1.0]
# Reads a BMP, JPG, PNG or GIF file and draws it into a picture control.
inputs:
  "path to image file": path, required
  "picture": string  # picture is the picture to which you want to add the pixmap. It defaults to an empty picture.
  "top left (0,0)": cluster{"x": i16, "y": i16}  # top left is a cluster containing a horizontal(x) and vertical(y) components.
  "error in (no error)": error
outputs:
  "dup path": path
  "new picture": string  # picture is the picture to which you want to add the pixmap. It defaults to an empty picture.
  "image size (pixels)": cluster{"x": i16, "y": i16}  # top left is a cluster containing a horizontal(x) and vertical(y) components.
  "error out": error
types:
  T1 = cluster{"x": i16, "y": i16, "Element 3": i16, "Element 4": i16}
uses:
  openg.library.file::Strip Path Extension - Path.gvi
  OpenG.Picture::Read GIF File.gvi
  openg.library.error::Build Error Cluster.gvi
diagram:
  case ($"error in (no error)") {
    frame No Error {
      call "Strip Path Extension - Path.gvi"(path=$"path to image file") -> (extension=w4)
      To Lower Case(string=w4) -> w5
      case (w5) ignore case {  # File Extension Name
        frame "bmp" {
          Read BMP File(6_1)(path to BMP file Input 0=$"path to image file", error in (no error) Input 1=$"error in (no error)") -> (rect Output 3=w9, flattened image data Output 4=w10, error out Output 5=w8, depth Output 6=w6, color table Output 7=w7)  # Read BMP File(6_1) (Placeholder)
        }
        frame "jpe", "jpeg", "jpg" {
          Read JPEG File(6_1)(path to JPEG file Input 0=$"path to image file", error in (no error) Input 1=$"error in (no error)") -> (rect Output 3=w9, flattened image data Output 4=w10, error out Output 5=w8, depth Output 6=w6, colorTable Output 7=w7)  # Read JPEG File(6_1) (Placeholder)
        }
        frame "gif" {
          call "Read GIF File.gvi"(path to GIF file=$"path to image file", error in (no error)=$"error in (no error)") -> (image data=w11, error out=w8)
          # If image has an even-number pixel-width
          # THEN Truncate right-most pixel.
          Property Node(instance in=w11) -> ("image depth"=w12, "Rectangle"=w9, "image"=w10, "colors"=w7)
          case (w12) {  # Adjust depth for ZEN
            frame 2..3 {
              w6 = 4
            }
            frame 5..7 {
              w6 = 8
            }
            frame Default {
              w6 = w12
            }
          }
        }
        frame "png" {
          Read PNG File(6_1)(path to PNG file Input 0=$"path to image file", error in (no error) Input 1=$"error in (no error)") -> (rect Output 3=w9, flattened image data Output 4=w10, error out Output 5=w8, depth Output 6=w6, colorTable Output 7=w7)  # Read PNG File(6_1) (Placeholder)
        }
        frame Default {
          Format Into String(formatString="Unsupported image type \"%s\"", w5) -> w13
          call "Build Error Cluster.gvi"(code="Image not found"(16), String to Prepend to source ("")=w13) -> (error out=w14)
          Merge Errors($"error in (no error)", w14) -> (error out=w8)
          w6 = default
          w7 = default
          w9 = default
          w10 = default
        }
      }
      case (w6) {  # image bit depth
        frame 0, Default {
          w15 = cluster{"Element 1": i16, "Element 2": i16} {all zero or empty}
          Format Into String(formatString="Unsupported  image depth \"%d\"", w6) -> w16
          call "Build Error Cluster.gvi"(code="Image not found"(16), String to Prepend to source ("")=w16) -> (error out=w17)
          Merge Errors(w8, w17) -> (error out=w3)
          w1 = $picture
          w2 = w15
        }
        frame 1, 4, 8, 24 {
          Property Node(instance in=$"top left (0,0)") -> ("x"=w18, "y"=w19)
          Property Node(instance in=w9) -> ("left"=w20, "top"=w21, "right"=w22, "bottom"=w23)
          Subtract(x=w22, y=w20) -> w24
          Add(w18, w24) -> w25
          Subtract(x=w23, y=w21) -> w26
          Add(w19, w26) -> w27
          Property Node(instance in=T1 {all zero or empty}, "x"=w18, "y"=w19, "Element 3"=w25, "Element 4"=w27) -> (instance out=w28)
          Draw Flattened Pixmap(6_1)(picture Input 0=$picture, rect Input 1=w28, flattened pixmap data Input 2=w10, bit depth(8) Input 4=w6, color table Input 5=w7) -> (new picture Output 3=w1)  # Draw Flattened Pixmap(6_1) (Placeholder)
          w29 = cluster{"Element 1": i16, "Element 2": i16} {all zero or empty}
          Property Node(instance in=w29, "Element 1"=w24, "Element 2"=w26) -> (instance out=w2)
          w3 = w8
        }
        frame 32 {
          Property Node[IsPlaceholderNodeForConversion=True]() -> ("App.Version"=w30)
          case (w30) {  # Remove Alpha Channel
            frame "6.1" {
              Decimate Array(array=w10) -> (out0=w32, out1=w33, out2=w34)
              Interleave Array(w32, w33, w34) -> w31
            }
            frame Default {
              Decimate Array(array=w10) -> (out1=w35, out2=w36, out3=w37)
              Interleave Array(w35, w36, w37) -> w31
            }
          }
          Property Node(instance in=$"top left (0,0)") -> ("x"=w38, "y"=w39)
          Property Node(instance in=w9) -> ("left"=w40, "top"=w41, "right"=w42, "bottom"=w43)
          Subtract(x=w42, y=w40) -> w44
          Add(w38, w44) -> w45
          Subtract(x=w43, y=w41) -> w46
          Add(w39, w46) -> w47
          Property Node(instance in=T1 {all zero or empty}, "x"=w38, "y"=w39, "Element 3"=w45, "Element 4"=w47) -> (instance out=w48)
          Draw Flattened Pixmap(6_1)(picture Input 0=$picture, rect Input 1=w48, flattened pixmap data Input 2=w31, bit depth(8) Input 4=24, color table Input 5=w7) -> (new picture Output 3=w1)  # Draw Flattened Pixmap(6_1) (Placeholder)
          w49 = cluster{"Element 1": i16, "Element 2": i16} {all zero or empty}
          Property Node(instance in=w49, "Element 1"=w44, "Element 2"=w46) -> (instance out=w2)
          w3 = w8
        }
      }
    }
    frame Error {
      w50 = cluster{"Element 1": i16, "Element 2": i16} {all zero or empty}
      w1 = $picture
      w2 = w50
      w3 = $"error in (no error)"
    }
  }
  $"new picture" <- w1
  $"image size (pixels)" <- w2
  $"dup path" <- $"path to image file"
  $"error out" <- w3
