vi "Flatten Pixmap - GIF.gvi"   [LabVIEW Platform Developer Preview 0.1.0]
inputs:
  "PixelTable": u32[][]
  "ExistingColorTable": u32[]
  "StartColorIndex": i32
outputs:
  "image data": "imagedata.gtype"  # image data returns information about the pixmap so you can use the Draw Flattened Pixmap VI to draw the pixmap as a picture or use the Graphics Formats VIs to save the pixmap to a file.
  "EndColorIndex": i32
types:
  T1 = cluster{"left": i16, "top": i16, "right": i16, "bottom": i16}
  "imagedata.gtype" = cluster{"image type": i32, "image depth": i32, "image": u8[], "mask": u8[], "colors": u32[], "Rectangle": T1}
diagram:
  w1 = 8  # Depth
  Array Size(array=$PixelTable) -> (size(s)=w2)
  Multiply Array Elements(numeric array=w2) -> (product=w3)
  w4 = 0  # U8
  Initialize Array(element=w4, size=w3) -> w5
  Array Size(array=$ExistingColorTable) -> (size(s)=w6)
  Power Of 2(x=w1) -> w7
  Is Less(x=w6, y=w7) -> w8
  case (w8) {
    frame False, Default {
      w9 = $ExistingColorTable
      w10 = $StartColorIndex
    }
    frame True {
      Is Greater Than 0(x=w6) -> w11
      Select(s=w11, t=$StartColorIndex, f=0) -> w10
      w12 = 0  # U32
      Subtract(x=w7, y=w6) -> w13
      Initialize Array(element=w12, size=w13) -> w14
      Build Array[ConcatenateInputs=True]($ExistingColorTable, w14) -> w9
    }
  }
  # Convert a 2D array of color-controls (RRGGBB) into an image-data cluster suitable for writing to a GIF file.
  s1 = w9  # shift register
  s2 = w10  # shift register
  s3 = w5  # shift register
  s4 = 0  # shift register
  for (iteration -> i1) {
    w15 = each element of $PixelTable
    s5 = s1  # shift register
    s6 = s2  # shift register
    s7 = s3  # shift register
    s8 = s4  # shift register
    for (after i1) {
      w16 = each element of w15
      Increment(x=s8) -> w17
      Search 1D Array(1D array=s5, element=w16) -> (index of element=w18)
      # color-array index
      Is Less Than 0(x=w18) -> w19
      # image array index
      case (w19) {
        frame False, Default {
          w20 = s5
          w21 = s6
          w22 = w18
        }
        frame True {
          Increment(x=s6) -> w21
          Replace Array Subset(inArray=s5, index=s6, new=w16) -> w20
          w22 = s6
        }
      }
      Replace Array Subset(inArray=s7, index=s8, new=w22) -> w23
      next s5 = w20
      next s6 = w21
      next s7 = w23
      next s8 = w17
    }
    next s1 = s5
    next s2 = s6
    next s3 = s7
    next s4 = s8
  }
  Array Index(array=w2) -> (out0[_]=w24, out1[_]=w25)
  Property Node(instance in=$"image data", "image type"=0, "image depth"=w1, "mask"=u8[] [], "Rectangle:bottom"=w24, "Rectangle:right"=w25, "Rectangle:left"=0, "Rectangle:top"=0, "image"=s3, "colors"=s1) -> (instance out=w26)
  $"image data" <- w26
  $EndColorIndex <- s2
