vi "Flatten Pixmaps - GIF.gvi"   [LabVIEW Platform Developer Preview 0.1.0]
inputs:
  "PixelTable": u32[][][]
  "GlobalColorTable(GIF)": bool
outputs:
  "Images": "imagedata.gtype"[]
types:
  T1 = cluster{"left": i16, "top": i16, "right": i16, "bottom": i16}
  "imagedata.gtype" = cluster{"image type": i32, "image depth": i32, "image": u8[], "mask": u8[], "colors": u32[], "Rectangle": T1}
uses:
  OpenG.Picture::Flatten Pixmap - GIF.gvi
diagram:
  # Use this VI to build an images array.
  # If the array will be written to an animated GIF,
  s1 = u32[] []  # shift register
  s2 = uninitialised  # shift register
  for {
    w1 = each element of $PixelTable
    call "Flatten Pixmap - GIF.gvi"(PixelTable=w1, ExistingColorTable=s1, StartColorIndex=s2) -> (image data=w3, EndColorIndex=w4)
    case ($"GlobalColorTable(GIF)") {
      frame False, Default {
        # Each image starts with
        # empty color-table, so
        # it will construct its own.
        w5 = default
        w6 = w3
        w7 = default
      }
      frame True {
        # Buffer current Global CT
        sequence {
          frame 0 {
            w8 = u32[] []  # [U32]
            Property Node(instance in=w3) -> ("colors"=w5)
          }
        }
        Property Node(instance in=w3, "colors"=w8) -> (instance out=w6)
        w7 = w4
      }
    }
    append w6 to w2
    next s1 = w5
    next s2 = w7
  }
  case ($"GlobalColorTable(GIF)") {
    frame False, Default {
      w9 = w2
    }
    frame True {
      Array Index(array=w2) -> (out0[_]=w10)
      # [Only] first image gets
      # complete color table
      Property Node(instance in=w10, "colors"=s1) -> (instance out=w11)
      Replace Array Subset(inArray=w2, index=0, new=w11) -> w9
    }
  }
  $Images <- w9
