vi "GIF.Read.Unpack.Interlace.gvi"   [LabVIEW Platform Developer Preview 0.1.0]
inputs:
  "Interlaced": u8[]
  "Columns": i32
outputs:
  "Flat": u8[]
diagram:
  # Appendix
  # E. Interlaced Images.
  #
  # The rows of an Interlaced images are arranged in the following order:
  #
  #       Group 1 : Every 8th. row, starting with row 0.              (Pass 1)
  #       Group 2 : Every 8th. row, starting with row 4.              (Pass 2)
  #       Group 3 : Every 4th. row, starting with row 2.              (Pass 3)
  #       Group 4 : Every 2nd. row, starting with row 1.              (Pass 4)
  #
  # The Following example illustrates how the rows of an interlaced image are
  # ordered.
  #
  #       Row Number                                        Interlace Pass
  #
  #  0    -----------------------------------------       1
  #  1    -----------------------------------------                         4
  #  2    -----------------------------------------                   3
  #  3    -----------------------------------------                         4
  #  4    -----------------------------------------             2
  #  5    -----------------------------------------                         4
  #  6    -----------------------------------------                   3
  #  7    -----------------------------------------                         4
  #  8    -----------------------------------------       1
  #  9    -----------------------------------------                         4
  #  10   -----------------------------------------                   3
  #  11   -----------------------------------------                         4
  #  12   -----------------------------------------             2
  #  13   -----------------------------------------                         4
  #  14   -----------------------------------------                   3
  #  15   -----------------------------------------                         4
  #  16   -----------------------------------------       1
  #  17   -----------------------------------------                         4
  #  18   -----------------------------------------                   3
  #  19   -----------------------------------------                         4
  Array Size(array=$Interlaced) -> (size(s)=w1)
  Is Greater Than 0(x=w1) -> w2
  case (w2) {
    frame False, Default {
      w3 = $Interlaced
    }
    frame True {
      Quotient And Remainder(x=w1, y=$Columns) -> (floor(x/y)=w4, x-y*floor(x/y)=w5)
      Is Greater Than 0(x=w5) -> w6
      Boolean To Integer(Boolean=w6) -> (0, 1=w7)
      Add(w7, w4) -> w8
      Reshape Array(inArray=$Interlaced, size=w8, size=$Columns) -> w9
      w10 = 0  # Pass#
      s1 = w9  # shift register
      s2 = 8  # shift register
      s3 = 0  # shift register
      s4 = w10  # shift register
      for (N = w8) {
        w11 = each element of w9
        Replace Array Subset(inArray=s1, index=s3, index=_, new=w11) -> w12
        Add(s3, s2) -> w13
        Is Less(x=w13, y=w8) -> w14
        case (w14) {
          frame False, Default {
            case (s4) {
              frame 0, Default {
                w15 = 8
                w16 = 4
              }
              frame 1 {
                w15 = 4
                w16 = 2
              }
              frame 2 {
                w15 = 2
                w16 = 1
              }
            }
            Increment(x=s4) -> w17
          }
          frame True {
            w15 = s2
            w16 = w13
            w17 = s4
          }
        }
        next s1 = w12
        next s2 = w15
        next s3 = w16
        next s4 = w17
      }
      Array Size(array=s1) -> (size(s)=w18)
      Multiply Array Elements(numeric array=w18) -> (product=w19)
      Reshape Array(inArray=s1, size=w19) -> w3
    }
  }
  $Flat <- w3
