vi "GIF.Read.Unpack.State.gvi"   [LabVIEW Platform Developer Preview 0.1.0]
inputs:
  "State in": T1 = "End_Of_File"
  "NextCharacter": u8
  "NextLabel": u8
  "ColorMap": bool
  "error in (no error)": error
outputs:
  "New State": T1
  "error out": error
types:
  T1 = enum{"Begin", "Header", "LS_LSDescriptor", "LS_GCTable", "Data_LGD_SPB", "Data_GB_GRB_PTE", "Data_GB_GCE", "Data_GB_GRB_TBI_IDesc", "Data_GB_GRB_TBI_CMap", "Data_GB_GRB_TBI_ImageData", "End_Of_File"}
uses:
  OpenG.Picture::Util.Error.Build.gvi
diagram:
  # <GIF Data Stream> ::=     Header <Logical Screen> <Data>* Trailer
  #
  # <Logical Screen> ::=      Logical Screen Descriptor [Global Color Table]
  #
  # <Data> ::=                <Graphic Block>  |
  #                           <Special-Purpose Block>
  #
  # <Graphic Block> ::=       [Graphic Control Extension] <Graphic-Rendering Block>
  #
  # <Graphic-Rendering Block> ::=  <Table-Based Image>  |
  #                                Plain Text Extension
  #
  # <Table-Based Image> ::=   Image Descriptor [Local Color Table] Image Data
  #
  # <Special-Purpose Block> ::=    Application Extension  |
  #                                Comment Extension
  # Appendix
  # A. Quick Reference Table.
  #
  # Block Name                  Required   Label       Ext.   Vers.
  # Application Extension       Opt. (*)   0xFF (255)  yes    89a
  # Comment Extension           Opt. (*)   0xFE (254)  yes    89a
  # Global Color Table          Opt. (1)   none        no     87a
  # Graphic Control Extension   Opt. (*)   0xF9 (249)  yes    89a
  # Header                      Req. (1)   none        no     N/A
  # Image Descriptor            Opt. (*)   0x2C (044)  no     87a (89a)
  # Local Color Table           Opt. (*)   none        no     87a
  # Logical Screen Descriptor   Req. (1)   none        no     87a (89a)
  # Plain Text Extension        Opt. (*)   0x01 (001)  yes    89a
  # Trailer                     Req. (1)   0x3B (059)  no     87a
  #
  # Unlabeled Blocks
  # Header                      Req. (1)   none        no     N/A
  # Logical Screen Descriptor   Req. (1)   none        no     87a (89a)
  # Global Color Table          Opt. (1)   none        no     87a
  # Local Color Table           Opt. (*)   none        no     87a
  #
  # Graphic-Rendering Blocks
  # Plain Text Extension        Opt. (*)   0x01 (001)  yes    89a
  # Image Descriptor            Opt. (*)   0x2C (044)  no     87a (89a)
  #
  # Control Blocks
  # Graphic Control Extension   Opt. (*)   0xF9 (249)  yes    89a
  #
  # Special Purpose Blocks
  # Trailer                     Req. (1)   0x3B (059)  no     87a
  # Comment Extension           Opt. (*)   0xFE (254)  yes    89a
  # Application Extension       Opt. (*)   0xFF (255)  yes    89a
  #
  # legend:           (1)   if present, at most one occurrence
  #                   (*)   zero or more occurrences
  #                   (+)   one or more occurrences
  #
  # Notes : The Header is not subject to Version Numbers.
  # (89a) The Logical Screen Descriptor and the Image Descriptor retained their
  # syntax from version 87a to version 89a, but some fields reserved under version
  # 87a are used under version 89a.
  case ($"State in") {
    frame "Begin", Default {
      # Default is required because the End_Of_File state has no case.
      w1 = "Header"
      w2 = $"error in (no error)"
    }
    frame "Header" {
      w1 = "LS_LSDescriptor"
      w2 = $"error in (no error)"
    }
    frame "LS_LSDescriptor".."Data_GB_GRB_PTE", "Data_GB_GRB_TBI_ImageData" {
      # Extension introducer
      Is Not Equal(x="LS_GCTable", y=$"State in") -> w3
      Logical And(w3, $ColorMap) -> w4
      # "LS_LSDESCRIPTOR
      # May be followed by:
      # LS_GCTABLE
      # DATA_GB_GCE.......... x21:xF9
      # DATA_GB_GRB_TBI_IDESC x2C
      # DATA_GB_GRB_PTE...... x21:x01
      # DATA_LGD_SPB_CEXT.... x21:xFE
      # DATA_LGD_SPB_AEXT.... x21:xFF
      case (w4) {
        frame False, Default {
          case ($NextCharacter) {
            frame Default {
              # LSDescriptor may be last Data-element
              w5 = "Extension introducer missing after Logical Screen Descriptor."
              call "Util.Error.Build.gvi"(Source=w5, error in (no error)=$"error in (no error)") -> (error out=w2)
              w1 = default
            }
            frame 33 {
              case ($NextLabel) {
                frame Default {
                  call "Util.Error.Build.gvi"(Source="Unexpected Label  (\"x%02x\") after Extension introducer.", error in (no error)=$"error in (no error)") -> (error out=w2)
                  w1 = default
                }
                frame 1 {
                  w1 = "Data_GB_GRB_PTE"
                  w2 = $"error in (no error)"
                }
                frame 249 {
                  w1 = "Data_GB_GCE"
                  w2 = $"error in (no error)"
                }
                frame 254..255 {
                  w1 = "Data_LGD_SPB"
                  w2 = $"error in (no error)"
                }
              }
            }
            frame 44 {
              w1 = "Data_GB_GRB_TBI_IDesc"
              w2 = $"error in (no error)"
            }
            frame 59 {
              w1 = "End_Of_File"
              w2 = $"error in (no error)"
            }
          }
        }
        frame True {
          w1 = "LS_GCTable"
          w2 = $"error in (no error)"
        }
      }
    }
    frame "Data_GB_GCE" {
      # "DATA_GB_GCE"
      # May be followed by:
      # LS_GCTABLE
      # DATA_GB_GRB_TBI_IDESC x2C
      # DATA_GB_GRB_PTE...... x21:x01
      case ($NextCharacter) {
        frame Default {
          w6 = "Last segment was DATA_GB_GCE, expected Extension introducer 0x21 or 0x2C but found: x%02x"
          Format Into String(formatString=w6, $NextCharacter) -> w7
          call "Util.Error.Build.gvi"(Source=w7, error in (no error)=$"error in (no error)") -> (error out=w2)
          w1 = default
        }
        frame 33 {
          case ($NextLabel) {
            frame Default {
              w8 = "Last segment was DATA_GB_GCE, found code 0x21 (Extension introducer) expected Plain-text extension label (0x01) but found: x%02x"
              Format Into String(formatString=w8, $NextLabel) -> w9
              call "Util.Error.Build.gvi"(Source=w9, error in (no error)=$"error in (no error)") -> (error out=w2)
              w1 = default
            }
            frame 1 {
              w2 = $"error in (no error)"
              w1 = "Data_GB_GRB_PTE"
            }
          }
        }
        frame 44 {
          w2 = $"error in (no error)"
          w1 = "Data_GB_GRB_TBI_IDesc"
        }
      }
    }
    frame "Data_GB_GRB_TBI_IDesc" {
      # DATA_GB_GRB_TBI_IMAGEDATA
      Select(s=$ColorMap, t="Data_GB_GRB_TBI_CMap", f="Data_GB_GRB_TBI_ImageData") -> w1
      w2 = $"error in (no error)"
    }
    frame "Data_GB_GRB_TBI_CMap" {
      # DATA_GB_GRB_TBI_IMAGEDATA
      w1 = "Data_GB_GRB_TBI_ImageData"
      w2 = $"error in (no error)"
    }
  }
  $"New State" <- w1
  $"error out" <- w2
