vi "GIF.Write.Pack.Data.NormalizeImage.gvi"   [LabVIEW Platform Developer Preview 0.1.0]
inputs:
  "ImageIn": u8[]
  "right": i16  # right is the horizontal coordinate of the right edge of the rectangle.
  "bottom": i16  # bottom is the vertical coordinate of the bottom edge of the rectangle.
outputs:
  "ImageOut": u8[]
diagram:
  Array Size(array=$ImageIn) -> (size(s)=w1)
  Increment(x=$right) -> w2
  Multiply($bottom, w2) -> w3
  Is Equal(x=w1, y=w3) -> w4
  # LabVIEW Picture/Image rows are (currently) padded to even byte width.
  # It's up to code that processes images to know this and to ignore the padding.
  # The Rectangle dimensions correctly reflect image size and can be used to
  # detect an remove the padding.
  case (w4) {
    frame False, Default {
      w5 = $ImageIn
    }
    frame True {
      # real width ("right") = 5
      # remove 6th byte
      # 00000x00000x00000x pad @ index=5
      # 0000000000x00000x pad @ index=10
      # 000000000000000x pad @ index=15
      s1 = $ImageIn  # shift register
      s2 = $right  # shift register
      for (N = $bottom) {
        Delete From Array(inArray=s1, length (1)=1, index0=s2) -> w6
        Add(s2, $right) -> w7
        next s1 = w6
        next s2 = w7
      }
      w5 = s1
    }
  }
  $ImageOut <- w5
