vi "GIF.Write.Pack.LogicalScreen.gvi"   [LabVIEW Platform Developer Preview 0.1.0]
inputs:
  "LV image data": "imagedata.gtype"  # image data returns information about the pixmap so you can use the Draw Flattened Pixmap VI to draw the pixmap as a picture or use the Graphics Formats VIs to save the pixmap to a file.
  "error in (no error)": error
outputs:
  "Pack in-progress out": u8[]
  "error out": error
types:
  T1 = cluster{"left": i16, "top": i16, "right": i16, "bottom": i16}
  "imagedata.gtype" = cluster{"image type": i32, "image depth": i32, "image": u8[], "mask": u8[], "colors": u32[], "Rectangle": T1}
uses:
  OpenG.Picture::Util.Error.Build.gvi
  NI::G Core::Picture::Color to RGBA.gvi
diagram:
  Property Node(instance in=$"LV image data") -> ("Rectangle:right"=w1, "Rectangle:left"=w2, "Rectangle:bottom"=w3, "Rectangle:top"=w4, "colors"=w5, "image depth"=w6)
  Array Size(array=w5) -> (size(s)=w7)
  Is Greater Than 0(x=w7) -> w8
  w9 = "Error: Missing Color-table (empty \"colors\" array).\nThe first (or only)\"image data\" cluster must have a Color-table."
  Select(s=w8, t="", f=w9) -> w10
  call "Util.Error.Build.gvi"(Source=w10, code=-1, Status=TRUE, error in (no error)=$"error in (no error)") -> (error out=w11)
  $"error out" <- w11
  w12 = 0x0  # BackgroundColor
  Array Size(array=w5) -> (size(s)=w13)
  Multiply(w13, 3) -> w14
  Initialize Array(element=0, size=w14) -> w15
  # Global color table
  s1 = w15  # shift register
  for (iteration -> i1) {
    w16 = each element of w5
    Multiply(i1, 3) -> w17
    call "Color to RGBA.gvi"(color=w16) -> (red=w18, green=w19, blue=w20)
    Increment(x=w17) -> w21
    Increment(x=w21) -> w22
    Replace Array Subset(inArray=s1, index=w17, new=w18, index=w21, new=w19, index=w22, new=w20) -> w23
    Type Cast(type=u32 0, x=w16)
    next s1 = w23
  }
  Subtract(x=w1, y=w2) -> w24
  # HEIGHT LSB First
  # WIDTH LSB First
  Split Number(x=w24) -> (high(x)=w25, low(x)=w26)
  Subtract(x=w3, y=w4) -> w27
  Split Number(x=w27) -> (high(x)=w28, low(x)=w29)
  Select(s=w8, t=0x8, f=0x0) -> w30
  Logarithm Base 2(x=w7) -> w31
  Round Toward Positive Infinity(x=w31) -> w32
  To Long Integer(number=w32) -> w33
  Max And Min(x=w33, y=w6) -> (min(x,y)=w34: i32)
  Decrement(x=w34) -> w35
  Logical Or(w30, w35) -> w36
  Logical Shift(x=w36, y=4) -> w37
  Add(w37, 7) -> w38
  To Unsigned Byte Integer(number=w38) -> w39
  w40 = 0x0  # PixelRatio
  Build Array[ConcatenateInputs=True](w26, w25, w29, w28, w39, w12, w40, s1) -> w41
  $"Pack in-progress out" <- w41
