vi "Util.Cmprs.LZW.CU.BitStream.Width.gvi"   [LabVIEW Platform Developer Preview 0.1.0]
inputs:
  "Code": i16
  "Reset": i16
  "ImageBits": i32
outputs:
  "Bit Width": i32
  "Bit Width next": i32
diagram:
  # Threshold
  Is Equal(x=$Reset, y=$Code) -> w1
  Increment(x=$Reset) -> w2
  Is Equal(x=w2, y=$Code) -> w3
  # Index
  Logical Or(w3, w1) -> w4
  # This VI is called for every code processed and mirrors the last index in the LZW strings-table.
  # Whether packing or unpacking, the first call to this VI will be the reset code (2^bits).
  # The reset code causes this VI to reset its counter to the last index in a new strings table.
  #  (EXAMPLE: 256 chars + 2 control-codes = 258 pre-defined codes => counter reset to 257)
  # With the exception of the termination-code (reset code + 1) all other codes increment MaxCode (the strings table max-index).
  #
  # When packing, this VI receives codes AFTER a string has been added to the strings-table.
  # When packing, the string table outputs a code for (the index of) an existing string - then adds a new string.
  # So, when packing a code, use "Bit Width" - the width applicable before bumping MaxCode.
  #
  # When unpacking, a bit-width is used to unpack a code.
  # "Bit Width next" represents the Bit Width appropriate for the next code to be unpacked.
  s1 = uninitialised  # shift register
  s2 = uninitialised  # shift register
  s3 = uninitialised  # shift register
  while {
    case (w4) {
      frame True {
        case (w1) {
          frame False, Default {
            w6 = s1
            w7 = s2
            w8 = s3
          }
          frame True {
            Power Of 2(x=$ImageBits) -> w9
            To Long Integer(number=w9) -> w10
            # While unpacking, only "Bit Width next" is used
            # StartIndex
            # 257
            # First Threshold
            # 512
            Increment(x=w10) -> w6
            Increment(x=$ImageBits) -> w7
            Power Of 2(x=w7) -> w11
            To Long Integer(number=w11) -> w8
          }
        }
      }
      frame False {
        Increment(x=s1) -> w12
        Is Equal(x=w12, y=s3) -> w13
        case (w13) {
          frame True {
            Is Greater(x=12, y=s2) -> w14
            case (w14) {
              frame False, Default {
                Power Of 2(x=$ImageBits) -> w15
                To Long Integer(number=w15) -> w16
                Increment(x=w16) -> w6
                Increment(x=$ImageBits) -> w7
                Power Of 2(x=w7) -> w17
                To Long Integer(number=w17) -> w8
              }
              frame True {
                Multiply(2, s3) -> w8
                Increment(x=s2) -> w7
                w6 = w12
              }
            }
          }
          frame False {
            w6 = w12
            w7 = s2
            w8 = s3
          }
        }
      }
    }
    w5 = s2
    next s1 = w6
    next s2 = w7
    next s3 = w8
    stop if TRUE
  }
  $"Bit Width next" <- s2
  $"Bit Width" <- w5
