vi "Util.Cmprs.LZW.CU.StringsTable.gvi"   [LabVIEW Platform Developer Preview 0.1.0]
inputs:
  "Pack": bool
  "Chars in": u8[]
  "Codes in": i16[]
  "error in (no error)": error
  "Bits": i32
outputs:
  "Codes out": i16[]
  "Chars out": u8[]
  "error out": error
panel indicators:
  "Packed": string[]
  "Unpacked": string[]
uses:
  OpenG.Picture::Util.Error.Build.gvi
diagram:
  Power Of 2(x=$Bits) -> w1
  To Word Integer(number=w1) -> w2
  Increment(x=w2) -> w3
  Increment(x=w3) -> w4
  # Build default strings table
  for (N = w4) (iteration -> i1) {
    To Unsigned Byte Integer(number=i1) -> w6
    Type Cast(type=string "", x=w6) -> w7
    append w7 to w5
  }
  case ($Pack) {
    frame False, Default {
      w9 = FALSE  # ErrFlag
      w10 = 0  # U8
      Initialize Array(element=w10) -> w11
      s1 = w5  # shift register
      s2 = ""  # shift register
      s3 = w11  # shift register
      s4 = -1  # shift register
      s5 = w9  # shift register
      for {
        w12 = each element of $"Codes in"
        In Range And Coerce[IncludeHighLimit=True](lower limit=w2, upper limit=w3, x=w12) -> (In Range?=w13)
        case (w13) {
          frame True {
            Is Equal(x=w2, y=w12) -> w19
            case (w19) {
              frame False, Default {
                w14 = s1
                w17 = s2
                w16 = s4
              }
              frame True {
                Increment(x=w2) -> w20
                Increment(x=w20) -> w21
                Array Subset(array=s1, length0=w21) -> w14
                w17 = ""
                w16 = -1
              }
            }
            w15 = s3
            w18 = s5
          }
          frame False {
            Array Size(array=s1) -> (size(s)=w22)
            Array Index(array=s1) -> (out0[s4]=w23)
            Concatenate Strings(w23, s2) -> w24
            Is Greater(x=w22, y=w12) -> w25
            case (w25) {
              frame False, Default {
                Is Less(x=w22, y=w12) -> w27
                Logical Or(w27, s5) -> w18
                w26 = w24
              }
              frame True {
                Array Index(array=s1) -> (out0[w12]=w26)
                w18 = s5
              }
            }
            String To Byte Array(encoding="Extended ASCII", string=w26) -> (unsigned byte array=w28)
            Build Array[ConcatenateInputs=True](s3, w28) -> w15
            String Subset(length (rest)=1, string=w26) -> w17
            Is Empty String Or Path(string/path=w23) -> w29
            case (w29) {
              frame False, Default {
                Concatenate Strings(w23, w17) -> w30
                Build Array[ConcatenateInputs=True](s1, w30) -> w14
              }
              frame True {
                w14 = s1
              }
            }
            w16 = w12
          }
        }
        next s1 = w14
        next s2 = w17
        next s3 = w15
        next s4 = w16
        next s5 = w18
      }
      $"Chars out" <- s3
      $Unpacked <- s1
      case (s5) {
        frame False, Default {
          w8 = $"error in (no error)"
        }
        frame True {
          w31 = "Error: LZW code out-of-range - index is past end of strings-table."
          call "Util.Error.Build.gvi"(Source=w31, error in (no error)=$"error in (no error)") -> (error out=w8)
        }
      }
    }
    frame True {
      w32 = 0  # I16
      Initialize Array(element=w32) -> w33
      s6 = ""  # shift register
      s7 = w5  # shift register
      s8 = uninitialised  # shift register
      s9 = w33  # shift register
      for {
        w34 = each element of $"Chars in"
        Type Cast(type=string "", x=w34) -> w35
        Concatenate Strings(s6, w35) -> w36
        Search 1D Array(1D array=s7, element=w36) -> (index of element=w37)
        Is Less Than 0(x=w37) -> w38
        case (w38) {
          frame False, Default {
            To Word Integer(number=w37) -> w39
            w40 = s9
            w41 = s7
            w42 = w36
          }
          frame True {
            Build Array[ConcatenateInputs=True](s7, w36) -> w43
            Build Array[ConcatenateInputs=True](s9, s8) -> w44
            Array Size(array=w43) -> (size(s)=w45)
            Is Greater(x=w45, y=0x1000) -> w46
            case (w46) {
              frame False {
                w41 = w43
                w40 = w44
              }
              frame True {
                Build Array[ConcatenateInputs=True](w44, w2) -> w40
                Add(w2, 2) -> w47
                Array Subset(array=w43, length0=w47) -> w41
              }
            }
            To Word Integer(number=w34) -> w39
            w42 = w35
          }
        }
        next s6 = w42
        next s7 = w41
        next s8 = w39
        next s9 = w40
      }
      Increment(x=w2) -> w48
      Build Array[ConcatenateInputs=True](w2, s9, s8, w48) -> w49
      $"Codes out" <- w49
      $Packed <- s7
      w8 = $"error in (no error)"
    }
  }
  $"error out" <- w8
