vi "Util.Error.Build.gvi"   [LabVIEW Platform Developer Preview 0.1.0]
inputs:
  "Source": string
  "code": i32 = -1  # The code input identifies the error or warning. The pop-up option Explain Error (or Explain Warning) gives more information about the error displayed.
  "Status": bool = TRUE
  "error in (no error)": error
  "Suppress call-chain info.": bool
outputs:
  "error out": error
diagram:
  Property Node(instance in=$"error in (no error)") -> ("status"=w1, "code"=w2, "source"=w3)
  Is Empty String Or Path(string/path=$Source) -> w4
  case (w4) {
    frame False, Default {
      Logical Or($Status, w1) -> w6
      case ($"Suppress call-chain info.") {
        frame False, Default {
          Call Chain() -> (callchain=w8)
          Array Subset(array=w8, index0=1) -> w9
          Array Of Strings To Path(array of strings=w9) -> (path=w10)
          Format Into String(formatString="\nOccurred in: %s", w10) -> w7
        }
        frame True {
          w7 = ""
        }
      }
      Concatenate Strings($Source, w7) -> w11
      case (w3) {
        frame "" {
          w12 = w11
        }
        frame Default {
          w13 = "\nNOTE! The following message occurred previously:\nError code: %d.\n%s"
          Format Into String(formatString=w13, initString=w11, w2, w3) -> w12
        }
      }
      Property Node(instance in=$"error in (no error)", "source"=w12, "code"=$code, "status"=w6) -> (instance out=w5)
    }
    frame True {
      w5 = $"error in (no error)"
    }
  }
  $"error out" <- w5
