vi "Write GIF File (Animated).gvi"   [LabVIEW Platform Developer Preview 0.1.0]
# Writes a multi-frame (animated) Compuserve GIF file. If no path is specified, a file dialog is used to find the file.
inputs:
  "path to GIF file": path, required  # path to BMP file specifies the path to and name of the bitmap file to read.
  "images data": "imagedata.gtype"[], required
  "error in (no error)": error
  "overwrite? (false)": bool  # Overwrite? If Overwrite is true, GIF will always be written. If Overwrite is false, GIF will only be written if file-path doesn't already exist; and, if file already exists, an error (10) will be produced.
  "delay (ms)": u32[], required
outputs:
  "path": path  # path to BMP file specifies the path to and name of the bitmap file to read.
  "error out": error
types:
  T1 = cluster{"left": i16, "top": i16, "right": i16, "bottom": i16}
  "imagedata.gtype" = cluster{"image type": i32, "image depth": i32, "image": u8[], "mask": u8[], "colors": u32[], "Rectangle": T1}
uses:
  OpenG.Picture::GIF.Write.Pack.gvi
diagram:
  case ($"error in (no error)") {
    frame No Error {
      # Empty
      # Path?
      Is Empty String Or Path(string/path=$"path to GIF file") -> w3
      case (w3) {  # Show File Dialog?
        frame False, Default {
          w4 = $"path to GIF file"
          w5 = default
        }
        frame True {
          File Dialog[FileDialogSelectionMode=File, NewOrExistingMode=New](pattern (all files)="*.gif") -> (cancelled=w5, error out=w6, selected path=w4)
          Property Node(instance in=w6)
        }
      }
      # cancelled?
      Not(x=w5) -> w7
      case (w7) {  # Write GIF File?
        frame False, Default {
          w1 = $"error in (no error)"
          w2 = w4
        }
        frame True {
          call "GIF.Write.Pack.gvi"(Images=$"images data", error in (no error)=$"error in (no error)", Delay (ms)=$"delay (ms)") -> (Array=w8, error out=w9)
          case (w9) {
            frame No Error {
              Byte Array To String(encoding="Extended ASCII", unsigned byte array=w8) -> (string=w10)
              compatOverwrite(overwrite (F) Input 0=$"overwrite? (false)") -> w11  # compatOverwrite (Placeholder)
              Open Or Create Or Replace File(error in=w9, file path (use dialog)=w4, operation (0:open)=w11) -> (error out=w12, refnum out=w13)
              Write To Binary File(data=w10, error in=w12, file (use dialog)=w13, prepend=FALSE) -> (error out=w14, refnum out=w15)
              Close File(error in=w14, refnum=w15) -> (error out=w1)
              w2 = w4
            }
            frame Error {
              w1 = w9
              w2 = w4
            }
          }
        }
      }
    }
    frame Error {
      w1 = $"error in (no error)"
      w2 = $"path to GIF file"
    }
  }
  $path <- w2
  $"error out" <- w1
