vi "Write GIF File.gvi"   [LabVIEW Platform Developer Preview 0.1.0]
# Writes a single-frame (non-animated) Compuserve GIF file. If no path is specified, a file dialog is used to find the file.
inputs:
  "path to GIF file": path, required  # path to BMP file specifies the path to and name of the bitmap file to read.
  "image data": "imagedata.gtype", required  # image data returns information about the pixmap so you can use the Draw Flattened Pixmap VI to draw the pixmap as a picture or use the Graphics Formats VIs to save the pixmap to a file.
  "error in (no error)": error
  "overwrite? (false)": bool  # Overwrite? If Overwrite is true, GIF will always be written. If Overwrite is false, GIF will only be written if file-path doesn't already exist; and, if file already exists, an error (10) will be produced.
outputs:
  "path": path  # path to BMP file specifies the path to and name of the bitmap file to read.
  "error out": error
types:
  T1 = cluster{"left": i16, "top": i16, "right": i16, "bottom": i16}
  "imagedata.gtype" = cluster{"image type": i32, "image depth": i32, "image": u8[], "mask": u8[], "colors": u32[], "Rectangle": T1}
uses:
  OpenG.Picture::Write GIF File (Animated).gvi
diagram:
  case ($"error in (no error)") {
    frame No Error {
      Build Array($"image data") -> w3
      call "Write GIF File (Animated).gvi"(path to GIF file=$"path to GIF file", images data=w3, error in (no error)=$"error in (no error)", overwrite? (false)=$"overwrite? (false)", delay (ms)=[0]) -> (path=w2, error out=w1)
    }
    frame Error {
      w1 = $"error in (no error)"
      w2 = $"path to GIF file"
    }
  }
  $path <- w2
  $"error out" <- w1
