vi "MEM IO Read Bytes.gvi"   [LabVIEW Platform Developer Preview 0.1.0]
# This function reads in a number of bytes starting at the specified physical memory adres.
inputs:
  "address": u32  # Physical adres from which to start reading.
  "type": u8[]
  "size": i32  # Number of bytes to read.
  "error in (no error)": error
outputs:
  "data": u8[]
  "error out": error
uses:
  OpenG.Port IO::ogportio.sli::PortIOReadMem
  OpenG.Port IO::PORT IO Error Translation.gvi
diagram:
  Property Node(instance in=$"error in (no error)") -> ("status"=w1)
  case (w1) {
    frame False, Default {
      Reshape Array(inArray=$type, size=$size) -> w4
      call "PortIOReadMem"(address in=$address, size in=$size, unit in=1, value in=w4) -> (return=w5, value out=w3)
      call "PORT IO Error Translation.gvi"(win error=w5, error in (no error)=$"error in (no error)") -> (error out=w2)
    }
    frame True {
      w2 = $"error in (no error)"
      w3 = $type
    }
  }
  $data <- w3
  $"error out" <- w2
