vi "MEM IO Read Words.gvi"   [LabVIEW Platform Developer Preview 0.1.0]
# This function reads in a number ofwords starting at the specified physical memory adres.
inputs:
  "address": u32  # Physical adres from which to start reading.
  "type": u16[]
  "size": i32  # Number of words to read.
  "error in (no error)": error
outputs:
  "data": u16[]
  "error out": error
uses:
  OpenG.Port IO::ogportio.sli::PortIOReadMem_3
  OpenG.Port IO::PORT IO Error Translation.gvi
diagram:
  Property Node(instance in=$"error in (no error)") -> ("status"=w1)
  case (w1) {
    frame False, Default {
      Multiply($size, 2) -> w4
      Reshape Array(inArray=$type, size=$size) -> w5
      call "PortIOReadMem_3"(address in=$address, size in=w4, unit in=2, value in=w5) -> (return=w6, value out=w3)
      call "PORT IO Error Translation.gvi"(win error=w6, error in (no error)=$"error in (no error)") -> (error out=w2)
    }
    frame True {
      w2 = $"error in (no error)"
      w3 = $type
    }
  }
  $data <- w3
  $"error out" <- w2
