vi "MEM IO Write Longs.gvi"   [LabVIEW Platform Developer Preview 0.1.0]
# This functionwrites out a number oflong words starting at the specified physical memory adres.
inputs:
  "address": u32  # Physical adres from which to start reading.
  "data": u32[]
  "error in (no error)": error
outputs:
  "error out": error
uses:
  OpenG.Port IO::ogportio.sli::PortIOWriteMem_2
  OpenG.Port IO::PORT IO Error Translation.gvi
diagram:
  Property Node(instance in=$"error in (no error)") -> ("status"=w1)
  case (w1) {
    frame False, Default {
      Array Size(array=$data) -> (size(s)=w3)
      Multiply(w3, 4) -> w4
      call "PortIOWriteMem_2"(address in=$address, size in=w4, unit in=4, value in=$data) -> (return=w5)
      call "PORT IO Error Translation.gvi"(win error=w5, error in (no error)=$"error in (no error)") -> (error out=w2)
    }
    frame True {
      w2 = $"error in (no error)"
    }
  }
  $"error out" <- w2
