vi "MEM IO Write Words.gvi"   [LabVIEW Platform Developer Preview 0.1.0]
# This function writes out a number of words starting at the specified physical memory adres.
inputs:
  "address": u32  # Physical adres from which to start reading.
  "data": u16[]
  "error in (no error)": error
outputs:
  "error out": error
uses:
  OpenG.Port IO::ogportio.sli::PortIOWriteMem_3
  OpenG.Port IO::PORT IO Error Translation.gvi
diagram:
  Property Node(instance in=$"error in (no error)") -> ("status"=w1)
  case (w1) {
    frame False, Default {
      Array Size(array=$data) -> (size(s)=w3)
      Multiply(w3, 2) -> w4
      call "PortIOWriteMem_3"(address in=$address, size in=w4, unit in=2, value in=$data) -> (return=w5)
      call "PORT IO Error Translation.gvi"(win error=w5, error in (no error)=$"error in (no error)") -> (error out=w2)
    }
    frame True {
      w2 = $"error in (no error)"
    }
  }
  $"error out" <- w2
