vi "PORT IO Error Translation.gvi"   [LabVIEW Platform Developer Preview 0.1.0]
inputs:
  "win error": u32
  "error in (no error)": error
outputs:
  "error out": error
diagram:
  Is Not Equal To 0(x=$"win error") -> w1
  Property Node(instance in=$"error in (no error)", "status"=w1, "code"=$"win error") -> (instance out=w2)
  $"error out" <- w2
