vi "PORT IO Read Byte.gvi"   [LabVIEW Platform Developer Preview 0.1.0]
# This function reads in a single byte from the specified IO port. If you set fast to True, and are running under Windows NT/2000/XP/2003 you must have enabled the according IO port with a call to "PORT IO Enable Range.vi" to avoid a General Protection Fault error.
inputs:
  "address": u16
  "type": u8
  "fast (F)": bool
  "error in (no error)": error
outputs:
  "value": u8
  "error out": error
uses:
  OpenG.Port IO::ogportio.sli::PortIORead
  OpenG.Port IO::ogportio.sli::PortIOReadDirect
  OpenG.Port IO::PORT IO Error Translation.gvi
diagram:
  Property Node(instance in=$"error in (no error)") -> ("status"=w1)
  case (w1) {
    frame False, Default {
      case ($"fast (F)") {
        frame False, Default {
          call "PortIORead"(address in=$address, size in=1, value in=$type) -> (return=w4, value out=w2)
        }
        frame True {
          call "PortIOReadDirect"(address in=$address, size in=1, value in=$type) -> (return=w4, value out=w2)
        }
      }
      call "PORT IO Error Translation.gvi"(win error=w4, error in (no error)=$"error in (no error)") -> (error out=w3)
    }
    frame True {
      w2 = $type
      w3 = $"error in (no error)"
    }
  }
  $value <- w2
  $"error out" <- w3
