vi "PORT IO Read Long.gvi"   [LabVIEW Platform Developer Preview 0.1.0]
# This function reads in a single long word from the specified IO port. If you set fast to True, and are running under Windows NT/2000/XP/2003 you must have enabled the according IO port with a call to "PORT IO Enable Range.vi" to avoid a General Protection Fault error.
inputs:
  "address": u16
  "type": u32
  "fast (F)": bool
  "error in (no error)": error
outputs:
  "value": u32
  "error out": error
uses:
  OpenG.Port IO::ogportio.sli::PortIORead_2
  OpenG.Port IO::ogportio.sli::PortIOReadDirect_2
  OpenG.Port IO::PORT IO Error Translation.gvi
diagram:
  Property Node(instance in=$"error in (no error)") -> ("status"=w1)
  case (w1) {
    frame False, Default {
      case ($"fast (F)") {
        frame False, Default {
          call "PortIORead_2"(address in=$address, size in=4, value in=$type) -> (return=w4, value out=w3)
        }
        frame True {
          call "PortIOReadDirect_2"(address in=$address, size in=4, value in=$type) -> (return=w4, value out=w3)
        }
      }
      call "PORT IO Error Translation.gvi"(win error=w4, error in (no error)=$"error in (no error)") -> (error out=w2)
    }
    frame True {
      w2 = $"error in (no error)"
      w3 = $type
    }
  }
  $value <- w3
  $"error out" <- w2
