vi "PORT IO VI Tree.gvi"   [LabVIEW Platform Developer Preview 0.1.0]
uses:
  OpenG.Port IO::PORT IO Get Version.gvi
  OpenG.Port IO::PORT IO Disable Range.gvi
  OpenG.Port IO::PORT IO Enable Range.gvi
  OpenG.Port IO::PORT IO Install Driver.gvi
  OpenG.Port IO::PORT IO Uninstall Driver.gvi
  OpenG.Port IO::PORT IO Read Byte.gvi
  OpenG.Port IO::PORT IO Read Word.gvi
  OpenG.Port IO::PORT IO Read Long.gvi
  OpenG.Port IO::PORT IO Write Byte.gvi
  OpenG.Port IO::PORT IO Write Word.gvi
  OpenG.Port IO::PORT IO Write Long.gvi
  OpenG.Port IO::MEM IO Read Bytes.gvi
  OpenG.Port IO::MEM IO Read Words.gvi
  OpenG.Port IO::MEM IO Read Longs.gvi
  OpenG.Port IO::MEM IO Write Bytes.gvi
  OpenG.Port IO::MEM IO Write Words.gvi
  OpenG.Port IO::MEM IO Write Longs.gvi
diagram:
  call "PORT IO Get Version.gvi"()
  call "PORT IO Disable Range.gvi"()
  call "PORT IO Enable Range.gvi"()
  call "PORT IO Install Driver.gvi"()
  call "PORT IO Uninstall Driver.gvi"()
  call "PORT IO Read Byte.gvi"()
  call "PORT IO Read Byte.gvi"()
  call "PORT IO Read Word.gvi"()
  call "PORT IO Read Long.gvi"()
  call "PORT IO Write Byte.gvi"()
  call "PORT IO Write Byte.gvi"()
  call "PORT IO Write Word.gvi"()
  call "PORT IO Write Long.gvi"()
  call "MEM IO Read Bytes.gvi"()
  call "MEM IO Read Bytes.gvi"()
  call "MEM IO Read Words.gvi"()
  call "MEM IO Read Longs.gvi"()
  call "MEM IO Write Bytes.gvi"()
  call "MEM IO Write Bytes.gvi"()
  call "MEM IO Write Words.gvi"()
  call "MEM IO Write Longs.gvi"()
