vi "Format Numeric Array.gvi"   [LabVIEW Platform Developer Preview 0.1.0]
inputs:
  "format string": string, required
  "Array": f64[], required
outputs:
  "Formatted on a line": string
diagram:
  Array To Spreadsheet String(array=$Array, delimiter=" ", format string=$"format string") -> (spreadsheet string=w1)
  Match Pattern(regular expression="[\\r\\n]*$", string=w1) -> (before substring=w2)
  $"Formatted on a line" <- w2
