vi "Read INI Cluster.gvi"   [LabVIEW Platform Developer Preview 0.1.0]
# Reads a cluster of section formatted clusters from configuration data identified by refnum, and returns them as a cluster of clusters of items.  Section cluster names are used as section names and key-value pairs correspond to the named cluster elements and thier values within the section formatted clusters.  Only the section clusters and items within the "INI Formatted Cluster Type" input cluster are read from the configuration data and returned in the output cluster of clusters of items.  The "found?" output will be TRUE only if all elements (recursively) are found.
# For example an Cluster containins subClusters MyCluster1 and MyCluster2, where MyCluster1 contains two elements MyNumeric and MyBoolean, and  MyCluster2 contains two elements MyEnum and MyString.  This would correspond to an INI write of the following data:
# [MyCluster1]
# MyNumeric=1.024
# MyBoolean=TRUE
# [MyCluster2]
# MyEnum=init
# MyString="Hello World"
# Note: Special characters in section and key names will be escape-coded.  These include the following: \00-\1F (non-printable chars); "[", "]", and "=" (INI syntax elements); \FE ("þ") and \FF ("ÿ") (legacy bracket encoding); Additionally, the escape character, "\", will be escaped as "\\".
# Note: This VI checks whether every element of the cluster has a name so it can be identified.
inputs:
  "refnum": "Config Data RefNum.gtype", required
  "INI Fomatted Cluster Type": variant, required
  "error in (no error)": error
outputs:
  "dup refnum": "Config Data RefNum.gtype"
  "INI Fomatted Cluster": variant
  "all found?": bool  # found? is TRUE if the key was found in the specified section.
  "error out": error
  "any found?": bool  # found? is TRUE if the key was found in the specified section.
types:
  "Config Data RefNum.gtype" = i32
uses:
  openg.library.variant data::Get Data Name.gvi
  openg.library.variant data::Get Cluster Element Names.gvi
  openg.library.variant data::Cluster to Array of VData.gvi
  openg.library.variant data::Get TDEnum from Data.gvi
  OpenG.Variant Configuration::Read Key (Variant).gvi
  OpenG.Variant Configuration::Read Section Cluster.gvi
  openg.library.variant data::Array of VData to VCluster.gvi
  openg.library.error::Build Error Cluster.gvi
diagram:
  call "Get Data Name.gvi"(Data=$"INI Fomatted Cluster Type", error in (no error)=$"error in (no error)") -> (Data dup=w1, Data Name=w2, error out=w3)
  call "Get Cluster Element Names.gvi"(Cluster=w1, error in (no error)=w3) -> (Element Names=w4, error out=w5)
  Is Empty String Or Path(string/path=w4) -> w6
  Or Array Elements(Boolean array=w6) -> (logical OR=w7)
  case (w7) {
    frame False, Default {
      call "Cluster to Array of VData.gvi"(Cluster=w1, error in (no error)=w5) -> (Array of VData=w13, error out=w14)
      s1 = $refnum  # shift register
      s2 = w14  # shift register
      for {
        w15 = each element of w13
        call "Get TDEnum from Data.gvi"(Data=w15) -> (Type Descriptor Enumeration=w19)
        case (w19) {
          frame Default {
            call "Read Key (Variant).gvi"(refnum=s1, type=w15, error in (no error)=s2, section=w2) -> (refnum out=w21, found?=w23, key-value=w22, error out=w20)
            w24 = w23
          }
          frame "Cluster" {
            call "Read Section Cluster.gvi"(refnum=s1, Section Formatted Cluster Type=w15, error in (no error)=s2) -> (dup refnum=w21, Section Formatted Cluster=w22, all found?=w23, error out=w20, any found?=w24)
          }
        }
        append w22 to w16
        append w23 to w17
        append w24 to w18
        next s1 = w21
        next s2 = w20
      }
      call "Array of VData to VCluster.gvi"(Array=w16, error in (no error)=s2) -> (VCluster=w9, error out=w10)
      And Array Elements(Boolean array=w17) -> (logical AND=w11)
      Or Array Elements(Boolean array=w18) -> (logical OR=w12)
      w8 = s1
    }
    frame True {
      call "Build Error Cluster.gvi"(code="Argument error"(1), String to Prepend to source ("")="Empty Cluster name or empty cluster element names.") -> (error out=w10)
      w8 = $refnum
      w9 = w1
      w11 = FALSE
      w12 = FALSE
    }
  }
  $"dup refnum" <- w8
  $"INI Fomatted Cluster" <- w9
  $"error out" <- w10
  $"all found?" <- w11
  $"any found?" <- w12
