vi "Read Key (Variant).gvi"   [LabVIEW Platform Developer Preview 0.1.0]
# Reads a value associated with key in a specified section of the configuration data identified by refnum.  If "key" input is not specified, the name of the variant object is used as the key.  the "found?" output will be TRUE for compount objects (clusters) only if all elements (recursively) are found.
# For example a Boolean named "Enable" with a value of TRUE would correspond to the key-value pair:
# Enable=TRUE
# Note: Special characters in section and key names will be escape-coded.  These include the following: \00-\1F (non-printable chars); "[", "]", and "=" (INI syntax elements); \FE ("þ") and \FF ("ÿ") (legacy bracket encoding); Additionally, the escape character, "\", will be escaped as "\\".
inputs:
  "refnum": "Config Data RefNum.gtype", required  # refnum is the reference number of the configuration data
  "key (optional)": string  # key is the name of the key to write.
  "type": variant, required
  "error in (no error)": error
  "section": string, required  # section is the name of the section in which to write the specified key.
  "format string (%;%f)": string = "%f"  # This formatter is used for numeric arrays only.
outputs:
  "refnum out": "Config Data RefNum.gtype"  # refnum out is the reference number of the configuration data.
  "found?": bool  # found? is TRUE if the key was found in the specified section.
  "key-value": variant
  "error out": error
panel controls:
  "Ref for recursive call": StrictVIRefnum<"function ">
types:
  "Config Data RefNum.gtype" = i32
uses:
  openg.library.variant data::Get Data Name.gvi
  openg.library.variant data::Get TDEnum from Data.gvi
  OpenG.Variant Configuration::Encode Section and Key Names.gvi
  NI::G Core::Configuration File (INI)::Read Key (I32).gvi
  NI::G Core::Configuration File (INI)::Read Key (U32).gvi
  NI::G Core::Configuration File (INI)::Read Key (Double).gvi
  NI::G Core::Configuration File (INI)::Read Key (String).gvi
  openg.library.variant data::Get Strings from Enum.gvi
  openg.library.variant data::Set Enum String Value.gvi
  openg.library.variant data::Strip Units.gvi
  NI::G Core::Configuration File (INI)::Read Key (Boolean).gvi
  NI::G Core::Configuration File (INI)::Read Key (Path).gvi
  openg.library.variant data::Reshape Array to 1D VArray.gvi
  openg.library.variant data::Get Array Element TDEnum.gvi
  openg.library.variant data::Get Array Element TD.gvi
  openg.library.variant data::Get Default Data from TD.gvi
  openg.library.variant data::Array of VData to VArray.gvi
  openg.library.variant data::Reshape 1D Array.gvi
  openg.library.variant data::Cluster to Array of VData.gvi
  openg.library.variant data::Set Data Name.gvi
  openg.library.variant data::Array of VData to VCluster.gvi
diagram:
  case ($"error in (no error)") {
    frame No Error {
      case ($"key (optional)") {
        frame "" {
          # use dataname
          call "Get Data Name.gvi"(Data=$type, error in (no error)=$"error in (no error)") -> (Data dup=w6, Data Name=w4, error out=w5)
        }
        frame Default {
          # use optional
          # key
          w4 = $"key (optional)"
          w5 = $"error in (no error)"
          w6 = $type
        }
      }
      Format Into String(formatString=" [%s]:%s ", $section, w4) -> w7
      call "Get TDEnum from Data.gvi"(Data=w6) -> (Type Descriptor Enumeration=w8)
      w9 = $"Ref for recursive call"
      while (iteration -> i1) {
        # legacy?
        # Second Try?
        # Key was not found, so try using  legacy encoding?
        # legacy?
        Is Equal(x=1, y=i1) -> w10
        call "Encode Section and Key Names.gvi"(string=w4, use legacy encoding scheme? (FALSE)=w10) -> (encoded string=w11)
        # Encode
        call "Encode Section and Key Names.gvi"(string=$section, use legacy encoding scheme? (FALSE)=w10) -> (encoded string=w12)
        # found?
        case (w8) {
          frame "I8".."I32" {
            Variant To Data(error in (no error)=w5, type=i32 0, variant=w6) -> (data=w14, error out=w15)
            call "Read Key (I32).gvi"(reference in=$refnum, key=w11, default value=w14, error in=w15, section=w12) -> (found=w3, value=w16, error out=w17)
            # I32 Type
            case (w8) {
              frame "I8" {
                To Byte Integer(number=w16) -> w18
                To Variant(anything=w18) -> w2
                w13 = w17
              }
              frame "I16" {
                To Word Integer(number=w16) -> w19
                To Variant(anything=w19) -> w2
                w13 = w17
              }
              frame "I32", Default {
                To Long Integer(number=w16) -> w20
                To Variant(anything=w20) -> w2
                w13 = w17
              }
            }
          }
          frame "U8".."U32" {
            Variant To Data(error in (no error)=w5, type=u32 0, variant=w6) -> (data=w21, error out=w22)
            call "Read Key (U32).gvi"(reference in=$refnum, key=w11, default value=w21, error in=w22, section=w12) -> (found=w3, value=w23, error out=w24)
            # U32 Type
            case (w8) {
              frame "U8" {
                To Unsigned Byte Integer(number=w23) -> w25
                To Variant(anything=w25) -> w2
                w13 = w24
              }
              frame "U16" {
                To Unsigned Word Integer(number=w23) -> w26
                To Variant(anything=w26) -> w2
                w13 = w24
              }
              frame "U32", Default {
                To Unsigned Long Integer(number=w23) -> w27
                To Variant(anything=w27) -> w2
                w13 = w24
              }
            }
          }
          frame "SGL".."EXT" {
            Variant To Data(error in (no error)=w5, type=f64 0, variant=w6) -> (data=w28, error out=w29)
            # DBL Type
            call "Read Key (Double).gvi"(reference in=$refnum, key=w11, default value=w28, error in=w29, section=w12) -> (found=w3, value=w30, error out=w13)
            case (w8) {
              frame "DBL", Default {
                To Double Precision Float(number=w30) -> w31
                To Variant(anything=w31) -> w2
              }
              frame "SGL" {
                To Single Precision Float(number=w30) -> w32
                To Variant(anything=w32) -> w2
              }
              frame "EXT" {
                To Double Precision Float(number=w30) -> w33
                To Variant(anything=w33) -> w2
              }
            }
          }
          frame "CSG".."CXT" {
            Variant To Data(error in (no error)=w5, type=c128 0+0i, variant=w6) -> (data=w34, error out=w35)
            call "Read Key (String).gvi"(reference in=$refnum, key=w11, error in=w35, section=w12) -> (found=w3, value=w36, error out=w37)
            Scan From String(inputString=w36, errIn=w37, default=w34) -> (errOut=w13, out0=w38)
            # CXT Type
            case (w8) {
              frame "CDB", Default {
                To Double Precision Complex(number=w38) -> w39
                To Variant(anything=w39) -> w2
              }
              frame "CSG" {
                To Single Precision Complex(number=w38) -> w40
                To Variant(anything=w40) -> w2
              }
              frame "CXT" {
                To Double Precision Complex(number=w38) -> w41
                To Variant(anything=w41) -> w2
              }
            }
          }
          frame "Enum U8".."Enum U32" {
            call "Get Strings from Enum.gvi"(Enum=w6, error in (no error)=w5) -> (String Value=w42, error out=w43)
            call "Read Key (String).gvi"(reference in=$refnum, key=w11, default value=w42, error in=w43, section=w12) -> (found=w3, value=w44, error out=w45)
            call "Set Enum String Value.gvi"(Default Enum Value=w6, String Value=w44, error in (no error)=w45) -> (Enum=w2, error out=w13)
          }
          frame "SGL PQ".."EXT PQ" {
            call "Strip Units.gvi"(Number or 1D array with units=w6, error in (no error)=w5) -> (Pure Number(s) (base units)=w46, error out=w47)
            Variant To Data(error in (no error)=w47, type=f64 0, variant=w46) -> (data=w48, error out=w49)
            call "Read Key (Double).gvi"(reference in=$refnum, key=w11, default value=w48, error in=w49, section=w12) -> (found=w3, value=w50, error out=w51)
            case (w8) {
              frame "DBL PQ", Default {
                To Double Precision Float(number=w50) -> w53
                Flatten To Byte Array(anything=w53) -> (data bytes=w52)
              }
              frame "SGL PQ" {
                To Single Precision Float(number=w50) -> w54
                Flatten To Byte Array(anything=w54) -> (data bytes=w52)
              }
              frame "EXT PQ" {
                To Double Precision Float(number=w50) -> w55
                Flatten To Byte Array(anything=w55) -> (data bytes=w52)
              }
            }
            Variant To Flattened Byte Array(variant=w6) -> (type string=w56)
            # DBL Type
            Flattened Byte Array To Variant(data string=w52, error in=w51, type string=w56) -> (error out=w13, variant out=w2)
          }
          frame "CSG PQ".."CXT PQ" {
            call "Strip Units.gvi"(Number or 1D array with units=w6, error in (no error)=w5) -> (Pure Number(s) (base units)=w57, error out=w58)
            Variant To Data(error in (no error)=w58, type=c128 0+0i, variant=w57) -> (data=w59, error out=w60)
            call "Read Key (String).gvi"(reference in=$refnum, key=w11, error in=w60, section=w12) -> (found=w3, value=w61, error out=w62)
            Scan From String(inputString=w61, errIn=w62, default=w59) -> (errOut=w63, out0=w64)
            # CXT Type
            case (w8) {
              frame "CDB PQ", Default {
                Flatten To Byte Array(anything=w64) -> (data bytes=w65)
              }
              frame "CSG PQ" {
                To Single Precision Complex(number=w64) -> w66
                Flatten To Byte Array(anything=w66) -> (data bytes=w65)
              }
              frame "CXT PQ" {
                To Double Precision Complex(number=w64) -> w67
                Flatten To Byte Array(anything=w67) -> (data bytes=w65)
              }
            }
            Variant To Flattened Byte Array(variant=w6) -> (type string=w68)
            Flattened Byte Array To Variant(data string=w65, error in=w63, type string=w68) -> (error out=w13, variant out=w2)
          }
          frame "Boolean" {
            Variant To Data(error in (no error)=w5, type=bool FALSE, variant=w6) -> (data=w69, error out=w70)
            call "Read Key (Boolean).gvi"(reference in=$refnum, key=w11, default value=w69, error in=w70, section=w12) -> (found=w3, value=w71, error out=w13)
            # Boolean Type
            To Variant(anything=w71) -> w2
          }
          frame "String", "DAQ" {
            Variant To Data(error in (no error)=w5, type=string "", variant=w6) -> (data=w72, error out=w73)
            # String Type
            call "Read Key (String).gvi"(reference in=$refnum, key=w11, default value=w72, error in=w73, section=w12) -> (found=w3, value=w74, error out=w13)
            To Variant(anything=w74) -> w2
          }
          frame "Path" {
            Variant To Data(error in (no error)=w5, type=path path "", variant=w6) -> (data=w75, error out=w76)
            call "Read Key (Path).gvi"(reference in=$refnum, key=w11, default value=w75, error in=w76, section=w12) -> (found=w3, value=w77, error out=w13)
            # Path Type
            To Variant(anything=w77) -> w2
          }
          frame "Array" {
            call "Reshape Array to 1D VArray.gvi"(MultiD Array=w6, error in (no error)=w5) -> (1D VArray=w78, error out=w79)
            call "Get Array Element TDEnum.gvi"(Array=w78, error in (no error)=w79) -> (Element Type=w80, error out=w81)
            case (w80) {
              frame Default {
                Concatenate Strings(w11, ".<size(s)>") -> w82
                call "Read Key (String).gvi"(reference in=$refnum, key=w82, section=w12, read raw string=TRUE) -> (found=w83, value=w84, error out=w85)
                case (w83) {
                  frame False, Default {
                    # array size(s) not found. Ignore element keys (if any) and return input array
                    w2 = w6
                    w13 = no error
                    w3 = FALSE
                  }
                  frame True {
                    Spreadsheet String To Array(array type=u32[] [], delimiter=" ", format string="%d", spreadsheet string=w84) -> (array=w86)
                    call "Get Array Element TD.gvi"(Array=w6, error in (no error)=w85) -> (Type Descriptor=w87, error out=w88)
                    call "Get Default Data from TD.gvi"(Type Descriptor=w87, error in (no error)=w88) -> (Default VData=w89, error out=w90)
                    Open VI Reference(error in (no error)=w90, type specifier VI Refnum (for type only)=w9) -> (error out=w91, vi reference=w92)
                    Multiply Array Elements(numeric array=w86) -> (product=w93)
                    # array.size(s) is found. Read elements keys. missing keys replace with datatype default.
                    s1 = w91  # shift register
                    s2 = w92  # shift register
                    for (N = w93) (iteration -> i2) {
                      Format Into String(formatString=" %d", initString=w11, i2) -> w96
                      CallByReference(Ref for recursive call Input 0=s2, Error IO Input 1=s1, format string (%;%f Input 2=$"format string (%;%f)", section Input 3=w12, type Input 5=w89, key (optional) Input 6=w96, refnum Input 7=$refnum) -> (Ref for recursive call Output 0=w97, Error IO Output 1=w98, error out Output 2=w99, key-value Output 3=w100, found? Output 4=w101)  # CallByReference (Placeholder)
                      Merge Errors(w98, w99) -> (error out=w102)
                      append w100 to w94
                      append w101 to w95
                      next s1 = w102
                      next s2 = w97
                    }
                    call "Array of VData to VArray.gvi"(1D Array of VData=w94, Element Type (when empty)=w89, error in (no error)=s1) -> (VArray=w103, error out=w104)
                    call "Reshape 1D Array.gvi"(1D Array=w103, Size(s)=w86, error in (no error)=w104) -> (Reshaped VArray=w2, error out=w13)
                    Close Reference(reference=s2)
                    Property Node[IsPlaceholderNodeForConversion=True]()
                    And Array Elements(Boolean array=w95) -> (logical AND=w3)
                  }
                }
              }
              frame "I8".."I32", "U8".."U32", "SGL".."EXT", "SGL PQ".."EXT PQ" {
                call "Read Key (String).gvi"(reference in=$refnum, key=w11, error in=w81, section=w12) -> (found=w3, value=w105, error out=w106)
                Scan From String(formatString="<size(s)=%[\\s0-9]> ", inputString=w105, errIn=w106) -> (outString=w107, errOut=w108, out0=w109)
                Variant To Flattened Byte Array(variant=w6) -> (data string=w110, type string=w111)
                Spreadsheet String To Array(array type=f64[] [], delimiter=" ", format string=$"format string (%;%f)", spreadsheet string=w107) -> (array=w112)
                Spreadsheet String To Array(array type=u32[] [], delimiter=" ", format string="%d", spreadsheet string=w109) -> (array=w113)
                Type Cast(type=string "", x=w113) -> w114
                case (w80) {
                  frame Default {
                    w115 = w110
                    w116 = ""
                  }
                  frame "I8" {
                    To Byte Integer(number=w112) -> w117
                    Type Cast(type=string "", x=w117) -> w115
                    w116 = w114
                  }
                  frame "I16" {
                    To Word Integer(number=w112) -> w118
                    Type Cast(type=string "", x=w118) -> w115
                    w116 = w114
                  }
                  frame "I32" {
                    To Long Integer(number=w112) -> w119
                    Type Cast(type=string "", x=w119) -> w115
                    w116 = w114
                  }
                  frame "U8" {
                    To Unsigned Byte Integer(number=w112) -> w120
                    Type Cast(type=string "", x=w120) -> w115
                    w116 = w114
                  }
                  frame "U16" {
                    To Unsigned Word Integer(number=w112) -> w121
                    Type Cast(type=string "", x=w121) -> w115
                    w116 = w114
                  }
                  frame "U32" {
                    To Unsigned Long Integer(number=w112) -> w122
                    Type Cast(type=string "", x=w122) -> w115
                    w116 = w114
                  }
                  frame "SGL", "SGL PQ" {
                    To Single Precision Float(number=w112) -> w123
                    Type Cast(type=string "", x=w123) -> w115
                    w116 = w114
                  }
                  frame "DBL", "DBL PQ" {
                    To Double Precision Float(number=w112) -> w124
                    Type Cast(type=string "", x=w124) -> w115
                    w116 = w114
                  }
                  frame "EXT", "EXT PQ" {
                    To Double Precision Float(number=w112) -> w125
                    Type Cast(type=string "", x=w125) -> w115
                    w116 = w114
                  }
                }
                Concatenate Strings(w116, w115) -> w126
                Flattened Byte Array To Variant(data string=w126, error in=w108, type string=w111) -> (error out=w127, variant out=w128)
                Select(s=w127, t=w6, f=w128) -> w2
                w13 = no error
              }
            }
          }
          frame "Cluster" {
            # >> Cluster Name >>
            call "Get Data Name.gvi"(Data=w6, error in (no error)=w5) -> (Data dup=w129, Data Name=w130, error out=w131)
            call "Cluster to Array of VData.gvi"(Cluster=w129, error in (no error)=w131) -> (Array of VData=w132, error out=w133)
            Open VI Reference(error in (no error)=w133, type specifier VI Refnum (for type only)=w9) -> (error out=w134, vi reference=w135)
            # Expand cluster to its elements
            # and read keys recursively.
            s3 = w135  # shift register
            s4 = w134  # shift register
            for {
              w136 = each element of w132
              call "Get Data Name.gvi"(Data=w136, error in (no error)=s4) -> (Data dup=w139, Data Name=w140, error out=w141)
              Format Into String(formatString=".%s", initString=w11, w140) -> w142
              CallByReference(Ref for recursive call Input 0=s3, Error IO Input 1=w141, format string (%;%f Input 2=$"format string (%;%f)", section Input 3=w12, type Input 5=w139, key (optional) Input 6=w142, refnum Input 7=$refnum) -> (Ref for recursive call Output 0=w143, Error IO Output 1=w144, error out Output 2=w145, key-value Output 3=w146, found? Output 4=w147)  # CallByReference (Placeholder)
              Merge Errors(w144, w145) -> (error out=w148)
              call "Set Data Name.gvi"(Data=w146, Data Name=w140, error in (no error)=w148) -> (Renamed Data=w149, error out=w150)
              append w149 to w137
              append w147 to w138
              next s3 = w143
              next s4 = w150
            }
            Close Reference(reference=s3)
            Property Node[IsPlaceholderNodeForConversion=True]()
            call "Array of VData to VCluster.gvi"(Array=w137, error in (no error)=s4) -> (VCluster=w151, error out=w152)
            call "Set Data Name.gvi"(Data=w151, Data Name=w130, error in (no error)=w152) -> (Renamed Data=w2, error out=w13)
            And Array Elements(Boolean array=w138) -> (logical AND=w3)
          }
          frame Default {
            Variant To Flattened Byte Array(variant=w6) -> (data string=w153, type string=w154)
            Type Cast(type=string "", x=w153) -> w155
            call "Read Key (String).gvi"(reference in=$refnum, key=w11, default value=w155, error in=w5, section=w12) -> (found=w3, value=w156, error out=w157)
            Type Cast(type=u8[] [], x=w156) -> w158
            Flattened Byte Array To Variant(data string=w158, error in=w157, type string=w154) -> (error out=w13, variant out=w2)
          }
        }
        # found?
        # second try?
        Property Node(instance in=w13) -> ("status"=w159)
        Logical Or(w3, w159, w10) -> w160
        stop if w160
      }
      case (w13) {
        frame No Error {
          w1 = w13
        }
        frame Error {
          # Add section and key names to
          # error source.
          Property Node(instance in=w13) -> ("source"=w161)
          Concatenate Strings(w7, w161) -> w162
          Property Node(instance in=w13, "source"=w162) -> (instance out=w1)
        }
      }
    }
    frame Error {
      w1 = $"error in (no error)"
      w2 = variant()
      w3 = FALSE
    }
  }
  $"error out" <- w1
  $"refnum out" <- $refnum
  $"found?" <- w3
  $"key-value" <- w2
