vi "Read Section Cluster.gvi"   [LabVIEW Platform Developer Preview 0.1.0]
# Reads key-value pairs from a section of the configuration data identified by refnum, and returns them as a cluster of items.  If "key" input is not specified, the name of the cluster within the "Section Formatted Cluster type" input is used as the key.  Only the items within the "Section Formatted Cluster Type" input cluster are read from the configuration data and returned in the output cluster.  The "found?" output will be TRUE only if all elements (recursively) are found.
# For example an section cluster named "MyCluster1" contains two elements named "MyNumeric" and "MyBoolean".  This would correspond to an INI read of the following data:
# [MyCluster1]
# MyNumeric=1.024
# MyBoolean=TRUE
# Note: Special characters in section and key names will be escape-coded.  These include the following: \00-\1F (non-printable chars); "[", "]", and "=" (INI syntax elements); \FE ("þ") and \FF ("ÿ") (legacy bracket encoding); Additionally, the escape character, "\", will be escaped as "\\".
inputs:
  "refnum": "Config Data RefNum.gtype", required
  "Section Formatted Cluster Type": variant, required
  "error in (no error)": error
  "section (optional)": string  # section is the name of the section in which to write the specified key.
outputs:
  "dup refnum": "Config Data RefNum.gtype"
  "Section Formatted Cluster": variant
  "all found?": bool  # found? is TRUE if the key was found in the specified section.
  "error out": error
  "any found?": bool  # found? is TRUE if the key was found in the specified section.
types:
  "Config Data RefNum.gtype" = i32
uses:
  openg.library.variant data::Cluster to Array of VData.gvi
  openg.library.variant data::Get Data Name.gvi
  OpenG.Variant Configuration::Read Key (Variant).gvi
  openg.library.variant data::Array of VData to VCluster.gvi
diagram:
  call "Cluster to Array of VData.gvi"(Cluster=$"Section Formatted Cluster Type", error in (no error)=$"error in (no error)") -> (Array of VData=w1, error out=w2)
  call "Get Data Name.gvi"(Data=$"Section Formatted Cluster Type", error in (no error)=w2) -> (Data Name=w3, error out=w4)
  Is Empty String Or Path(string/path=$"section (optional)") -> w5
  Not(x=w5) -> w6
  Select(s=w6, t=$"section (optional)", f=w3) -> w7
  s1 = $refnum  # shift register
  s2 = w4  # shift register
  for {
    w8 = each element of w1
    call "Read Key (Variant).gvi"(refnum=s1, type=w8, error in (no error)=s2, section=w7) -> (refnum out=w11, found?=w12, key-value=w13, error out=w14)
    append w13 to w9
    append w12 to w10
    next s1 = w11
    next s2 = w14
  }
  call "Array of VData to VCluster.gvi"(Array=w9) -> (VCluster=w15)
  $"Section Formatted Cluster" <- w15
  Or Array Elements(Boolean array=w10) -> (logical OR=w16)
  $"any found?" <- w16
  $"error out" <- s2
  $"dup refnum" <- s1
  And Array Elements(Boolean array=w10) -> (logical AND=w17)
  $"all found?" <- w17
