vi "VI Tree - variantconfig.gvi"   [LabVIEW Platform Developer Preview 0.1.0]
panel controls:
  "refnum": "Config Data RefNum.gtype"  # refnum is the reference number of the configuration data
  "VI ref": VIRefnum
types:
  "Config Data RefNum.gtype" = i32
uses:
  OpenG.Variant Configuration::Read Key (Variant).gvi
  OpenG.Variant Configuration::Format Numeric Array.gvi
  OpenG.Variant Configuration::Write Key (Variant).gvi
  OpenG.Variant Configuration::Encode Section and Key Names.gvi
  OpenG.Variant Configuration::Read Section Cluster.gvi
  OpenG.Variant Configuration::Write Section Cluster.gvi
  OpenG.Variant Configuration::Read INI Cluster.gvi
  OpenG.Variant Configuration::Write INI Cluster.gvi
  OpenG.Variant Configuration::Read Panel from INI.gvi
  OpenG.Variant Configuration::Write Panel to INI.gvi
diagram:
  sequence {
    frame 0 {
      # API (Palette VIs)
      call "Read Key (Variant).gvi"(refnum=$refnum, type=variant(), section="")
      # Utility
      call "Format Numeric Array.gvi"(format string="", Array=f64[] [])
      call "Write Key (Variant).gvi"(refnum=$refnum, key-value=variant(), section="")
      call "Encode Section and Key Names.gvi"(string="")
      call "Read Section Cluster.gvi"(refnum=$refnum, Section Formatted Cluster Type=variant())
      call "Write Section Cluster.gvi"(refnum=$refnum, Section Formatted Cluster=variant())
      call "Read INI Cluster.gvi"(refnum=$refnum, INI Fomatted Cluster Type=variant())
      call "Write INI Cluster.gvi"(refnum=$refnum, INI Fomatted Cluster=variant())
      call "Read Panel from INI.gvi"(refnum=$refnum, VI ref=$"VI ref")
      call "Write Panel to INI.gvi"(refnum=$refnum, VI ref=$"VI ref")
    }
  }
