vi "Write INI Cluster.gvi"   [LabVIEW Platform Developer Preview 0.1.0]
# Writes a cluster of section formatted clusters to configuration data identified by refnum.  Section cluster names are used as section names and key-value pairs correspond to the named cluster elements and thier values within the section formatted clusters.  Only the items within the "INI  Formatted Cluster" input cluster are written to the configuration data.
# For example an Cluster containins subClusters MyCluster1 and MyCluster2, where MyCluster1 contains two elements MyNumeric and MyBoolean, and  MyCluster2 contains two elements MyEnum and MyString.  This would correspond to an INI write of the following data:
# [MyCluster1]
# MyNumeric=1.024
# MyBoolean=TRUE
# [MyCluster2]
# MyEnum=init
# MyString="Hello World"
# Note: Special characters in section and key names will be escape-coded.  These include the following: \00-\1F (non-printable chars); "[", "]", and "=" (INI syntax elements); \FE ("þ") and \FF ("ÿ") (legacy bracket encoding); Additionally, the escape character, "\", will be escaped as "\\".
# Note: This VI checks whether every element of the cluster has a name so it can be identified.
inputs:
  "refnum": "Config Data RefNum.gtype", required
  "INI Fomatted Cluster": variant, required
  "error in (no error)": error
  "float number format (optional)": string  # section is the name of the section in which to write the specified key.
outputs:
  "dup refnum": "Config Data RefNum.gtype"
  "error out": error
types:
  "Config Data RefNum.gtype" = i32
uses:
  openg.library.variant data::Get Data Name.gvi
  openg.library.variant data::Get Cluster Element Names.gvi
  openg.library.variant data::Cluster to Array of VData.gvi
  openg.library.variant data::Get TDEnum from Data.gvi
  OpenG.Variant Configuration::Write Key (Variant).gvi
  OpenG.Variant Configuration::Write Section Cluster.gvi
  openg.library.error::Build Error Cluster.gvi
diagram:
  case ($"error in (no error)") {
    frame No Error {
      call "Get Data Name.gvi"(Data=$"INI Fomatted Cluster", error in (no error)=$"error in (no error)") -> (Data dup=w3, Data Name=w4, error out=w5)
      call "Get Cluster Element Names.gvi"(Cluster=w3, error in (no error)=w5) -> (Element Names=w6, error out=w7)
      Is Empty String Or Path(string/path=w6) -> w8
      Or Array Elements(Boolean array=w8) -> (logical OR=w9)
      case (w9) {
        frame False, Default {
          call "Cluster to Array of VData.gvi"(Cluster=w3, error in (no error)=w7) -> (Array of VData=w10, error out=w11)
          s1 = $refnum  # shift register
          s2 = w11  # shift register
          for {
            w12 = each element of w10
            call "Get TDEnum from Data.gvi"(Data=w12) -> (Type Descriptor Enumeration=w13)
            case (w13) {
              frame Default {
                call "Write Key (Variant).gvi"(refnum=s1, key-value=w12, error in (no error)=s2, section=w4, float number format=$"float number format (optional)") -> (refnum out=w15, error out=w14)
              }
              frame "Cluster" {
                call "Write Section Cluster.gvi"(refnum=s1, Section Formatted Cluster=w12, error in (no error)=s2, float number format (optional)=$"float number format (optional)") -> (dup refnum=w15, error out=w14)
              }
            }
            next s1 = w15
            next s2 = w14
          }
          w1 = s2
          w2 = s1
        }
        frame True {
          call "Build Error Cluster.gvi"(code="Argument error"(1), String to Prepend to source ("")="Empty Cluster element names.") -> (error out=w1)
          w2 = $refnum
        }
      }
    }
    frame Error {
      w1 = $"error in (no error)"
      w2 = $refnum
    }
  }
  $"dup refnum" <- w2
  $"error out" <- w1
