vi "Write Key (Variant).gvi"   [LabVIEW Platform Developer Preview 0.1.0]
# Writes a value associated with key in a specified section of the configuration data identified by refnum.  If "key" input is not specified, the name of the variant object is used as the key.
# For example a Boolean named "Enable" with a value of TRUE would correspond to the key-value pair:
# Enable=TRUE
# Note: Special characters in section and key names will be escape-coded.  These include the following: \00-\1F (non-printable chars); "[", "]", and "=" (INI syntax elements); \FE ("þ") and \FF ("ÿ") (legacy bracket encoding); Additionally, the escape character, "\", will be escaped as "\\".
inputs:
  "refnum": "Config Data RefNum.gtype", required  # refnum is the reference number of the configuration data
  "key (optional)": string  # key is the name of the key to write.
  "key-value": variant, required
  "error in (no error)": error
  "section": string, required  # section is the name of the section in which to write the specified key.
  "float number format": string  # section is the name of the section in which to write the specified key.
  "write raw string? (F)": bool  # write raw string? specifies whether to write the string without escaping unprintable and backslash ("\") characters.
outputs:
  "refnum out": "Config Data RefNum.gtype"  # refnum out is the reference number of the configuration data.
  "error out": error
panel controls:
  "Ref for recursive call": StrictVIRefnum<"function ">
types:
  "Config Data RefNum.gtype" = i32
uses:
  openg.library.variant data::Get Data Name.gvi
  OpenG.Variant Configuration::Encode Section and Key Names.gvi
  openg.library.variant data::Get TDEnum from Data.gvi
  openg.library.string::Format Variant Into String.gvi
  NI::G Core::Configuration File (INI)::Write Key (String).gvi
  NI::G Core::Configuration File (INI)::Write Key (Path).gvi
  openg.library.variant data::Cluster to Array of VData.gvi
  openg.library.variant data::Reshape Array to 1D VArray.gvi
  openg.library.variant data::Get Array Element TDEnum.gvi
  OpenG.Variant Configuration::Format Numeric Array.gvi
  openg.library.variant data::Array to Array of VData.gvi
  openg.library.variant data::Strip Units.gvi
  NI::G Core::Configuration File (INI)::Write Key (U32).gvi
diagram:
  $"refnum out" <- $refnum
  case ($"error in (no error)") {
    frame No Error {
      case ($"key (optional)") {
        frame "" {
          # use dataname
          call "Get Data Name.gvi"(Data=$"key-value", error in (no error)=$"error in (no error)") -> (Data dup=w4, Data Name=w2, error out=w3)
        }
        frame Default {
          # use optional
          # key
          w2 = $"key (optional)"
          w3 = $"error in (no error)"
          w4 = $"key-value"
        }
      }
      w5 = FALSE  # use legacy encoding scheme = FALSE
      call "Encode Section and Key Names.gvi"(string=$section, use legacy encoding scheme? (FALSE)=w5) -> (encoded string=w6)
      # Encode
      call "Get TDEnum from Data.gvi"(Data=w4) -> (Type Descriptor Enumeration=w7)
      call "Encode Section and Key Names.gvi"(string=w2, use legacy encoding scheme? (FALSE)=w5) -> (encoded string=w8)
      case (w7) {
        frame "SGL".."CXT", "SGL PQ".."CXT PQ" {
          call "Format Variant Into String.gvi"(error in (no error)=w3, Variant=w4, Format String=$"float number format") -> (Output String=w9, error out=w10)
          call "Write Key (String).gvi"(reference in=$refnum, key=w8, value=w9, error in=w10, section=w6) -> (error out=w1)
        }
        frame "I8".."I32", "U8".."U32", "Enum U8".."Enum U32", "Boolean" {
          call "Format Variant Into String.gvi"(error in (no error)=w3, Variant=w4) -> (Output String=w11, error out=w12)
          call "Write Key (String).gvi"(reference in=$refnum, key=w8, value=w11, error in=w12, section=w6) -> (error out=w1)
        }
        frame "String", "DAQ" {
          w13 = string ""  # String Type
          Variant To Data(error in (no error)=w3, type=w13, variant=w4) -> (data=w14, error out=w15)
          call "Write Key (String).gvi"(reference in=$refnum, key=w8, value=w14, error in=w15, section=w6, write raw string=$"write raw string? (F)") -> (error out=w1)
        }
        frame "Path" {
          w16 = path path ""  # Path Type
          Variant To Data(error in (no error)=w3, type=w16, variant=w4) -> (data=w17, error out=w18)
          call "Write Key (Path).gvi"(reference in=$refnum, key=w8, value=w17, error in=w18, section=w6) -> (error out=w1)
        }
        frame "Cluster" {
          # Expand cluster to its elements
          # and create keys recursively.
          call "Cluster to Array of VData.gvi"(Cluster=w4, error in (no error)=w3) -> (Array of VData=w19, error out=w20)
          Open VI Reference(error in (no error)=w20, type specifier VI Refnum (for type only)=$"Ref for recursive call") -> (error out=w21, vi reference=w22)
          s1 = w22  # shift register
          s2 = w21  # shift register
          for {
            w23 = each element of w19
            call "Get Data Name.gvi"(Data=w23, error in (no error)=s2) -> (Data dup=w24, Data Name=w25, error out=w26)
            Format Into String(formatString=".%s", initString=w8, w25) -> w27
            CallByReference(Ref for recursive call Input 0=s1, Error IO Input 1=w26, format string Input 2=$"float number format", section Input 4=w6, key-value Input 6=w24, key (optional) Input 7=w27, refnum Input 8=$refnum) -> (Ref for recursive call Output 0=w28, Error IO Output 1=w29, error out Output 2=w30)  # CallByReference (Placeholder)
            Merge Errors(w29, w30) -> (error out=w31)
            next s1 = w28
            next s2 = w31
          }
          Close Reference(reference=s1)
          Property Node[IsPlaceholderNodeForConversion=True]()
          w1 = s2
        }
        frame "Array" {
          call "Reshape Array to 1D VArray.gvi"(MultiD Array=w4, error in (no error)=w3) -> (1D VArray=w32, Size(s)=w33, error out=w34)
          call "Get Array Element TDEnum.gvi"(Array=w32, error in (no error)=w34) -> (Element Type=w35, error out=w36)
          call "Format Numeric Array.gvi"(format string="%d", Array=w33) -> (Formatted on a line=w37)
          case (w35) {
            frame Default {
              call "Array to Array of VData.gvi"(MultiD Array=w32, error in (no error)=w36) -> (1D Array of Variants=w38, error out=w39)
              Concatenate Strings(w8, ".<size(s)>") -> w40
              call "Write Key (String).gvi"(reference in=$refnum, key=w40, value=w37, error in=w39, section=w6) -> (error out=w41)
              Open VI Reference(error in (no error)=w41, type specifier VI Refnum (for type only)=$"Ref for recursive call") -> (error out=w42, vi reference=w43)
              s3 = w43  # shift register
              s4 = w42  # shift register
              for (iteration -> i1) {
                w44 = each element of w38
                Format Into String(formatString=" %d", initString=w8, i1) -> w45
                CallByReference(Ref for recursive call Input 0=s3, format string Input 2=$"float number format", section Input 4=w6, error in (no error) Input 5=s4, key-value Input 6=w44, key (optional) Input 7=w45, refnum Input 8=$refnum) -> (Ref for recursive call Output 0=w46, Error IO Output 1=w47, error out Output 2=w48)  # CallByReference (Placeholder)
                Merge Errors(w47, w48) -> (error out=w49)
                next s3 = w46
                next s4 = w49
              }
              # Expand array to its
              # elements and create
              # keys recursively.
              Close Reference(reference=s3)
              Property Node[IsPlaceholderNodeForConversion=True]()
              w1 = s4
            }
            frame "I8".."I32", "U8".."U32" {
              w50 = f64[] []  # DBL Array
              Variant To Data(error in (no error)=w36, type=w50, variant=w32) -> (data=w51, error out=w52)
              Format Into String(formatString="<size(s)=%s> ", w37) -> w53
              call "Format Numeric Array.gvi"(format string="%d", Array=w51) -> (Formatted on a line=w54)
              Concatenate Strings(w53, w54) -> w55
              call "Write Key (String).gvi"(reference in=$refnum, key=w8, value=w55, error in=w52, section=w6) -> (error out=w1)
            }
            frame "SGL".."EXT", "SGL PQ".."EXT PQ" {
              case (w35) {
                frame Default {
                  w56 = w36
                  w57 = w32
                }
                frame "SGL PQ".."EXT PQ" {
                  call "Strip Units.gvi"(Number or 1D array with units=w32, error in (no error)=w36) -> (Pure Number(s) (base units)=w57, error out=w56)
                }
              }
              w58 = f64[] []  # DBL Array
              Variant To Data(error in (no error)=w56, type=w58, variant=w57) -> (data=w59, error out=w60)
              Format Into String(formatString="<size(s)=%s> ", w37) -> w61
              call "Format Numeric Array.gvi"(format string=$"float number format", Array=w59) -> (Formatted on a line=w62)
              Concatenate Strings(w61, w62) -> w63
              call "Write Key (String).gvi"(reference in=$refnum, key=w8, value=w63, error in=w60, section=w6) -> (error out=w1)
            }
          }
        }
        frame Default {
          Variant To Flattened Byte Array(variant=w4) -> (data string=w64)
          call "Write Key (U32).gvi"(reference in=$refnum, key=w8, value=w64, error in=w3, section=w6) -> (error out=w1)
        }
      }
    }
    frame Error {
      w1 = $"error in (no error)"
    }
  }
  $"error out" <- w1
