vi "Write Panel to INI.gvi"   [LabVIEW Platform Developer Preview 0.1.0]
# Writes the values of the controls on the Front Panel of VI ref to a standard LabVIEW configuration (INI) file as key-value pairs.s
# Use this VI in conjunction with the Read Panel from INI from the OpenG Variant Config palette.
inputs:
  "refnum": "Config Data RefNum.gtype", required  # refnum is the reference number of the configuration data
  "VI ref": VIRefnum, required
  "error in (no error)": error
  "float number format (optional)": string  # section is the name of the section in which to write the specified key.
outputs:
  "refnum out": "Config Data RefNum.gtype"  # refnum is the reference number of the configuration data
  "error out": error
types:
  "Config Data RefNum.gtype" = i32
uses:
  OpenG.Variant Configuration::Write Key (Variant).gvi
diagram:
  $"refnum out" <- $refnum
  case ($"error in (no error)") {
    frame No Error {
      w2 = TRUE  # controls
      Invoke Node: Ctrl Val.Get All(VI ref Input 0=$"VI ref", error in (no error) Input 1=$"error in (no error)", Controls Input 2=w2) -> (VI ref Output 0=w3, error out Output 1=w4, Get All Control Values Variant Output 2=w5)  # Invoke Node: Ctrl Val.Get All (Placeholder)
      w6 = FALSE  # indicators
      Invoke Node: Ctrl Val.Get All(VI ref Input 0=w3, error in (no error) Input 1=w4, Controls Input 2=w6) -> (VI ref Output 0=w7, error out Output 1=w8, Get All Control Values Variant Output 2=w9)  # Invoke Node: Ctrl Val.Get All (Placeholder)
      Build Array[ConcatenateInputs=True](w9, w5) -> w10
      Property Node[IsPlaceholderNodeForConversion=True](instance in=w7, error in=w8) -> ("Name"=w11)
      s1 = w8  # shift register
      for {
        w12 = each element of w10
        Property Node(instance in=w12) -> ("Name"=w13, "Variant Data"=w14)
        call "Write Key (Variant).gvi"(refnum=$refnum, key (optional)=w13, key-value=w14, error in (no error)=s1, section=w11, float number format=$"float number format (optional)") -> (error out=w15)
        next s1 = w15
      }
      w1 = s1
    }
    frame Error {
      w1 = $"error in (no error)"
    }
  }
  $"error out" <- w1
