vi "Write Section Cluster.gvi"   [LabVIEW Platform Developer Preview 0.1.0]
# Writes key-value pairs to a section of the configuration data identified by refnum, which correspond to the named items and thier values within the "Section Formatted Cluster" input.  If "key" input is not specified, the name of the cluster within the "Section Formatted Cluster" input is used as the key.
# For example an section cluster named "MyCluster1" contains two elements named "MyNumeric" and "MyBoolean".  This would correspond to an INI write of the following data:
# [MyCluster1]
# MyNumeric=1.024
# MyBoolean=TRUE
# Note: Special characters in section and key names will be escape-coded.  These include the following: \00-\1F (non-printable chars); "[", "]", and "=" (INI syntax elements); \FE ("þ") and \FF ("ÿ") (legacy bracket encoding); Additionally, the escape character, "\", will be escaped as "\\".
inputs:
  "refnum": "Config Data RefNum.gtype", required
  "Section Formatted Cluster": variant, required
  "error in (no error)": error
  "section (optional)": string  # section is the name of the section in which to write the specified key.
  "float number format (optional)": string  # section is the name of the section in which to write the specified key.
outputs:
  "dup refnum": "Config Data RefNum.gtype"
  "error out": error
types:
  "Config Data RefNum.gtype" = i32
uses:
  openg.library.variant data::Cluster to Array of VData.gvi
  openg.library.variant data::Get Data Name.gvi
  OpenG.Variant Configuration::Write Key (Variant).gvi
diagram:
  case ($"error in (no error)") {
    frame No Error {
      call "Cluster to Array of VData.gvi"(Cluster=$"Section Formatted Cluster", error in (no error)=$"error in (no error)") -> (Array of VData=w3, error out=w4)
      call "Get Data Name.gvi"(Data=$"Section Formatted Cluster", error in (no error)=w4) -> (Data Name=w5, error out=w6)
      Is Empty String Or Path(string/path=$"section (optional)") -> w7
      Not(x=w7) -> w8
      Select(s=w8, t=$"section (optional)", f=w5) -> w9
      s1 = $refnum  # shift register
      s2 = w6  # shift register
      for {
        w10 = each element of w3
        call "Write Key (Variant).gvi"(refnum=s1, key-value=w10, error in (no error)=s2, section=w9, float number format=$"float number format (optional)") -> (refnum out=w11, error out=w12)
        next s1 = w11
        next s2 = w12
      }
      w1 = s2
      w2 = s1
    }
    frame Error {
      w1 = $"error in (no error)"
      w2 = $refnum
    }
  }
  $"dup refnum" <- w2
  $"error out" <- w1
